% Simulink data dictionary mav_dtype.sldd

MAV_AUTOPILOT = enum(AddClassNameToEnumNames=true)  % Micro air vehicle / autopilot classes. This identifies the individual model.
  GENERIC = 0  % Generic autopilot, full support for everything
  RESERVED = 1  % Reserved for future use.
  SLUGS = 2  % SLUGS autopilot, http://slugsuav.soe.ucsc.edu
  ARDUPILOTMEGA = 3  % ArduPilotMega / ArduCopter, http://diydrones.com
  OPENPILOT = 4  % OpenPilot, http://openpilot.org
  GENERIC_WAYPOINTS_ONLY = 5  % Generic autopilot only supporting simple waypoints
  GENERIC_WAYPOINTS_AND_SIMPLE_NAVIGATION_ONLY = 6  % Generic autopilot supporting waypoints and other simple navigation commands
  GENERIC_MISSION_FULL = 7  % Generic autopilot supporting the full mission command set
  INVALID = 8  % No valid autopilot, e.g. a GCS or other MAVLink component
  PPZ = 9  % PPZ UAV - http://nongnu.org/paparazzi
  UDB = 10  % UAV Dev Board
  FP = 11  % FlexiPilot
  PX4 = 12  % PX4 Autopilot - http://pixhawk.ethz.ch/px4/
  SMACCMPILOT = 13  % SMACCMPilot - http://smaccmpilot.org
  AUTOQUAD = 14  % AutoQuad -- http://autoquad.org
  ARMAZILA = 15  % Armazila -- http://armazila.com
  AEROB = 16  % Aerob -- http://aerob.ru
  ASLUAV = 17  % ASLUAV autopilot -- http://www.asl.ethz.ch
  SMARTAP = 18  % SmartAP Autopilot - http://sky-drones.com
  AIRRAILS = 19  % AirRails - http://uaventure.com

MAV_FIRMWARE_VERSION_TYPE = enum(AddClassNameToEnumNames=true)  % These values define the type of firmware release.  These values indicate the first version or release of this type.  For example the first alpha release would be 64, the second would be 65.
  DEV = 0  % development release
  ALPHA = 64  % alpha release
  BETA = 128  % beta release
  RC = 192  % release candidate
  OFFICIAL = 255  % official stable release

MAV_HL_FAILURE_FLAG = enum(AddClassNameToEnumNames=true)  % Flags to report failure cases over the high latency telemtry.
  GPS = 1  % GPS failure.
  DIFFERENTIAL_PRESSURE = 2  % Differential pressure sensor failure.
  ABSOLUTE_PRESSURE = 4  % Absolute pressure sensor failure.
  A3D_ACCEL = 8  % Accelerometer sensor failure.
  A3D_GYRO = 16  % Gyroscope sensor failure.
  A3D_MAG = 32  % Magnetometer sensor failure.
  TERRAIN = 64  % Terrain subsystem failure.
  BATTERY = 128  % Battery failure/critical low battery.
  RC_RECEIVER = 256  % RC receiver failure/no rc connection.
  OFFBOARD_LINK = 512  % Offboard link failure.
  ENGINE = 1024  % Engine failure.
  GEOFENCE = 2048  % Geofence violation.
  ESTIMATOR = 4096  % Estimator failure, for example measurement rejection or large variances.
  MISSION = 8192  % Mission failure.

MAV_MODE_FLAG = enum(AddClassNameToEnumNames=true)  % These flags encode the MAV mode.
  SAFETY_ARMED = 128  % 0b10000000 MAV safety set to armed. Motors are enabled / running / can start. Ready to fly. Additional note: this flag is to be ignore when sent in the command MAV_CMD_DO_SET_MODE and MAV_CMD_COMPONENT_ARM_DISARM shall be used instead. The flag can still be used to report the armed state.
  MANUAL_INPUT_ENABLED = 64  % 0b01000000 remote control input is enabled.
  HIL_ENABLED = 32  % 0b00100000 hardware in the loop simulation. All motors / actuators are blocked, but internal software is full operational.
  STABILIZE_ENABLED = 16  % 0b00010000 system stabilizes electronically its attitude (and optionally position). It needs however further control inputs to move around.
  GUIDED_ENABLED = 8  % 0b00001000 guided mode enabled, system flies waypoints / mission items.
  AUTO_ENABLED = 4  % 0b00000100 autonomous mode enabled, system finds its own goal positions. Guided flag can be set or not, depends on the actual implementation.
  TEST_ENABLED = 2  % 0b00000010 system has a test mode enabled. This flag is intended for temporary system tests and should not be used for stable implementations.
  CUSTOM_MODE_ENABLED = 1  % 0b00000001 Reserved for future use.

MAV_MODE_FLAG_DECODE_POSITION = enum(AddClassNameToEnumNames=true)  % These values encode the bit positions of the decode position. These values can be used to read the value of a flag bit by combining the base_mode variable with AND with the flag position value. The result will be either 0 or 1, depending on if the flag is set or not.
  SAFETY = 128  % First bit:  10000000
  MANUAL = 64  % Second bit: 01000000
  HIL = 32  % Third bit:  00100000
  STABILIZE = 16  % Fourth bit: 00010000
  GUIDED = 8  % Fifth bit:  00001000
  AUTO = 4  % Sixt bit:   00000100
  TEST = 2  % Seventh bit: 00000010
  CUSTOM_MODE = 1  % Eighth bit: 00000001

MAV_GOTO = enum(AddClassNameToEnumNames=true)  % Override command, pauses current mission execution and moves immediately to a position
  DO_HOLD = 0  % Hold at the current position.
  DO_CONTINUE = 1  % Continue with the next item in mission execution.
  HOLD_AT_CURRENT_POSITION = 2  % Hold at the current position of the system
  HOLD_AT_SPECIFIED_POSITION = 3  % Hold at the position specified in the parameters of the DO_HOLD action

MAV_MODE = enum(AddClassNameToEnumNames=true)  % These defines are predefined OR-combined mode flags. There is no need to use values from this enum, but it
  % simplifies the use of the mode flags. Note that manual input is enabled in all modes as a safety override.
  PREFLIGHT = 0  % System is not ready to fly, booting, calibrating, etc. No flag is set.
  STABILIZE_DISARMED = 80  % System is allowed to be active, under assisted RC control.
  STABILIZE_ARMED = 208  % System is allowed to be active, under assisted RC control.
  MANUAL_DISARMED = 64  % System is allowed to be active, under manual (RC) control, no stabilization
  MANUAL_ARMED = 192  % System is allowed to be active, under manual (RC) control, no stabilization
  GUIDED_DISARMED = 88  % System is allowed to be active, under autonomous control, manual setpoint
  GUIDED_ARMED = 216  % System is allowed to be active, under autonomous control, manual setpoint
  AUTO_DISARMED = 92  % System is allowed to be active, under autonomous control and navigation (the trajectory is decided onboard and not pre-programmed by waypoints)
  AUTO_ARMED = 220  % System is allowed to be active, under autonomous control and navigation (the trajectory is decided onboard and not pre-programmed by waypoints)
  TEST_DISARMED = 66  % UNDEFINED mode. This solely depends on the autopilot - use with caution, intended for developers only.
  TEST_ARMED = 194  % UNDEFINED mode. This solely depends on the autopilot - use with caution, intended for developers only.

MAV_STATE = enum(AddClassNameToEnumNames=true)
  UNINIT = 0  % Uninitialized system, state is unknown.
  BOOT = 1  % System is booting up.
  CALIBRATING = 2  % System is calibrating and not flight-ready.
  STANDBY = 3  % System is grounded and on standby. It can be launched any time.
  ACTIVE = 4  % System is active and might be already airborne. Motors are engaged.
  CRITICAL = 5  % System is in a non-normal flight mode. It can however still navigate.
  EMERGENCY = 6  % System is in a non-normal flight mode. It lost control over parts or over the whole airframe. It is in mayday and going down.
  POWEROFF = 7  % System just initialized its power-down sequence, will shut down now.
  FLIGHT_TERMINATION = 8  % System is terminating itself.

MAV_COMPONENT = enum(AddClassNameToEnumNames=true)
  MAV_COMP_ID_ALL = 0
  MAV_COMP_ID_AUTOPILOT1 = 1
  MAV_COMP_ID_CAMERA = 100
  MAV_COMP_ID_CAMERA2 = 101
  MAV_COMP_ID_CAMERA3 = 102
  MAV_COMP_ID_CAMERA4 = 103
  MAV_COMP_ID_CAMERA5 = 104
  MAV_COMP_ID_CAMERA6 = 105
  MAV_COMP_ID_SERVO1 = 140
  MAV_COMP_ID_SERVO2 = 141
  MAV_COMP_ID_SERVO3 = 142
  MAV_COMP_ID_SERVO4 = 143
  MAV_COMP_ID_SERVO5 = 144
  MAV_COMP_ID_SERVO6 = 145
  MAV_COMP_ID_SERVO7 = 146
  MAV_COMP_ID_SERVO8 = 147
  MAV_COMP_ID_SERVO9 = 148
  MAV_COMP_ID_SERVO10 = 149
  MAV_COMP_ID_SERVO11 = 150
  MAV_COMP_ID_SERVO12 = 151
  MAV_COMP_ID_SERVO13 = 152
  MAV_COMP_ID_SERVO14 = 153
  MAV_COMP_ID_GIMBAL = 154
  MAV_COMP_ID_LOG = 155
  MAV_COMP_ID_ADSB = 156
  MAV_COMP_ID_OSD = 157  % On Screen Display (OSD) devices for video links
  MAV_COMP_ID_PERIPHERAL = 158  % Generic autopilot peripheral component ID. Meant for devices that do not implement the parameter sub-protocol
  MAV_COMP_ID_QX1_GIMBAL = 159
  MAV_COMP_ID_FLARM = 160
  MAV_COMP_ID_MAPPER = 180
  MAV_COMP_ID_MISSIONPLANNER = 190
  MAV_COMP_ID_PATHPLANNER = 195
  MAV_COMP_ID_IMU = 200
  MAV_COMP_ID_IMU_2 = 201
  MAV_COMP_ID_IMU_3 = 202
  MAV_COMP_ID_GPS = 220
  MAV_COMP_ID_GPS2 = 221
  MAV_COMP_ID_UDP_BRIDGE = 240
  MAV_COMP_ID_UART_BRIDGE = 241
  MAV_COMP_ID_SYSTEM_CONTROL = 250

MAV_SYS_STATUS_SENSOR = enum(AddClassNameToEnumNames=true)  % These encode the sensors whose status is sent as part of the SYS_STATUS message.
  A3D_GYRO = 1  % 0x01 3D gyro
  A3D_ACCEL = 2  % 0x02 3D accelerometer
  A3D_MAG = 4  % 0x04 3D magnetometer
  ABSOLUTE_PRESSURE = 8  % 0x08 absolute pressure
  DIFFERENTIAL_PRESSURE = 16  % 0x10 differential pressure
  GPS = 32  % 0x20 GPS
  OPTICAL_FLOW = 64  % 0x40 optical flow
  VISION_POSITION = 128  % 0x80 computer vision position
  LASER_POSITION = 256  % 0x100 laser based position
  EXTERNAL_GROUND_TRUTH = 512  % 0x200 external ground truth (Vicon or Leica)
  ANGULAR_RATE_CONTROL = 1024  % 0x400 3D angular rate control
  ATTITUDE_STABILIZATION = 2048  % 0x800 attitude stabilization
  YAW_POSITION = 4096  % 0x1000 yaw position
  Z_ALTITUDE_CONTROL = 8192  % 0x2000 z/altitude control
  XY_POSITION_CONTROL = 16384  % 0x4000 x/y position control
  MOTOR_OUTPUTS = 32768  % 0x8000 motor outputs / control
  RC_RECEIVER = 65536  % 0x10000 rc receiver
  A3D_GYRO2 = 131072  % 0x20000 2nd 3D gyro
  A3D_ACCEL2 = 262144  % 0x40000 2nd 3D accelerometer
  A3D_MAG2 = 524288  % 0x80000 2nd 3D magnetometer
  MAV_SYS_STATUS_GEOFENCE = 1048576  % 0x100000 geofence
  MAV_SYS_STATUS_AHRS = 2097152  % 0x200000 AHRS subsystem health
  MAV_SYS_STATUS_TERRAIN = 4194304  % 0x400000 Terrain subsystem health
  MAV_SYS_STATUS_REVERSE_MOTOR = 8388608  % 0x800000 Motors are reversed
  MAV_SYS_STATUS_LOGGING = 16777216  % 0x1000000 Logging
  BATTERY = 33554432  % 0x2000000 Battery
  PROXIMITY = 67108864  % 0x4000000 Proximity

MAV_MAVLINK_DATA_STREAM_TYPE = enum(AddClassNameToEnumNames=true)
  MAVLINK_DATA_STREAM_IMG_JPEG = 0
  MAVLINK_DATA_STREAM_IMG_BMP = 1
  MAVLINK_DATA_STREAM_IMG_RAW8U = 2
  MAVLINK_DATA_STREAM_IMG_RAW32U = 3
  MAVLINK_DATA_STREAM_IMG_PGM = 4
  MAVLINK_DATA_STREAM_IMG_PNG = 5

MAV_FENCE_ACTION = enum(AddClassNameToEnumNames=true)
  NONE = 0  % Disable fenced mode
  GUIDED = 1  % Switched to guided mode to return point (fence point 0)
  REPORT = 2  % Report fence breach, but don't take action
  GUIDED_THR_PASS = 3  % Switched to guided mode to return point (fence point 0) with manual throttle control
  RTL = 4  % Switch to RTL (return to launch) mode and head for the return point.

MAV_FENCE_BREACH = enum(AddClassNameToEnumNames=true)
  NONE = 0  % No last fence breach
  MINALT = 1  % Breached minimum altitude
  MAXALT = 2  % Breached maximum altitude
  BOUNDARY = 3  % Breached fence boundary

MAV_MOUNT_MODE = enum(AddClassNameToEnumNames=true)  % Enumeration of possible mount operation modes
  RETRACT = 0  % Load and keep safe position (Roll,Pitch,Yaw) from permant memory and stop stabilization
  NEUTRAL = 1  % Load and keep neutral position (Roll,Pitch,Yaw) from permanent memory.
  MAVLINK_TARGETING = 2  % Load neutral position and start MAVLink Roll,Pitch,Yaw control with stabilization
  RC_TARGETING = 3  % Load neutral position and start RC Roll,Pitch,Yaw control with stabilization
  GPS_POINT = 4  % Load neutral position and start to point to Lat,Lon,Alt

MAV_UAVCAN_NODE_HEALTH = enum(AddClassNameToEnumNames=true)  % Generalized UAVCAN node health
  OK = 0  % The node is functioning properly.
  WARNING = 1  % A critical parameter went out of range or the node has encountered a minor failure.
  ERROR = 2  % The node has encountered a major failure.
  CRITICAL = 3  % The node has suffered a fatal malfunction.

MAV_UAVCAN_NODE_MODE = enum(AddClassNameToEnumNames=true)  % Generalized UAVCAN node mode
  OPERATIONAL = 0  % The node is performing its primary functions.
  INITIALIZATION = 1  % The node is initializing; this mode is entered immediately after startup.
  MAINTENANCE = 2  % The node is under maintenance.
  SOFTWARE_UPDATE = 3  % The node is in the process of updating its software.
  OFFLINE = 7  % The node is no longer available online.

MAV_CMD = enum(AddClassNameToEnumNames=true)  % Commands to be executed by the MAV. They can be executed on user request, or as part of a mission script. If the action is used in a mission, the parameter mapping to the waypoint/mission message is as follows: Param 1, Param 2, Param 3, Param 4, X: Param 5, Y:Param 6, Z:Param 7. This command list is similar what ARINC 424 is for commercial aircraft: A data format how to interpret waypoint/mission data.
  NAV_WAYPOINT = 16  % Navigate to waypoint.
    % Hold time in decimal seconds. (ignored by fixed wing, time to stay at waypoint for rotary wing)
    % Acceptance radius in meters (if the sphere with this radius is hit, the waypoint counts as reached)
    % 0 to pass through the WP, if > 0 radius in meters to pass by WP. Positive value for clockwise orbit, negative value for counter-clockwise orbit. Allows trajectory control.
    % Desired yaw angle at waypoint (rotary wing). NaN for unchanged.
    % Latitude
    % Longitude
    % Altitude
  NAV_LOITER_UNLIM = 17  % Loiter around this waypoint an unlimited amount of time
    % Empty
    % Empty
    % Radius around waypoint, in meters. If positive loiter clockwise, else counter-clockwise
    % Desired yaw angle.
    % Latitude
    % Longitude
    % Altitude
  NAV_LOITER_TURNS = 18  % Loiter around this waypoint for X turns
    % Turns
    % Empty
    % Radius around waypoint, in meters. If positive loiter clockwise, else counter-clockwise
    % Forward moving aircraft this sets exit xtrack location: 0 for center of loiter wp, 1 for exit location. Else, this is desired yaw angle
    % Latitude
    % Longitude
    % Altitude
  NAV_LOITER_TIME = 19  % Loiter around this waypoint for X seconds
    % Seconds (decimal)
    % Empty
    % Radius around waypoint, in meters. If positive loiter clockwise, else counter-clockwise
    % Forward moving aircraft this sets exit xtrack location: 0 for center of loiter wp, 1 for exit location. Else, this is desired yaw angle
    % Latitude
    % Longitude
    % Altitude
  NAV_RETURN_TO_LAUNCH = 20  % Return to launch location
    % Empty
    % Empty
    % Empty
    % Empty
    % Empty
    % Empty
    % Empty
  NAV_LAND = 21  % Land at location
    % Abort Alt
    % Precision land mode. (0 = normal landing, 1 = opportunistic precision landing, 2 = required precsion landing)
    % Empty
    % Desired yaw angle. NaN for unchanged.
    % Latitude
    % Longitude
    % Altitude (ground level)
  NAV_TAKEOFF = 22  % Takeoff from ground / hand
    % Minimum pitch (if airspeed sensor present), desired pitch without sensor
    % Empty
    % Empty
    % Yaw angle (if magnetometer present), ignored without magnetometer. NaN for unchanged.
    % Latitude
    % Longitude
    % Altitude
  NAV_LAND_LOCAL = 23  % Land at local position (local frame only)
    % Landing target number (if available)
    % Maximum accepted offset from desired landing position [m] - computed magnitude from spherical coordinates: d = sqrt(x^2 + y^2 + z^2), which gives the maximum accepted distance between the desired landing position and the position where the vehicle is about to land
    % Landing descend rate [ms^-1]
    % Desired yaw angle [rad]
    % Y-axis position [m]
    % X-axis position [m]
    % Z-axis / ground level position [m]
  NAV_TAKEOFF_LOCAL = 24  % Takeoff from local position (local frame only)
    % Minimum pitch (if airspeed sensor present), desired pitch without sensor [rad]
    % Empty
    % Takeoff ascend rate [ms^-1]
    % Yaw angle [rad] (if magnetometer or another yaw estimation source present), ignored without one of these
    % Y-axis position [m]
    % X-axis position [m]
    % Z-axis position [m]
  NAV_FOLLOW = 25  % Vehicle following, i.e. this waypoint represents the position of a moving vehicle
    % Following logic to use (e.g. loitering or sinusoidal following) - depends on specific autopilot implementation
    % Ground speed of vehicle to be followed
    % Radius around waypoint, in meters. If positive loiter clockwise, else counter-clockwise
    % Desired yaw angle.
    % Latitude
    % Longitude
    % Altitude
  NAV_CONTINUE_AND_CHANGE_ALT = 30  % Continue on the current course and climb/descend to specified altitude.  When the altitude is reached continue to the next command (i.e., don't proceed to the next command until the desired altitude is reached.
    % Climb or Descend (0 = Neutral, command completes when within 5m of this command's altitude, 1 = Climbing, command completes when at or above this command's altitude, 2 = Descending, command completes when at or below this command's altitude.
    % Empty
    % Empty
    % Empty
    % Empty
    % Empty
    % Desired altitude in meters
  NAV_LOITER_TO_ALT = 31  % Begin loiter at the specified Latitude and Longitude.  If Lat=Lon=0, then loiter at the current position.  Don't consider the navigation command complete (don't leave loiter) until the altitude has been reached.  Additionally, if the Heading Required parameter is non-zero the  aircraft will not leave the loiter until heading toward the next waypoint.
    % Heading Required (0 = False)
    % Radius in meters. If positive loiter clockwise, negative counter-clockwise, 0 means no change to standard loiter.
    % Empty
    % Forward moving aircraft this sets exit xtrack location: 0 for center of loiter wp, 1 for exit location
    % Latitude
    % Longitude
    % Altitude
  DO_FOLLOW = 32  % Being following a target
    % System ID (the system ID of the FOLLOW_TARGET beacon). Send 0 to disable follow-me and return to the default position hold mode
    % RESERVED
    % RESERVED
    % altitude flag: 0: Keep current altitude, 1: keep altitude difference to target, 2: go to a fixed altitude above home
    % altitude
    % RESERVED
    % TTL in seconds in which the MAV should go to the default position hold mode after a message rx timeout
  DO_FOLLOW_REPOSITION = 33  % Reposition the MAV after a follow target command has been sent
    % Camera q1 (where 0 is on the ray from the camera to the tracking device)
    % Camera q2
    % Camera q3
    % Camera q4
    % altitude offset from target (m)
    % X offset from target (m)
    % Y offset from target (m)
  NAV_ROI = 80  % THIS INTERFACE IS DEPRECATED AS OF JANUARY 2018. Please use MAV_CMD_DO_SET_ROI_* messages instead. Sets the region of interest (ROI) for a sensor set or the vehicle itself. This can then be used by the vehicles control system to control the vehicle attitude and the attitude of various sensors such as cameras.
    % Region of intereset mode. (see MAV_ROI enum)
    % Waypoint index/ target ID. (see MAV_ROI enum)
    % ROI index (allows a vehicle to manage multiple ROI's)
    % Empty
    % x the location of the fixed ROI (see MAV_FRAME)
    % y
    % z
  NAV_PATHPLANNING = 81  % Control autonomous path planning on the MAV.
    % 0: Disable local obstacle avoidance / local path planning (without resetting map), 1: Enable local path planning, 2: Enable and reset local path planning
    % 0: Disable full path planning (without resetting map), 1: Enable, 2: Enable and reset map/occupancy grid, 3: Enable and reset planned route, but not occupancy grid
    % Empty
    % Yaw angle at goal, in compass degrees, [0..360]
    % Latitude/X of goal
    % Longitude/Y of goal
    % Altitude/Z of goal
  NAV_SPLINE_WAYPOINT = 82  % Navigate to waypoint using a spline path.
    % Hold time in decimal seconds. (ignored by fixed wing, time to stay at waypoint for rotary wing)
    % Empty
    % Empty
    % Empty
    % Latitude/X of goal
    % Longitude/Y of goal
    % Altitude/Z of goal
  NAV_VTOL_TAKEOFF = 84  % Takeoff from ground using VTOL mode
    % Empty
    % Front transition heading, see VTOL_TRANSITION_HEADING enum.
    % Empty
    % Yaw angle in degrees. NaN for unchanged.
    % Latitude
    % Longitude
    % Altitude
  NAV_VTOL_LAND = 85  % Land using VTOL mode
    % Empty
    % Empty
    % Approach altitude (with the same reference as the Altitude field). NaN if unspecified.
    % Yaw angle in degrees. NaN for unchanged.
    % Latitude
    % Longitude
    % Altitude (ground level)
  NAV_GUIDED_ENABLE = 92  % hand control over to an external controller
    % On / Off (> 0.5f on)
    % Empty
    % Empty
    % Empty
    % Empty
    % Empty
    % Empty
  NAV_DELAY = 93  % Delay the next navigation command a number of seconds or until a specified time
    % Delay in seconds (decimal, -1 to enable time-of-day fields)
    % hour (24h format, UTC, -1 to ignore)
    % minute (24h format, UTC, -1 to ignore)
    % second (24h format, UTC)
    % Empty
    % Empty
    % Empty
  NAV_PAYLOAD_PLACE = 94  % Descend and place payload.  Vehicle descends until it detects a hanging payload has reached the ground, the gripper is opened to release the payload
    % Maximum distance to descend (meters)
    % Empty
    % Empty
    % Empty
    % Latitude (deg * 1E7)
    % Longitude (deg * 1E7)
    % Altitude (meters)
  NAV_LAST = 95  % NOP - This command is only used to mark the upper limit of the NAV/ACTION commands in the enumeration
    % Empty
    % Empty
    % Empty
    % Empty
    % Empty
    % Empty
    % Empty
  CONDITION_DELAY = 112  % Delay mission state machine.
    % Delay in seconds (decimal)
    % Empty
    % Empty
    % Empty
    % Empty
    % Empty
    % Empty
  CONDITION_CHANGE_ALT = 113  % Ascend/descend at rate.  Delay mission state machine until desired altitude reached.
    % Descent / Ascend rate (m/s)
    % Empty
    % Empty
    % Empty
    % Empty
    % Empty
    % Finish Altitude
  CONDITION_DISTANCE = 114  % Delay mission state machine until within desired distance of next NAV point.
    % Distance (meters)
    % Empty
    % Empty
    % Empty
    % Empty
    % Empty
    % Empty
  CONDITION_YAW = 115  % Reach a certain target angle.
    % target angle: [0-360], 0 is north
    % speed during yaw change:[deg per second]
    % direction: negative: counter clockwise, positive: clockwise [-1,1]
    % relative offset or absolute angle: [ 1,0]
    % Empty
    % Empty
    % Empty
  CONDITION_LAST = 159  % NOP - This command is only used to mark the upper limit of the CONDITION commands in the enumeration
    % Empty
    % Empty
    % Empty
    % Empty
    % Empty
    % Empty
    % Empty
  DO_SET_MODE = 176  % Set system mode.
    % Mode, as defined by ENUM MAV_MODE
    % Custom mode - this is system specific, please refer to the individual autopilot specifications for details.
    % Custom sub mode - this is system specific, please refer to the individual autopilot specifications for details.
    % Empty
    % Empty
    % Empty
    % Empty
  DO_JUMP = 177  % Jump to the desired command in the mission list.  Repeat this action only the specified number of times
    % Sequence number
    % Repeat count
    % Empty
    % Empty
    % Empty
    % Empty
    % Empty
  DO_CHANGE_SPEED = 178  % Change speed and/or throttle set points.
    % Speed type (0=Airspeed, 1=Ground Speed)
    % Speed  (m/s, -1 indicates no change)
    % Throttle  ( Percent, -1 indicates no change)
    % absolute or relative [0,1]
    % Empty
    % Empty
    % Empty
  DO_SET_HOME = 179  % Changes the home location either to the current location or a specified location.
    % Use current (1=use current location, 0=use specified location)
    % Empty
    % Empty
    % Empty
    % Latitude
    % Longitude
    % Altitude
  DO_SET_PARAMETER = 180  % Set a system parameter.  Caution!  Use of this command requires knowledge of the numeric enumeration value of the parameter.
    % Parameter number
    % Parameter value
    % Empty
    % Empty
    % Empty
    % Empty
    % Empty
  DO_SET_RELAY = 181  % Set a relay to a condition.
    % Relay number
    % Setting (1=on, 0=off, others possible depending on system hardware)
    % Empty
    % Empty
    % Empty
    % Empty
    % Empty
  DO_REPEAT_RELAY = 182  % Cycle a relay on and off for a desired number of cyles with a desired period.
    % Relay number
    % Cycle count
    % Cycle time (seconds, decimal)
    % Empty
    % Empty
    % Empty
    % Empty
  DO_SET_SERVO = 183  % Set a servo to a desired PWM value.
    % Servo number
    % PWM (microseconds, 1000 to 2000 typical)
    % Empty
    % Empty
    % Empty
    % Empty
    % Empty
  DO_REPEAT_SERVO = 184  % Cycle a between its nominal setting and a desired PWM for a desired number of cycles with a desired period.
    % Servo number
    % PWM (microseconds, 1000 to 2000 typical)
    % Cycle count
    % Cycle time (seconds)
    % Empty
    % Empty
    % Empty
  DO_FLIGHTTERMINATION = 185  % Terminate flight immediately
    % Flight termination activated if > 0.5
    % Empty
    % Empty
    % Empty
    % Empty
    % Empty
    % Empty
  DO_CHANGE_ALTITUDE = 186  % Change altitude set point.
    % Altitude in meters
    % Mav frame of new altitude (see MAV_FRAME)
    % Empty
    % Empty
    % Empty
    % Empty
    % Empty
  DO_LAND_START = 189  % Mission command to perform a landing. This is used as a marker in a mission to tell the autopilot where a sequence of mission items that represents a landing starts. It may also be sent via a COMMAND_LONG to trigger a landing, in which case the nearest (geographically) landing sequence in the mission will be used. The Latitude/Longitude is optional, and may be set to 0 if not needed. If specified then it will be used to help find the closest landing sequence.
    % Empty
    % Empty
    % Empty
    % Empty
    % Latitude
    % Longitude
    % Empty
  DO_RALLY_LAND = 190  % Mission command to perform a landing from a rally point.
    % Break altitude (meters)
    % Landing speed (m/s)
    % Empty
    % Empty
    % Empty
    % Empty
    % Empty
  DO_GO_AROUND = 191  % Mission command to safely abort an autonmous landing.
    % Altitude (meters)
    % Empty
    % Empty
    % Empty
    % Empty
    % Empty
    % Empty
  DO_REPOSITION = 192  % Reposition the vehicle to a specific WGS84 global position.
    % Ground speed, less than 0 (-1) for default
    % Bitmask of option flags, see the MAV_DO_REPOSITION_FLAGS enum.
    % Reserved
    % Yaw heading, NaN for unchanged. For planes indicates loiter direction (0: clockwise, 1: counter clockwise)
    % Latitude (deg * 1E7)
    % Longitude (deg * 1E7)
    % Altitude (meters)
  DO_PAUSE_CONTINUE = 193  % If in a GPS controlled position mode, hold the current position or continue.
    % 0: Pause current mission or reposition command, hold current position. 1: Continue mission. A VTOL capable vehicle should enter hover mode (multicopter and VTOL planes). A plane should loiter with the default loiter radius.
    % Reserved
    % Reserved
    % Reserved
    % Reserved
    % Reserved
    % Reserved
  DO_SET_REVERSE = 194  % Set moving direction to forward or reverse.
    % Direction (0=Forward, 1=Reverse)
    % Empty
    % Empty
    % Empty
    % Empty
    % Empty
    % Empty
  DO_SET_ROI_LOCATION = 195  % Sets the region of interest (ROI) to a location. This can then be used by the vehicles control system to control the vehicle attitude and the attitude of various sensors such as cameras.
    % Empty
    % Empty
    % Empty
    % Empty
    % Latitude
    % Longitude
    % Altitude
  DO_SET_ROI_WPNEXT_OFFSET = 196  % Sets the region of interest (ROI) to be toward next waypoint, with optional pitch/roll/yaw offset. This can then be used by the vehicles control system to control the vehicle attitude and the attitude of various sensors such as cameras.
    % Empty
    % Empty
    % Empty
    % Empty
    % pitch offset from next waypoint
    % roll offset from next waypoint
    % yaw offset from next waypoint
  DO_SET_ROI_NONE = 197  % Cancels any previous ROI command returning the vehicle/sensors to default flight characteristics. This can then be used by the vehicles control system to control the vehicle attitude and the attitude of various sensors such as cameras.
    % Empty
    % Empty
    % Empty
    % Empty
    % Empty
    % Empty
    % Empty
  DO_CONTROL_VIDEO = 200  % Control onboard camera system.
    % Camera ID (-1 for all)
    % Transmission: 0: disabled, 1: enabled compressed, 2: enabled raw
    % Transmission mode: 0: video stream, >0: single images every n seconds (decimal)
    % Recording: 0: disabled, 1: enabled compressed, 2: enabled raw
    % Empty
    % Empty
    % Empty
  DO_SET_ROI = 201  % THIS INTERFACE IS DEPRECATED AS OF JANUARY 2018. Please use MAV_CMD_DO_SET_ROI_* messages instead. Sets the region of interest (ROI) for a sensor set or the vehicle itself. This can then be used by the vehicles control system to control the vehicle attitude and the attitude of various sensors such as cameras.
    % Region of intereset mode. (see MAV_ROI enum)
    % Waypoint index/ target ID. (see MAV_ROI enum)
    % ROI index (allows a vehicle to manage multiple ROI's)
    % Empty
    % MAV_ROI_WPNEXT: pitch offset from next waypoint, MAV_ROI_LOCATION: latitude
    % MAV_ROI_WPNEXT: roll offset from next waypoint, MAV_ROI_LOCATION: longitude
    % MAV_ROI_WPNEXT: yaw offset from next waypoint, MAV_ROI_LOCATION: altitude
  DO_DIGICAM_CONFIGURE = 202  % THIS INTERFACE IS DEPRECATED since 2018-01. Please use PARAM_EXT_XXX messages and the camera definition format described in https://mavlink.io/en/protocol/camera_def.html.
    % Modes: P, TV, AV, M, Etc
    % Shutter speed: Divisor number for one second
    % Aperture: F stop number
    % ISO number e.g. 80, 100, 200, Etc
    % Exposure type enumerator
    % Command Identity
    % Main engine cut-off time before camera trigger in seconds/10 (0 means no cut-off)
  DO_DIGICAM_CONTROL = 203  % THIS INTERFACE IS DEPRECATED since 2018-01. Please use PARAM_EXT_XXX messages and the camera definition format described in https://mavlink.io/en/protocol/camera_def.html.
    % Session control e.g. show/hide lens
    % Zoom's absolute position
    % Zooming step value to offset zoom from the current position
    % Focus Locking, Unlocking or Re-locking
    % Shooting Command
    % Command Identity
    % Test shot identifier. If set to 1, image will only be captured, but not counted towards internal frame count.
  DO_MOUNT_CONFIGURE = 204  % Mission command to configure a camera or antenna mount
    % Mount operation mode (see MAV_MOUNT_MODE enum)
    % stabilize roll? (1 = yes, 0 = no)
    % stabilize pitch? (1 = yes, 0 = no)
    % stabilize yaw? (1 = yes, 0 = no)
    % roll input (0 = angle, 1 = angular rate)
    % pitch input (0 = angle, 1 = angular rate)
    % yaw input (0 = angle, 1 = angular rate)
  DO_MOUNT_CONTROL = 205  % Mission command to control a camera or antenna mount
    % pitch depending on mount mode (degrees or degrees/second depending on pitch input).
    % roll depending on mount mode (degrees or degrees/second depending on roll input).
    % yaw depending on mount mode (degrees or degrees/second depending on yaw input).
    % alt in meters depending on mount mode.
    % latitude in degrees * 1E7, set if appropriate mount mode.
    % longitude in degrees * 1E7, set if appropriate mount mode.
    % MAV_MOUNT_MODE enum value
  DO_SET_CAM_TRIGG_DIST = 206  % Mission command to set camera trigger distance for this flight. The camera is trigerred each time this distance is exceeded. This command can also be used to set the shutter integration time for the camera.
    % Camera trigger distance (meters). 0 to stop triggering.
    % Camera shutter integration time (milliseconds). -1 or 0 to ignore
    % Trigger camera once immediately. (0 = no trigger, 1 = trigger)
    % Empty
    % Empty
    % Empty
    % Empty
  DO_FENCE_ENABLE = 207  % Mission command to enable the geofence
    % enable? (0=disable, 1=enable, 2=disable_floor_only)
    % Empty
    % Empty
    % Empty
    % Empty
    % Empty
    % Empty
  DO_PARACHUTE = 208  % Mission command to trigger a parachute
    % action (0=disable, 1=enable, 2=release, for some systems see PARACHUTE_ACTION enum, not in general message set.)
    % Empty
    % Empty
    % Empty
    % Empty
    % Empty
    % Empty
  DO_MOTOR_TEST = 209  % Mission command to perform motor test
    % motor number (a number from 1 to max number of motors on the vehicle)
    % throttle type (0=throttle percentage, 1=PWM, 2=pilot throttle channel pass-through. See MOTOR_TEST_THROTTLE_TYPE enum)
    % throttle
    % timeout (in seconds)
    % motor count (number of motors to test to test in sequence, waiting for the timeout above between them; 0=1 motor, 1=1 motor, 2=2 motors...)
    % motor test order (See MOTOR_TEST_ORDER enum)
    % Empty
  DO_INVERTED_FLIGHT = 210  % Change to/from inverted flight
    % inverted (0=normal, 1=inverted)
    % Empty
    % Empty
    % Empty
    % Empty
    % Empty
    % Empty
  NAV_SET_YAW_SPEED = 213  % Sets a desired vehicle turn angle and speed change
    % yaw angle to adjust steering by in centidegress
    % speed - normalized to 0 .. 1
    % Empty
    % Empty
    % Empty
    % Empty
    % Empty
  DO_SET_CAM_TRIGG_INTERVAL = 214  % Mission command to set camera trigger interval for this flight. If triggering is enabled, the camera is triggered each time this interval expires. This command can also be used to set the shutter integration time for the camera.
    % Camera trigger cycle time (milliseconds). -1 or 0 to ignore.
    % Camera shutter integration time (milliseconds). Should be less than trigger cycle time. -1 or 0 to ignore.
    % Empty
    % Empty
    % Empty
    % Empty
    % Empty
  DO_MOUNT_CONTROL_QUAT = 220  % Mission command to control a camera or antenna mount, using a quaternion as reference.
    % q1 - quaternion param #1, w (1 in null-rotation)
    % q2 - quaternion param #2, x (0 in null-rotation)
    % q3 - quaternion param #3, y (0 in null-rotation)
    % q4 - quaternion param #4, z (0 in null-rotation)
    % Empty
    % Empty
    % Empty
  DO_GUIDED_MASTER = 221  % set id of master controller
    % System ID
    % Component ID
    % Empty
    % Empty
    % Empty
    % Empty
    % Empty
  DO_GUIDED_LIMITS = 222  % set limits for external control
    % timeout - maximum time (in seconds) that external controller will be allowed to control vehicle. 0 means no timeout
    % absolute altitude min (in meters, AMSL) - if vehicle moves below this alt, the command will be aborted and the mission will continue.  0 means no lower altitude limit
    % absolute altitude max (in meters)- if vehicle moves above this alt, the command will be aborted and the mission will continue.  0 means no upper altitude limit
    % horizontal move limit (in meters, AMSL) - if vehicle moves more than this distance from it's location at the moment the command was executed, the command will be aborted and the mission will continue. 0 means no horizontal altitude limit
    % Empty
    % Empty
    % Empty
  DO_ENGINE_CONTROL = 223  % Control vehicle engine. This is interpreted by the vehicles engine controller to change the target engine state. It is intended for vehicles with internal combustion engines
    % 0: Stop engine, 1:Start Engine
    % 0: Warm start, 1:Cold start. Controls use of choke where applicable
    % Height delay (meters). This is for commanding engine start only after the vehicle has gained the specified height. Used in VTOL vehicles during takeoff to start engine after the aircraft is off the ground. Zero for no delay.
    % Empty
    % Empty
    % Empty
    % Empty
    % Empty
  DO_LAST = 240  % NOP - This command is only used to mark the upper limit of the DO commands in the enumeration
    % Empty
    % Empty
    % Empty
    % Empty
    % Empty
    % Empty
    % Empty
  PREFLIGHT_CALIBRATION = 241  % Trigger calibration. This command will be only accepted if in pre-flight mode. Except for Temperature Calibration, only one sensor should be set in a single message and all others should be zero.
    % 1: gyro calibration, 3: gyro temperature calibration
    % 1: magnetometer calibration
    % 1: ground pressure calibration
    % 1: radio RC calibration, 2: RC trim calibration
    % 1: accelerometer calibration, 2: board level calibration, 3: accelerometer temperature calibration, 4: simple accelerometer calibration
    % 1: APM: compass/motor interference calibration (PX4: airspeed calibration, deprecated), 2: airspeed calibration
    % 1: ESC calibration, 3: barometer temperature calibration
  PREFLIGHT_SET_SENSOR_OFFSETS = 242  % Set sensor offsets. This command will be only accepted if in pre-flight mode.
    % Sensor to adjust the offsets for: 0: gyros, 1: accelerometer, 2: magnetometer, 3: barometer, 4: optical flow, 5: second magnetometer, 6: third magnetometer
    % X axis offset (or generic dimension 1), in the sensor's raw units
    % Y axis offset (or generic dimension 2), in the sensor's raw units
    % Z axis offset (or generic dimension 3), in the sensor's raw units
    % Generic dimension 4, in the sensor's raw units
    % Generic dimension 5, in the sensor's raw units
    % Generic dimension 6, in the sensor's raw units
  PREFLIGHT_UAVCAN = 243  % Trigger UAVCAN config. This command will be only accepted if in pre-flight mode.
    % 1: Trigger actuator ID assignment and direction mapping.
    % Reserved
    % Reserved
    % Reserved
    % Reserved
    % Reserved
    % Reserved
  PREFLIGHT_STORAGE = 245  % Request storage of different parameter values and logs. This command will be only accepted if in pre-flight mode.
    % Parameter storage: 0: READ FROM FLASH/EEPROM, 1: WRITE CURRENT TO FLASH/EEPROM, 2: Reset to defaults
    % Mission storage: 0: READ FROM FLASH/EEPROM, 1: WRITE CURRENT TO FLASH/EEPROM, 2: Reset to defaults
    % Onboard logging: 0: Ignore, 1: Start default rate logging, -1: Stop logging, > 1: start logging with rate of param 3 in Hz (e.g. set to 1000 for 1000 Hz logging)
    % Reserved
    % Empty
    % Empty
    % Empty
  PREFLIGHT_REBOOT_SHUTDOWN = 246  % Request the reboot or shutdown of system components.
    % 0: Do nothing for autopilot, 1: Reboot autopilot, 2: Shutdown autopilot, 3: Reboot autopilot and keep it in the bootloader until upgraded.
    % 0: Do nothing for onboard computer, 1: Reboot onboard computer, 2: Shutdown onboard computer, 3: Reboot onboard computer and keep it in the bootloader until upgraded.
    % WIP: 0: Do nothing for camera, 1: Reboot onboard camera, 2: Shutdown onboard camera, 3: Reboot onboard camera and keep it in the bootloader until upgraded
    % WIP: 0: Do nothing for mount (e.g. gimbal), 1: Reboot mount, 2: Shutdown mount, 3: Reboot mount and keep it in the bootloader until upgraded
    % Reserved, send 0
    % Reserved, send 0
    % WIP: ID (e.g. camera ID -1 for all IDs)
  OVERRIDE_GOTO = 252  % Hold / continue the current action
    % MAV_GOTO_DO_HOLD: hold MAV_GOTO_DO_CONTINUE: continue with next item in mission plan
    % MAV_GOTO_HOLD_AT_CURRENT_POSITION: Hold at current position MAV_GOTO_HOLD_AT_SPECIFIED_POSITION: hold at specified position
    % MAV_FRAME coordinate frame of hold point
    % Desired yaw angle in degrees
    % Latitude / X position
    % Longitude / Y position
    % Altitude / Z position
  MISSION_START = 300  % start running a mission
    % first_item: the first mission item to run
    % last_item:  the last mission item to run (after this item is run, the mission ends)
  COMPONENT_ARM_DISARM = 400  % Arms / Disarms a component
    % 1 to arm, 0 to disarm
  GET_HOME_POSITION = 410  % Request the home position from the vehicle.
    % Reserved
    % Reserved
    % Reserved
    % Reserved
    % Reserved
    % Reserved
    % Reserved
  START_RX_PAIR = 500  % Starts receiver pairing
    % 0:Spektrum
    % RC type (see RC_TYPE enum)
  GET_MESSAGE_INTERVAL = 510  % Request the interval between messages for a particular MAVLink message ID
    % The MAVLink message ID
  SET_MESSAGE_INTERVAL = 511  % Request the interval between messages for a particular MAVLink message ID. This interface replaces REQUEST_DATA_STREAM
    % The MAVLink message ID
    % The interval between two messages, in microseconds. Set to -1 to disable and 0 to request default rate.
  REQUEST_PROTOCOL_VERSION = 519  % Request MAVLink protocol version compatibility
    % 1: Request supported protocol versions by all nodes on the network
    % Reserved (all remaining params)
  REQUEST_AUTOPILOT_CAPABILITIES = 520  % Request autopilot capabilities
    % 1: Request autopilot version
    % Reserved (all remaining params)
  REQUEST_CAMERA_INFORMATION = 521  % Request camera information (CAMERA_INFORMATION).
    % 0: No action 1: Request camera capabilities
    % Reserved (all remaining params)
  REQUEST_CAMERA_SETTINGS = 522  % Request camera settings (CAMERA_SETTINGS).
    % 0: No Action 1: Request camera settings
    % Reserved (all remaining params)
  REQUEST_STORAGE_INFORMATION = 525  % WIP: Request storage information (STORAGE_INFORMATION). Use the command's target_component to target a specific component's storage.
    % Storage ID (0 for all, 1 for first, 2 for second, etc.)
    % 0: No Action 1: Request storage information
    % Reserved (all remaining params)
  STORAGE_FORMAT = 526  % WIP: Format a storage medium. Once format is complete, a STORAGE_INFORMATION message is sent. Use the command's target_component to target a specific component's storage.
    % Storage ID (1 for first, 2 for second, etc.)
    % 0: No action 1: Format storage
    % Reserved (all remaining params)
  REQUEST_CAMERA_CAPTURE_STATUS = 527  % Request camera capture status (CAMERA_CAPTURE_STATUS)
    % 0: No Action 1: Request camera capture status
    % Reserved (all remaining params)
  REQUEST_FLIGHT_INFORMATION = 528  % WIP: Request flight information (FLIGHT_INFORMATION)
    % 1: Request flight information
    % Reserved (all remaining params)
  RESET_CAMERA_SETTINGS = 529  % Reset all camera settings to Factory Default
    % 0: No Action 1: Reset all settings
    % Reserved (all remaining params)
  SET_CAMERA_MODE = 530  % Set camera running mode. Use NAN for reserved values.
    % Reserved (Set to 0)
    % Camera mode (see CAMERA_MODE enum)
    % Reserved (all remaining params)
  IMAGE_START_CAPTURE = 2000  % Start image capture sequence. Sends CAMERA_IMAGE_CAPTURED after each capture. Use NAN for reserved values.
    % Reserved (Set to 0)
    % Duration between two consecutive pictures (in seconds)
    % Number of images to capture total - 0 for unlimited capture
    % Capture sequence (ID to prevent double captures when a command is retransmitted, 0: unused, >= 1: used)
    % Reserved (all remaining params)
  IMAGE_STOP_CAPTURE = 2001  % Stop image capture sequence Use NAN for reserved values.
    % Reserved (Set to 0)
    % Reserved (all remaining params)
  REQUEST_CAMERA_IMAGE_CAPTURE = 2002  % WIP: Re-request a CAMERA_IMAGE_CAPTURE packet. Use NAN for reserved values.
    % Sequence number for missing CAMERA_IMAGE_CAPTURE packet
    % Reserved (all remaining params)
  DO_TRIGGER_CONTROL = 2003  % Enable or disable on-board camera triggering system.
    % Trigger enable/disable (0 for disable, 1 for start), -1 to ignore
    % 1 to reset the trigger sequence, -1 or 0 to ignore
    % 1 to pause triggering, but without switching the camera off or retracting it. -1 to ignore
  VIDEO_START_CAPTURE = 2500  % Starts video capture (recording). Use NAN for reserved values.
    % Reserved (Set to 0)
    % Frequency CAMERA_CAPTURE_STATUS messages should be sent while recording (0 for no messages, otherwise frequency in Hz)
    % Reserved (all remaining params)
  VIDEO_STOP_CAPTURE = 2501  % Stop the current video capture (recording). Use NAN for reserved values.
    % Reserved (Set to 0)
    % Reserved (all remaining params)
  VIDEO_START_STREAMING = 2502  % WIP: Start video streaming
    % Camera ID (0 for all cameras, 1 for first, 2 for second, etc.)
    % Reserved
  VIDEO_STOP_STREAMING = 2503  % WIP: Stop the current video streaming
    % Camera ID (0 for all cameras, 1 for first, 2 for second, etc.)
    % Reserved
  REQUEST_VIDEO_STREAM_INFORMATION = 2504  % WIP: Request video stream information (VIDEO_STREAM_INFORMATION)
    % Camera ID (0 for all cameras, 1 for first, 2 for second, etc.)
    % 0: No Action 1: Request video stream information
    % Reserved (all remaining params)
  LOGGING_START = 2510  % Request to start streaming logging data over MAVLink (see also LOGGING_DATA message)
    % Format: 0: ULog
    % Reserved (set to 0)
    % Reserved (set to 0)
    % Reserved (set to 0)
    % Reserved (set to 0)
    % Reserved (set to 0)
    % Reserved (set to 0)
  LOGGING_STOP = 2511  % Request to stop streaming log data over MAVLink
    % Reserved (set to 0)
    % Reserved (set to 0)
    % Reserved (set to 0)
    % Reserved (set to 0)
    % Reserved (set to 0)
    % Reserved (set to 0)
    % Reserved (set to 0)
  AIRFRAME_CONFIGURATION = 2520  % Landing gear ID (default: 0, -1 for all)
    % Landing gear position (Down: 0, Up: 1, NAN for no change)
    % Reserved, set to NAN
    % Reserved, set to NAN
    % Reserved, set to NAN
    % Reserved, set to NAN
    % Reserved, set to NAN
  CONTROL_HIGH_LATENCY = 2600  % Request to start/stop transmitting over the high latency telemetry
    % Control transmittion over high latency telemetry (0: stop, 1: start)
    % Empty
    % Empty
    % Empty
    % Empty
    % Empty
    % Empty
  PANORAMA_CREATE = 2800  % Create a panorama at the current position
    % Viewing angle horizontal of the panorama (in degrees, +- 0.5 the total angle)
    % Viewing angle vertical of panorama (in degrees)
    % Speed of the horizontal rotation (in degrees per second)
    % Speed of the vertical rotation (in degrees per second)
  DO_VTOL_TRANSITION = 3000  % Request VTOL transition
    % The target VTOL state, as defined by ENUM MAV_VTOL_STATE. Only MAV_VTOL_STATE_MC and MAV_VTOL_STATE_FW can be used.
  SET_GUIDED_SUBMODE_STANDARD = 4000  % This command sets the submode to standard guided when vehicle is in guided mode. The vehicle holds position and altitude and the user can input the desired velocites along all three axes.
  SET_GUIDED_SUBMODE_CIRCLE = 4001  % This command sets submode circle when vehicle is in guided mode. Vehicle flies along a circle facing the center of the circle. The user can input the velocity along the circle and change the radius. If no input is given the vehicle will hold position.
    % Radius of desired circle in CIRCLE_MODE
    % User defined
    % User defined
    % User defined
    % Unscaled target latitude of center of circle in CIRCLE_MODE
    % Unscaled target longitude of center of circle in CIRCLE_MODE
  CONDITION_GATE = 4501  % WIP: Delay mission state machine until gate has been reached.
    % Geometry: 0: orthogonal to path between previous and next waypoint.
    % Altitude: 0: ignore altitude
    % Empty
    % Empty
    % Latitude
    % Longitude
    % Altitude
  ARM_AUTHORIZATION_REQUEST = 3001  % Request authorization to arm the vehicle to a external entity, the arm authorizer is resposible to request all data that is needs from the vehicle before authorize or deny the request. If approved the progress of command_ack message should be set with period of time that this authorization is valid in seconds or in case it was denied it should be set with one of the reasons in ARM_AUTH_DENIED_REASON.
    % Vehicle system id, this way ground station can request arm authorization on behalf of any vehicle
  NAV_FENCE_RETURN_POINT = 5000  % Fence return point. There can only be one fence return point.
    % Reserved
    % Reserved
    % Reserved
    % Reserved
    % Latitude
    % Longitude
    % Altitude
  NAV_FENCE_POLYGON_VERTEX_INCLUSION = 5001  % Fence vertex for an inclusion polygon (the polygon must not be self-intersecting). The vehicle must stay within this area. Minimum of 3 vertices required.
    % Polygon vertex count
    % Reserved
    % Reserved
    % Reserved
    % Latitude
    % Longitude
    % Reserved
  NAV_FENCE_POLYGON_VERTEX_EXCLUSION = 5002  % Fence vertex for an exclusion polygon (the polygon must not be self-intersecting). The vehicle must stay outside this area. Minimum of 3 vertices required.
    % Polygon vertex count
    % Reserved
    % Reserved
    % Reserved
    % Latitude
    % Longitude
    % Reserved
  NAV_FENCE_CIRCLE_INCLUSION = 5003  % Circular fence area. The vehicle must stay inside this area.
    % radius in meters
    % Reserved
    % Reserved
    % Reserved
    % Latitude
    % Longitude
    % Reserved
  NAV_FENCE_CIRCLE_EXCLUSION = 5004  % Circular fence area. The vehicle must stay outside this area.
    % radius in meters
    % Reserved
    % Reserved
    % Reserved
    % Latitude
    % Longitude
    % Reserved
  NAV_RALLY_POINT = 5100  % Rally point. You can have multiple rally points defined.
    % Reserved
    % Reserved
    % Reserved
    % Reserved
    % Latitude
    % Longitude
    % Altitude
  UAVCAN_GET_NODE_INFO = 5200  % Commands the vehicle to respond with a sequence of messages UAVCAN_NODE_INFO, one message per every UAVCAN node that is online. Note that some of the response messages can be lost, which the receiver can detect easily by checking whether every received UAVCAN_NODE_STATUS has a matching message UAVCAN_NODE_INFO received earlier; if not, this command should be sent again in order to request re-transmission of the node information messages.
    % Reserved (set to 0)
    % Reserved (set to 0)
    % Reserved (set to 0)
    % Reserved (set to 0)
    % Reserved (set to 0)
    % Reserved (set to 0)
    % Reserved (set to 0)
  PAYLOAD_PREPARE_DEPLOY = 30001  % Deploy payload on a Lat / Lon / Alt position. This includes the navigation to reach the required release position and velocity.
    % Operation mode. 0: prepare single payload deploy (overwriting previous requests), but do not execute it. 1: execute payload deploy immediately (rejecting further deploy commands during execution, but allowing abort). 2: add payload deploy to existing deployment list.
    % Desired approach vector in degrees compass heading (0..360). A negative value indicates the system can define the approach vector at will.
    % Desired ground speed at release time. This can be overriden by the airframe in case it needs to meet minimum airspeed. A negative value indicates the system can define the ground speed at will.
    % Minimum altitude clearance to the release position in meters. A negative value indicates the system can define the clearance at will.
    % Latitude unscaled for MISSION_ITEM or in 1e7 degrees for MISSION_ITEM_INT
    % Longitude unscaled for MISSION_ITEM or in 1e7 degrees for MISSION_ITEM_INT
    % Altitude, in meters AMSL
  PAYLOAD_CONTROL_DEPLOY = 30002  % Control the payload deployment.
    % Operation mode. 0: Abort deployment, continue normal mission. 1: switch to payload deploment mode. 100: delete first payload deployment request. 101: delete all payload deployment requests.
    % Reserved
    % Reserved
    % Reserved
    % Reserved
    % Reserved
    % Reserved
  WAYPOINT_USER_1 = 31000  % User defined waypoint item. Ground Station will show the Vehicle as flying through this item.
    % User defined
    % User defined
    % User defined
    % User defined
    % Latitude unscaled
    % Longitude unscaled
    % Altitude, in meters AMSL
  WAYPOINT_USER_2 = 31001  % User defined waypoint item. Ground Station will show the Vehicle as flying through this item.
    % User defined
    % User defined
    % User defined
    % User defined
    % Latitude unscaled
    % Longitude unscaled
    % Altitude, in meters AMSL
  WAYPOINT_USER_3 = 31002  % User defined waypoint item. Ground Station will show the Vehicle as flying through this item.
    % User defined
    % User defined
    % User defined
    % User defined
    % Latitude unscaled
    % Longitude unscaled
    % Altitude, in meters AMSL
  WAYPOINT_USER_4 = 31003  % User defined waypoint item. Ground Station will show the Vehicle as flying through this item.
    % User defined
    % User defined
    % User defined
    % User defined
    % Latitude unscaled
    % Longitude unscaled
    % Altitude, in meters AMSL
  WAYPOINT_USER_5 = 31004  % User defined waypoint item. Ground Station will show the Vehicle as flying through this item.
    % User defined
    % User defined
    % User defined
    % User defined
    % Latitude unscaled
    % Longitude unscaled
    % Altitude, in meters AMSL
  SPATIAL_USER_1 = 31005  % User defined spatial item. Ground Station will not show the Vehicle as flying through this item. Example: ROI item.
    % User defined
    % User defined
    % User defined
    % User defined
    % Latitude unscaled
    % Longitude unscaled
    % Altitude, in meters AMSL
  SPATIAL_USER_2 = 31006  % User defined spatial item. Ground Station will not show the Vehicle as flying through this item. Example: ROI item.
    % User defined
    % User defined
    % User defined
    % User defined
    % Latitude unscaled
    % Longitude unscaled
    % Altitude, in meters AMSL
  SPATIAL_USER_3 = 31007  % User defined spatial item. Ground Station will not show the Vehicle as flying through this item. Example: ROI item.
    % User defined
    % User defined
    % User defined
    % User defined
    % Latitude unscaled
    % Longitude unscaled
    % Altitude, in meters AMSL
  SPATIAL_USER_4 = 31008  % User defined spatial item. Ground Station will not show the Vehicle as flying through this item. Example: ROI item.
    % User defined
    % User defined
    % User defined
    % User defined
    % Latitude unscaled
    % Longitude unscaled
    % Altitude, in meters AMSL
  SPATIAL_USER_5 = 31009  % User defined spatial item. Ground Station will not show the Vehicle as flying through this item. Example: ROI item.
    % User defined
    % User defined
    % User defined
    % User defined
    % Latitude unscaled
    % Longitude unscaled
    % Altitude, in meters AMSL
  USER_1 = 31010  % User defined command. Ground Station will not show the Vehicle as flying through this item. Example: MAV_CMD_DO_SET_PARAMETER item.
    % User defined
    % User defined
    % User defined
    % User defined
    % User defined
    % User defined
    % User defined
  USER_2 = 31011  % User defined command. Ground Station will not show the Vehicle as flying through this item. Example: MAV_CMD_DO_SET_PARAMETER item.
    % User defined
    % User defined
    % User defined
    % User defined
    % User defined
    % User defined
    % User defined
  USER_3 = 31012  % User defined command. Ground Station will not show the Vehicle as flying through this item. Example: MAV_CMD_DO_SET_PARAMETER item.
    % User defined
    % User defined
    % User defined
    % User defined
    % User defined
    % User defined
    % User defined
  USER_4 = 31013  % User defined command. Ground Station will not show the Vehicle as flying through this item. Example: MAV_CMD_DO_SET_PARAMETER item.
    % User defined
    % User defined
    % User defined
    % User defined
    % User defined
    % User defined
    % User defined
  USER_5 = 31014  % User defined command. Ground Station will not show the Vehicle as flying through this item. Example: MAV_CMD_DO_SET_PARAMETER item.
    % User defined
    % User defined
    % User defined
    % User defined
    % User defined
    % User defined
    % User defined

MAV_DATA_STREAM = enum(AddClassNameToEnumNames=true)  % THIS INTERFACE IS DEPRECATED AS OF JULY 2015. Please use MESSAGE_INTERVAL instead. A data stream is not a fixed set of messages, but rather a
  % recommendation to the autopilot software. Individual autopilots may or may not obey
  % the recommended messages.
  ALL = 0  % Enable all data streams
  RAW_SENSORS = 1  % Enable IMU_RAW, GPS_RAW, GPS_STATUS packets.
  EXTENDED_STATUS = 2  % Enable GPS_STATUS, CONTROL_STATUS, AUX_STATUS
  RC_CHANNELS = 3  % Enable RC_CHANNELS_SCALED, RC_CHANNELS_RAW, SERVO_OUTPUT_RAW
  RAW_CONTROLLER = 4  % Enable ATTITUDE_CONTROLLER_OUTPUT, POSITION_CONTROLLER_OUTPUT, NAV_CONTROLLER_OUTPUT.
  POSITION = 6  % Enable LOCAL_POSITION, GLOBAL_POSITION/GLOBAL_POSITION_INT messages.
  EXTRA1 = 10  % Dependent on the autopilot
  EXTRA2 = 11  % Dependent on the autopilot
  EXTRA3 = 12  % Dependent on the autopilot

MAV_ROI = enum(AddClassNameToEnumNames=true)  % THIS INTERFACE IS DEPRECATED AS OF JANUARY 2018. Please use MAV_CMD_DO_SET_ROI_* messages instead. The ROI (region of interest) for the vehicle. This can be
  % be used by the vehicle for camera/vehicle attitude alignment (see
  % MAV_CMD_NAV_ROI).
  NONE = 0  % No region of interest.
  WPNEXT = 1  % Point toward next waypoint, with optional pitch/roll/yaw offset.
  WPINDEX = 2  % Point toward given waypoint.
  LOCATION = 3  % Point toward fixed location.
  TARGET = 4  % Point toward of given id.

MAV_CMD_ACK = enum(AddClassNameToEnumNames=true)  % ACK / NACK / ERROR values as a result of MAV_CMDs and for mission item transmission.
  OK = 0  % Command / mission item is ok.
  ERR_FAIL = 1  % Generic error message if none of the other reasons fails or if no detailed error reporting is implemented.
  ERR_ACCESS_DENIED = 2  % The system is refusing to accept this command from this source / communication partner.
  ERR_NOT_SUPPORTED = 3  % Command or mission item is not supported, other commands would be accepted.
  ERR_COORDINATE_FRAME_NOT_SUPPORTED = 4  % The coordinate frame of this command / mission item is not supported.
  ERR_COORDINATES_OUT_OF_RANGE = 5  % The coordinate frame of this command is ok, but he coordinate values exceed the safety limits of this system. This is a generic error, please use the more specific error messages below if possible.
  ERR_X_LAT_OUT_OF_RANGE = 6  % The X or latitude value is out of range.
  ERR_Y_LON_OUT_OF_RANGE = 7  % The Y or longitude value is out of range.
  ERR_Z_ALT_OUT_OF_RANGE = 8  % The Z or altitude value is out of range.

MAV_PARAM_TYPE = enum(AddClassNameToEnumNames=true)  % Specifies the datatype of a MAVLink parameter.
  UINT8 = 1  % 8-bit unsigned integer
  INT8 = 2  % 8-bit signed integer
  UINT16 = 3  % 16-bit unsigned integer
  INT16 = 4  % 16-bit signed integer
  UINT32 = 5  % 32-bit unsigned integer
  INT32 = 6  % 32-bit signed integer
  UINT64 = 7  % 64-bit unsigned integer
  INT64 = 8  % 64-bit signed integer
  REAL32 = 9  % 32-bit floating-point
  REAL64 = 10  % 64-bit floating-point

MAV_PARAM_EXT_TYPE = enum(AddClassNameToEnumNames=true)  % Specifies the datatype of a MAVLink extended parameter.
  UINT8 = 1  % 8-bit unsigned integer
  INT8 = 2  % 8-bit signed integer
  UINT16 = 3  % 16-bit unsigned integer
  INT16 = 4  % 16-bit signed integer
  UINT32 = 5  % 32-bit unsigned integer
  INT32 = 6  % 32-bit signed integer
  UINT64 = 7  % 64-bit unsigned integer
  INT64 = 8  % 64-bit signed integer
  REAL32 = 9  % 32-bit floating-point
  REAL64 = 10  % 64-bit floating-point
  CUSTOM = 11  % Custom Type

MAV_RESULT = enum(AddClassNameToEnumNames=true)  % result from a mavlink command
  ACCEPTED = 0  % Command ACCEPTED and EXECUTED
  TEMPORARILY_REJECTED = 1  % Command TEMPORARY REJECTED/DENIED
  DENIED = 2  % Command PERMANENTLY DENIED
  UNSUPPORTED = 3  % Command UNKNOWN/UNSUPPORTED
  FAILED = 4  % Command executed, but failed
  IN_PROGRESS = 5  % WIP: Command being executed

MAV_MISSION_RESULT = enum(AddClassNameToEnumNames=true)  % result in a mavlink mission ack
  MAV_MISSION_ACCEPTED = 0  % mission accepted OK
  MAV_MISSION_ERROR = 1  % generic error / not accepting mission commands at all right now
  MAV_MISSION_UNSUPPORTED_FRAME = 2  % coordinate frame is not supported
  MAV_MISSION_UNSUPPORTED = 3  % command is not supported
  MAV_MISSION_NO_SPACE = 4  % mission item exceeds storage space
  MAV_MISSION_INVALID = 5  % one of the parameters has an invalid value
  MAV_MISSION_INVALID_PARAM1 = 6  % param1 has an invalid value
  MAV_MISSION_INVALID_PARAM2 = 7  % param2 has an invalid value
  MAV_MISSION_INVALID_PARAM3 = 8  % param3 has an invalid value
  MAV_MISSION_INVALID_PARAM4 = 9  % param4 has an invalid value
  MAV_MISSION_INVALID_PARAM5_X = 10  % x/param5 has an invalid value
  MAV_MISSION_INVALID_PARAM6_Y = 11  % y/param6 has an invalid value
  MAV_MISSION_INVALID_PARAM7 = 12  % param7 has an invalid value
  MAV_MISSION_INVALID_SEQUENCE = 13  % received waypoint out of sequence
  MAV_MISSION_DENIED = 14  % not accepting any mission commands from this communication partner

MAV_SEVERITY = enum(AddClassNameToEnumNames=true)  % Indicates the severity level, generally used for status messages to indicate their relative urgency. Based on RFC-5424 using expanded definitions at: http://www.kiwisyslog.com/kb/info:-syslog-message-levels/.
  EMERGENCY = 0  % System is unusable. This is a "panic" condition.
  ALERT = 1  % Action should be taken immediately. Indicates error in non-critical systems.
  CRITICAL = 2  % Action must be taken immediately. Indicates failure in a primary system.
  ERROR = 3  % Indicates an error in secondary/redundant systems.
  WARNING = 4  % Indicates about a possible future error if this is not resolved within a given timeframe. Example would be a low battery warning.
  NOTICE = 5  % An unusual event has occured, though not an error condition. This should be investigated for the root cause.
  INFO = 6  % Normal operational messages. Useful for logging. No action is required for these messages.
  DEBUG = 7  % Useful non-operational messages that can assist in debugging. These should not occur during normal operation.

MAV_POWER_STATUS = enum(AddClassNameToEnumNames=true)  % Power supply status flags (bitmask)
  BRICK_VALID = 1  % main brick power supply valid
  SERVO_VALID = 2  % main servo power supply valid for FMU
  USB_CONNECTED = 4  % USB power is connected
  PERIPH_OVERCURRENT = 8  % peripheral supply is in over-current state
  PERIPH_HIPOWER_OVERCURRENT = 16  % hi-power peripheral supply is in over-current state
  CHANGED = 32  % Power status has changed since boot

MAV_SERIAL_CONTROL_DEV = enum(AddClassNameToEnumNames=true)  % SERIAL_CONTROL device types
  TELEM1 = 0  % First telemetry port
  TELEM2 = 1  % Second telemetry port
  GPS1 = 2  % First GPS port
  GPS2 = 3  % Second GPS port
  SHELL = 10  % system shell

MAV_SERIAL_CONTROL_FLAG = enum(AddClassNameToEnumNames=true)  % SERIAL_CONTROL flags (bitmask)
  REPLY = 1  % Set if this is a reply
  RESPOND = 2  % Set if the sender wants the receiver to send a response as another SERIAL_CONTROL message
  EXCLUSIVE = 4  % Set if access to the serial port should be removed from whatever driver is currently using it, giving exclusive access to the SERIAL_CONTROL protocol. The port can be handed back by sending a request without this flag set
  BLOCKING = 8  % Block on writes to the serial port
  MULTI = 16  % Send multiple replies until port is drained

MAV_DISTANCE_SENSOR = enum(AddClassNameToEnumNames=true)  % Enumeration of distance sensor types
  LASER = 0  % Laser rangefinder, e.g. LightWare SF02/F or PulsedLight units
  ULTRASOUND = 1  % Ultrasound rangefinder, e.g. MaxBotix units
  INFRARED = 2  % Infrared rangefinder, e.g. Sharp units
  RADAR = 3  % Radar type, e.g. uLanding units
  UNKNOWN = 4  % Broken or unknown type, e.g. analog units

MAV_SENSOR_ORIENTATION = enum(AddClassNameToEnumNames=true)  % Enumeration of sensor orientation, according to its rotations
  MAV_SENSOR_ROTATION_NONE = 0  % Roll: 0, Pitch: 0, Yaw: 0
  MAV_SENSOR_ROTATION_YAW_45 = 1  % Roll: 0, Pitch: 0, Yaw: 45
  MAV_SENSOR_ROTATION_YAW_90 = 2  % Roll: 0, Pitch: 0, Yaw: 90
  MAV_SENSOR_ROTATION_YAW_135 = 3  % Roll: 0, Pitch: 0, Yaw: 135
  MAV_SENSOR_ROTATION_YAW_180 = 4  % Roll: 0, Pitch: 0, Yaw: 180
  MAV_SENSOR_ROTATION_YAW_225 = 5  % Roll: 0, Pitch: 0, Yaw: 225
  MAV_SENSOR_ROTATION_YAW_270 = 6  % Roll: 0, Pitch: 0, Yaw: 270
  MAV_SENSOR_ROTATION_YAW_315 = 7  % Roll: 0, Pitch: 0, Yaw: 315
  MAV_SENSOR_ROTATION_ROLL_180 = 8  % Roll: 180, Pitch: 0, Yaw: 0
  MAV_SENSOR_ROTATION_ROLL_180_YAW_45 = 9  % Roll: 180, Pitch: 0, Yaw: 45
  MAV_SENSOR_ROTATION_ROLL_180_YAW_90 = 10  % Roll: 180, Pitch: 0, Yaw: 90
  MAV_SENSOR_ROTATION_ROLL_180_YAW_135 = 11  % Roll: 180, Pitch: 0, Yaw: 135
  MAV_SENSOR_ROTATION_PITCH_180 = 12  % Roll: 0, Pitch: 180, Yaw: 0
  MAV_SENSOR_ROTATION_ROLL_180_YAW_225 = 13  % Roll: 180, Pitch: 0, Yaw: 225
  MAV_SENSOR_ROTATION_ROLL_180_YAW_270 = 14  % Roll: 180, Pitch: 0, Yaw: 270
  MAV_SENSOR_ROTATION_ROLL_180_YAW_315 = 15  % Roll: 180, Pitch: 0, Yaw: 315
  MAV_SENSOR_ROTATION_ROLL_90 = 16  % Roll: 90, Pitch: 0, Yaw: 0
  MAV_SENSOR_ROTATION_ROLL_90_YAW_45 = 17  % Roll: 90, Pitch: 0, Yaw: 45
  MAV_SENSOR_ROTATION_ROLL_90_YAW_90 = 18  % Roll: 90, Pitch: 0, Yaw: 90
  MAV_SENSOR_ROTATION_ROLL_90_YAW_135 = 19  % Roll: 90, Pitch: 0, Yaw: 135
  MAV_SENSOR_ROTATION_ROLL_270 = 20  % Roll: 270, Pitch: 0, Yaw: 0
  MAV_SENSOR_ROTATION_ROLL_270_YAW_45 = 21  % Roll: 270, Pitch: 0, Yaw: 45
  MAV_SENSOR_ROTATION_ROLL_270_YAW_90 = 22  % Roll: 270, Pitch: 0, Yaw: 90
  MAV_SENSOR_ROTATION_ROLL_270_YAW_135 = 23  % Roll: 270, Pitch: 0, Yaw: 135
  MAV_SENSOR_ROTATION_PITCH_90 = 24  % Roll: 0, Pitch: 90, Yaw: 0
  MAV_SENSOR_ROTATION_PITCH_270 = 25  % Roll: 0, Pitch: 270, Yaw: 0
  MAV_SENSOR_ROTATION_PITCH_180_YAW_90 = 26  % Roll: 0, Pitch: 180, Yaw: 90
  MAV_SENSOR_ROTATION_PITCH_180_YAW_270 = 27  % Roll: 0, Pitch: 180, Yaw: 270
  MAV_SENSOR_ROTATION_ROLL_90_PITCH_90 = 28  % Roll: 90, Pitch: 90, Yaw: 0
  MAV_SENSOR_ROTATION_ROLL_180_PITCH_90 = 29  % Roll: 180, Pitch: 90, Yaw: 0
  MAV_SENSOR_ROTATION_ROLL_270_PITCH_90 = 30  % Roll: 270, Pitch: 90, Yaw: 0
  MAV_SENSOR_ROTATION_ROLL_90_PITCH_180 = 31  % Roll: 90, Pitch: 180, Yaw: 0
  MAV_SENSOR_ROTATION_ROLL_270_PITCH_180 = 32  % Roll: 270, Pitch: 180, Yaw: 0
  MAV_SENSOR_ROTATION_ROLL_90_PITCH_270 = 33  % Roll: 90, Pitch: 270, Yaw: 0
  MAV_SENSOR_ROTATION_ROLL_180_PITCH_270 = 34  % Roll: 180, Pitch: 270, Yaw: 0
  MAV_SENSOR_ROTATION_ROLL_270_PITCH_270 = 35  % Roll: 270, Pitch: 270, Yaw: 0
  MAV_SENSOR_ROTATION_ROLL_90_PITCH_180_YAW_90 = 36  % Roll: 90, Pitch: 180, Yaw: 90
  MAV_SENSOR_ROTATION_ROLL_90_YAW_270 = 37  % Roll: 90, Pitch: 0, Yaw: 270
  MAV_SENSOR_ROTATION_ROLL_315_PITCH_315_YAW_315 = 38  % Roll: 315, Pitch: 315, Yaw: 315

MAV_PROTOCOL_CAPABILITY = enum(AddClassNameToEnumNames=true)  % Bitmask of (optional) autopilot capabilities (64 bit). If a bit is set, the autopilot supports this capability.
  MISSION_FLOAT = 1  % Autopilot supports MISSION float message type.
  PARAM_FLOAT = 2  % Autopilot supports the new param float message type.
  MISSION_INT = 4  % Autopilot supports MISSION_INT scaled integer message type.
  COMMAND_INT = 8  % Autopilot supports COMMAND_INT scaled integer message type.
  PARAM_UNION = 16  % Autopilot supports the new param union message type.
  FTP = 32  % Autopilot supports the new FILE_TRANSFER_PROTOCOL message type.
  SET_ATTITUDE_TARGET = 64  % Autopilot supports commanding attitude offboard.
  SET_POSITION_TARGET_LOCAL_NED = 128  % Autopilot supports commanding position and velocity targets in local NED frame.
  SET_POSITION_TARGET_GLOBAL_INT = 256  % Autopilot supports commanding position and velocity targets in global scaled integers.
  TERRAIN = 512  % Autopilot supports terrain protocol / data handling.
  SET_ACTUATOR_TARGET = 1024  % Autopilot supports direct actuator control.
  FLIGHT_TERMINATION = 2048  % Autopilot supports the flight termination command.
  COMPASS_CALIBRATION = 4096  % Autopilot supports onboard compass calibration.
  MAVLINK2 = 8192  % Autopilot supports mavlink version 2.
  MISSION_FENCE = 16384  % Autopilot supports mission fence protocol.
  MISSION_RALLY = 32768  % Autopilot supports mission rally point protocol.
  FLIGHT_INFORMATION = 65536  % Autopilot supports the flight information protocol.

MAV_MISSION_TYPE = enum(AddClassNameToEnumNames=true)  % Type of mission items being requested/sent in mission protocol.
  MISSION = 0  % Items are mission commands for main mission.
  FENCE = 1  % Specifies GeoFence area(s). Items are MAV_CMD_FENCE_ GeoFence items.
  RALLY = 2  % Specifies the rally points for the vehicle. Rally points are alternative RTL points. Items are MAV_CMD_RALLY_POINT rally point items.
  ALL = 255  % Only used in MISSION_CLEAR_ALL to clear all mission types.

MAV_ESTIMATOR_TYPE = enum(AddClassNameToEnumNames=true)  % Enumeration of estimator types
  NAIVE = 1  % This is a naive estimator without any real covariance feedback.
  VISION = 2  % Computer vision based estimate. Might be up to scale.
  VIO = 3  % Visual-inertial estimate.
  GPS = 4  % Plain GPS estimate.
  GPS_INS = 5  % Estimator integrating GPS and inertial sensing.

MAV_BATTERY_TYPE = enum(AddClassNameToEnumNames=true)  % Enumeration of battery types
  UNKNOWN = 0  % Not specified.
  LIPO = 1  % Lithium polymer battery
  LIFE = 2  % Lithium-iron-phosphate battery
  LION = 3  % Lithium-ION battery
  NIMH = 4  % Nickel metal hydride battery

MAV_BATTERY_FUNCTION = enum(AddClassNameToEnumNames=true)  % Enumeration of battery functions
  UNKNOWN = 0  % Battery function is unknown
  ALL = 1  % Battery supports all flight systems
  PROPULSION = 2  % Battery for the propulsion system
  AVIONICS = 3  % Avionics battery
  MAV_BATTERY_TYPE_PAYLOAD = 4  % Payload battery

MAV_BATTERY_CHARGE_STATE = enum(AddClassNameToEnumNames=true)  % Enumeration for low battery states.
  UNDEFINED = 0  % Low battery state is not provided
  OK = 1  % Battery is not in low state. Normal operation.
  LOW = 2  % Battery state is low, warn and monitor close.
  CRITICAL = 3  % Battery state is critical, return or abort immediately.
  EMERGENCY = 4  % Battery state is too low for ordinary abort sequence. Perform fastest possible emergency stop to prevent damage.
  FAILED = 5  % Battery failed, damage unavoidable.
  UNHEALTHY = 6  % Battery is diagnosed to be defective or an error occurred, usage is discouraged / prohibited.

MAV_VTOL_STATE = enum(AddClassNameToEnumNames=true)  % Enumeration of VTOL states
  UNDEFINED = 0  % MAV is not configured as VTOL
  TRANSITION_TO_FW = 1  % VTOL is in transition from multicopter to fixed-wing
  TRANSITION_TO_MC = 2  % VTOL is in transition from fixed-wing to multicopter
  MC = 3  % VTOL is in multicopter state
  FW = 4  % VTOL is in fixed-wing state

MAV_LANDED_STATE = enum(AddClassNameToEnumNames=true)  % Enumeration of landed detector states
  UNDEFINED = 0  % MAV landed state is unknown
  ON_GROUND = 1  % MAV is landed (on ground)
  IN_AIR = 2  % MAV is in air
  TAKEOFF = 3  % MAV currently taking off
  LANDING = 4  % MAV currently landing

MAV_ADSB_ALTITUDE_TYPE = enum(AddClassNameToEnumNames=true)  % Enumeration of the ADSB altimeter types
  PRESSURE_QNH = 0  % Altitude reported from a Baro source using QNH reference
  GEOMETRIC = 1  % Altitude reported from a GNSS source

MAV_ADSB_EMITTER_TYPE = enum(AddClassNameToEnumNames=true)  % ADSB classification for the type of vehicle emitting the transponder signal
  NO_INFO = 0
  LIGHT = 1
  SMALL = 2
  LARGE = 3
  HIGH_VORTEX_LARGE = 4
  HEAVY = 5
  HIGHLY_MANUV = 6
  ROTOCRAFT = 7
  UNASSIGNED = 8
  GLIDER = 9
  LIGHTER_AIR = 10
  PARACHUTE = 11
  ULTRA_LIGHT = 12
  UNASSIGNED2 = 13
  UAV = 14
  SPACE = 15
  UNASSGINED3 = 16
  EMERGENCY_SURFACE = 17
  SERVICE_SURFACE = 18
  POINT_OBSTACLE = 19

MAV_ADSB_FLAGS = enum(AddClassNameToEnumNames=true)  % These flags indicate status such as data validity of each data source. Set = data valid
  VALID_COORDS = 1
  VALID_ALTITUDE = 2
  VALID_HEADING = 4
  VALID_VELOCITY = 8
  VALID_CALLSIGN = 16
  VALID_SQUAWK = 32
  SIMULATED = 64

MAV_DO_REPOSITION_FLAGS = enum(AddClassNameToEnumNames=true)  % Bitmask of options for the MAV_CMD_DO_REPOSITION
  CHANGE_MODE = 1  % The aircraft should immediately transition into guided. This should not be set for follow me applications

MAV_ESTIMATOR_STATUS_FLAGS = enum(AddClassNameToEnumNames=true)  % Flags in EKF_STATUS message
  ESTIMATOR_ATTITUDE = 1  % True if the attitude estimate is good
  ESTIMATOR_VELOCITY_HORIZ = 2  % True if the horizontal velocity estimate is good
  ESTIMATOR_VELOCITY_VERT = 4  % True if the  vertical velocity estimate is good
  ESTIMATOR_POS_HORIZ_REL = 8  % True if the horizontal position (relative) estimate is good
  ESTIMATOR_POS_HORIZ_ABS = 16  % True if the horizontal position (absolute) estimate is good
  ESTIMATOR_POS_VERT_ABS = 32  % True if the vertical position (absolute) estimate is good
  ESTIMATOR_POS_VERT_AGL = 64  % True if the vertical position (above ground) estimate is good
  ESTIMATOR_CONST_POS_MODE = 128  % True if the EKF is in a constant position mode and is not using external measurements (eg GPS or optical flow)
  ESTIMATOR_PRED_POS_HORIZ_REL = 256  % True if the EKF has sufficient data to enter a mode that will provide a (relative) position estimate
  ESTIMATOR_PRED_POS_HORIZ_ABS = 512  % True if the EKF has sufficient data to enter a mode that will provide a (absolute) position estimate
  ESTIMATOR_GPS_GLITCH = 1024  % True if the EKF has detected a GPS glitch
  ESTIMATOR_ACCEL_ERROR = 2048  % True if the EKF has detected bad accelerometer data

MAV_MOTOR_TEST_ORDER = enum(AddClassNameToEnumNames=true)
  DEFAULT = 0  % default autopilot motor test method
  SEQUENCE = 1  % motor numbers are specified as their index in a predefined vehicle-specific sequence
  BOARD = 2  % motor numbers are specified as the output as labeled on the board

MAV_MOTOR_TEST_THROTTLE_TYPE = enum(AddClassNameToEnumNames=true)
  MOTOR_TEST_THROTTLE_PERCENT = 0  % throttle as a percentage from 0 ~ 100
  MOTOR_TEST_THROTTLE_PWM = 1  % throttle as an absolute PWM value (normally in range of 1000~2000)
  MOTOR_TEST_THROTTLE_PILOT = 2  % throttle pass-through from pilot's transmitter
  MOTOR_TEST_COMPASS_CAL = 3  % per-motor compass calibration test

MAV_GPS_INPUT_IGNORE_FLAGS = enum(AddClassNameToEnumNames=true)
  GPS_INPUT_IGNORE_FLAG_ALT = 1  % ignore altitude field
  GPS_INPUT_IGNORE_FLAG_HDOP = 2  % ignore hdop field
  GPS_INPUT_IGNORE_FLAG_VDOP = 4  % ignore vdop field
  GPS_INPUT_IGNORE_FLAG_VEL_HORIZ = 8  % ignore horizontal velocity field (vn and ve)
  GPS_INPUT_IGNORE_FLAG_VEL_VERT = 16  % ignore vertical velocity field (vd)
  GPS_INPUT_IGNORE_FLAG_SPEED_ACCURACY = 32  % ignore speed accuracy field
  GPS_INPUT_IGNORE_FLAG_HORIZONTAL_ACCURACY = 64  % ignore horizontal accuracy field
  GPS_INPUT_IGNORE_FLAG_VERTICAL_ACCURACY = 128  % ignore vertical accuracy field

MAV_COLLISION_ACTION = enum(AddClassNameToEnumNames=true)  % Possible actions an aircraft can take to avoid a collision.
  NONE = 0  % Ignore any potential collisions
  REPORT = 1  % Report potential collision
  ASCEND_OR_DESCEND = 2  % Ascend or Descend to avoid threat
  MOVE_HORIZONTALLY = 3  % Move horizontally to avoid threat
  MOVE_PERPENDICULAR = 4  % Aircraft to move perpendicular to the collision's velocity vector
  RTL = 5  % Aircraft to fly directly back to its launch point
  HOVER = 6  % Aircraft to stop in place

MAV_COLLISION_THREAT_LEVEL = enum(AddClassNameToEnumNames=true)  % Aircraft-rated danger from this threat.
  NONE = 0  % Not a threat
  LOW = 1  % Craft is mildly concerned about this threat
  HIGH = 2  % Craft is panicing, and may take actions to avoid threat

MAV_COLLISION_SRC = enum(AddClassNameToEnumNames=true)  % Source of information about this collision.
  ADSB = 0  % ID field references ADSB_VEHICLE packets
  MAVLINK_GPS_GLOBAL_INT = 1  % ID field references MAVLink SRC ID

MAV_GPS_FIX_TYPE = enum(AddClassNameToEnumNames=true)  % Type of GPS fix
  NO_GPS = 0  % No GPS connected
  NO_FIX = 1  % No position information, GPS is connected
  A2D_FIX = 2  % 2D position
  A3D_FIX = 3  % 3D position
  DGPS = 4  % DGPS/SBAS aided 3D position
  RTK_FLOAT = 5  % RTK float, 3D position
  RTK_FIXED = 6  % RTK Fixed, 3D position
  STATIC = 7  % Static fixed, typically used for base stations
  PPP = 8  % PPP, 3D position.

MAV_LANDING_TARGET_TYPE = enum(AddClassNameToEnumNames=true)  % Type of landing target
  LIGHT_BEACON = 0  % Landing target signaled by light beacon (ex: IR-LOCK)
  RADIO_BEACON = 1  % Landing target signaled by radio beacon (ex: ILS, NDB)
  VISION_FIDUCIAL = 2  % Landing target represented by a fiducial marker (ex: ARTag)
  VISION_OTHER = 3  % Landing target represented by a pre-defined visual shape/feature (ex: X-marker, H-marker, square)

MAV_VTOL_TRANSITION_HEADING = enum(AddClassNameToEnumNames=true)  % Direction of VTOL transition
  VEHICLE_DEFAULT = 0  % Respect the heading configuration of the vehicle.
  NEXT_WAYPOINT = 1  % Use the heading pointing towards the next waypoint.
  TAKEOFF = 2  % Use the heading on takeoff (while sitting on the ground).
  SPECIFIED = 3  % Use the specified heading in parameter 4.
  ANY = 4  % Use the current heading when reaching takeoff altitude (potentially facing the wind when weather-vaning is active).

MAV_CAMERA_CAP_FLAGS = enum(AddClassNameToEnumNames=true)  % Camera capability flags (Bitmap).
  CAPTURE_VIDEO = 1  % Camera is able to record video.
  CAPTURE_IMAGE = 2  % Camera is able to capture images.
  HAS_MODES = 4  % Camera has separate Video and Image/Photo modes (MAV_CMD_SET_CAMERA_MODE)
  CAN_CAPTURE_IMAGE_IN_VIDEO_MODE = 8  % Camera can capture images while in video mode
  CAN_CAPTURE_VIDEO_IN_IMAGE_MODE = 16  % Camera can capture videos while in Photo/Image mode
  HAS_IMAGE_SURVEY_MODE = 32  % Camera has image survey mode (MAV_CMD_SET_CAMERA_MODE)

MAV_PARAM_ACK = enum(AddClassNameToEnumNames=true)  % Result from a PARAM_EXT_SET message.
  ACCEPTED = 0  % Parameter value ACCEPTED and SET
  VALUE_UNSUPPORTED = 1  % Parameter value UNKNOWN/UNSUPPORTED
  FAILED = 2  % Parameter failed to set
  IN_PROGRESS = 3  % Parameter value received but not yet validated or set. A subsequent PARAM_EXT_ACK will follow once operation is completed with the actual result. These are for parameters that may take longer to set. Instead of waiting for an ACK and potentially timing out, you will immediately receive this response to let you know it was received.

MAV_CAMERA_MODE = enum(AddClassNameToEnumNames=true)  % Camera Modes.
  IMAGE = 0  % Camera is in image/photo capture mode.
  VIDEO = 1  % Camera is in video capture mode.
  IMAGE_SURVEY = 2  % Camera is in image survey capture mode. It allows for camera controller to do specific settings for surveys.

MAV_ARM_AUTH_DENIED_REASON = enum(AddClassNameToEnumNames=true)
  GENERIC = 0  % Not a specific reason
  NONE = 1  % Authorizer will send the error as string to GCS
  INVALID_WAYPOINT = 2  % At least one waypoint have a invalid value
  TIMEOUT = 3  % Timeout in the authorizer process(in case it depends on network)
  AIRSPACE_IN_USE = 4  % Airspace of the mission in use by another vehicle, second result parameter can have the waypoint id that caused it to be denied.
  BAD_WEATHER = 5  % Weather is not good to fly

MAV_RTK_BASELINE_COORDINATE_SYSTEM = enum(AddClassNameToEnumNames=true)  % RTK GPS baseline coordinate system, used for RTK corrections
  ECEF = 0  % Earth-centered, Earth-fixed
  NED = 1  % North, East, Down

MAV_RC_TYPE = enum(AddClassNameToEnumNames=true)  % RC type
  SPEKTRUM_DSM2 = 0  % Spektrum DSM2
  SPEKTRUM_DSMX = 1  % Spektrum DSMX

mav_frame = Simulink.Bus()
  stx: uint8
  len: uint8
  seq: uint8
  sysid: uint8
  cmpid: uint8
  msgid: uint8
  payload: Bus: mav_payload
  cha: uint8
  chb: uint8

mav_heartbeat = Simulink.Bus()  % The heartbeat message shows that a system is present and responding. The type of the MAV and Autopilot hardware allow the receiving system to treat further messages from this system appropriate (e.g. by laying out the user interface based on the autopilot).
  type: uint8  % Type of the MAV (quadrotor, helicopter, etc., up to 15 types, defined in MAV_TYPE ENUM)
  autopilot: uint8  % Autopilot type / class. defined in MAV_AUTOPILOT ENUM
  base_mode: uint8  % System mode bitfield, as defined by MAV_MODE_FLAG enum
  custom_mode: uint32  % A bitfield for use for autopilot-specific flags
  system_status: uint8  % System status flag, as defined by MAV_STATE enum
  mavlink_version: uint8_t_mavlink_version  % MAVLink version, not writable by user, gets added by protocol because of magic data type: uint8_t_mavlink_version

mav_sys_status = Simulink.Bus()  % The general system state. If the system is following the MAVLink standard, the system state is mainly defined by three orthogonal states/modes: The system mode, which is either LOCKED (motors shut down and locked), MANUAL (system under RC control), GUIDED (system with autonomous position control, position setpoint controlled manually) or AUTO (system guided by path/waypoint planner). The NAV_MODE defined the current flight state: LIFTOFF (often an open-loop maneuver), LANDING, WAYPOINTS or VECTOR. This represents the internal navigation state machine. The system status shows whether the system is currently active or not and if an emergency occured. During the CRITICAL and EMERGENCY states the MAV is still considered to be active, but should start emergency procedures autonomously. After a failure occured it should first move from active to critical to allow manual intervention and then move to emergency after a certain timeout.
  onboard_control_sensors_present: uint32  % Bitmask showing which onboard controllers and sensors are present. Value of 0: not present. Value of 1: present. Indices defined by ENUM MAV_SYS_STATUS_SENSOR
  onboard_control_sensors_enabled: uint32  % Bitmask showing which onboard controllers and sensors are enabled:  Value of 0: not enabled. Value of 1: enabled. Indices defined by ENUM MAV_SYS_STATUS_SENSOR
  onboard_control_sensors_health: uint32  % Bitmask showing which onboard controllers and sensors are operational or have an error:  Value of 0: not enabled. Value of 1: enabled. Indices defined by ENUM MAV_SYS_STATUS_SENSOR
  load: uint16  % Maximum usage in percent of the mainloop time, (0%: 0, 100%: 1000) should be always below 1000
  voltage_battery: uint16  % Battery voltage, in millivolts (1 = 1 millivolt)
  current_battery: int16  % Battery current, in 10*milliamperes (1 = 10 milliampere), -1: autopilot does not measure the current
  battery_remaining: int8_t  % Remaining battery energy: (0%: 0, 100%: 100), -1: autopilot estimate the remaining battery
  drop_rate_comm: uint16  % Communication drops in percent, (0%: 0, 100%: 10'000), (UART, I2C, SPI, CAN), dropped packets on all links (packets that were corrupted on reception on the MAV)
  errors_comm: uint16  % Communication errors (UART, I2C, SPI, CAN), dropped packets on all links (packets that were corrupted on reception on the MAV)
  errors_count1: uint16  % Autopilot-specific errors
  errors_count2: uint16  % Autopilot-specific errors
  errors_count3: uint16  % Autopilot-specific errors
  errors_count4: uint16  % Autopilot-specific errors

mav_system_time = Simulink.Bus()  % The system time is the time of the master clock, typically the computer clock of the main onboard computer.
  time_unix_usec: fixdt(0,64,0)  % Timestamp of the master clock in microseconds since UNIX epoch.
  time_boot_ms: uint32  % Timestamp of the component clock since boot time in milliseconds.

mav_ping = Simulink.Bus()  % A ping message either requesting or responding to a ping. This allows to measure the system latencies, including serial port, radio modem and UDP connections.
  time_usec: fixdt(0,64,0)  % Unix timestamp in microseconds or since system boot if smaller than MAVLink epoch (1.1.2009)
  seq: uint32  % PING sequence
  target_system: uint8  % 0: request ping from all receiving systems, if greater than 0: message is a ping response and number is the system id of the requesting system
  target_component: uint8  % 0: request ping from all receiving components, if greater than 0: message is a ping response and number is the system id of the requesting system

mav_change_operator_control = Simulink.Bus()  % Request to control this MAV
  target_system: uint8  % System the GCS requests control for
  control_request: uint8  % 0: request control of this MAV, 1: Release control of this MAV
  version: uint8  % 0: key as plaintext, 1-255: future, different hashing/encryption variants. The GCS should in general use the safest mode possible initially and then gradually move down the encryption level if it gets a NACK message indicating an encryption mismatch.
  passkey: int8[25]  % Password / Key, depending on version plaintext or encrypted. 25 or less characters, NULL terminated. The characters may involve A-Z, a-z, 0-9, and "!?,.-"

mav_change_operator_control_ack = Simulink.Bus()  % Accept / deny control of this MAV
  gcs_system_id: uint8  % ID of the GCS this message
  control_request: uint8  % 0: request control of this MAV, 1: Release control of this MAV
  ack: uint8  % 0: ACK, 1: NACK: Wrong passkey, 2: NACK: Unsupported passkey encryption method, 3: NACK: Already under control

mav_auth_key = Simulink.Bus()  % Emit an encrypted signature / key identifying this system. PLEASE NOTE: This protocol has been kept simple, so transmitting the key requires an encrypted channel for true safety.
  key: int8[32]  % key

mav_set_mode = Simulink.Bus()  % THIS INTERFACE IS DEPRECATED. USE COMMAND_LONG with MAV_CMD_DO_SET_MODE INSTEAD. Set the system mode, as defined by enum MAV_MODE. There is no target component id as the mode is by definition for the overall aircraft, not only for one component.
  target_system: uint8  % The system setting the mode
  base_mode: uint8  % The new base mode
  custom_mode: uint32  % The new autopilot-specific mode. This field can be ignored by an autopilot.

mav_param_request_read = Simulink.Bus()  % Request to read the onboard parameter with the param_id string id. Onboard parameters are stored as key[const char*] -> value[float]. This allows to send a parameter to any other component (such as the GCS) without the need of previous knowledge of possible parameter names. Thus the same GCS can store different parameters for different autopilots. See also https://mavlink.io/en/protocol/parameter.html for a full documentation of QGroundControl and IMU code.
  target_system: uint8  % System ID
  target_component: uint8  % Component ID
  param_id: int8[16]  % Onboard parameter id, terminated by NULL if the length is less than 16 human-readable chars and WITHOUT null termination (NULL) byte if the length is exactly 16 chars - applications have to provide 16+1 bytes storage if the ID is stored as string
  param_index: int16  % Parameter index. Send -1 to use the param ID field as identifier (else the param id will be ignored)

mav_param_request_list = Simulink.Bus()  % Request all parameters of this component. After this request, all parameters are emitted.
  target_system: uint8  % System ID
  target_component: uint8  % Component ID

mav_param_value = Simulink.Bus()  % Emit the value of a onboard parameter. The inclusion of param_count and param_index in the message allows the recipient to keep track of received parameters and allows him to re-request missing parameters after a loss or timeout.
  param_id: int8[16]  % Onboard parameter id, terminated by NULL if the length is less than 16 human-readable chars and WITHOUT null termination (NULL) byte if the length is exactly 16 chars - applications have to provide 16+1 bytes storage if the ID is stored as string
  param_value: single  % Onboard parameter value
  param_type: uint8  % Onboard parameter type: see the MAV_PARAM_TYPE enum for supported data types.
  param_count: uint16  % Total number of onboard parameters
  param_index: uint16  % Index of this onboard parameter

mav_param_set = Simulink.Bus()  % Set a parameter value TEMPORARILY to RAM. It will be reset to default on system reboot. Send the ACTION MAV_ACTION_STORAGE_WRITE to PERMANENTLY write the RAM contents to EEPROM. IMPORTANT: The receiving component should acknowledge the new parameter value by sending a param_value message to all communication partners. This will also ensure that multiple GCS all have an up-to-date list of all parameters. If the sending GCS did not receive a PARAM_VALUE message within its timeout time, it should re-send the PARAM_SET message.
  target_system: uint8  % System ID
  target_component: uint8  % Component ID
  param_id: int8[16]  % Onboard parameter id, terminated by NULL if the length is less than 16 human-readable chars and WITHOUT null termination (NULL) byte if the length is exactly 16 chars - applications have to provide 16+1 bytes storage if the ID is stored as string
  param_value: single  % Onboard parameter value
  param_type: uint8  % Onboard parameter type: see the MAV_PARAM_TYPE enum for supported data types.

mav_gps_raw_int = Simulink.Bus()  % The global position, as returned by the Global Positioning System (GPS). This is
  % NOT the global position estimate of the system, but rather a RAW sensor value. See message GLOBAL_POSITION for the global position estimate.
  time_usec: fixdt(0,64,0)  % Timestamp (microseconds since UNIX epoch or microseconds since system boot)
  fix_type: uint8  % See the GPS_FIX_TYPE enum.
  lat: int32  % Latitude (WGS84, EGM96 ellipsoid), in degrees * 1E7
  lon: int32  % Longitude (WGS84, EGM96 ellipsoid), in degrees * 1E7
  alt: int32  % Altitude (AMSL, NOT WGS84), in meters * 1000 (positive for up). Note that virtually all GPS modules provide the AMSL altitude in addition to the WGS84 altitude.
  eph: uint16  % GPS HDOP horizontal dilution of position (unitless). If unknown, set to: UINT16_MAX
  epv: uint16  % GPS VDOP vertical dilution of position (unitless). If unknown, set to: UINT16_MAX
  vel: uint16  % GPS ground speed (m/s * 100). If unknown, set to: UINT16_MAX
  cog: uint16  % Course over ground (NOT heading, but direction of movement) in degrees * 100, 0.0..359.99 degrees. If unknown, set to: UINT16_MAX
  satellites_visible: uint8  % Number of satellites visible. If unknown, set to 255
  alt_ellipsoid: int32  % Altitude (above WGS84, EGM96 ellipsoid), in meters * 1000 (positive for up).
  h_acc: uint32  % Position uncertainty in meters * 1000 (positive for up).
  v_acc: uint32  % Altitude uncertainty in meters * 1000 (positive for up).
  vel_acc: uint32  % Speed uncertainty in meters * 1000 (positive for up).
  hdg_acc: uint32  % Heading / track uncertainty in degrees * 1e5.

mav_gps_status = Simulink.Bus()  % The positioning status, as reported by GPS. This message is intended to display status information about each satellite visible to the receiver. See message GLOBAL_POSITION for the global position estimate. This message can contain information for up to 20 satellites.
  satellites_visible: uint8  % Number of satellites visible
  satellite_prn: uint8[20]  % Global satellite ID
  satellite_used: uint8[20]  % 0: Satellite not used, 1: used for localization
  satellite_elevation: uint8[20]  % Elevation (0: right on top of receiver, 90: on the horizon) of satellite
  satellite_azimuth: uint8[20]  % Direction of satellite, 0: 0 deg, 255: 360 deg.
  satellite_snr: uint8[20]  % Signal to noise ratio of satellite

mav_scaled_imu = Simulink.Bus()  % The RAW IMU readings for the usual 9DOF sensor setup. This message should contain the scaled values to the described units
  time_boot_ms: uint32  % Timestamp (milliseconds since system boot)
  xacc: int16  % X acceleration (mg)
  yacc: int16  % Y acceleration (mg)
  zacc: int16  % Z acceleration (mg)
  xgyro: int16  % Angular speed around X axis (millirad /sec)
  ygyro: int16  % Angular speed around Y axis (millirad /sec)
  zgyro: int16  % Angular speed around Z axis (millirad /sec)
  xmag: int16  % X Magnetic field (milli tesla)
  ymag: int16  % Y Magnetic field (milli tesla)
  zmag: int16  % Z Magnetic field (milli tesla)

mav_raw_imu = Simulink.Bus()  % The RAW IMU readings for the usual 9DOF sensor setup. This message should always contain the true raw values without any scaling to allow data capture and system debugging.
  time_usec: fixdt(0,64,0)  % Timestamp (microseconds since UNIX epoch or microseconds since system boot)
  xacc: int16  % X acceleration (raw)
  yacc: int16  % Y acceleration (raw)
  zacc: int16  % Z acceleration (raw)
  xgyro: int16  % Angular speed around X axis (raw)
  ygyro: int16  % Angular speed around Y axis (raw)
  zgyro: int16  % Angular speed around Z axis (raw)
  xmag: int16  % X Magnetic field (raw)
  ymag: int16  % Y Magnetic field (raw)
  zmag: int16  % Z Magnetic field (raw)

mav_raw_pressure = Simulink.Bus()  % The RAW pressure readings for the typical setup of one absolute pressure and one differential pressure sensor. The sensor values should be the raw, UNSCALED ADC values.
  time_usec: fixdt(0,64,0)  % Timestamp (microseconds since UNIX epoch or microseconds since system boot)
  press_abs: int16  % Absolute pressure (raw)
  press_diff1: int16  % Differential pressure 1 (raw, 0 if nonexistant)
  press_diff2: int16  % Differential pressure 2 (raw, 0 if nonexistant)
  temperature: int16  % Raw Temperature measurement (raw)

mav_scaled_pressure = Simulink.Bus()  % The pressure readings for the typical setup of one absolute and differential pressure sensor. The units are as specified in each field.
  time_boot_ms: uint32  % Timestamp (milliseconds since system boot)
  press_abs: single  % Absolute pressure (hectopascal)
  press_diff: single  % Differential pressure 1 (hectopascal)
  temperature: int16  % Temperature measurement (0.01 degrees celsius)

mav_attitude = Simulink.Bus()  % The attitude in the aeronautical frame (right-handed, Z-down, X-front, Y-right).
  time_boot_ms: uint32  % Timestamp (milliseconds since system boot)
  roll: single  % Roll angle (rad, -pi..+pi)
  pitch: single  % Pitch angle (rad, -pi..+pi)
  yaw: single  % Yaw angle (rad, -pi..+pi)
  rollspeed: single  % Roll angular speed (rad/s)
  pitchspeed: single  % Pitch angular speed (rad/s)
  yawspeed: single  % Yaw angular speed (rad/s)

mav_attitude_quaternion = Simulink.Bus()  % The attitude in the aeronautical frame (right-handed, Z-down, X-front, Y-right), expressed as quaternion. Quaternion order is w, x, y, z and a zero rotation would be expressed as (1 0 0 0).
  time_boot_ms: uint32  % Timestamp (milliseconds since system boot)
  q1: single  % Quaternion component 1, w (1 in null-rotation)
  q2: single  % Quaternion component 2, x (0 in null-rotation)
  q3: single  % Quaternion component 3, y (0 in null-rotation)
  q4: single  % Quaternion component 4, z (0 in null-rotation)
  rollspeed: single  % Roll angular speed (rad/s)
  pitchspeed: single  % Pitch angular speed (rad/s)
  yawspeed: single  % Yaw angular speed (rad/s)

mav_local_position_ned = Simulink.Bus()  % The filtered local position (e.g. fused computer vision and accelerometers). Coordinate frame is right-handed, Z-axis down (aeronautical frame, NED / north-east-down convention)
  time_boot_ms: uint32  % Timestamp (milliseconds since system boot)
  x: single  % X Position
  y: single  % Y Position
  z: single  % Z Position
  vx: single  % X Speed
  vy: single  % Y Speed
  vz: single  % Z Speed

mav_global_position_int = Simulink.Bus()  % The filtered global position (e.g. fused GPS and accelerometers). The position is in GPS-frame (right-handed, Z-up). It
  % is designed as scaled integer message since the resolution of float is not sufficient.
  time_boot_ms: uint32  % Timestamp (milliseconds since system boot)
  lat: int32  % Latitude, expressed as degrees * 1E7
  lon: int32  % Longitude, expressed as degrees * 1E7
  alt: int32  % Altitude in meters, expressed as * 1000 (millimeters), AMSL (not WGS84 - note that virtually all GPS modules provide the AMSL as well)
  relative_alt: int32  % Altitude above ground in meters, expressed as * 1000 (millimeters)
  vx: int16  % Ground X Speed (Latitude, positive north), expressed as m/s * 100
  vy: int16  % Ground Y Speed (Longitude, positive east), expressed as m/s * 100
  vz: int16  % Ground Z Speed (Altitude, positive down), expressed as m/s * 100
  hdg: uint16  % Vehicle heading (yaw angle) in degrees * 100, 0.0..359.99 degrees. If unknown, set to: UINT16_MAX

mav_rc_channels_scaled = Simulink.Bus()  % The scaled values of the RC channels received. (-100%) -10000, (0%) 0, (100%) 10000. Channels that are inactive should be set to UINT16_MAX.
  time_boot_ms: uint32  % Timestamp (milliseconds since system boot)
  port: uint8  % Servo output port (set of 8 outputs = 1 port). Most MAVs will just use one, but this allows for more than 8 servos.
  chan1_scaled: int16  % RC channel 1 value scaled, (-100%) -10000, (0%) 0, (100%) 10000, (invalid) INT16_MAX.
  chan2_scaled: int16  % RC channel 2 value scaled, (-100%) -10000, (0%) 0, (100%) 10000, (invalid) INT16_MAX.
  chan3_scaled: int16  % RC channel 3 value scaled, (-100%) -10000, (0%) 0, (100%) 10000, (invalid) INT16_MAX.
  chan4_scaled: int16  % RC channel 4 value scaled, (-100%) -10000, (0%) 0, (100%) 10000, (invalid) INT16_MAX.
  chan5_scaled: int16  % RC channel 5 value scaled, (-100%) -10000, (0%) 0, (100%) 10000, (invalid) INT16_MAX.
  chan6_scaled: int16  % RC channel 6 value scaled, (-100%) -10000, (0%) 0, (100%) 10000, (invalid) INT16_MAX.
  chan7_scaled: int16  % RC channel 7 value scaled, (-100%) -10000, (0%) 0, (100%) 10000, (invalid) INT16_MAX.
  chan8_scaled: int16  % RC channel 8 value scaled, (-100%) -10000, (0%) 0, (100%) 10000, (invalid) INT16_MAX.
  rssi: uint8  % Receive signal strength indicator, 0: 0%, 100: 100%, 255: invalid/unknown.

mav_rc_channels_raw = Simulink.Bus()  % The RAW values of the RC channels received. The standard PPM modulation is as follows: 1000 microseconds: 0%, 2000 microseconds: 100%. Individual receivers/transmitters might violate this specification.
  time_boot_ms: uint32  % Timestamp (milliseconds since system boot)
  port: uint8  % Servo output port (set of 8 outputs = 1 port). Most MAVs will just use one, but this allows for more than 8 servos.
  chan1_raw: uint16  % RC channel 1 value, in microseconds. A value of UINT16_MAX implies the channel is unused.
  chan2_raw: uint16  % RC channel 2 value, in microseconds. A value of UINT16_MAX implies the channel is unused.
  chan3_raw: uint16  % RC channel 3 value, in microseconds. A value of UINT16_MAX implies the channel is unused.
  chan4_raw: uint16  % RC channel 4 value, in microseconds. A value of UINT16_MAX implies the channel is unused.
  chan5_raw: uint16  % RC channel 5 value, in microseconds. A value of UINT16_MAX implies the channel is unused.
  chan6_raw: uint16  % RC channel 6 value, in microseconds. A value of UINT16_MAX implies the channel is unused.
  chan7_raw: uint16  % RC channel 7 value, in microseconds. A value of UINT16_MAX implies the channel is unused.
  chan8_raw: uint16  % RC channel 8 value, in microseconds. A value of UINT16_MAX implies the channel is unused.
  rssi: uint8  % Receive signal strength indicator, 0: 0%, 100: 100%, 255: invalid/unknown.

mav_servo_output_raw = Simulink.Bus()  % The RAW values of the servo outputs (for RC input from the remote, use the RC_CHANNELS messages). The standard PPM modulation is as follows: 1000 microseconds: 0%, 2000 microseconds: 100%.
  time_usec: uint32  % Timestamp (microseconds since system boot)
  port: uint8  % Servo output port (set of 8 outputs = 1 port). Most MAVs will just use one, but this allows to encode more than 8 servos.
  servo1_raw: uint16  % Servo output 1 value, in microseconds
  servo2_raw: uint16  % Servo output 2 value, in microseconds
  servo3_raw: uint16  % Servo output 3 value, in microseconds
  servo4_raw: uint16  % Servo output 4 value, in microseconds
  servo5_raw: uint16  % Servo output 5 value, in microseconds
  servo6_raw: uint16  % Servo output 6 value, in microseconds
  servo7_raw: uint16  % Servo output 7 value, in microseconds
  servo8_raw: uint16  % Servo output 8 value, in microseconds
  servo9_raw: uint16  % Servo output 9 value, in microseconds
  servo10_raw: uint16  % Servo output 10 value, in microseconds
  servo11_raw: uint16  % Servo output 11 value, in microseconds
  servo12_raw: uint16  % Servo output 12 value, in microseconds
  servo13_raw: uint16  % Servo output 13 value, in microseconds
  servo14_raw: uint16  % Servo output 14 value, in microseconds
  servo15_raw: uint16  % Servo output 15 value, in microseconds
  servo16_raw: uint16  % Servo output 16 value, in microseconds

mav_mission_request_partial_list = Simulink.Bus()  % Request a partial list of mission items from the system/component. https://mavlink.io/en/protocol/mission.html. If start and end index are the same, just send one waypoint.
  target_system: uint8  % System ID
  target_component: uint8  % Component ID
  start_index: int16  % Start index, 0 by default
  end_index: int16  % End index, -1 by default (-1: send list to end). Else a valid index of the list
  mission_type: uint8  % Mission type, see MAV_MISSION_TYPE

mav_mission_write_partial_list = Simulink.Bus()  % This message is sent to the MAV to write a partial list. If start index == end index, only one item will be transmitted / updated. If the start index is NOT 0 and above the current list size, this request should be REJECTED!
  target_system: uint8  % System ID
  target_component: uint8  % Component ID
  start_index: int16  % Start index, 0 by default and smaller / equal to the largest index of the current onboard list.
  end_index: int16  % End index, equal or greater than start index.
  mission_type: uint8  % Mission type, see MAV_MISSION_TYPE

mav_mission_item = Simulink.Bus()  % Message encoding a mission item. This message is emitted to announce
  % the presence of a mission item and to set a mission item on the system. The mission item can be either in x, y, z meters (type: LOCAL) or x:lat, y:lon, z:altitude. Local frame is Z-down, right handed (NED), global frame is Z-up, right handed (ENU). See also https://mavlink.io/en/protocol/mission.html.
  target_system: uint8  % System ID
  target_component: uint8  % Component ID
  seq: uint16  % Sequence
  frame: uint8  % The coordinate system of the waypoint, as defined by MAV_FRAME enum
  command: uint16  % The scheduled action for the waypoint, as defined by MAV_CMD enum
  current: uint8  % false:0, true:1
  autocontinue: uint8  % autocontinue to next wp
  param1: single  % PARAM1, see MAV_CMD enum
  param2: single  % PARAM2, see MAV_CMD enum
  param3: single  % PARAM3, see MAV_CMD enum
  param4: single  % PARAM4, see MAV_CMD enum
  x: single  % PARAM5 / local: x position, global: latitude
  y: single  % PARAM6 / y position: global: longitude
  z: single  % PARAM7 / z position: global: altitude (relative or absolute, depending on frame.
  mission_type: uint8  % Mission type, see MAV_MISSION_TYPE

mav_mission_request = Simulink.Bus()  % Request the information of the mission item with the sequence number seq. The response of the system to this message should be a MISSION_ITEM message. https://mavlink.io/en/protocol/mission.html
  target_system: uint8  % System ID
  target_component: uint8  % Component ID
  seq: uint16  % Sequence
  mission_type: uint8  % Mission type, see MAV_MISSION_TYPE

mav_mission_set_current = Simulink.Bus()  % Set the mission item with sequence number seq as current item. This means that the MAV will continue to this mission item on the shortest path (not following the mission items in-between).
  target_system: uint8  % System ID
  target_component: uint8  % Component ID
  seq: uint16  % Sequence

mav_mission_current = Simulink.Bus()  % Message that announces the sequence number of the current active mission item. The MAV will fly towards this mission item.
  seq: uint16  % Sequence

mav_mission_request_list = Simulink.Bus()  % Request the overall list of mission items from the system/component.
  target_system: uint8  % System ID
  target_component: uint8  % Component ID
  mission_type: uint8  % Mission type, see MAV_MISSION_TYPE

mav_mission_count = Simulink.Bus()  % This message is emitted as response to MISSION_REQUEST_LIST by the MAV and to initiate a write transaction. The GCS can then request the individual mission item based on the knowledge of the total number of waypoints.
  target_system: uint8  % System ID
  target_component: uint8  % Component ID
  count: uint16  % Number of mission items in the sequence
  mission_type: uint8  % Mission type, see MAV_MISSION_TYPE

mav_mission_clear_all = Simulink.Bus()  % Delete all mission items at once.
  target_system: uint8  % System ID
  target_component: uint8  % Component ID
  mission_type: uint8  % Mission type, see MAV_MISSION_TYPE

mav_mission_item_reached = Simulink.Bus()  % A certain mission item has been reached. The system will either hold this position (or circle on the orbit) or (if the autocontinue on the WP was set) continue to the next waypoint.
  seq: uint16  % Sequence

mav_mission_ack = Simulink.Bus()  % Ack message during waypoint handling. The type field states if this message is a positive ack (type=0) or if an error happened (type=non-zero).
  target_system: uint8  % System ID
  target_component: uint8  % Component ID
  type: uint8  % See MAV_MISSION_RESULT enum
  mission_type: uint8  % Mission type, see MAV_MISSION_TYPE

mav_set_gps_global_origin = Simulink.Bus()  % As local waypoints exist, the global waypoint reference allows to transform between the local coordinate frame and the global (GPS) coordinate frame. This can be necessary when e.g. in- and outdoor settings are connected and the MAV should move from in- to outdoor.
  target_system: uint8  % System ID
  latitude: int32  % Latitude (WGS84), in degrees * 1E7
  longitude: int32  % Longitude (WGS84), in degrees * 1E7
  altitude: int32  % Altitude (AMSL), in meters * 1000 (positive for up)
  time_usec: fixdt(0,64,0)  % Timestamp (microseconds since UNIX epoch or microseconds since system boot)

mav_gps_global_origin = Simulink.Bus()  % Once the MAV sets a new GPS-Local correspondence, this message announces the origin (0,0,0) position
  latitude: int32  % Latitude (WGS84), in degrees * 1E7
  longitude: int32  % Longitude (WGS84), in degrees * 1E7
  altitude: int32  % Altitude (AMSL), in meters * 1000 (positive for up)
  time_usec: fixdt(0,64,0)  % Timestamp (microseconds since UNIX epoch or microseconds since system boot)

mav_param_map_rc = Simulink.Bus()  % Bind a RC channel to a parameter. The parameter should change accoding to the RC channel value.
  target_system: uint8  % System ID
  target_component: uint8  % Component ID
  param_id: int8[16]  % Onboard parameter id, terminated by NULL if the length is less than 16 human-readable chars and WITHOUT null termination (NULL) byte if the length is exactly 16 chars - applications have to provide 16+1 bytes storage if the ID is stored as string
  param_index: int16  % Parameter index. Send -1 to use the param ID field as identifier (else the param id will be ignored), send -2 to disable any existing map for this rc_channel_index.
  parameter_rc_channel_index: uint8  % Index of parameter RC channel. Not equal to the RC channel id. Typically correpsonds to a potentiometer-knob on the RC.
  param_value0: single  % Initial parameter value
  scale: single  % Scale, maps the RC range [-1, 1] to a parameter value
  param_value_min: single  % Minimum param value. The protocol does not define if this overwrites an onboard minimum value. (Depends on implementation)
  param_value_max: single  % Maximum param value. The protocol does not define if this overwrites an onboard maximum value. (Depends on implementation)

mav_mission_request_int = Simulink.Bus()  % Request the information of the mission item with the sequence number seq. The response of the system to this message should be a MISSION_ITEM_INT message. https://mavlink.io/en/protocol/mission.html
  target_system: uint8  % System ID
  target_component: uint8  % Component ID
  seq: uint16  % Sequence
  mission_type: uint8  % Mission type, see MAV_MISSION_TYPE

mav_safety_set_allowed_area = Simulink.Bus()  % Set a safety zone (volume), which is defined by two corners of a cube. This message can be used to tell the MAV which setpoints/waypoints to accept and which to reject. Safety areas are often enforced by national or competition regulations.
  target_system: uint8  % System ID
  target_component: uint8  % Component ID
  frame: uint8  % Coordinate frame, as defined by MAV_FRAME enum. Can be either global, GPS, right-handed with Z axis up or local, right handed, Z axis down.
  p1x: single  % x position 1 / Latitude 1
  p1y: single  % y position 1 / Longitude 1
  p1z: single  % z position 1 / Altitude 1
  p2x: single  % x position 2 / Latitude 2
  p2y: single  % y position 2 / Longitude 2
  p2z: single  % z position 2 / Altitude 2

mav_safety_allowed_area = Simulink.Bus()  % Read out the safety zone the MAV currently assumes.
  frame: uint8  % Coordinate frame, as defined by MAV_FRAME enum. Can be either global, GPS, right-handed with Z axis up or local, right handed, Z axis down.
  p1x: single  % x position 1 / Latitude 1
  p1y: single  % y position 1 / Longitude 1
  p1z: single  % z position 1 / Altitude 1
  p2x: single  % x position 2 / Latitude 2
  p2y: single  % y position 2 / Longitude 2
  p2z: single  % z position 2 / Altitude 2

mav_attitude_quaternion_cov = Simulink.Bus()  % The attitude in the aeronautical frame (right-handed, Z-down, X-front, Y-right), expressed as quaternion. Quaternion order is w, x, y, z and a zero rotation would be expressed as (1 0 0 0).
  time_usec: fixdt(0,64,0)  % Timestamp (microseconds since system boot or since UNIX epoch)
  q: single[4]  % Quaternion components, w, x, y, z (1 0 0 0 is the null-rotation)
  rollspeed: single  % Roll angular speed (rad/s)
  pitchspeed: single  % Pitch angular speed (rad/s)
  yawspeed: single  % Yaw angular speed (rad/s)
  covariance: single[9]  % Attitude covariance

mav_nav_controller_output = Simulink.Bus()  % The state of the fixed wing navigation and position controller.
  nav_roll: single  % Current desired roll in degrees
  nav_pitch: single  % Current desired pitch in degrees
  nav_bearing: int16  % Current desired heading in degrees
  target_bearing: int16  % Bearing to current waypoint/target in degrees
  wp_dist: uint16  % Distance to active waypoint in meters
  alt_error: single  % Current altitude error in meters
  aspd_error: single  % Current airspeed error in meters/second
  xtrack_error: single  % Current crosstrack error on x-y plane in meters

mav_global_position_int_cov = Simulink.Bus()  % The filtered global position (e.g. fused GPS and accelerometers). The position is in GPS-frame (right-handed, Z-up). It  is designed as scaled integer message since the resolution of float is not sufficient. NOTE: This message is intended for onboard networks / companion computers and higher-bandwidth links and optimized for accuracy and completeness. Please use the GLOBAL_POSITION_INT message for a minimal subset.
  time_usec: fixdt(0,64,0)  % Timestamp (microseconds since system boot or since UNIX epoch)
  estimator_type: uint8  % Class id of the estimator this estimate originated from.
  lat: int32  % Latitude, expressed as degrees * 1E7
  lon: int32  % Longitude, expressed as degrees * 1E7
  alt: int32  % Altitude in meters, expressed as * 1000 (millimeters), above MSL
  relative_alt: int32  % Altitude above ground in meters, expressed as * 1000 (millimeters)
  vx: single  % Ground X Speed (Latitude), expressed as m/s
  vy: single  % Ground Y Speed (Longitude), expressed as m/s
  vz: single  % Ground Z Speed (Altitude), expressed as m/s
  covariance: single[36]  % Covariance matrix (first six entries are the first ROW, next six entries are the second row, etc.)

mav_local_position_ned_cov = Simulink.Bus()  % The filtered local position (e.g. fused computer vision and accelerometers). Coordinate frame is right-handed, Z-axis down (aeronautical frame, NED / north-east-down convention)
  time_usec: fixdt(0,64,0)  % Timestamp (microseconds since system boot or since UNIX epoch)
  estimator_type: uint8  % Class id of the estimator this estimate originated from.
  x: single  % X Position
  y: single  % Y Position
  z: single  % Z Position
  vx: single  % X Speed (m/s)
  vy: single  % Y Speed (m/s)
  vz: single  % Z Speed (m/s)
  ax: single  % X Acceleration (m/s^2)
  ay: single  % Y Acceleration (m/s^2)
  az: single  % Z Acceleration (m/s^2)
  covariance: single[45]  % Covariance matrix upper right triangular (first nine entries are the first ROW, next eight entries are the second row, etc.)

mav_rc_channels = Simulink.Bus()  % The PPM values of the RC channels received. The standard PPM modulation is as follows: 1000 microseconds: 0%, 2000 microseconds: 100%. Individual receivers/transmitters might violate this specification.
  time_boot_ms: uint32  % Timestamp (milliseconds since system boot)
  chancount: uint8  % Total number of RC channels being received. This can be larger than 18, indicating that more channels are available but not given in this message. This value should be 0 when no RC channels are available.
  chan1_raw: uint16  % RC channel 1 value, in microseconds. A value of UINT16_MAX implies the channel is unused.
  chan2_raw: uint16  % RC channel 2 value, in microseconds. A value of UINT16_MAX implies the channel is unused.
  chan3_raw: uint16  % RC channel 3 value, in microseconds. A value of UINT16_MAX implies the channel is unused.
  chan4_raw: uint16  % RC channel 4 value, in microseconds. A value of UINT16_MAX implies the channel is unused.
  chan5_raw: uint16  % RC channel 5 value, in microseconds. A value of UINT16_MAX implies the channel is unused.
  chan6_raw: uint16  % RC channel 6 value, in microseconds. A value of UINT16_MAX implies the channel is unused.
  chan7_raw: uint16  % RC channel 7 value, in microseconds. A value of UINT16_MAX implies the channel is unused.
  chan8_raw: uint16  % RC channel 8 value, in microseconds. A value of UINT16_MAX implies the channel is unused.
  chan9_raw: uint16  % RC channel 9 value, in microseconds. A value of UINT16_MAX implies the channel is unused.
  chan10_raw: uint16  % RC channel 10 value, in microseconds. A value of UINT16_MAX implies the channel is unused.
  chan11_raw: uint16  % RC channel 11 value, in microseconds. A value of UINT16_MAX implies the channel is unused.
  chan12_raw: uint16  % RC channel 12 value, in microseconds. A value of UINT16_MAX implies the channel is unused.
  chan13_raw: uint16  % RC channel 13 value, in microseconds. A value of UINT16_MAX implies the channel is unused.
  chan14_raw: uint16  % RC channel 14 value, in microseconds. A value of UINT16_MAX implies the channel is unused.
  chan15_raw: uint16  % RC channel 15 value, in microseconds. A value of UINT16_MAX implies the channel is unused.
  chan16_raw: uint16  % RC channel 16 value, in microseconds. A value of UINT16_MAX implies the channel is unused.
  chan17_raw: uint16  % RC channel 17 value, in microseconds. A value of UINT16_MAX implies the channel is unused.
  chan18_raw: uint16  % RC channel 18 value, in microseconds. A value of UINT16_MAX implies the channel is unused.
  rssi: uint8  % Receive signal strength indicator, 0: 0%, 100: 100%, 255: invalid/unknown.

mav_request_data_stream = Simulink.Bus()  % THIS INTERFACE IS DEPRECATED. USE SET_MESSAGE_INTERVAL INSTEAD.
  target_system: uint8  % The target requested to send the message stream.
  target_component: uint8  % The target requested to send the message stream.
  req_stream_id: uint8  % The ID of the requested data stream
  req_message_rate: uint16  % The requested message rate
  start_stop: uint8  % 1 to start sending, 0 to stop sending.

mav_data_stream = Simulink.Bus()  % THIS INTERFACE IS DEPRECATED. USE MESSAGE_INTERVAL INSTEAD.
  stream_id: uint8  % The ID of the requested data stream
  message_rate: uint16  % The message rate
  on_off: uint8  % 1 stream is enabled, 0 stream is stopped.

mav_manual_control = Simulink.Bus()  % This message provides an API for manually controlling the vehicle using standard joystick axes nomenclature, along with a joystick-like input device. Unused axes can be disabled an buttons are also transmit as boolean values of their
  target: uint8  % The system to be controlled.
  x: int16  % X-axis, normalized to the range [-1000,1000]. A value of INT16_MAX indicates that this axis is invalid. Generally corresponds to forward(1000)-backward(-1000) movement on a joystick and the pitch of a vehicle.
  y: int16  % Y-axis, normalized to the range [-1000,1000]. A value of INT16_MAX indicates that this axis is invalid. Generally corresponds to left(-1000)-right(1000) movement on a joystick and the roll of a vehicle.
  z: int16  % Z-axis, normalized to the range [-1000,1000]. A value of INT16_MAX indicates that this axis is invalid. Generally corresponds to a separate slider movement with maximum being 1000 and minimum being -1000 on a joystick and the thrust of a vehicle. Positive values are positive thrust, negative values are negative thrust.
  r: int16  % R-axis, normalized to the range [-1000,1000]. A value of INT16_MAX indicates that this axis is invalid. Generally corresponds to a twisting of the joystick, with counter-clockwise being 1000 and clockwise being -1000, and the yaw of a vehicle.
  buttons: uint16  % A bitfield corresponding to the joystick buttons' current state, 1 for pressed, 0 for released. The lowest bit corresponds to Button 1.

mav_rc_channels_override = Simulink.Bus()  % The RAW values of the RC channels sent to the MAV to override info received from the RC radio. A value of UINT16_MAX means no change to that channel. A value of 0 means control of that channel should be released back to the RC radio. The standard PPM modulation is as follows: 1000 microseconds: 0%, 2000 microseconds: 100%. Individual receivers/transmitters might violate this specification.
  target_system: uint8  % System ID
  target_component: uint8  % Component ID
  chan1_raw: uint16  % RC channel 1 value, in microseconds. A value of UINT16_MAX means to ignore this field.
  chan2_raw: uint16  % RC channel 2 value, in microseconds. A value of UINT16_MAX means to ignore this field.
  chan3_raw: uint16  % RC channel 3 value, in microseconds. A value of UINT16_MAX means to ignore this field.
  chan4_raw: uint16  % RC channel 4 value, in microseconds. A value of UINT16_MAX means to ignore this field.
  chan5_raw: uint16  % RC channel 5 value, in microseconds. A value of UINT16_MAX means to ignore this field.
  chan6_raw: uint16  % RC channel 6 value, in microseconds. A value of UINT16_MAX means to ignore this field.
  chan7_raw: uint16  % RC channel 7 value, in microseconds. A value of UINT16_MAX means to ignore this field.
  chan8_raw: uint16  % RC channel 8 value, in microseconds. A value of UINT16_MAX means to ignore this field.
  chan9_raw: uint16  % RC channel 9 value, in microseconds. A value of 0 means to ignore this field.
  chan10_raw: uint16  % RC channel 10 value, in microseconds. A value of 0 or UINT16_MAX means to ignore this field.
  chan11_raw: uint16  % RC channel 11 value, in microseconds. A value of 0 or UINT16_MAX means to ignore this field.
  chan12_raw: uint16  % RC channel 12 value, in microseconds. A value of 0 or UINT16_MAX means to ignore this field.
  chan13_raw: uint16  % RC channel 13 value, in microseconds. A value of 0 or UINT16_MAX means to ignore this field.
  chan14_raw: uint16  % RC channel 14 value, in microseconds. A value of 0 or UINT16_MAX means to ignore this field.
  chan15_raw: uint16  % RC channel 15 value, in microseconds. A value of 0 or UINT16_MAX means to ignore this field.
  chan16_raw: uint16  % RC channel 16 value, in microseconds. A value of 0 or UINT16_MAX means to ignore this field.
  chan17_raw: uint16  % RC channel 17 value, in microseconds. A value of 0 or UINT16_MAX means to ignore this field.
  chan18_raw: uint16  % RC channel 18 value, in microseconds. A value of 0 or UINT16_MAX means to ignore this field.

mav_mission_item_int = Simulink.Bus()  % Message encoding a mission item. This message is emitted to announce
  % the presence of a mission item and to set a mission item on the system. The mission item can be either in x, y, z meters (type: LOCAL) or x:lat, y:lon, z:altitude. Local frame is Z-down, right handed (NED), global frame is Z-up, right handed (ENU). See also https://mavlink.io/en/protocol/mission.html.
  target_system: uint8  % System ID
  target_component: uint8  % Component ID
  seq: uint16  % Waypoint ID (sequence number). Starts at zero. Increases monotonically for each waypoint, no gaps in the sequence (0,1,2,3,4).
  frame: uint8  % The coordinate system of the waypoint, as defined by MAV_FRAME enum
  command: uint16  % The scheduled action for the waypoint, as defined by MAV_CMD enum
  current: uint8  % false:0, true:1
  autocontinue: uint8  % autocontinue to next wp
  param1: single  % PARAM1, see MAV_CMD enum
  param2: single  % PARAM2, see MAV_CMD enum
  param3: single  % PARAM3, see MAV_CMD enum
  param4: single  % PARAM4, see MAV_CMD enum
  x: int32  % PARAM5 / local: x position in meters * 1e4, global: latitude in degrees * 10^7
  y: int32  % PARAM6 / y position: local: x position in meters * 1e4, global: longitude in degrees *10^7
  z: single  % PARAM7 / z position: global: altitude in meters (relative or absolute, depending on frame.
  mission_type: uint8  % Mission type, see MAV_MISSION_TYPE

mav_vfr_hud = Simulink.Bus()  % Metrics typically displayed on a HUD for fixed wing aircraft
  airspeed: single  % Current airspeed in m/s
  groundspeed: single  % Current ground speed in m/s
  heading: int16  % Current heading in degrees, in compass units (0..360, 0=north)
  throttle: uint16  % Current throttle setting in integer percent, 0 to 100
  alt: single  % Current altitude (MSL), in meters
  climb: single  % Current climb rate in meters/second

mav_command_int = Simulink.Bus()  % Message encoding a command with parameters as scaled integers. Scaling depends on the actual command value.
  target_system: uint8  % System ID
  target_component: uint8  % Component ID
  frame: uint8  % The coordinate system of the COMMAND, as defined by MAV_FRAME enum
  command: uint16  % The scheduled action for the mission item, as defined by MAV_CMD enum
  current: uint8  % false:0, true:1
  autocontinue: uint8  % autocontinue to next wp
  param1: single  % PARAM1, see MAV_CMD enum
  param2: single  % PARAM2, see MAV_CMD enum
  param3: single  % PARAM3, see MAV_CMD enum
  param4: single  % PARAM4, see MAV_CMD enum
  x: int32  % PARAM5 / local: x position in meters * 1e4, global: latitude in degrees * 10^7
  y: int32  % PARAM6 / local: y position in meters * 1e4, global: longitude in degrees * 10^7
  z: single  % PARAM7 / z position: global: altitude in meters (relative or absolute, depending on frame.

mav_command_long = Simulink.Bus()  % Send a command with up to seven parameters to the MAV
  target_system: uint8  % System which should execute the command
  target_component: uint8  % Component which should execute the command, 0 for all components
  command: uint16  % Command ID, as defined by MAV_CMD enum.
  confirmation: uint8  % 0: First transmission of this command. 1-255: Confirmation transmissions (e.g. for kill command)
  param1: single  % Parameter 1, as defined by MAV_CMD enum.
  param2: single  % Parameter 2, as defined by MAV_CMD enum.
  param3: single  % Parameter 3, as defined by MAV_CMD enum.
  param4: single  % Parameter 4, as defined by MAV_CMD enum.
  param5: single  % Parameter 5, as defined by MAV_CMD enum.
  param6: single  % Parameter 6, as defined by MAV_CMD enum.
  param7: single  % Parameter 7, as defined by MAV_CMD enum.

mav_command_ack = Simulink.Bus()  % Report status of a command. Includes feedback whether the command was executed.
  command: uint16  % Command ID, as defined by MAV_CMD enum.
  result: uint8  % See MAV_RESULT enum
  progress: uint8  % WIP: Also used as result_param1, it can be set with a enum containing the errors reasons of why the command was denied or the progress percentage or 255 if unknown the progress when result is MAV_RESULT_IN_PROGRESS.
  result_param2: int32  % WIP: Additional parameter of the result, example: which parameter of MAV_CMD_NAV_WAYPOINT caused it to be denied.
  target_system: uint8  % WIP: System which requested the command to be executed
  target_component: uint8  % WIP: Component which requested the command to be executed

mav_manual_setpoint = Simulink.Bus()  % Setpoint in roll, pitch, yaw and thrust from the operator
  time_boot_ms: uint32  % Timestamp in milliseconds since system boot
  roll: single  % Desired roll rate in radians per second
  pitch: single  % Desired pitch rate in radians per second
  yaw: single  % Desired yaw rate in radians per second
  thrust: single  % Collective thrust, normalized to 0 .. 1
  mode_switch: uint8  % Flight mode switch position, 0.. 255
  manual_override_switch: uint8  % Override mode switch position, 0.. 255

mav_set_attitude_target = Simulink.Bus()  % Sets a desired vehicle attitude. Used by an external controller to command the vehicle (manual controller or other system).
  time_boot_ms: uint32  % Timestamp in milliseconds since system boot
  target_system: uint8  % System ID
  target_component: uint8  % Component ID
  type_mask: uint8  % Mappings: If any of these bits are set, the corresponding input should be ignored: bit 1: body roll rate, bit 2: body pitch rate, bit 3: body yaw rate. bit 4-bit 6: reserved, bit 7: throttle, bit 8: attitude
  q: single[4]  % Attitude quaternion (w, x, y, z order, zero-rotation is 1, 0, 0, 0)
  body_roll_rate: single  % Body roll rate in radians per second
  body_pitch_rate: single  % Body pitch rate in radians per second
  body_yaw_rate: single  % Body yaw rate in radians per second
  thrust: single  % Collective thrust, normalized to 0 .. 1 (-1 .. 1 for vehicles capable of reverse trust)

mav_attitude_target = Simulink.Bus()  % Reports the current commanded attitude of the vehicle as specified by the autopilot. This should match the commands sent in a SET_ATTITUDE_TARGET message if the vehicle is being controlled this way.
  time_boot_ms: uint32  % Timestamp in milliseconds since system boot
  type_mask: uint8  % Mappings: If any of these bits are set, the corresponding input should be ignored: bit 1: body roll rate, bit 2: body pitch rate, bit 3: body yaw rate. bit 4-bit 7: reserved, bit 8: attitude
  q: single[4]  % Attitude quaternion (w, x, y, z order, zero-rotation is 1, 0, 0, 0)
  body_roll_rate: single  % Body roll rate in radians per second
  body_pitch_rate: single  % Body pitch rate in radians per second
  body_yaw_rate: single  % Body yaw rate in radians per second
  thrust: single  % Collective thrust, normalized to 0 .. 1 (-1 .. 1 for vehicles capable of reverse trust)

mav_set_position_target_local_ned = Simulink.Bus()  % Sets a desired vehicle position in a local north-east-down coordinate frame. Used by an external controller to command the vehicle (manual controller or other system).
  time_boot_ms: uint32  % Timestamp in milliseconds since system boot
  target_system: uint8  % System ID
  target_component: uint8  % Component ID
  coordinate_frame: uint8  % Valid options are: MAV_FRAME_LOCAL_NED = 1, MAV_FRAME_LOCAL_OFFSET_NED = 7, MAV_FRAME_BODY_NED = 8, MAV_FRAME_BODY_OFFSET_NED = 9
  type_mask: uint16  % Bitmask to indicate which dimensions should be ignored by the vehicle: a value of 0b0000000000000000 or 0b0000001000000000 indicates that none of the setpoint dimensions should be ignored. If bit 10 is set the floats afx afy afz should be interpreted as force instead of acceleration. Mapping: bit 1: x, bit 2: y, bit 3: z, bit 4: vx, bit 5: vy, bit 6: vz, bit 7: ax, bit 8: ay, bit 9: az, bit 10: is force setpoint, bit 11: yaw, bit 12: yaw rate
  x: single  % X Position in NED frame in meters
  y: single  % Y Position in NED frame in meters
  z: single  % Z Position in NED frame in meters (note, altitude is negative in NED)
  vx: single  % X velocity in NED frame in meter / s
  vy: single  % Y velocity in NED frame in meter / s
  vz: single  % Z velocity in NED frame in meter / s
  afx: single  % X acceleration or force (if bit 10 of type_mask is set) in NED frame in meter / s^2 or N
  afy: single  % Y acceleration or force (if bit 10 of type_mask is set) in NED frame in meter / s^2 or N
  afz: single  % Z acceleration or force (if bit 10 of type_mask is set) in NED frame in meter / s^2 or N
  yaw: single  % yaw setpoint in rad
  yaw_rate: single  % yaw rate setpoint in rad/s

mav_position_target_local_ned = Simulink.Bus()  % Reports the current commanded vehicle position, velocity, and acceleration as specified by the autopilot. This should match the commands sent in SET_POSITION_TARGET_LOCAL_NED if the vehicle is being controlled this way.
  time_boot_ms: uint32  % Timestamp in milliseconds since system boot
  coordinate_frame: uint8  % Valid options are: MAV_FRAME_LOCAL_NED = 1, MAV_FRAME_LOCAL_OFFSET_NED = 7, MAV_FRAME_BODY_NED = 8, MAV_FRAME_BODY_OFFSET_NED = 9
  type_mask: uint16  % Bitmask to indicate which dimensions should be ignored by the vehicle: a value of 0b0000000000000000 or 0b0000001000000000 indicates that none of the setpoint dimensions should be ignored. If bit 10 is set the floats afx afy afz should be interpreted as force instead of acceleration. Mapping: bit 1: x, bit 2: y, bit 3: z, bit 4: vx, bit 5: vy, bit 6: vz, bit 7: ax, bit 8: ay, bit 9: az, bit 10: is force setpoint, bit 11: yaw, bit 12: yaw rate
  x: single  % X Position in NED frame in meters
  y: single  % Y Position in NED frame in meters
  z: single  % Z Position in NED frame in meters (note, altitude is negative in NED)
  vx: single  % X velocity in NED frame in meter / s
  vy: single  % Y velocity in NED frame in meter / s
  vz: single  % Z velocity in NED frame in meter / s
  afx: single  % X acceleration or force (if bit 10 of type_mask is set) in NED frame in meter / s^2 or N
  afy: single  % Y acceleration or force (if bit 10 of type_mask is set) in NED frame in meter / s^2 or N
  afz: single  % Z acceleration or force (if bit 10 of type_mask is set) in NED frame in meter / s^2 or N
  yaw: single  % yaw setpoint in rad
  yaw_rate: single  % yaw rate setpoint in rad/s

mav_set_position_target_global_int = Simulink.Bus()  % Sets a desired vehicle position, velocity, and/or acceleration in a global coordinate system (WGS84). Used by an external controller to command the vehicle (manual controller or other system).
  time_boot_ms: uint32  % Timestamp in milliseconds since system boot. The rationale for the timestamp in the setpoint is to allow the system to compensate for the transport delay of the setpoint. This allows the system to compensate processing latency.
  target_system: uint8  % System ID
  target_component: uint8  % Component ID
  coordinate_frame: uint8  % Valid options are: MAV_FRAME_GLOBAL_INT = 5, MAV_FRAME_GLOBAL_RELATIVE_ALT_INT = 6, MAV_FRAME_GLOBAL_TERRAIN_ALT_INT = 11
  type_mask: uint16  % Bitmask to indicate which dimensions should be ignored by the vehicle: a value of 0b0000000000000000 or 0b0000001000000000 indicates that none of the setpoint dimensions should be ignored. If bit 10 is set the floats afx afy afz should be interpreted as force instead of acceleration. Mapping: bit 1: x, bit 2: y, bit 3: z, bit 4: vx, bit 5: vy, bit 6: vz, bit 7: ax, bit 8: ay, bit 9: az, bit 10: is force setpoint, bit 11: yaw, bit 12: yaw rate
  lat_int: int32  % X Position in WGS84 frame in 1e7 * degrees
  lon_int: int32  % Y Position in WGS84 frame in 1e7 * degrees
  alt: single  % Altitude in meters in AMSL altitude, not WGS84 if absolute or relative, above terrain if GLOBAL_TERRAIN_ALT_INT
  vx: single  % X velocity in NED frame in meter / s
  vy: single  % Y velocity in NED frame in meter / s
  vz: single  % Z velocity in NED frame in meter / s
  afx: single  % X acceleration or force (if bit 10 of type_mask is set) in NED frame in meter / s^2 or N
  afy: single  % Y acceleration or force (if bit 10 of type_mask is set) in NED frame in meter / s^2 or N
  afz: single  % Z acceleration or force (if bit 10 of type_mask is set) in NED frame in meter / s^2 or N
  yaw: single  % yaw setpoint in rad
  yaw_rate: single  % yaw rate setpoint in rad/s

mav_position_target_global_int = Simulink.Bus()  % Reports the current commanded vehicle position, velocity, and acceleration as specified by the autopilot. This should match the commands sent in SET_POSITION_TARGET_GLOBAL_INT if the vehicle is being controlled this way.
  time_boot_ms: uint32  % Timestamp in milliseconds since system boot. The rationale for the timestamp in the setpoint is to allow the system to compensate for the transport delay of the setpoint. This allows the system to compensate processing latency.
  coordinate_frame: uint8  % Valid options are: MAV_FRAME_GLOBAL_INT = 5, MAV_FRAME_GLOBAL_RELATIVE_ALT_INT = 6, MAV_FRAME_GLOBAL_TERRAIN_ALT_INT = 11
  type_mask: uint16  % Bitmask to indicate which dimensions should be ignored by the vehicle: a value of 0b0000000000000000 or 0b0000001000000000 indicates that none of the setpoint dimensions should be ignored. If bit 10 is set the floats afx afy afz should be interpreted as force instead of acceleration. Mapping: bit 1: x, bit 2: y, bit 3: z, bit 4: vx, bit 5: vy, bit 6: vz, bit 7: ax, bit 8: ay, bit 9: az, bit 10: is force setpoint, bit 11: yaw, bit 12: yaw rate
  lat_int: int32  % X Position in WGS84 frame in 1e7 * degrees
  lon_int: int32  % Y Position in WGS84 frame in 1e7 * degrees
  alt: single  % Altitude in meters in AMSL altitude, not WGS84 if absolute or relative, above terrain if GLOBAL_TERRAIN_ALT_INT
  vx: single  % X velocity in NED frame in meter / s
  vy: single  % Y velocity in NED frame in meter / s
  vz: single  % Z velocity in NED frame in meter / s
  afx: single  % X acceleration or force (if bit 10 of type_mask is set) in NED frame in meter / s^2 or N
  afy: single  % Y acceleration or force (if bit 10 of type_mask is set) in NED frame in meter / s^2 or N
  afz: single  % Z acceleration or force (if bit 10 of type_mask is set) in NED frame in meter / s^2 or N
  yaw: single  % yaw setpoint in rad
  yaw_rate: single  % yaw rate setpoint in rad/s

mav_local_position_ned_system_global_offset = Simulink.Bus()  % The offset in X, Y, Z and yaw between the LOCAL_POSITION_NED messages of MAV X and the global coordinate frame in NED coordinates. Coordinate frame is right-handed, Z-axis down (aeronautical frame, NED / north-east-down convention)
  time_boot_ms: uint32  % Timestamp (milliseconds since system boot)
  x: single  % X Position
  y: single  % Y Position
  z: single  % Z Position
  roll: single  % Roll
  pitch: single  % Pitch
  yaw: single  % Yaw

mav_hil_state = Simulink.Bus()  % DEPRECATED PACKET! Suffers from missing airspeed fields and singularities due to Euler angles. Please use HIL_STATE_QUATERNION instead. Sent from simulation to autopilot. This packet is useful for high throughput applications such as hardware in the loop simulations.
  time_usec: fixdt(0,64,0)  % Timestamp (microseconds since UNIX epoch or microseconds since system boot)
  roll: single  % Roll angle (rad)
  pitch: single  % Pitch angle (rad)
  yaw: single  % Yaw angle (rad)
  rollspeed: single  % Body frame roll / phi angular speed (rad/s)
  pitchspeed: single  % Body frame pitch / theta angular speed (rad/s)
  yawspeed: single  % Body frame yaw / psi angular speed (rad/s)
  lat: int32  % Latitude, expressed as degrees * 1E7
  lon: int32  % Longitude, expressed as degrees * 1E7
  alt: int32  % Altitude in meters, expressed as * 1000 (millimeters)
  vx: int16  % Ground X Speed (Latitude), expressed as m/s * 100
  vy: int16  % Ground Y Speed (Longitude), expressed as m/s * 100
  vz: int16  % Ground Z Speed (Altitude), expressed as m/s * 100
  xacc: int16  % X acceleration (mg)
  yacc: int16  % Y acceleration (mg)
  zacc: int16  % Z acceleration (mg)

mav_hil_controls = Simulink.Bus()  % Sent from autopilot to simulation. Hardware in the loop control outputs
  time_usec: fixdt(0,64,0)  % Timestamp (microseconds since UNIX epoch or microseconds since system boot)
  roll_ailerons: single  % Control output -1 .. 1
  pitch_elevator: single  % Control output -1 .. 1
  yaw_rudder: single  % Control output -1 .. 1
  throttle: single  % Throttle 0 .. 1
  aux1: single  % Aux 1, -1 .. 1
  aux2: single  % Aux 2, -1 .. 1
  aux3: single  % Aux 3, -1 .. 1
  aux4: single  % Aux 4, -1 .. 1
  mode: uint8  % System mode (MAV_MODE)
  nav_mode: uint8  % Navigation mode (MAV_NAV_MODE)

mav_hil_rc_inputs_raw = Simulink.Bus()  % Sent from simulation to autopilot. The RAW values of the RC channels received. The standard PPM modulation is as follows: 1000 microseconds: 0%, 2000 microseconds: 100%. Individual receivers/transmitters might violate this specification.
  time_usec: fixdt(0,64,0)  % Timestamp (microseconds since UNIX epoch or microseconds since system boot)
  chan1_raw: uint16  % RC channel 1 value, in microseconds
  chan2_raw: uint16  % RC channel 2 value, in microseconds
  chan3_raw: uint16  % RC channel 3 value, in microseconds
  chan4_raw: uint16  % RC channel 4 value, in microseconds
  chan5_raw: uint16  % RC channel 5 value, in microseconds
  chan6_raw: uint16  % RC channel 6 value, in microseconds
  chan7_raw: uint16  % RC channel 7 value, in microseconds
  chan8_raw: uint16  % RC channel 8 value, in microseconds
  chan9_raw: uint16  % RC channel 9 value, in microseconds
  chan10_raw: uint16  % RC channel 10 value, in microseconds
  chan11_raw: uint16  % RC channel 11 value, in microseconds
  chan12_raw: uint16  % RC channel 12 value, in microseconds
  rssi: uint8  % Receive signal strength indicator, 0: 0%, 255: 100%

mav_payload = Simulink.Bus()
  heartbeat: Bus: mav_heartbeat
  sys_status: Bus: mav_sys_status
  system_time: Bus: mav_system_time
  ping: Bus: mav_ping
  change_operator_control: Bus: mav_change_operator_control
  change_operator_control_ack: Bus: mav_change_operator_control_ack
  auth_key: Bus: mav_auth_key
  set_mode: Bus: mav_set_mode
  param_request_read: Bus: mav_param_request_read
  param_request_list: Bus: mav_param_request_list
  param_value: Bus: mav_param_value
  param_set: Bus: mav_param_set
  gps_raw_int: Bus: mav_gps_raw_int
  gps_status: Bus: mav_gps_status
  scaled_imu: Bus: mav_scaled_imu
  raw_imu: Bus: mav_raw_imu
  raw_pressure: Bus: mav_raw_pressure
  scaled_pressure: Bus: mav_scaled_pressure
  attitude: Bus: mav_attitude
  attitude_quaternion: Bus: mav_attitude_quaternion
  local_position_ned: Bus: mav_local_position_ned
  global_position_int: Bus: mav_global_position_int
  rc_channels_scaled: Bus: mav_rc_channels_scaled
  rc_channels_raw: Bus: mav_rc_channels_raw
  servo_output_raw: Bus: mav_servo_output_raw
  mission_request_partial_list: Bus: mav_mission_request_partial_list
  mission_write_partial_list: Bus: mav_mission_write_partial_list
  mission_item: Bus: mav_mission_item
  mission_request: Bus: mav_mission_request
  mission_set_current: Bus: mav_mission_set_current
  mission_current: Bus: mav_mission_current
  mission_request_list: Bus: mav_mission_request_list
  mission_count: Bus: mav_mission_count
  mission_clear_all: Bus: mav_mission_clear_all
  mission_item_reached: Bus: mav_mission_item_reached
  mission_ack: Bus: mav_mission_ack
  set_gps_global_origin: Bus: mav_set_gps_global_origin
  gps_global_origin: Bus: mav_gps_global_origin
  param_map_rc: Bus: mav_param_map_rc
  mission_request_int: Bus: mav_mission_request_int
  safety_set_allowed_area: Bus: mav_safety_set_allowed_area
  safety_allowed_area: Bus: mav_safety_allowed_area
  attitude_quaternion_cov: Bus: mav_attitude_quaternion_cov
  nav_controller_output: Bus: mav_nav_controller_output
  global_position_int_cov: Bus: mav_global_position_int_cov
  local_position_ned_cov: Bus: mav_local_position_ned_cov
  rc_channels: Bus: mav_rc_channels
  request_data_stream: Bus: mav_request_data_stream
  data_stream: Bus: mav_data_stream
  manual_control: Bus: mav_manual_control
  rc_channels_override: Bus: mav_rc_channels_override
  mission_item_int: Bus: mav_mission_item_int
  vfr_hud: Bus: mav_vfr_hud
  command_int: Bus: mav_command_int
  command_long: Bus: mav_command_long
  command_ack: Bus: mav_command_ack
  manual_setpoint: Bus: mav_manual_setpoint
  set_attitude_target: Bus: mav_set_attitude_target
  attitude_target: Bus: mav_attitude_target
  set_position_target_local_ned: Bus: mav_set_position_target_local_ned
  position_target_local_ned: Bus: mav_position_target_local_ned
  set_position_target_global_int: Bus: mav_set_position_target_global_int
  position_target_global_int: Bus: mav_position_target_global_int
  local_position_ned_system_global_offset: Bus: mav_local_position_ned_system_global_offset
  hil_state: Bus: mav_hil_state
  hil_controls: Bus: mav_hil_controls
  hil_rc_inputs_raw: Bus: mav_hil_rc_inputs_raw

MAV_FRAME = enum(DefaultValue="GLOBAL", AddClassNameToEnumNames=true)
  GLOBAL = 0  % Global coordinate frame, WGS84 coordinate system. First value / x: latitude, second value / y: longitude, third value / z: positive altitude over mean sea level (MSL).
  LOCAL_NED = 1  % Local coordinate frame, Z-down (x: north, y: east, z: down).
  MISSION = 2  % NOT a coordinate frame, indicates a mission command.
  GLOBAL_RELATIVE_ALT = 3  % Global coordinate frame, WGS84 coordinate system, relative altitude over ground with respect to the home position. First value / x: latitude, second value / y: longitude, third value / z: positive altitude with 0 being at the altitude of the home location.
  LOCAL_ENU = 4  % Local coordinate frame, Z-up (x: east, y: north, z: up).
  GLOBAL_INT = 5  % Global coordinate frame, WGS84 coordinate system. First value / x: latitude in degrees*1.0e-7, second value / y: longitude in degrees*1.0e-7, third value / z: positive altitude over mean sea level (MSL).
  GLOBAL_RELATIVE_ALT_INT = 6  % Global coordinate frame, WGS84 coordinate system, relative altitude over ground with respect to the home position. First value / x: latitude in degrees*10e-7, second value / y: longitude in degrees*10e-7, third value / z: positive altitude with 0 being at the altitude of the home location.
  LOCAL_OFFSET_NED = 7  % Offset to the current local frame. Anything expressed in this frame should be added to the current local frame position.
  BODY_NED = 8  % Setpoint in body NED frame. This makes sense if all position control is externalized - e.g. useful to command 2 m/s^2 acceleration to the right.
  BODY_OFFSET_NED = 9  % Offset in body NED frame. This makes sense if adding setpoints to the current flight path, to avoid an obstacle - e.g. useful to command 2 m/s^2 acceleration to the east.
  GLOBAL_TERRAIN_ALT = 10  % Global coordinate frame with above terrain level altitude. WGS84 coordinate system, relative altitude over terrain with respect to the waypoint coordinate. First value / x: latitude in degrees, second value / y: longitude in degrees, third value / z: positive altitude in meters with 0 being at ground level in terrain model.
  GLOBAL_TERRAIN_ALT_INT = 11  % Global coordinate frame with above terrain level altitude. WGS84 coordinate system, relative altitude over terrain with respect to the waypoint coordinate. First value / x: latitude in degrees*10e-7, second value / y: longitude in degrees*10e-7, third value / z: positive altitude in meters with 0 being at ground level in terrain model.
  BODY_FRD = 12  % Body fixed frame of reference, Z-down (x: forward, y: right, z: down).
  BODY_FLU = 13  % Body fixed frame of reference, Z-up (x: forward, y: left, z: up).
  MOCAP_NED = 14  % Odometry local coordinate frame of data given by a motion capture system, Z-down (x: north, y: east, z: down).
  MOCAP_ENU = 15  % Odometry local coordinate frame of data given by a motion capture system, Z-up (x: east, y: north, z: up).
  VISION_NED = 16  % Odometry local coordinate frame of data given by a vision estimation system, Z-down (x: north, y: east, z: down).
  VISION_ENU = 17  % Odometry local coordinate frame of data given by a vision estimation system, Z-up (x: east, y: north, z: up).
  ESTIM_NED = 18  % Odometry local coordinate frame of data given by an estimator running onboard the vehicle, Z-down (x: north, y: east, z: down).
  ESTIM_ENU = 19  % Odometry local coordinate frame of data given by an estimator running onboard the vehicle, Z-up (x: east, y: noth, z: up).
  LOCAL_RELATIVE_ALT = 20
  LOCAL_ABSOLUTE_ALT = 21

MAV_SYS_TYPE = enum(AddClassNameToEnumNames=true)
  GENERIC = 0  % Generic micro air vehicle.
  FIXED_WING = 1  % Fixed wing aircraft.
  QUADROTOR = 2  % Quadrotor
  COAXIAL = 3  % Coaxial helicopter
  HELICOPTER = 4  % Normal helicopter with tail rotor.
  ANTENNA_TRACKER = 5  % Ground installation
  GCS = 6  % Operator control unit / ground control station
  AIRSHIP = 7  % Airship, controlled
  FREE_BALLOON = 8  % Free balloon, uncontrolled
  ROCKET = 9  % Rocket
  GROUND_ROVER = 10  % Ground rover
  SURFACE_BOAT = 11  % Surface vessel, boat, ship
  SUBMARINE = 12  % Submarine
  HEXAROTOR = 13  % Hexarotor
  OCTOROTOR = 14  % Octorotor
  TRICOPTER = 15  % Tricopter
  FLAPPING_WING = 16  % Flapping wing
  KITE = 17  % Kite
  ONBOARD_CONTROLLER = 18  % Onboard companion controller
  VTOL_DUOROTOR = 19  % Two-rotor VTOL using control surfaces in vertical operation in addition. Tailsitter.
  VTOL_QUADROTOR = 20  % Quad-rotor VTOL using a V-shaped quad config in vertical operation. Tailsitter.
  VTOL_TILTROTOR = 21  % Tiltrotor VTOL
  VTOL_RESERVED2 = 22  % VTOL reserved 2
  VTOL_RESERVED3 = 23  % VTOL reserved 3
  VTOL_RESERVED4 = 24  % VTOL reserved 4
  VTOL_RESERVED5 = 25  % VTOL reserved 5
  GIMBAL = 26  % Onboard gimbal
  ADSB = 27  % Onboard ADSB peripheral
  PARAFOIL = 28  % Steerable, nonrigid airfoil
  DODECAROTOR = 29  % Dodecarotor
  CAMERA = 30  % Camera
  CHARGING_STATION = 31  % Charging station
  FLARM = 32  % Onboard FLARM collision avoidance system