% Simulink data dictionary px4_dict.sldd
% references px4_param.sldd
% references mav_dtype.sldd
% references px4_topic.sldd

PX4_CUSTOM_MAIN_MODE = enum(DefaultValue="MANUAL", AddClassNameToEnumNames=true)
  MANUAL = 1
  ALTCTL = 2
  POSCTL = 3
  AUTO = 4
  ACRO = 5
  OFFBOARD = 6
  STABILIZED = 7
  RATTITUDE_LEGACY = 8
  SIMPLE = 9

PX4_CUSTOM_SUB_MODE_AUTO = enum(DefaultValue="READY", AddClassNameToEnumNames=true)
  READY = 1
  TAKEOFF = 2
  LOITER = 3
  MISSION = 4
  RTL = 5
  LAND = 6
  RESERVED_DO_NOT_USE = 7
  FOLLOW_TARGET = 8
  PRECLAND = 9