% Simulink data dictionary px4_param.sldd

CAL_GYRO2_XSCALE = Simulink.Parameter(1)
ctl_bw = Simulink.Parameter(75, DataType="int32", Min=10, Max=250, Unit="Hz")  % Speed controller bandwidth, in Hz. Higher values result in faster speed and current rise times, but may result in overshoot and higher current consumption. For fixed-wing aircraft, this value should be less than 50 Hz; for multirotors, values up to 100 Hz may provide improvements in responsiveness.
ctl_dir = Simulink.Parameter(1, DataType="int32", Min=0, Max=1)  % Motor spin direction as detected during initial enumeration. Use 0 or 1 to reverse direction.

ctl_gain = Simulink.Parameter(1, DataType="single", Min=0, Max=1, Unit="C/rad")  % Speed (RPM) controller gain. Determines controller
  % aggressiveness; units are amp-seconds per radian. Systems with
  % higher rotational inertia (large props) will need gain increased;
  % systems with low rotational inertia (small props) may need gain
  % decreased. Higher values result in faster response, but may result
  % in oscillation and excessive overshoot. Lower values result in a
  % slower, smoother response.

ctl_hz_idle = Simulink.Parameter(3.5, DataType="single", Min=0, Max=100, Unit="Hz")  % Idle speed (e Hz)
ctl_start_rate = Simulink.Parameter(25, DataType="int32", Min=5, Max=1000, Unit="1/s^2")  % Spin-up rate (e Hz/s)
esc_index = Simulink.Parameter(0, DataType="int32", Min=0, Max=15)  % Index of this ESC in throttle command messages.
id_ext_status = Simulink.Parameter(20034, DataType="int32", Min=1, Max=1000000)  % Extended status ID
int_ext_status = Simulink.Parameter(50000, DataType="int32", Min=0, Max=1000000, Unit="us")  % Extended status interval (µs)
int_status = Simulink.Parameter(50000, DataType="int32", Max=1000000, Unit="us")  % ESC status interval (µs)

mot_i_max = Simulink.Parameter(12, DataType="single", Min=1, Max=80, Unit="A")  % Motor current limit in amps. This determines the maximum
  % current controller setpoint, as well as the maximum allowable
  % current setpoint slew rate. This value should generally be set to
  % the continuous current rating listed in the motor’s specification
  % sheet, or set equal to the motor’s specified continuous power
  % divided by the motor voltage limit.

mot_kv = Simulink.Parameter(2300, DataType="int32", Min=0, Max=4000, Unit="rpm/V")  % Motor Kv in RPM per volt. This can be taken from the motor’s
  % specification sheet; accuracy will help control performance but
  % some deviation from the specified value is acceptable.

mot_ls = Simulink.Parameter(0, DataType="single", Unit="H")  % READ ONLY: Motor inductance in henries. This is measured on start-up.

mot_num_poles = Simulink.Parameter(14, DataType="int32", Min=2, Max=40)  % Number of motor poles. Used to convert mechanical speeds to
  % electrical speeds. This number should be taken from the motor’s
  % specification sheet.

mot_rs = Simulink.Parameter(0, DataType="single", Unit="Ohm")  % READ ONLY: Motor resistance in ohms. This is measured on start-up. When
  % tuning a new motor, check that this value is approximately equal
  % to the value shown in the motor’s specification sheet.

mot_v_accel = Simulink.Parameter(0.5, DataType="single", Min=0.01, Max=1, Unit="V")  % Acceleration limit (V)

mot_v_max = Simulink.Parameter(14.8, DataType="single", Min=0, Unit="V")  % Motor voltage limit in volts. The current controller’s
  % commanded voltage will never exceed this value. Note that this may
  % safely be above the nominal voltage of the motor; to determine the
  % actual motor voltage limit, divide the motor’s rated power by the
  % motor current limit.

ASPD_BETA_GATE = Simulink.Parameter(1, DataType="int32", Min=1, Max=5, Unit="SD")  % Sets the number of standard deviations used by the innovation consistency test.
ASPD_BETA_NOISE = Simulink.Parameter(0.3, DataType="single", Min=0, Max=1, Unit="rad")  % Sideslip measurement noise of the internal wind estimator(s) of the airspeed selector.
ASPD_DO_CHECKS = Simulink.Parameter(1, DataType="int32")  % If set to true then the data comming from the airspeed sensors is checked for validity. Only applied if ASPD_PRIMARY > 0.
ASPD_FALLBACK_GW = Simulink.Parameter(0, DataType="int32")  % If set to true and airspeed checks are enabled, it will use a sensor-less airspeed estimation based on groundspeed minus windspeed if no other airspeed sensor available to fall back to.
ASPD_FS_INNOV = Simulink.Parameter(1, DataType="single", Min=0.5, Max=3)  % This specifies the minimum airspeed test ratio required to trigger a failsafe. Larger values make the check less sensitive, smaller values make it more sensitive. Start with a value of 1.0 when tuning. When tas_test_ratio is > 1.0 it indicates the inconsistency between predicted and measured airspeed is large enough to cause the wind EKF to reject airspeed measurements. The time required to detect a fault when the threshold is exceeded depends on the size of the exceedance and is controlled by the ASPD_FS_INTEG parameter.
ASPD_FS_INTEG = Simulink.Parameter(5, DataType="single", Max=30, Unit="s")  % This sets the time integral of airspeed test ratio exceedance above ASPD_FS_INNOV required to trigger a failsafe. For example if ASPD_FS_INNOV is 1 and estimator_status.tas_test_ratio is 2.0, then the exceedance is 1.0 and the integral will rise at a rate of 1.0/second. A negative value disables the check. Larger positive values make the check less sensitive, smaller positive values make it more sensitive.
ASPD_FS_T_START = Simulink.Parameter(-1, DataType="int32", Min=-1, Max=1000, Unit="s")  % Delay before switching back to using airspeed sensor if checks indicate sensor is good. Set to a negative value to disable the re-enabling in flight.
ASPD_FS_T_STOP = Simulink.Parameter(2, DataType="int32", Min=1, Max=10, Unit="s")  % Delay before stopping use of airspeed sensor if checks indicate sensor is bad.
ASPD_PRIMARY = Simulink.Parameter(1, DataType="int32")
ASPD_SCALE = Simulink.Parameter(1, DataType="single", Min=0.5, Max=1.5)  % Scale can either be entered manually, or estimated in-flight by setting ASPD_SCALE_EST to 1.
ASPD_SCALE_EST = Simulink.Parameter(0, DataType="int32")  % Turns the automatic airspeed scale (scale from IAS to CAS) on or off. It is recommended to fly level altitude while performing the estimation. Set to 1 to start estimation (best when already flying). Set to 0 to end scale estimation. The estimated scale is then saved using the ASPD_SCALE parameter.
ASPD_SC_P_NOISE = Simulink.Parameter(0.0001, DataType="single", Min=0, Max=0.1, Unit="Hz")  % Airspeed scale process noise of the internal wind estimator(s) of the airspeed selector.
ASPD_TAS_GATE = Simulink.Parameter(3, DataType="int32", Min=1, Max=5, Unit="SD")  % Sets the number of standard deviations used by the innovation consistency test.
ASPD_TAS_NOISE = Simulink.Parameter(1.4, DataType="single", Min=0, Max=4, Unit="m/s")  % True airspeed measurement noise of the internal wind estimator(s) of the airspeed selector.
ASPD_W_P_NOISE = Simulink.Parameter(0.1, DataType="single", Min=0, Max=1, Unit="m/s^2")  % Wind process noise of the internal wind estimator(s) of the airspeed selector.
ATT_ACC_COMP = Simulink.Parameter(1, DataType="int32")
ATT_BIAS_MAX = Simulink.Parameter(0.05, DataType="single", Min=0, Max=2, Unit="rad/s")
ATT_EXT_HDG_M = Simulink.Parameter(0, DataType="int32", Min=0, Max=2)  % Set to 1 to use heading estimate from vision. Set to 2 to use heading from motion capture.
ATT_MAG_DECL = Simulink.Parameter(0, DataType="single", Unit="deg")  % This parameter is not used in normal operation, as the declination is looked up based on the GPS coordinates of the vehicle.
ATT_MAG_DECL_A = Simulink.Parameter(1, DataType="int32")
ATT_W_ACC = Simulink.Parameter(0.2, DataType="single", Min=0, Max=1)
ATT_W_EXT_HDG = Simulink.Parameter(0.1, DataType="single", Min=0, Max=1)
ATT_W_GYRO_BIAS = Simulink.Parameter(0.1, DataType="single", Min=0, Max=1)
ATT_W_MAG = Simulink.Parameter(0.1, DataType="single", Min=0, Max=1)  % Set to 0 to avoid using the magnetometer.
BAT1_A_PER_V = Simulink.Parameter(-1, DataType="single")  % The voltage seen by the ADC multiplied by this factor will determine the battery current. A value of -1 means to use the board default.
BAT1_CAPACITY = Simulink.Parameter(-1, DataType="single", Min=-1, Max=100000, Unit="mAh")  % Defines the capacity of battery 1 in mAh.
BAT1_I_CHANNEL = Simulink.Parameter(-1, DataType="int32")  % This parameter specifies the ADC channel used to monitor current of main power battery. A value of -1 means to use the board default.
BAT1_N_CELLS = Simulink.Parameter(0, DataType="int32")  % Defines the number of cells the attached battery consists of.
BAT1_R_INTERNAL = Simulink.Parameter(-1, DataType="single", Min=-1, Max=0.2, Unit="Ohm")  % If non-negative, then this will be used in place of BAT1_V_LOAD_DROP for all calculations.
BAT1_SOURCE = Simulink.Parameter(0, DataType="int32")  % This parameter controls the source of battery data. The value 'Power Module' means that measurements are expected to come from a power module. If the value is set to 'External' then the system expects to receive mavlink battery status messages. If the value is set to 'ESCs', the battery information are taken from the esc_status message. This requires the ESC to provide both voltage as well as current.
BAT1_V_CHANNEL = Simulink.Parameter(-1, DataType="int32")  % This parameter specifies the ADC channel used to monitor voltage of main power battery. A value of -1 means to use the board default.
BAT1_V_CHARGED = Simulink.Parameter(4.05, DataType="single", Unit="V")  % Defines the voltage where a single cell of battery 1 is considered full under a mild load. This will never be the nominal voltage of 4.2V
BAT1_V_DIV = Simulink.Parameter(-1, DataType="single")  % This is the divider from battery 1 voltage to ADC voltage. If using e.g. Mauch power modules the value from the datasheet can be applied straight here. A value of -1 means to use the board default.
BAT1_V_EMPTY = Simulink.Parameter(3.5, DataType="single", Unit="V")  % Defines the voltage where a single cell of battery 1 is considered empty. The voltage should be chosen before the steep dropoff to 2.8V. A typical lithium battery can only be discharged down to 10% before it drops off to a voltage level damaging the cells.
BAT1_V_LOAD_DROP = Simulink.Parameter(0.3, DataType="single", Min=0.07, Max=0.5, Unit="V")  % This implicitely defines the internal resistance to maximum current ratio for battery 1 and assumes linearity. A good value to use is the difference between the 5C and 20-25C load. Not used if BAT1_R_INTERNAL is set.
BAT2_A_PER_V = Simulink.Parameter(-1, DataType="single")  % The voltage seen by the ADC multiplied by this factor will determine the battery current. A value of -1 means to use the board default.
BAT2_CAPACITY = Simulink.Parameter(-1, DataType="single", Min=-1, Max=100000, Unit="mAh")  % Defines the capacity of battery 2 in mAh.
BAT2_I_CHANNEL = Simulink.Parameter(-1, DataType="int32")  % This parameter specifies the ADC channel used to monitor current of main power battery. A value of -1 means to use the board default.
BAT2_N_CELLS = Simulink.Parameter(0, DataType="int32")  % Defines the number of cells the attached battery consists of.
BAT2_R_INTERNAL = Simulink.Parameter(-1, DataType="single", Min=-1, Max=0.2, Unit="Ohm")  % If non-negative, then this will be used in place of BAT2_V_LOAD_DROP for all calculations.
BAT2_SOURCE = Simulink.Parameter(-1, DataType="int32")  % This parameter controls the source of battery data. The value 'Power Module' means that measurements are expected to come from a power module. If the value is set to 'External' then the system expects to receive mavlink battery status messages. If the value is set to 'ESCs', the battery information are taken from the esc_status message. This requires the ESC to provide both voltage as well as current.
BAT2_V_CHANNEL = Simulink.Parameter(-1, DataType="int32")  % This parameter specifies the ADC channel used to monitor voltage of main power battery. A value of -1 means to use the board default.
BAT2_V_CHARGED = Simulink.Parameter(4.05, DataType="single", Unit="V")  % Defines the voltage where a single cell of battery 1 is considered full under a mild load. This will never be the nominal voltage of 4.2V
BAT2_V_DIV = Simulink.Parameter(-1, DataType="single")  % This is the divider from battery 2 voltage to ADC voltage. If using e.g. Mauch power modules the value from the datasheet can be applied straight here. A value of -1 means to use the board default.
BAT2_V_EMPTY = Simulink.Parameter(3.5, DataType="single", Unit="V")  % Defines the voltage where a single cell of battery 1 is considered empty. The voltage should be chosen before the steep dropoff to 2.8V. A typical lithium battery can only be discharged down to 10% before it drops off to a voltage level damaging the cells.
BAT2_V_LOAD_DROP = Simulink.Parameter(0.3, DataType="single", Min=0.07, Max=0.5, Unit="V")  % This implicitely defines the internal resistance to maximum current ratio for battery 1 and assumes linearity. A good value to use is the difference between the 5C and 20-25C load. Not used if BAT2_R_INTERNAL is set.
BAT_ADC_CHANNEL = Simulink.Parameter(-1, DataType="int32")
BAT_CRIT_THR = Simulink.Parameter(0.07, DataType="single", Min=0.05, Max=0.25, Unit="norm")  % Sets the threshold when the battery will be reported as critically low. This has to be lower than the low threshold. This threshold commonly will trigger RTL.
BAT_EMERGEN_THR = Simulink.Parameter(0.05, DataType="single", Min=0.03, Max=0.1, Unit="norm")  % Sets the threshold when the battery will be reported as dangerously low. This has to be lower than the critical threshold. This threshold commonly will trigger landing.
BAT_N_CELLS = Simulink.Parameter(3, DataType="int32")
BAT_V_CHARGED = Simulink.Parameter(4.05, DataType="single")
BAT_V_EMPTY = Simulink.Parameter(3.5, DataType="single")
BAT_V_LOAD_DROP = Simulink.Parameter(0.3, DataType="single")
BAT_V_OFFS_CURR = Simulink.Parameter(0, DataType="single")  % This offset will be subtracted before calculating the battery current based on the voltage.
CAM_CAP_DELAY = Simulink.Parameter(0, DataType="single", Min=0, Max=100, Unit="ms")  % This parameter sets the delay between image integration start and strobe firing
CAM_CAP_EDGE = Simulink.Parameter(0, DataType="int32")
CAM_CAP_FBACK = Simulink.Parameter(0, DataType="int32")  % Enables camera capture feedback
CAM_CAP_MODE = Simulink.Parameter(0, DataType="int32")  % Change time measurement
TRIG_ACT_TIME = Simulink.Parameter(40, DataType="single", Min=0.1, Max=3000, Unit="ms")  % This parameter sets the time the trigger needs to pulled high or low.
TRIG_DISTANCE = Simulink.Parameter(25, DataType="single", Min=0, Unit="m")  % Sets the distance at which to trigger the camera.
TRIG_INTERFACE = Simulink.Parameter(4, DataType="int32")  % Selects the trigger interface
TRIG_INTERVAL = Simulink.Parameter(40, DataType="single", Min=4, Max=10000, Unit="ms")  % This parameter sets the time between two consecutive trigger events
TRIG_MIN_INTERVA = Simulink.Parameter(1, DataType="single", Min=1, Max=10000, Unit="ms")  % This parameter sets the minimum time between two consecutive trigger events the specific camera setup is supporting.
TRIG_MODE = Simulink.Parameter(0, DataType="int32", Min=0, Max=4)
TRIG_PINS = Simulink.Parameter(56, DataType="int32", Min=1, Max=12345678)  % Selects which FMU pin is used (range: AUX1-AUX8 on Pixhawk controllers with an I/O board, MAIN1-MAIN8 on controllers without an I/O board). The PWM interface takes two pins per camera, while relay triggers on every pin individually. Example: Value 56 would trigger on pins 5 and 6. For GPIO mode Pin 6 will be triggered followed by 5. With a value of 65 pin 5 will be triggered followed by 6. Pins may be non contiguous. I.E. 16 or 61. In GPIO mode the delay pin to pin is < .2 uS.
TRIG_PINS_EX = Simulink.Parameter(0, DataType="int32", Min=0, Max=2147483647)  % This Bit mask selects which FMU pin is used (range: AUX9-AUX32) If the value is not 0 it takes precedence over TRIG_PINS. If bits above 8 are set that value is used as the selector for trigger pins. greater then 8. 0x00000300 Would be Pins 9,10. If the value is
TRIG_POLARITY = Simulink.Parameter(0, DataType="int32", Min=0, Max=1)  % This parameter sets the polarity of the trigger (0 = active low, 1 = active high )
TRIG_PWM_NEUTRAL = Simulink.Parameter(1500, DataType="int32", Min=1000, Max=2000, Unit="us")
TRIG_PWM_SHOOT = Simulink.Parameter(1900, DataType="int32", Min=1000, Max=2000, Unit="us")
CBRK_AIRSPD_CHK = Simulink.Parameter(0, DataType="int32", Min=0, Max=162128)  % Setting this parameter to 162128 will disable the check for an airspeed sensor. The sensor driver will not be started and it cannot be calibrated. WARNING: ENABLING THIS CIRCUIT BREAKER IS AT OWN RISK
CBRK_BUZZER = Simulink.Parameter(0, DataType="int32", Min=0, Max=782097)  % Setting this parameter to 782097 will disable the buzzer audio notification. Setting this parameter to 782090 will disable the startup tune, while keeping all others enabled.
CBRK_ENGINEFAIL = Simulink.Parameter(284953, DataType="int32", Min=0, Max=284953)  % Setting this parameter to 284953 will disable the engine failure detection. If the aircraft is in engine failure mode the engine failure flag will be set to healthy WARNING: ENABLING THIS CIRCUIT BREAKER IS AT OWN RISK
CBRK_FLIGHTTERM = Simulink.Parameter(121212, DataType="int32", Min=0, Max=121212)  % Setting this parameter to 121212 will disable the flight termination action if triggered by the FailureDetector logic or if FMU is lost. This circuit breaker does not affect the RC loss, data link loss, geofence, and takeoff failure detection safety logic.
CBRK_IO_SAFETY = Simulink.Parameter(22027, DataType="int32", Min=0, Max=22027)  % Setting this parameter to 22027 will disable IO safety. WARNING: ENABLING THIS CIRCUIT BREAKER IS AT OWN RISK
CBRK_RATE_CTRL = Simulink.Parameter(0, DataType="int32", Min=0, Max=140253)  % Setting this parameter to 140253 will disable the rate controller uORB publication. WARNING: ENABLING THIS CIRCUIT BREAKER IS AT OWN RISK
CBRK_SUPPLY_CHK = Simulink.Parameter(0, DataType="int32", Min=0, Max=894281)  % Setting this parameter to 894281 will disable the power valid checks in the commander. WARNING: ENABLING THIS CIRCUIT BREAKER IS AT OWN RISK
CBRK_USB_CHK = Simulink.Parameter(197848, DataType="int32", Min=0, Max=197848)  % Setting this parameter to 197848 will disable the USB connected checks in the commander, setting it to 0 keeps them enabled (recommended). We are generally recommending to not fly with the USB link connected and production vehicles should set this parameter to zero to prevent users from flying USB powered. However, for R&D purposes it has proven over the years to work just fine.
CBRK_VELPOSERR = Simulink.Parameter(0, DataType="int32", Min=0, Max=201607)  % Setting this parameter to 201607 will disable the position and velocity accuracy checks in the commander. WARNING: ENABLING THIS CIRCUIT BREAKER IS AT OWN RISK
CBRK_VTOLARMING = Simulink.Parameter(0, DataType="int32", Min=0, Max=159753)  % Setting this parameter to 159753 will enable arming in fixed-wing mode for VTOLs. WARNING: ENABLING THIS CIRCUIT BREAKER IS AT OWN RISK
COM_ARM_ARSP_EN = Simulink.Parameter(1, DataType="int32")  % Deny arming if the current airspeed measurement is greater than half the cruise airspeed (FW_AIRSPD_TRIM). Excessive airspeed measurements on ground are either caused by wind or bad airspeed calibration.
COM_ARM_AUTH_ID = Simulink.Parameter(10, DataType="int32")  % Used if arm authorization is requested by COM_ARM_AUTH_REQ.
COM_ARM_AUTH_MET = Simulink.Parameter(0, DataType="int32")  % Methods: - one arm: request authorization and arm when authorization is received - two step arm: 1st arm command request an authorization and 2nd arm command arm the drone if authorized Used if arm authorization is requested by COM_ARM_AUTH_REQ.
COM_ARM_AUTH_REQ = Simulink.Parameter(0, DataType="int32")  % By default off. The default allows to arm the vehicle without a arm authorization.
COM_ARM_AUTH_TO = Simulink.Parameter(1, DataType="single", Unit="s")  % Timeout for authorizer answer. Used if arm authorization is requested by COM_ARM_AUTH_REQ.
COM_ARM_CHK_ESCS = Simulink.Parameter(0, DataType="int32")  % If this parameter is set, the system will check ESC's online status and failures. This param is specific for ESCs reporting status. It shall be used only if ESCs support telemetry.
COM_ARM_EKF_HGT = Simulink.Parameter(1, DataType="single", Min=0.1, Max=1)
COM_ARM_EKF_POS = Simulink.Parameter(0.5, DataType="single", Min=0.1, Max=1)
COM_ARM_EKF_VEL = Simulink.Parameter(0.5, DataType="single", Min=0.1, Max=1)
COM_ARM_EKF_YAW = Simulink.Parameter(0.5, DataType="single", Min=0.1, Max=1)
COM_ARM_IMU_ACC = Simulink.Parameter(0.7, DataType="single", Min=0.1, Max=1, Unit="m/s^2")
COM_ARM_IMU_GYR = Simulink.Parameter(0.25, DataType="single", Min=0.02, Max=0.3, Unit="rad/s")
COM_ARM_MAG_ANG = Simulink.Parameter(45, DataType="int32", Min=3, Max=180, Unit="deg")  % Set -1 to disable the check.
COM_ARM_MAG_STR = Simulink.Parameter(1, DataType="int32")  % Deny arming if the estimator detects a strong magnetic disturbance (check enabled by EKF2_MAG_CHECK)
COM_ARM_MIS_REQ = Simulink.Parameter(0, DataType="int32")  % The default allows to arm the vehicle without a valid mission.
COM_ARM_SDCARD = Simulink.Parameter(1, DataType="int32")  % This check detects if the FMU SD card is missing. Depending on the value of the parameter, the check can be disabled, warn only or deny arming.
COM_ARM_SWISBTN = Simulink.Parameter(0, DataType="int32")  % 0: Arming/disarming triggers on switch transition. 1: Arming/disarming triggers when holding the momentary button down for COM_RC_ARM_HYST like the stick gesture.
COM_ARM_WO_GPS = Simulink.Parameter(1, DataType="int32")  % The default allows the vehicle to arm without GPS signal.
COM_CPU_MAX = Simulink.Parameter(90, DataType="single", Min=-1, Max=100, Unit="%")  % A negative value disables the check.
COM_DISARM_LAND = Simulink.Parameter(2, DataType="single", Unit="s")  % A non-zero, positive value specifies the time-out period in seconds after which the vehicle will be automatically disarmed in case a landing situation has been detected during this period. A zero or negative value means that automatic disarming triggered by landing detection is disabled.
COM_DISARM_PRFLT = Simulink.Parameter(10, DataType="single", Unit="s")  % A non-zero, positive value specifies the time in seconds, within which the vehicle is expected to take off after arming. In case the vehicle didn't takeoff within the timeout it disarms again. A negative value disables autmoatic disarming triggered by a pre-takeoff timeout.
COM_DL_LOSS_T = Simulink.Parameter(10, DataType="int32", Min=5, Max=300, Unit="s")  % After this amount of seconds without datalink the data link lost mode triggers
COM_EF_C2T = Simulink.Parameter(5, DataType="single", Min=0, Max=50, Unit="A/%")  % Engine failure triggers only below this current value
COM_EF_THROT = Simulink.Parameter(0.5, DataType="single", Min=0, Max=1, Unit="norm")  % Engine failure triggers only above this throttle value
COM_EF_TIME = Simulink.Parameter(10, DataType="single", Min=0, Max=60, Unit="s")  % Engine failure triggers only if the throttle threshold and the current to throttle threshold are violated for this time
COM_FLIGHT_UUID = Simulink.Parameter(0, DataType="int32", Min=0)  % This number is incremented automatically after every flight on disarming in order to remember the next flight UUID. The first flight is 0.
COM_FLTMODE1 = Simulink.Parameter(-1, DataType="int32")  % If the main switch channel is in this range the selected flight mode will be applied.
COM_FLTMODE2 = Simulink.Parameter(-1, DataType="int32")  % If the main switch channel is in this range the selected flight mode will be applied.
COM_FLTMODE3 = Simulink.Parameter(-1, DataType="int32")  % If the main switch channel is in this range the selected flight mode will be applied.
COM_FLTMODE4 = Simulink.Parameter(-1, DataType="int32")  % If the main switch channel is in this range the selected flight mode will be applied.
COM_FLTMODE5 = Simulink.Parameter(-1, DataType="int32")  % If the main switch channel is in this range the selected flight mode will be applied.
COM_FLTMODE6 = Simulink.Parameter(-1, DataType="int32")  % If the main switch channel is in this range the selected flight mode will be applied.
COM_FLT_PROFILE = Simulink.Parameter(0, DataType="int32")  % Describes the intended use of the vehicle. Can be used by ground control software or log post processing. This param does not influence the behavior within the firmware. This means for example the control logic is independent of the setting of this param (but depends on other params).
COM_HLDL_LOSS_T = Simulink.Parameter(120, DataType="int32", Min=60, Max=3600, Unit="s")  % After this amount of seconds without datalink the data link lost mode triggers
COM_HLDL_REG_T = Simulink.Parameter(0, DataType="int32", Min=0, Max=60, Unit="s")  % After a data link loss: after this number of seconds with a healthy datalink the 'datalink loss' flag is set back to false
COM_HOME_H_T = Simulink.Parameter(5, DataType="single", Min=2, Max=15, Unit="m")  % The home position will be set if the estimated positioning accuracy is below the threshold.
COM_HOME_IN_AIR = Simulink.Parameter(0, DataType="int32")  % If set to true, the autopilot is allowed to set its home position after takeoff The true home position is back-computed if a local position is estimate if available. If no local position is available, home is set to the current position.
COM_HOME_V_T = Simulink.Parameter(10, DataType="single", Min=5, Max=25, Unit="m")  % The home position will be set if the estimated positioning accuracy is below the threshold.
COM_KILL_DISARM = Simulink.Parameter(5, DataType="single", Min=0, Max=30, Unit="s")
COM_LKDOWN_TKO = Simulink.Parameter(3, DataType="single", Min=-1, Max=5, Unit="s")  % A non-zero, positive value specifies the timeframe in seconds within failure detector is allowed to put the vehicle into a lockdown state if attitude exceeds the limits defined in FD_FAIL_P and FD_FAIL_R. The check is not executed for flight modes that do support acrobatic maneuvers, e.g: Acro (MC/FW) and Manual (FW). A zero or negative value means that the check is disabled.
COM_LOW_BAT_ACT = Simulink.Parameter(0, DataType="int32")  % Action the system takes at critical battery. See also BAT_CRIT_THR and BAT_EMERGEN_THR for definition of battery states.
COM_MOT_TEST_EN = Simulink.Parameter(1, DataType="int32")  % If set, enables the motor test interface via MAVLink (DO_MOTOR_TEST), that allows spinning the motors for testing purposes.
COM_OBC_LOSS_T = Simulink.Parameter(5, DataType="single", Min=0, Max=60, Unit="s")
COM_OBL_ACT = Simulink.Parameter(0, DataType="int32")  % The offboard loss failsafe will only be entered after a timeout, set by COM_OF_LOSS_T in seconds.
COM_OBL_RC_ACT = Simulink.Parameter(0, DataType="int32")  % The offboard loss failsafe will only be entered after a timeout, set by COM_OF_LOSS_T in seconds.
COM_OBS_AVOID = Simulink.Parameter(0, DataType="int32")
COM_OF_LOSS_T = Simulink.Parameter(1, DataType="single", Min=0, Max=60, Unit="s")  % See COM_OBL_ACT and COM_OBL_RC_ACT to configure action.
COM_POSCTL_NAVL = Simulink.Parameter(0, DataType="int32")  % This sets the flight mode that will be used if navigation accuracy is no longer adequate for position control. Navigation accuracy checks can be disabled using the CBRK_VELPOSERR parameter, but doing so will remove protection for all flight modes.
COM_POS_FS_DELAY = Simulink.Parameter(1, DataType="int32", Min=1, Max=100, Unit="s")  % This sets number of seconds that the position checks need to be failed before the failsafe will activate. The default value has been optimised for rotary wing applications. For fixed wing applications, a larger value between 5 and 10 should be used.
COM_POS_FS_EPH = Simulink.Parameter(5, DataType="single", Unit="m")  % This is the horizontal position error (EPH) threshold that will trigger a failsafe. The default is appropriate for a multicopter. Can be increased for a fixed-wing.
COM_POS_FS_EPV = Simulink.Parameter(10, DataType="single", Unit="m")  % This is the vertical position error (EPV) threshold that will trigger a failsafe. The default is appropriate for a multicopter. Can be increased for a fixed-wing.
COM_POS_FS_GAIN = Simulink.Parameter(10, DataType="int32")  % This sets the rate that the loss of position probation time grows when position checks are failing. The default value has been optimised for rotary wing applications. For fixed wing applications a value of 0 should be used.
COM_POS_FS_PROB = Simulink.Parameter(30, DataType="int32", Min=1, Max=100, Unit="s")  % The probation delay is the number of seconds that the EKF innovation checks need to pass for the position to be declared good after it has been declared bad. The probation delay will be reset to this parameter value when takeoff is detected. After takeoff, if position checks are passing, the probation delay will reduce by one second for every lapsed second of valid position down to a minimum of 1 second. If position checks are failing, the probation delay will increase by COM_POS_FS_GAIN seconds for every lapsed second up to a maximum of 100 seconds. The default value has been optimised for rotary wing applications. For fixed wing applications, a value of 1 should be used.
COM_POWER_COUNT = Simulink.Parameter(1, DataType="int32", Min=0, Max=4)  % This configures a check to verify the expected number of 5V rail power supplies are present. By default only one is expected. Note: CBRK_SUPPLY_CHK disables all power checks including this one.
COM_PREARM_MODE = Simulink.Parameter(0, DataType="int32")  % Condition to enter the prearmed state, an intermediate state between disarmed and armed in which non-throttling actuators are active.
COM_RCL_ACT_T = Simulink.Parameter(15, DataType="single", Min=0, Max=25, Unit="s")  % RC signal not updated -> still use data for COM_RC_LOSS_T seconds Consider RC signal lost -> wait COM_RCL_ACT_T seconds on the spot waiting to regain signal React with failsafe action NAV_RCL_ACT A zero value disables the delay.
COM_RCL_EXCEPT = Simulink.Parameter(0, DataType="int32", Min=0, Max=31)  % Specify modes in which RC loss is ignored and the failsafe action not triggered.
COM_RC_ARM_HYST = Simulink.Parameter(1000, DataType="int32", Min=100, Max=1500, Unit="ms")  % The default value of 1000 requires the stick to be held in the arm or disarm position for 1 second.
COM_RC_IN_MODE = Simulink.Parameter(0, DataType="int32", Min=0, Max=2)  % The default value of 0 requires a valid RC transmitter setup. Setting this to 1 allows joystick control and disables RC input handling and the associated checks. A value of 2 will generate RC control data from manual input received via MAVLink instead of directly forwarding the manual input data.
COM_RC_LOSS_T = Simulink.Parameter(0.5, DataType="single", Min=0, Max=35, Unit="s")  % After this amount of seconds without RC connection it's considered lost and not used anymore
COM_RC_OVERRIDE = Simulink.Parameter(1, DataType="int32", Min=0, Max=7)  % When RC stick override is enabled, moving the RC sticks more than COM_RC_STICK_OV from their center position immediately gives control back to the pilot by switching to Position mode. Note: Only has an effect on multicopters, and VTOLs in multicopter mode.
COM_RC_STICK_OV = Simulink.Parameter(30, DataType="single", Min=5, Max=80, Unit="%")  % If COM_RC_OVERRIDE is enabled and the joystick input is moved more than this threshold the autopilot the pilot takes over control.
COM_REARM_GRACE = Simulink.Parameter(1, DataType="int32")  % Re-arming grace allows to rearm the drone with manual command without running prearmcheck during 5 s after disarming.
COM_TAKEOFF_ACT = Simulink.Parameter(0, DataType="int32")  % The mode transition after TAKEOFF has completed successfully.
COM_VEL_FS_EVH = Simulink.Parameter(1, DataType="single", Unit="m/s")  % This is the horizontal velocity error (EVH) threshold that will trigger a failsafe. The default is appropriate for a multicopter. Can be increased for a fixed-wing.
NAV_DLL_ACT = Simulink.Parameter(0, DataType="int32", Min=0, Max=6)  % The data link loss failsafe will only be entered after a timeout, set by COM_DL_LOSS_T in seconds. Once the timeout occurs the selected action will be executed.
NAV_RCL_ACT = Simulink.Parameter(2, DataType="int32", Min=1, Max=6)  % The RC loss failsafe will only be entered after a timeout, set by COM_RC_LOSS_T in seconds. If RC input checks have been disabled by setting the COM_RC_IN_MODE param it will not be triggered.
RTL_FLT_TIME = Simulink.Parameter(15, DataType="single", Unit="min")  % This is used to determine when the vehicle should be switched to RTL due to low battery. Note, particularly for multirotors this should reflect flight time at cruise speed, not while stationary
DSHOT_3D_DEAD_H = Simulink.Parameter(1000, DataType="int32", Min=1000, Max=1999)  % When the actuator_output is between DSHOT_3D_DEAD_L and DSHOT_3D_DEAD_H, motor will not spin. This value is with respect to the mixer_module range (0-1999), not the DSHOT values.
DSHOT_3D_DEAD_L = Simulink.Parameter(1000, DataType="int32", Min=0, Max=1000)  % When the actuator_output is between DSHOT_3D_DEAD_L and DSHOT_3D_DEAD_H, motor will not spin. This value is with respect to the mixer_module range (0-1999), not the DSHOT values.
DSHOT_3D_ENABLE = Simulink.Parameter(0, DataType="int32")  % WARNING: ESC must be configured for 3D mode, and DSHOT_MIN set to 0. This splits the throttle ranges in two. Direction 1) 48 is the slowest, 1047 is the fastest. Direction 2) 1049 is the slowest, 2047 is the fastest. When mixer outputs 1000 or value inside DSHOT 3D deadband, DShot 0 is sent.
DSHOT_CONFIG = Simulink.Parameter(0, DataType="int32")  % This enables/disables DShot. The different modes define different speeds, for example DShot150 = 150kb/s. Not all ESCs support all modes. Note: this enables DShot on the FMU outputs. For boards with an IO it is the AUX outputs.
DSHOT_MIN = Simulink.Parameter(0.055, DataType="single", Min=0, Max=1, Unit="%")  % Minimum Output Value for DShot in percent. The value depends on the ESC. Make sure to set this high enough so that the motors are always spinning while armed.
DSHOT_TEL_CFG = Simulink.Parameter(0, DataType="int32")  % Configure on which serial port to run DShot Driver.
MOT_POLE_COUNT = Simulink.Parameter(14, DataType="int32")  % Specify the number of magnetic poles of the motors. It is required to compute the RPM value from the eRPM returned with the ESC telemetry. Either get the number from the motor spec sheet or count the magnets on the bell of the motor (not the stator magnets). Typical motors for 5 inch props have 14 poles.
NAV_AH_ALT = Simulink.Parameter(600, DataType="single", Min=-50, Unit="m")  % Altitude of airfield home waypoint
NAV_AH_LAT = Simulink.Parameter(-265847810, DataType="int32", Min=-900000000, Max=900000000, Unit="deg*1e7")  % Latitude of airfield home waypoint
NAV_AH_LON = Simulink.Parameter(1518423250, DataType="int32", Min=-1800000000, Max=1800000000, Unit="deg*1e7")  % Longitude of airfield home waypoint
EKF2_ABIAS_INIT = Simulink.Parameter(0.2, DataType="single", Min=0, Max=0.5, Unit="m/s^2")
EKF2_ABL_ACCLIM = Simulink.Parameter(25, DataType="single", Min=20, Max=200, Unit="m/s^2")  % If the magnitude of the IMU accelerometer vector exceeds this value, the EKF delta velocity state estimation will be inhibited. This reduces the adverse effect of high manoeuvre accelerations and IMU nonlinerity and scale factor errors on the delta velocity bias estimates.
EKF2_ABL_GYRLIM = Simulink.Parameter(3, DataType="single", Min=2, Max=20, Unit="rad/s")  % If the magnitude of the IMU angular rate vector exceeds this value, the EKF delta velocity state estimation will be inhibited. This reduces the adverse effect of rapid rotation rates and associated errors on the delta velocity bias estimates.
EKF2_ABL_LIM = Simulink.Parameter(0.4, DataType="single", Min=0, Max=0.8, Unit="m/s^2")  % The ekf delta velocity bias states will be limited to within a range equivalent to +- of this value.
EKF2_ABL_TAU = Simulink.Parameter(0.5, DataType="single", Min=0.1, Max=1, Unit="s")  % The vector magnitude of angular rate and acceleration used to check if learning should be inhibited has a peak hold filter applied to it with an exponential decay. This parameter controls the time constant of the decay.
EKF2_ACC_B_NOISE = Simulink.Parameter(0.003, DataType="single", Min=0, Max=0.01, Unit="m/s^3")
EKF2_ACC_NOISE = Simulink.Parameter(0.35, DataType="single", Min=0.01, Max=1, Unit="m/s^2")
EKF2_AID_MASK = Simulink.Parameter(1, DataType="int32", Min=0, Max=511)  % Set bits in the following positions to enable: 0 : Set to true to use GPS data if available 1 : Set to true to use optical flow data if available 2 : Set to true to inhibit IMU delta velocity bias estimation 3 : Set to true to enable vision position fusion 4 : Set to true to enable vision yaw fusion. Cannot be used if bit position 7 is true. 5 : Set to true to enable multi-rotor drag specific force fusion 6 : set to true if the EV observations are in a non NED reference frame and need to be rotated before being used 7 : Set to true to enable GPS yaw fusion. Cannot be used if bit position 4 is true.
EKF2_ANGERR_INIT = Simulink.Parameter(0.1, DataType="single", Min=0, Max=0.5, Unit="rad")
EKF2_ARSP_THR = Simulink.Parameter(0, DataType="single", Min=0, Unit="m/s")  % A value of zero will deactivate airspeed fusion. Any other positive value will determine the minimum airspeed which will still be fused. Set to about 90% of the vehicles stall speed. Both airspeed fusion and sideslip fusion must be active for the EKF to continue navigating after loss of GPS. Use EKF2_FUSE_BETA to activate sideslip fusion.
EKF2_ASPD_MAX = Simulink.Parameter(20, DataType="single", Min=5, Max=50, Unit="m/s")
EKF2_ASP_DELAY = Simulink.Parameter(100, DataType="single", Min=0, Max=300, Unit="ms")
EKF2_AVEL_DELAY = Simulink.Parameter(5, DataType="single", Min=0, Max=300, Unit="ms")
EKF2_BARO_DELAY = Simulink.Parameter(0, DataType="single", Min=0, Max=300, Unit="ms")
EKF2_BARO_GATE = Simulink.Parameter(5, DataType="single", Min=1, Unit="SD")  % Sets the number of standard deviations used by the innovation consistency test.
EKF2_BARO_NOISE = Simulink.Parameter(3.5, DataType="single", Min=0.01, Max=15, Unit="m")
EKF2_BCOEF_X = Simulink.Parameter(100, DataType="single", Min=0, Max=200, Unit="kg/m^2")  % This parameter controls the prediction of drag produced by bluff body drag along the forward/reverse axis when flying a multi-copter which enables estimation of wind drift when enabled by the EKF2_AID_MASK parameter. The EKF2_BCOEF_X paraemter should be set initially to the ratio of mass / projected frontal area and adjusted together with EKF2_MCOEF to minimise variance of the X-axis drag specific force innovation sequence. The drag produced by this effect scales with speed squared. Set this parameter to zero to turn off the bluff body drag model for this axis. The predicted drag from the rotors is specified separately by the EKF2_MCOEF parameter.
EKF2_BCOEF_Y = Simulink.Parameter(100, DataType="single", Min=0, Max=200, Unit="kg/m^2")  % This parameter controls the prediction of drag produced by bluff body drag along the right/left axis when flying a multi-copter, which enables estimation of wind drift when enabled by the EKF2_AID_MASK parameter. The EKF2_BCOEF_Y paraemter should be set initially to the ratio of mass / projected side area and adjusted together with EKF2_MCOEF to minimise variance of the Y-axis drag specific force innovation sequence. The drag produced by this effect scales with speed squared. et this parameter to zero to turn off the bluff body drag model for this axis. The predicted drag from the rotors is specified separately by the EKF2_MCOEF parameter.
EKF2_BETA_GATE = Simulink.Parameter(5, DataType="single", Min=1, Unit="SD")  % Sets the number of standard deviations used by the innovation consistency test.
EKF2_BETA_NOISE = Simulink.Parameter(0.3, DataType="single", Min=0.1, Max=1, Unit="m/s")
EKF2_DECL_TYPE = Simulink.Parameter(7, DataType="int32", Min=0, Max=7)  % Set bits in the following positions to enable functions. 0 : Set to true to use the declination from the geo_lookup library when the GPS position becomes available, set to false to always use the EKF2_MAG_DECL value. 1 : Set to true to save the EKF2_MAG_DECL parameter to the value returned by the EKF when the vehicle disarms. 2 : Set to true to always use the declination as an observation when 3-axis magnetometer fusion is being used.
EKF2_DRAG_NOISE = Simulink.Parameter(2.5, DataType="single", Min=0.5, Max=10, Unit="(m/s^2)^2")  % Increasing this makes the multi-rotor wind estimates adjust more slowly.
EKF2_EAS_NOISE = Simulink.Parameter(1.4, DataType="single", Min=0.5, Max=5, Unit="m/s")
EKF2_EVA_NOISE = Simulink.Parameter(0.05, DataType="single", Min=0.05, Unit="rad")
EKF2_EVP_GATE = Simulink.Parameter(5, DataType="single", Min=1, Unit="SD")  % Sets the number of standard deviations used by the innovation consistency test.
EKF2_EVP_NOISE = Simulink.Parameter(0.1, DataType="single", Min=0.01, Unit="m")
EKF2_EVV_GATE = Simulink.Parameter(3, DataType="single", Min=1, Unit="SD")  % Sets the number of standard deviations used by the innovation consistency test.
EKF2_EVV_NOISE = Simulink.Parameter(0.1, DataType="single", Min=0.01, Unit="m/s")
EKF2_EV_DELAY = Simulink.Parameter(175, DataType="single", Min=0, Max=300, Unit="ms")
EKF2_EV_NOISE_MD = Simulink.Parameter(0, DataType="int32")  % If set to true the observation noise is set from the parameters directly, if set to false the measurement noise is taken from the vision message and the parameter are used as a lower bound.
EKF2_EV_POS_X = Simulink.Parameter(0, DataType="single", Unit="m")
EKF2_EV_POS_Y = Simulink.Parameter(0, DataType="single", Unit="m")
EKF2_EV_POS_Z = Simulink.Parameter(0, DataType="single", Unit="m")
EKF2_FUSE_BETA = Simulink.Parameter(0, DataType="int32")  % A value of 1 indicates that fusion is active Both  sideslip fusion and airspeed fusion must be active for the EKF to continue navigating after loss of GPS. Use EKF2_ARSP_THR to activate airspeed fusion.
EKF2_GBIAS_INIT = Simulink.Parameter(0.1, DataType="single", Min=0, Max=0.2, Unit="rad/s")
EKF2_GND_EFF_DZ = Simulink.Parameter(4, DataType="single", Min=0, Max=10, Unit="m")  % Sets the value of deadzone applied to negative baro innovations. Deadzone is enabled when EKF2_GND_EFF_DZ > 0.
EKF2_GND_MAX_HGT = Simulink.Parameter(0.5, DataType="single", Min=0, Max=5, Unit="m")  % Sets the maximum distance to the ground level where negative baro innovations are expected.
EKF2_GPS_CHECK = Simulink.Parameter(245, DataType="int32", Min=0, Max=511)  % Set bits to 1 to enable checks. Checks enabled by the following bit positions 0 : Minimum required sat count set by EKF2_REQ_NSATS 1 : Maximum allowed PDOP set by EKF2_REQ_PDOP 2 : Maximum allowed horizontal position error set by EKF2_REQ_EPH 3 : Maximum allowed vertical position error set by EKF2_REQ_EPV 4 : Maximum allowed speed error set by EKF2_REQ_SACC 5 : Maximum allowed horizontal position rate set by EKF2_REQ_HDRIFT. This check will only run when the vehicle is on ground and stationary. Detecton of the stationary condition is controlled by the EKF2_MOVE_TEST parameter. 6 : Maximum allowed vertical position rate set by EKF2_REQ_VDRIFT. This check will only run when the vehicle is on ground and stationary. Detecton of the stationary condition is controlled by the EKF2_MOVE_TEST parameter. 7 : Maximum allowed horizontal speed set by EKF2_REQ_HDRIFT. This check will only run when the vehicle is on ground and stationary. Detecton of the stationary condition is controlled by the EKF2_MOVE_TEST parameter. 8 : Maximum allowed vertical velocity discrepancy set by EKF2_REQ_VDRIFT
EKF2_GPS_DELAY = Simulink.Parameter(110, DataType="single", Min=0, Max=300, Unit="ms")
EKF2_GPS_POS_X = Simulink.Parameter(0, DataType="single", Unit="m")
EKF2_GPS_POS_Y = Simulink.Parameter(0, DataType="single", Unit="m")
EKF2_GPS_POS_Z = Simulink.Parameter(0, DataType="single", Unit="m")
EKF2_GPS_P_GATE = Simulink.Parameter(5, DataType="single", Min=1, Unit="SD")  % Sets the number of standard deviations used by the innovation consistency test.

EKF2_GPS_P_NOISE = Simulink.Parameter(0.5, DataType="single", Min=0.01, Max=10, Unit="m")
EKF2_GPS_V_GATE = Simulink.Parameter(5, DataType="single", Min=1, Unit="SD")  % Sets the number of standard deviations used by the innovation consistency test.
EKF2_GPS_V_NOISE = Simulink.Parameter(0.3, DataType="single", Min=0.01, Max=5, Unit="m/s")
EKF2_GSF_TAS = Simulink.Parameter(15, DataType="single", Min=0, Max=100, Unit="m/s")  % If no airspeed measurements are avalable, the EKF-GSF AHRS calculation will assume this value of true airspeed when compensating for centripetal acceleration during turns. Set to zero to disable centripetal acceleration compensation during fixed wing flight modes.
EKF2_GYR_B_NOISE = Simulink.Parameter(0.001, DataType="single", Min=0, Max=0.01, Unit="rad/s^2")
EKF2_GYR_NOISE = Simulink.Parameter(0.015, DataType="single", Min=0.0001, Max=0.1, Unit="rad/s")
EKF2_HDG_GATE = Simulink.Parameter(2.6, DataType="single", Min=1, Unit="SD")  % Sets the number of standard deviations used by the innovation consistency test.
EKF2_HEAD_NOISE = Simulink.Parameter(0.3, DataType="single", Min=0.01, Max=1, Unit="rad")
EKF2_HGT_MODE = Simulink.Parameter(0, DataType="int32")  % The range sensor option should only be used when for operation over a flat surface as the local NED origin will move up and down with ground level.
EKF2_IMU_POS_X = Simulink.Parameter(0, DataType="single", Unit="m")
EKF2_IMU_POS_Y = Simulink.Parameter(0, DataType="single", Unit="m")
EKF2_IMU_POS_Z = Simulink.Parameter(0, DataType="single", Unit="m")
EKF2_MAG_ACCLIM = Simulink.Parameter(0.5, DataType="single", Min=0, Max=5, Unit="m/s^2")  % This parameter is used when the magnetometer fusion method is set automatically (EKF2_MAG_TYPE = 0). If the filtered horizontal acceleration is greater than this parameter value, then the EKF will use 3-axis magnetomer fusion.
EKF2_MAG_B_NOISE = Simulink.Parameter(0.0001, DataType="single", Min=0, Max=0.1, Unit="gauss/s")
EKF2_MAG_CHECK = Simulink.Parameter(0, DataType="int32")  % When set, the EKF checks the strength of the magnetic field to decide whether the magnetometer data is valid. If GPS data is received, the magnetic field is compared to a World Magnetic Model (WMM), otherwise an average value is used. This check is useful to reject occasional hard iron disturbance.
EKF2_MAG_DECL = Simulink.Parameter(0, DataType="single", Unit="deg")
EKF2_MAG_DELAY = Simulink.Parameter(0, DataType="single", Min=0, Max=300, Unit="ms")
EKF2_MAG_E_NOISE = Simulink.Parameter(0.001, DataType="single", Min=0, Max=0.1, Unit="gauss/s")
EKF2_MAG_GATE = Simulink.Parameter(3, DataType="single", Min=1, Unit="SD")  % Sets the number of standard deviations used by the innovation consistency test.
EKF2_MAG_NOISE = Simulink.Parameter(0.05, DataType="single", Min=0.001, Max=1, Unit="gauss")
EKF2_MAG_TYPE = Simulink.Parameter(0, DataType="int32")  % Integer controlling the type of magnetometer fusion used - magnetic heading or 3-component vector. The fuson of magnetomer data as a three component vector enables vehicle body fixed hard iron errors to be learned, but requires a stable earth field. If set to 'Automatic' magnetic heading fusion is used when on-ground and 3-axis magnetic field fusion in-flight with fallback to magnetic heading fusion if there is insufficient motion to make yaw or magnetic field states observable. If set to 'Magnetic heading' magnetic heading fusion is used at all times If set to '3-axis' 3-axis field fusion is used at all times. If set to 'VTOL custom' the behaviour is the same as 'Automatic', but if fusing airspeed, magnetometer fusion is only allowed to modify the magnetic field states. This can be used by VTOL platforms with large magnetic field disturbances to prevent incorrect bias states being learned during forward flight operation which can adversely affect estimation accuracy after transition to hovering flight. If set to 'MC custom' the behaviour is the same as 'Automatic, but if there are no earth frame position or velocity observations being used, the magnetometer will not be used. This enables vehicles to operate with no GPS in environments where the magnetic field cannot be used to provide a heading reference. Prior to flight, the yaw angle is assumed to be constant if movement tests controlled by the EKF2_MOVE_TEST parameter indicate that the vehicle is static. This allows the vehicle to be placed on the ground to learn the yaw gyro bias prior to flight. If set to 'None' the magnetometer will not be used under any circumstance. If no external source of yaw is available, it is possible to use post-takeoff horizontal movement combined with GPS velocity measurements to align the yaw angle with the timer required (depending on the amount of movement and GPS data quality). Other external sources of yaw may be used if selected via the EKF2_AID_MASK parameter.
EKF2_MAG_YAWLIM = Simulink.Parameter(0.25, DataType="single", Min=0, Max=1, Unit="rad/s")  % This parameter is used when the magnetometer fusion method is set automatically (EKF2_MAG_TYPE = 0). If the filtered yaw rate is greater than this parameter value, then the EKF will use 3-axis magnetomer fusion.
EKF2_MCOEF = Simulink.Parameter(0.15, DataType="single", Min=0, Max=1, Unit="1/s")  % This parameter controls the prediction of drag produced by the propellers when flying a multi-copter, which enables estimation of wind drift when enabled by the EKF2_AID_MASK parameter. The drag produced by this effect scales with speed not speed squared and is produced because some of the air velocity normal to the propeller axis of rotation is lost when passing through the rotor disc. This  changes the momentum of the flow which creates a drag reaction force. When comparing un-ducted propellers of the same diameter, the effect is roughly proportional to the area of the propeller blades when viewed side on and changes with propeller selection. Momentum drag is significantly higher for ducted rotors. For example, if flying at 10 m/s at sea level conditions produces a rotor induced drag deceleration of 1.5 m/s/s when the multi-copter levelled to zero roll/pitch, then EKF2_MCOEF would be set to 0.15 = (1.5/10.0). Set EKF2_MCOEF to a positive value to enable wind estimation using this drag effect. To account for the drag produced by the body which scales with speed squared, see documentation for the EKF2_BCOEF_X and EKF2_BCOEF_Y parameters. The EKF2_MCOEF parameter should be adjusted together with EKF2_BCOEF_X and EKF2_BCOEF_Y to minimise variance of the X and y axis drag specific force innovation sequences.
EKF2_MIN_OBS_DT = Simulink.Parameter(20, DataType="int32", Min=10, Max=50, Unit="ms")  % Baro and Magnetometer data will be averaged before downsampling, other data will be point sampled resulting in loss of information.
EKF2_MIN_RNG = Simulink.Parameter(0.1, DataType="single", Min=0.01, Unit="m")  % If the vehicle is on ground, is not moving as determined by the motion test controlled by EKF2_MOVE_TEST and the range finder is returning invalid or no data, then an assumed range value of EKF2_MIN_RNG will be used by the terrain estimator so that a terrain height estimate is avilable at the start of flight in situations where the range finder may be inside its minimum measurements distance when on ground.
EKF2_MOVE_TEST = Simulink.Parameter(1, DataType="single", Min=0.1, Max=10)  % Scales the threshold tests applied to IMU data used to determine if the vehicle is static or moving. See parameter descriptions for EKF2_GPS_CHECK and EKF2_MAG_TYPE for further information on the functionality affected by this parameter.
EKF2_MULTI_IMU = Simulink.Parameter(0, DataType="int32", Min=0, Max=4)  % Maximum number of IMUs to use for Multi-EKF. Set 0 to disable. Requires SENS_IMU_MODE 0.
EKF2_MULTI_MAG = Simulink.Parameter(0, DataType="int32", Min=0, Max=4)  % Maximum number of magnetometers to use for Multi-EKF. Set 0 to disable. Requires SENS_MAG_MODE 0.
EKF2_NOAID_NOISE = Simulink.Parameter(10, DataType="single", Min=0.5, Max=50, Unit="m")
EKF2_NOAID_TOUT = Simulink.Parameter(5000000, DataType="int32", Min=500000, Max=10000000, Unit="us")
EKF2_OF_DELAY = Simulink.Parameter(20, DataType="single", Min=0, Max=300, Unit="ms")  % Assumes measurement is timestamped at trailing edge of integration period
EKF2_OF_GATE = Simulink.Parameter(3, DataType="single", Min=1, Unit="SD")  % Sets the number of standard deviations used by the innovation consistency test.
EKF2_OF_N_MAX = Simulink.Parameter(0.5, DataType="single", Min=0.05, Unit="rad/s")  % (when it's reported quality metric is at the minimum set by EKF2_OF_QMIN). The following condition must be met: EKF2_OF_N_MAXN >= EKF2_OF_N_MIN
EKF2_OF_N_MIN = Simulink.Parameter(0.15, DataType="single", Min=0.05, Unit="rad/s")
EKF2_OF_POS_X = Simulink.Parameter(0, DataType="single", Unit="m")
EKF2_OF_POS_Y = Simulink.Parameter(0, DataType="single", Unit="m")
EKF2_OF_POS_Z = Simulink.Parameter(0, DataType="single", Unit="m")
EKF2_OF_QMIN = Simulink.Parameter(1, DataType="int32", Min=0, Max=255)
EKF2_PCOEF_XN = Simulink.Parameter(0, DataType="single", Min=-0.5, Max=0.5)  % This is the ratio of static pressure error to dynamic pressure generated by a negative wind relative velocity along the X body axis. If the baro height estimate rises during backwards flight, then this will be a negative number.
EKF2_PCOEF_XP = Simulink.Parameter(0, DataType="single", Min=-0.5, Max=0.5)  % This is the ratio of static pressure error to dynamic pressure generated by a positive wind relative velocity along the X body axis. If the baro height estimate rises during forward flight, then this will be a negative number.
EKF2_PCOEF_YN = Simulink.Parameter(0, DataType="single", Min=-0.5, Max=0.5)  % This is the ratio of static pressure error to dynamic pressure generated by a wind relative velocity along the negative Y (LH) body axis. If the baro height estimate rises during sideways flight to the left, then this will be a negative number.
EKF2_PCOEF_YP = Simulink.Parameter(0, DataType="single", Min=-0.5, Max=0.5)  % This is the ratio of static pressure error to dynamic pressure generated by a wind relative velocity along the positive Y (RH) body axis. If the baro height estimate rises during sideways flight to the right, then this will be a negative number.
EKF2_PCOEF_Z = Simulink.Parameter(0, DataType="single", Min=-0.5, Max=0.5)  % This is the ratio of static pressure error to dynamic pressure generated by a wind relative velocity along the Z body axis.
EKF2_REQ_EPH = Simulink.Parameter(3, DataType="single", Min=2, Max=100, Unit="m")
EKF2_REQ_EPV = Simulink.Parameter(5, DataType="single", Min=2, Max=100, Unit="m")
EKF2_REQ_GPS_H = Simulink.Parameter(10, DataType="single", Min=0.1, Unit="s")  % Minimum continuous period without GPS failure required to mark a healthy GPS status. It can be reduced to speed up initialization, but it's recommended to keep this unchanged for a vehicle.
EKF2_REQ_HDRIFT = Simulink.Parameter(0.1, DataType="single", Min=0.1, Max=1, Unit="m/s")
EKF2_REQ_NSATS = Simulink.Parameter(6, DataType="int32", Min=4, Max=12)
EKF2_REQ_PDOP = Simulink.Parameter(2.5, DataType="single", Min=1.5, Max=5)
EKF2_REQ_SACC = Simulink.Parameter(0.5, DataType="single", Min=0.5, Max=5, Unit="m/s")
EKF2_REQ_VDRIFT = Simulink.Parameter(0.2, DataType="single", Min=0.1, Max=1.5, Unit="m/s")
EKF2_RNG_AID = Simulink.Parameter(1, DataType="int32")  % If this parameter is enabled then the estimator will make use of the range finder measurements to estimate it's height even if range sensor is not the primary height source. It will only do so if conditions for range measurement fusion are met. This enables the range finder to be used during low speed and low altitude operation, eg takeoff and landing, where baro interference from rotor wash is excessive and can corrupt EKF state estimates. It is intended to be used where a vertical takeoff and landing is performed, and horizontal flight does not occur until above EKF2_RNG_A_HMAX. If vehicle motion causes repeated switching between the primary height sensor and range finder, an offset in the local position origin can accumulate. Also range finder measurements are less reliable and can experience unexpected errors. For these reasons, if accurate control of height relative to ground is required, it is recommended to use the MPC_ALT_MODE parameter instead, unless baro errors are severe enough to cause problems with landing and takeoff.
EKF2_RNG_A_HMAX = Simulink.Parameter(5, DataType="single", Min=1, Max=10, Unit="m")  % If the vehicle absolute altitude exceeds this value then the estimator will not fuse range measurements to estimate it's height. This only applies when range aid mode is activated (EKF2_RNG_AID = enabled).
EKF2_RNG_A_IGATE = Simulink.Parameter(1, DataType="single", Min=0.1, Max=5, Unit="SD")  % A lower value means HAGL needs to be more stable in order to use range finder for height estimation in range aid mode
EKF2_RNG_A_VMAX = Simulink.Parameter(1, DataType="single", Min=0.1, Max=2, Unit="m/s")  % If the vehicle horizontal speed exceeds this value then the estimator will not fuse range measurements to estimate it's height. This only applies when range aid mode is activated (EKF2_RNG_AID = enabled).
EKF2_RNG_DELAY = Simulink.Parameter(5, DataType="single", Min=0, Max=300, Unit="ms")
EKF2_RNG_GATE = Simulink.Parameter(5, DataType="single", Min=1, Unit="SD")  % Sets the number of standard deviations used by the innovation consistency test.
EKF2_RNG_NOISE = Simulink.Parameter(0.1, DataType="single", Min=0.01, Unit="m")
EKF2_RNG_PITCH = Simulink.Parameter(0, DataType="single", Min=-0.75, Max=0.75, Unit="rad")
EKF2_RNG_POS_X = Simulink.Parameter(0, DataType="single", Unit="m")
EKF2_RNG_POS_Y = Simulink.Parameter(0, DataType="single", Unit="m")
EKF2_RNG_POS_Z = Simulink.Parameter(0, DataType="single", Unit="m")
EKF2_RNG_QLTY_T = Simulink.Parameter(1, DataType="single", Min=0.1, Max=5, Unit="s")
EKF2_RNG_SFE = Simulink.Parameter(0.05, DataType="single", Min=0, Max=0.2, Unit="m/m")  % Specifies the increase in range finder noise with range.
EKF2_SEL_ERR_RED = Simulink.Parameter(0.2, DataType="single")  % EKF2 instances have to be better than the selected by at least this amount before their relative score can be reduced.
EKF2_SEL_IMU_ACC = Simulink.Parameter(1, DataType="single", Unit="m/s^2")  % EKF2 selector acceleration error threshold for comparing accelerometers. Acceleration vector differences larger than this will result in accumulated velocity error.
EKF2_SEL_IMU_ANG = Simulink.Parameter(15, DataType="single", Unit="deg")  % EKF2 selector maximum accumulated angular error threshold for comparing gyros. Accumulated angular error larger than this will result in the sensor being declared faulty.
EKF2_SEL_IMU_RAT = Simulink.Parameter(7, DataType="single", Unit="deg/s")  % EKF2 selector angular rate error threshold for comparing gyros. Angular rate vector differences larger than this will result in accumulated angular error.
EKF2_SEL_IMU_VEL = Simulink.Parameter(2, DataType="single", Unit="m/s")  % EKF2 selector maximum accumulated velocity threshold for comparing accelerometers. Accumulated velocity error larger than this will result in the sensor being declared faulty.
EKF2_SYNT_MAG_Z = Simulink.Parameter(0, DataType="int32")  % Use for vehicles where the measured body Z magnetic field is subject to strong magnetic interference. For magnetic heading fusion the magnetometer Z measurement will be replaced by a synthetic value calculated using the knowledge of the 3D magnetic field vector at the location of the drone. Therefore, this parameter will only have an effect if the global position of the drone is known. For 3D mag fusion the magnetometer Z measurement will simply be ingored instead of fusing the synthetic value.
EKF2_TAS_GATE = Simulink.Parameter(3, DataType="single", Min=1, Unit="SD")  % Sets the number of standard deviations used by the innovation consistency test.
EKF2_TAU_POS = Simulink.Parameter(0.25, DataType="single", Min=0.1, Max=1, Unit="s")
EKF2_TAU_VEL = Simulink.Parameter(0.25, DataType="single", Max=1, Unit="s")
EKF2_TERR_GRAD = Simulink.Parameter(0.5, DataType="single", Min=0, Unit="m/m")
EKF2_TERR_MASK = Simulink.Parameter(3, DataType="int32", Min=0, Max=3)  % Set bits in the following positions to enable: 0 : Set to true to use range finder data if available 1 : Set to true to use optical flow data if available
EKF2_TERR_NOISE = Simulink.Parameter(5, DataType="single", Min=0.5, Unit="m/s")
EKF2_WIND_NOISE = Simulink.Parameter(0.1, DataType="single", Min=0, Max=1, Unit="m/s^2")
EV_TSK_RC_LOSS = Simulink.Parameter(0, DataType="int32")  % Enable/disable event task for RC Loss. When enabled, an alarm tune will be played via buzzer or ESCs, if supported. The alarm will sound after a disarm, if the vehicle was previously armed and only if the vehicle had RC signal at some point. Particularly useful for locating crashed drones without a GPS sensor.
EV_TSK_STAT_DIS = Simulink.Parameter(0, DataType="int32")  % Enable/disable event task for displaying the vehicle status using arm-mounted LEDs. When enabled and if the vehicle supports it, LEDs will flash indicating various vehicle status changes. Currently PX4 has not implemented any specific status events. -
FW_ACRO_X_MAX = Simulink.Parameter(90, DataType="single", Min=45, Max=720, Unit="deg")  % This is the rate the controller is trying to achieve if the user applies full roll stick input in acro mode.
FW_ACRO_Y_MAX = Simulink.Parameter(90, DataType="single", Min=45, Max=720, Unit="deg")  % This is the body y rate the controller is trying to achieve if the user applies full pitch stick input in acro mode.
FW_ACRO_Z_MAX = Simulink.Parameter(45, DataType="single", Min=10, Max=180, Unit="deg")  % This is the body z rate the controller is trying to achieve if the user applies full yaw stick input in acro mode.
FW_ARSP_MODE = Simulink.Parameter(0, DataType="int32")  % For small wings or VTOL without airspeed sensor this parameter can be used to enable flying without an airspeed reading
FW_ARSP_SCALE_EN = Simulink.Parameter(1, DataType="int32")  % This enables a logic that automatically adjusts the output of the rate controller to take into account the real torque produced by an aerodynamic control surface given the current deviation from the trim airspeed (FW_AIRSPD_TRIM). Enable when using aerodynamic control surfaces (e.g.: plane) Disable when using rotor wings (e.g.: autogyro)
FW_BAT_SCALE_EN = Simulink.Parameter(0, DataType="int32")  % This compensates for voltage drop of the battery over time by attempting to normalize performance across the operating range of the battery. The fixed wing should constantly behave as if it was fully charged with reduced max thrust at lower battery percentages. i.e. if cruise speed is at 0.5 throttle at 100% battery, it will still be 0.5 at 60% battery.
FW_DTRIM_P_FLPS = Simulink.Parameter(0, DataType="single", Min=-0.25, Max=0.25)  % This increment is added to the pitch trim whenever flaps are fully deployed.
FW_DTRIM_P_VMAX = Simulink.Parameter(0, DataType="single", Min=-0.25, Max=0.25)  % This increment is added to TRIM_PITCH when airspeed is FW_AIRSPD_MAX.
FW_DTRIM_P_VMIN = Simulink.Parameter(0, DataType="single", Min=-0.25, Max=0.25)  % This increment is added to TRIM_PITCH when airspeed is FW_AIRSPD_MIN.
FW_DTRIM_R_FLPS = Simulink.Parameter(0, DataType="single", Min=-0.25, Max=0.25)  % This increment is added to TRIM_ROLL whenever flaps are fully deployed.
FW_DTRIM_R_VMAX = Simulink.Parameter(0, DataType="single", Min=-0.25, Max=0.25)  % This increment is added to TRIM_ROLL when airspeed is FW_AIRSPD_MAX.
FW_DTRIM_R_VMIN = Simulink.Parameter(0, DataType="single", Min=-0.25, Max=0.25)  % This increment is added to TRIM_ROLL when airspeed is FW_AIRSPD_MIN.
FW_DTRIM_Y_VMAX = Simulink.Parameter(0, DataType="single", Min=-0.25, Max=0.25)  % This increment is added to TRIM_YAW when airspeed is FW_AIRSPD_MAX.
FW_DTRIM_Y_VMIN = Simulink.Parameter(0, DataType="single", Min=-0.25, Max=0.25)  % This increment is added to TRIM_YAW when airspeed is FW_AIRSPD_MIN.
FW_FLAPERON_SCL = Simulink.Parameter(0, DataType="single", Min=0, Max=1, Unit="norm")
FW_FLAPS_LND_SCL = Simulink.Parameter(1, DataType="single", Min=0, Max=1, Unit="norm")  % Sets a fraction of full flaps (FW_FLAPS_SCL) during landing
FW_FLAPS_SCL = Simulink.Parameter(1, DataType="single", Min=0, Max=1, Unit="norm")
FW_FLAPS_TO_SCL = Simulink.Parameter(0, DataType="single", Min=0, Max=1, Unit="norm")  % Sets a fraction of full flaps (FW_FLAPS_SCL) during take-off
FW_MAN_P_MAX = Simulink.Parameter(45, DataType="single", Min=0, Max=90, Unit="deg")  % Max pitch for manual control in attitude stabilized mode
FW_MAN_P_SC = Simulink.Parameter(1, DataType="single", Min=0, Unit="norm")  % Scale factor applied to the desired pitch actuator command in full manual mode. This parameter allows to adjust the throws of the control surfaces.
FW_MAN_R_MAX = Simulink.Parameter(45, DataType="single", Min=0, Max=90, Unit="deg")  % Max roll for manual control in attitude stabilized mode
FW_MAN_R_SC = Simulink.Parameter(1, DataType="single", Min=0, Max=1, Unit="norm")  % Scale factor applied to the desired roll actuator command in full manual mode. This parameter allows to adjust the throws of the control surfaces.
FW_MAN_Y_SC = Simulink.Parameter(1, DataType="single", Min=0, Unit="norm")  % Scale factor applied to the desired yaw actuator command in full manual mode. This parameter allows to adjust the throws of the control surfaces.
FW_PR_FF = Simulink.Parameter(0.5, DataType="single", Min=0, Max=10, Unit="%/rad/s")  % Direct feed forward from rate setpoint to control surface output
FW_PR_I = Simulink.Parameter(0.1, DataType="single", Min=0.005, Max=0.5, Unit="%/rad")  % This gain defines how much control response will result out of a steady state error. It trims any constant error.
FW_PR_IMAX = Simulink.Parameter(0.4, DataType="single", Min=0, Max=1)  % The portion of the integrator part in the control surface deflection is limited to this value
FW_PR_P = Simulink.Parameter(0.08, DataType="single", Min=0.005, Max=1, Unit="%/rad/s")  % This defines how much the elevator input will be commanded depending on the current body angular rate error.
FW_PSP_OFF = Simulink.Parameter(0, DataType="single", Min=-90, Max=90, Unit="deg")  % An airframe specific offset of the pitch setpoint in degrees, the value is added to the pitch setpoint and should correspond to the pitch at typical cruise speed of the airframe.
FW_P_RMAX_NEG = Simulink.Parameter(60, DataType="single", Min=0, Max=90, Unit="deg/s")  % This limits the maximum pitch down up angular rate the controller will output (in degrees per second).
FW_P_RMAX_POS = Simulink.Parameter(60, DataType="single", Min=0, Max=90, Unit="deg/s")  % This limits the maximum pitch up angular rate the controller will output (in degrees per second).
FW_P_TC = Simulink.Parameter(0.4, DataType="single", Min=0.2, Max=1, Unit="s")  % This defines the latency between a pitch step input and the achieved setpoint (inverse to a P gain). Half a second is a good start value and fits for most average systems. Smaller systems may require smaller values, but as this will wear out servos faster, the value should only be decreased as needed.
FW_RLL_TO_YAW_FF = Simulink.Parameter(0, DataType="single", Min=0)  % This gain can be used to counteract the "adverse yaw" effect for fixed wings. When the plane enters a roll it will tend to yaw the nose out of the turn. This gain enables the use of a yaw actuator (rudder, airbrakes, ...) to counteract this effect.
FW_RR_FF = Simulink.Parameter(0.5, DataType="single", Min=0, Max=10, Unit="%/rad/s")  % Direct feed forward from rate setpoint to control surface output. Use this to obtain a tigher response of the controller without introducing noise amplification.
FW_RR_I = Simulink.Parameter(0.1, DataType="single", Min=0.005, Max=0.2, Unit="%/rad")  % This gain defines how much control response will result out of a steady state error. It trims any constant error.
FW_RR_IMAX = Simulink.Parameter(0.2, DataType="single", Min=0, Max=1)  % The portion of the integrator part in the control surface deflection is limited to this value.
FW_RR_P = Simulink.Parameter(0.05, DataType="single", Min=0.005, Max=1, Unit="%/rad/s")  % This defines how much the aileron input will be commanded depending on the current body angular rate error.
FW_R_RMAX = Simulink.Parameter(70, DataType="single", Min=0, Max=90, Unit="deg/s")  % This limits the maximum roll rate the controller will output (in degrees per second).
FW_R_TC = Simulink.Parameter(0.4, DataType="single", Min=0.4, Max=1, Unit="s")  % This defines the latency between a roll step input and the achieved setpoint (inverse to a P gain). Half a second is a good start value and fits for most average systems. Smaller systems may require smaller values, but as this will wear out servos faster, the value should only be decreased as needed.
FW_WR_FF = Simulink.Parameter(0.2, DataType="single", Min=0, Max=10, Unit="%/rad/s")  % Direct feed forward from rate setpoint to control surface output
FW_WR_I = Simulink.Parameter(0.1, DataType="single", Min=0.005, Max=0.5, Unit="%/rad")  % This gain defines how much control response will result out of a steady state error. It trims any constant error.
FW_WR_IMAX = Simulink.Parameter(1, DataType="single", Min=0, Max=1)  % The portion of the integrator part in the control surface deflection is limited to this value
FW_WR_P = Simulink.Parameter(0.5, DataType="single", Min=0.005, Max=1, Unit="%/rad/s")  % This defines how much the wheel steering input will be commanded depending on the current body angular rate error.
FW_W_EN = Simulink.Parameter(0, DataType="int32")
FW_W_RMAX = Simulink.Parameter(30, DataType="single", Min=0, Max=90, Unit="deg/s")  % This limits the maximum wheel steering rate the controller will output (in degrees per second).
FW_YR_FF = Simulink.Parameter(0.3, DataType="single", Min=0, Max=10, Unit="%/rad/s")  % Direct feed forward from rate setpoint to control surface output
FW_YR_I = Simulink.Parameter(0.1, DataType="single", Min=0, Max=50, Unit="%/rad")  % This gain defines how much control response will result out of a steady state error. It trims any constant error.
FW_YR_IMAX = Simulink.Parameter(0.2, DataType="single", Min=0, Max=1)  % The portion of the integrator part in the control surface deflection is limited to this value
FW_YR_P = Simulink.Parameter(0.05, DataType="single", Min=0.005, Max=1, Unit="%/rad/s")  % This defines how much the rudder input will be commanded depending on the current body angular rate error.
FW_Y_RMAX = Simulink.Parameter(50, DataType="single", Min=0, Max=90, Unit="deg/s")  % This limits the maximum yaw rate the controller will output (in degrees per second).
FW_CLMBOUT_DIFF = Simulink.Parameter(10, DataType="single", Min=0, Max=150, Unit="m")  % If the altitude error exceeds this parameter, the system will climb out with maximum throttle and minimum airspeed until it is closer than this distance to the desired altitude. Mostly used for takeoff waypoints / modes. Set to 0 to disable climbout mode (not recommended).
FW_L1_DAMPING = Simulink.Parameter(0.75, DataType="single", Min=0.6, Max=0.9)  % Damping factor for L1 control.
FW_L1_PERIOD = Simulink.Parameter(20, DataType="single", Min=12, Max=50, Unit="m")  % This is the L1 distance and defines the tracking point ahead of the aircraft its following. A value of 18-25 meters works for most aircraft. Shorten slowly during tuning until response is sharp without oscillation.
FW_L1_R_SLEW_MAX = Simulink.Parameter(90, DataType="single", Min=0, Unit="deg/s")  % The maxium change in roll angle setpoint per second.
FW_LND_AIRSPD_SC = Simulink.Parameter(1.3, DataType="single", Min=1, Max=1.5, Unit="norm")  % Multiplying this factor with the minimum airspeed of the plane gives the target airspeed the landing approach. FW_AIRSPD_MIN * FW_LND_AIRSPD_SC
FW_LND_ANG = Simulink.Parameter(5, DataType="single", Min=1, Max=15, Unit="deg")
FW_LND_EARLYCFG = Simulink.Parameter(0, DataType="int32")  % When disabled, the landing configuration (flaps, landing airspeed, etc.) is only activated on the final approach to landing. When enabled, it is already activated when entering the final loiter-down (loiter-to-alt) waypoint before the landing approach. This shifts the (often large) altitude and airspeed errors caused by the configuration change away from the ground such that these are not so critical. It also gives the controller enough time to adapt to the new configuration such that the landing approach starts with a cleaner initial state.
FW_LND_FLALT = Simulink.Parameter(3, DataType="single", Min=0, Max=25, Unit="m")
FW_LND_FL_PMAX = Simulink.Parameter(15, DataType="single", Min=0, Max=45, Unit="deg")  % Maximum pitch during flare, a positive sign means nose up Applied once FW_LND_FLALT is reached
FW_LND_FL_PMIN = Simulink.Parameter(2.5, DataType="single", Min=0, Max=15, Unit="deg")  % Minimum pitch during flare, a positive sign means nose up Applied once FW_LND_FLALT is reached
FW_LND_HHDIST = Simulink.Parameter(15, DataType="single", Min=0, Max=30, Unit="m")  % Set to 0 to disable heading hold.
FW_LND_HVIRT = Simulink.Parameter(10, DataType="single", Min=1, Max=15, Unit="m")
FW_LND_THRTC_SC = Simulink.Parameter(1, DataType="single", Min=0.2, Max=1)  % Set this parameter to less than 1.0 to make TECS react faster to altitude errors during landing than during normal flight (i.e. giving efficiency and low motor wear at high altitudes but control accuracy during landing). During landing, the TECS altitude time constant (FW_T_ALT_TC) is multiplied by this value.
FW_LND_TLALT = Simulink.Parameter(-1, DataType="single", Min=-1, Max=30, Unit="m")  % Default of -1.0 lets the system default to applying throttle limiting at 2/3 of the flare altitude.
FW_LND_USETER = Simulink.Parameter(0, DataType="int32")  % This is turned off by default and a waypoint or return altitude is normally used (or sea level for an arbitrary land position).
FW_POSCTL_INV_ST = Simulink.Parameter(0, DataType="int32", Min=0, Max=1)  % Set RC/joystick configuration for fixed-wing position and altitude controlled flight.
FW_P_LIM_MAX = Simulink.Parameter(45, DataType="single", Min=0, Max=60, Unit="deg")  % The maximum positive pitch the controller will output.
FW_P_LIM_MIN = Simulink.Parameter(-45, DataType="single", Min=-60, Max=0, Unit="deg")  % The minimum negative pitch the controller will output.
FW_R_LIM = Simulink.Parameter(50, DataType="single", Min=35, Max=65, Unit="deg")  % The maximum roll the controller will output.
FW_THR_ALT_SCL = Simulink.Parameter(0, DataType="single", Min=0, Max=10)  % Automatically adjust throttle to account for decreased air density at higher altitudes. Start with a scale factor of 1.0 and adjust for different propulsion systems. When flying without airspeed sensor this will help to keep a constant performance over large altitude ranges. The default value of 0 will disable scaling.
FW_THR_CRUISE = Simulink.Parameter(0.6, DataType="single", Min=0, Max=1, Unit="norm")  % This is the throttle setting required to achieve the desired cruise speed. Most airframes have a value of 0.5-0.7.
FW_THR_IDLE = Simulink.Parameter(0.15, DataType="single", Min=0, Max=0.4, Unit="norm")  % This is the minimum throttle while on the ground For aircraft with internal combustion engine this parameter should be set above desired idle rpm.
FW_THR_LND_MAX = Simulink.Parameter(1, DataType="single", Min=0, Max=1, Unit="norm")  % During the flare of the autonomous landing process, this value will be set as throttle limit when the aircraft altitude is below FW_LND_TLALT.
FW_THR_MAX = Simulink.Parameter(1, DataType="single", Min=0, Max=1, Unit="norm")  % This is the maximum throttle % that can be used by the controller. For overpowered aircraft, this should be reduced to a value that provides sufficient thrust to climb at the maximum pitch angle PTCH_MAX.
FW_THR_MIN = Simulink.Parameter(0, DataType="single", Min=0, Max=1, Unit="norm")  % This is the minimum throttle % that can be used by the controller. For electric aircraft this will normally be set to zero, but can be set to a small non-zero value if a folding prop is fitted to prevent the prop from folding and unfolding repeatedly in-flight or to provide some aerodynamic drag from a turning prop to improve the descent rate. For aircraft with internal combustion engine this parameter should be set for desired idle rpm.
FW_THR_SLEW_MAX = Simulink.Parameter(0, DataType="single", Min=0, Max=1)  % Maximum slew rate for the commanded throttle
FW_TKO_PITCH_MIN = Simulink.Parameter(10, DataType="single", Min=-5, Max=30, Unit="deg")
LAUN_ALL_ON = Simulink.Parameter(0, DataType="int32")
LAUN_CAT_A = Simulink.Parameter(30, DataType="single", Min=0, Unit="m/s^2")  % LAUN_CAT_A for LAUN_CAT_T serves as threshold to trigger launch detection.
LAUN_CAT_MDEL = Simulink.Parameter(0, DataType="single", Min=0, Max=10, Unit="s")  % Delay between starting attitude control and powering up the throttle (giving throttle control to the controller) Before this timespan is up the throttle will be set to FW_THR_IDLE, set to 0 to deactivate
LAUN_CAT_PMAX = Simulink.Parameter(30, DataType="single", Min=0, Max=45, Unit="deg")  % This is an extra limit for the maximum pitch which is imposed in the phase before the throttle turns on. This allows to limit the maximum pitch angle during a bungee launch (make the launch less steep).
LAUN_CAT_T = Simulink.Parameter(0.05, DataType="single", Min=0, Max=5, Unit="s")  % LAUN_CAT_A for LAUN_CAT_T serves as threshold to trigger launch detection.
FW_AIRSPD_MAX = Simulink.Parameter(20, DataType="single", Min=0.5, Max=40, Unit="m/s")  % If the CAS (calibrated airspeed) is above this value, the TECS controller will try to decrease airspeed more aggressively.
FW_AIRSPD_MIN = Simulink.Parameter(10, DataType="single", Min=0.5, Max=40, Unit="m/s")  % The minimal airspeed (calibrated airspeed) the user is able to command. Further, if the airspeed falls below this value, the TECS controller will try to increase airspeed more aggressively.
FW_AIRSPD_STALL = Simulink.Parameter(7, DataType="single", Min=0.5, Max=40, Unit="m/s")  % The stall airspeed (calibrated airspeed) of the vehicle. It is used for airspeed sensor failure detection and for the control surface scaling airspeed limits.
FW_AIRSPD_TRIM = Simulink.Parameter(15, DataType="single", Min=0.5, Max=40, Unit="m/s")  % The trim CAS (calibrated airspeed) of the vehicle. If an airspeed controller is active, this is the default airspeed setpoint that the controller will try to achieve if no other airspeed setpoint sources are present (e.g. through non-centered RC sticks).
FW_GND_SPD_MIN = Simulink.Parameter(5, DataType="single", Min=0, Max=40, Unit="m/s")  % The controller will increase the commanded airspeed to maintain this minimum groundspeed to the next waypoint.
FW_T_ALT_TC = Simulink.Parameter(5, DataType="single", Min=2)
FW_T_CLMB_MAX = Simulink.Parameter(5, DataType="single", Min=1, Max=15, Unit="m/s")  % This is the best climb rate that the aircraft can achieve with the throttle set to THR_MAX and the airspeed set to the default value. For electric aircraft make sure this number can be achieved towards the end of flight when the battery voltage has reduced. The setting of this parameter can be checked by commanding a positive altitude change of 100m in loiter, RTL or guided mode. If the throttle required to climb is close to THR_MAX and the aircraft is maintaining airspeed, then this parameter is set correctly. If the airspeed starts to reduce, then the parameter is set to high, and if the throttle demand required to climb and maintain speed is noticeably less than FW_THR_MAX, then either FW_T_CLMB_MAX should be increased or FW_THR_MAX reduced.
FW_T_CLMB_R_SP = Simulink.Parameter(3, DataType="single", Min=0.5, Max=15, Unit="m/s")  % The default rate at which the vehicle will climb in autonomous modes to achieve altitude setpoints. In manual modes this defines the maximum rate at which the altitude setpoint can be increased.
FW_T_HRATE_FF = Simulink.Parameter(0.3, DataType="single", Min=0, Max=1)
FW_T_I_GAIN_PIT = Simulink.Parameter(0.1, DataType="single", Min=0, Max=2)  % This is the integrator gain on the pitch part of the control loop. Increasing this gain increases the speed at which speed and height offsets are trimmed out, but reduces damping and increases overshoot. Set this value to zero to completely disable all integrator action.
FW_T_I_GAIN_THR = Simulink.Parameter(0.3, DataType="single", Min=0, Max=2)  % This is the integrator gain on the throttle part of the control loop. Increasing this gain increases the speed at which speed and height offsets are trimmed out, but reduces damping and increases overshoot. Set this value to zero to completely disable all integrator action.
FW_T_PTCH_DAMP = Simulink.Parameter(0.1, DataType="single", Min=0, Max=2)  % This is the damping gain for the pitch demand loop. Increase to add damping to correct for oscillations in height. The default value of 0.0 will work well provided the pitch to servo controller has been tuned properly.
FW_T_RLL2THR = Simulink.Parameter(15, DataType="single", Min=0, Max=20)  % Increasing this gain turn increases the amount of throttle that will be used to compensate for the additional drag created by turning. Ideally this should be set to  approximately 10 x the extra sink rate in m/s created by a 45 degree bank turn. Increase this gain if the aircraft initially loses energy in turns and reduce if the aircraft initially gains energy in turns. Efficient high aspect-ratio aircraft (eg powered sailplanes) can use a lower value, whereas inefficient low aspect-ratio models (eg delta wings) can use a higher value.
FW_T_SEB_R_FF = Simulink.Parameter(1, DataType="single", Min=0.5, Max=3)
FW_T_SINK_MAX = Simulink.Parameter(5, DataType="single", Min=1, Max=15, Unit="m/s")  % This sets the maximum descent rate that the controller will use. If this value is too large, the aircraft can over-speed on descent. This should be set to a value that can be achieved without exceeding the lower pitch angle limit and without over-speeding the aircraft.
FW_T_SINK_MIN = Simulink.Parameter(2, DataType="single", Min=1, Max=5, Unit="m/s")  % This is the sink rate of the aircraft with the throttle set to THR_MIN and flown at the same airspeed as used to measure FW_T_CLMB_MAX.
FW_T_SINK_R_SP = Simulink.Parameter(2, DataType="single", Min=0.5, Max=15, Unit="m/s")  % The default rate at which the vehicle will sink in autonomous modes to achieve altitude setpoints. In manual modes this defines the maximum rate at which the altitude setpoint can be decreased.
FW_T_SPDWEIGHT = Simulink.Parameter(1, DataType="single", Min=0, Max=2)  % This parameter adjusts the amount of weighting that the pitch control applies to speed vs height errors. Setting it to 0.0 will cause the pitch control to control height and ignore speed errors. This will normally improve height accuracy but give larger airspeed errors. Setting it to 2.0 will cause the pitch control loop to control speed and ignore height errors. This will normally reduce airspeed errors, but give larger height errors. The default value of 1.0 allows the pitch control to simultaneously control height and speed. Note to Glider Pilots - set this parameter to 2.0 (The glider will adjust its pitch angle to maintain airspeed, ignoring changes in height).
FW_T_SPD_OMEGA = Simulink.Parameter(2, DataType="single", Min=1, Max=10, Unit="rad/s")  % This is the cross-over frequency (in radians/second) of the complementary filter used to fuse longitudinal acceleration and airspeed to obtain an improved airspeed estimate. Increasing this frequency weights the solution more towards use of the airspeed sensor, whilst reducing it weights the solution more towards use of the accelerometer data.
FW_T_STE_R_TC = Simulink.Parameter(0.4, DataType="single", Min=0, Max=2)  % This filter is applied to the specific total energy rate used for throttle damping.
FW_T_TAS_R_TC = Simulink.Parameter(0.2, DataType="single", Min=0, Max=2)  % This filter is applied to the true airspeed rate.
FW_T_TAS_TC = Simulink.Parameter(5, DataType="single", Min=2)
FW_T_THR_DAMP = Simulink.Parameter(0.1, DataType="single", Min=0, Max=2)  % This is the damping gain for the throttle demand loop. Increase to add damping to correct for oscillations in speed and height.
FW_T_VERT_ACC = Simulink.Parameter(7, DataType="single", Min=1, Max=10, Unit="m/s^2")  % This is the maximum vertical acceleration (in m/s/s) either up or down that the controller will use to correct speed or height errors. The default value of 7 m/s/s (equivalent to +- 0.7 g) allows for reasonably aggressive pitch changes if required to recover from under-speed conditions.
FD_ESCS_EN = Simulink.Parameter(1, DataType="int32")  % If enabled, failure detector will verify that all the ESCs have successfully armed when the vehicle has transitioned to the armed state. Timeout for receiving an acknowledgement from the ESCs is 0.3s, if no feedback is received the failure detector will auto disarm the vehicle.
FD_EXT_ATS_EN = Simulink.Parameter(0, DataType="int32")  % Enabled on either AUX5 or MAIN5 depending on board. External ATS is required by ASTM F3322-18.
FD_EXT_ATS_TRIG = Simulink.Parameter(1900, DataType="int32", Unit="us")  % External ATS is required by ASTM F3322-18.
FD_FAIL_P = Simulink.Parameter(60, DataType="int32", Min=60, Max=180, Unit="deg")  % Maximum pitch angle before FailureDetector triggers the attitude_failure flag. The flag triggers flight termination (if @CBRK_FLIGHTTERM = 0), which sets outputs to their failsafe values. On takeoff the flag triggers lockdown (irrespective of @CBRK_FLIGHTTERM), which disarms motors but does not set outputs to failsafe values. Setting this parameter to 0 disables the check
FD_FAIL_P_TTRI = Simulink.Parameter(0.3, DataType="single", Min=0.02, Max=5, Unit="s")  % Seconds (decimal) that pitch has to exceed FD_FAIL_P before being considered as a failure.
FD_FAIL_R = Simulink.Parameter(60, DataType="int32", Min=60, Max=180, Unit="deg")  % Maximum roll angle before FailureDetector triggers the attitude_failure flag. The flag triggers flight termination (if @CBRK_FLIGHTTERM = 0), which sets outputs to their failsafe values. On takeoff the flag triggers lockdown (irrespective of @CBRK_FLIGHTTERM), which disarms motors but does not set outputs to failsafe values. Setting this parameter to 0 disables the check
FD_FAIL_R_TTRI = Simulink.Parameter(0.3, DataType="single", Min=0.02, Max=5, Unit="s")  % Seconds (decimal) that roll has to exceed FD_FAIL_R before being considered as a failure.
NAV_FT_DST = Simulink.Parameter(8, DataType="single", Min=1, Unit="m")  % The distance in meters to follow the target at
NAV_FT_FS = Simulink.Parameter(1, DataType="int32", Min=0, Max=3)  % The side to follow the target from (front right = 0, behind = 1, front = 2, front left = 3)
NAV_FT_RS = Simulink.Parameter(0.5, DataType="single", Min=0, Max=1)  % lower numbers increase the responsiveness to changing long lat but also ignore less noise
NAV_MIN_FT_HT = Simulink.Parameter(8, DataType="single", Min=8, Unit="m")  % The minimum height in meters relative to home for following a target
GPS_1_CONFIG = Simulink.Parameter(201, DataType="int32")  % Configure on which serial port to run Main GPS.
GPS_1_GNSS = Simulink.Parameter(0, DataType="int32", Min=0, Max=31)  % This integer bitmask controls the set of GNSS systems used by the receiver. Check your receiver's documentation on how many systems are supported to be used in parallel. Currently this functionality is just implemented for u-blox receivers. When no bits are set, the receiver's default configuration should be used. Set bits true to enable: 0 : Use GPS (with QZSS) 1 : Use SBAS (multiple GPS augmentation systems) 2 : Use Galileo 3 : Use BeiDou 4 : Use GLONASS
GPS_1_PROTOCOL = Simulink.Parameter(1, DataType="int32", Min=0, Max=5)  % Select the GPS protocol over serial. Auto-detection will probe all protocols, and thus is a bit slower.
GPS_2_CONFIG = Simulink.Parameter(0, DataType="int32")  % Configure on which serial port to run Secondary GPS.
GPS_2_GNSS = Simulink.Parameter(0, DataType="int32", Min=0, Max=31)  % This integer bitmask controls the set of GNSS systems used by the receiver. Check your receiver's documentation on how many systems are supported to be used in parallel. Currently this functionality is just implemented for u-blox receivers. When no bits are set, the receiver's default configuration should be used. Set bits true to enable: 0 : Use GPS (with QZSS) 1 : Use SBAS (multiple GPS augmentation systems) 2 : Use Galileo 3 : Use BeiDou 4 : Use GLONASS

GPS_2_PROTOCOL = Simulink.Parameter(1, DataType="int32", Min=0, Max=5)  % Select the GPS protocol over serial. Auto-detection will probe all protocols, and thus is a bit slower.
GPS_DUMP_COMM = Simulink.Parameter(0, DataType="int32", Min=0, Max=2)  % If this is set to 1, all GPS communication data will be published via uORB, and written to the log file as gps_dump message. If this is set to 2, the main GPS is configured to output RTCM data, which is then logged as gps_dump and can be used for PPK.
GPS_UBX_DYNMODEL = Simulink.Parameter(7, DataType="int32", Min=0, Max=9)  % u-blox receivers support different dynamic platform models to adjust the navigation engine to the expected application environment.
GPS_UBX_MODE = Simulink.Parameter(0, DataType="int32", Min=0, Max=1)  % Select the u-blox configuration setup. Most setups will use the default, including RTK and dual GPS without heading. The Heading mode requires 2 F9P devices to be attached. The main GPS will act as rover and output heading information, whereas the secondary will act as moving base, sending RTCM on UART2 to the rover GPS. RTK is still possible with this setup.
GPS_YAW_OFFSET = Simulink.Parameter(0, DataType="single", Min=0, Max=360, Unit="deg")  % Heading offset angle for dual antenna GPS setups that support heading estimation. (currently only for the Trimble MB-Two). Set this to 0 if the antennas are parallel to the forward-facing direction of the vehicle and the first antenna is in front. The offset angle increases clockwise. Set this to 90 if the first antenna is placed on the right side and the second on the left side of the vehicle.
NAV_GPSF_LT = Simulink.Parameter(0, DataType="single", Min=0, Max=3600, Unit="s")  % The time in seconds the system should do open loop loiter and wait for GPS recovery before it goes into flight termination. Set to 0 to disable.
NAV_GPSF_P = Simulink.Parameter(0, DataType="single", Min=-30, Max=30, Unit="deg")  % Pitch in degrees during the open loop loiter
NAV_GPSF_R = Simulink.Parameter(15, DataType="single", Min=0, Max=30, Unit="deg")  % Roll in degrees during the loiter
NAV_GPSF_TR = Simulink.Parameter(0, DataType="single", Min=0, Max=1, Unit="norm")  % Thrust value which is set during the open loop loiter
GF_ACTION = Simulink.Parameter(2, DataType="int32", Min=0, Max=5)  % Note: Setting this value to 4 enables flight termination, which will kill the vehicle on violation of the fence. Due to the inherent danger of this, this function is disabled using a software circuit breaker, which needs to be reset to 0 to really shut down the system.
GF_ALTMODE = Simulink.Parameter(0, DataType="int32", Min=0, Max=1)  % Select which altitude (AMSL) source should be used for geofence calculations.
GF_COUNT = Simulink.Parameter(-1, DataType="int32", Min=-1, Max=10)  % Set how many subsequent position measurements outside of the fence are needed before geofence violation is triggered
GF_MAX_HOR_DIST = Simulink.Parameter(0, DataType="single", Min=0, Max=10000, Unit="m")  % Maximum horizontal distance in meters the vehicle can be from home before triggering a geofence action. Disabled if 0.
GF_MAX_VER_DIST = Simulink.Parameter(0, DataType="single", Min=0, Max=10000, Unit="m")  % Maximum vertical distance in meters the vehicle can be from home before triggering a geofence action. Disabled if 0.
GF_SOURCE = Simulink.Parameter(0, DataType="int32", Min=0, Max=1)  % Select which position source should be used. Selecting GPS instead of global position makes sure that there is no dependence on the position estimator 0 = global position, 1 = GPS
HTE_ACC_GATE = Simulink.Parameter(3, DataType="single", Min=1, Max=10, Unit="SD")  % Sets the number of standard deviations used by the innovation consistency test.
HTE_HT_ERR_INIT = Simulink.Parameter(0.1, DataType="single", Min=0, Max=1, Unit="normalized_thrust")  % Sets the number of standard deviations used by the innovation consistency test.
HTE_HT_NOISE = Simulink.Parameter(0.0036, DataType="single", Min=0.0001, Max=1, Unit="normalized_thrust/s")  % Reduce to make the hover thrust estimate more stable, increase if the real hover thrust is expected to change quickly over time.
LNDFW_AIRSPD_MAX = Simulink.Parameter(6, DataType="single", Min=4, Max=20, Unit="m/s")  % Maximum airspeed allowed in the landed state
LNDFW_VEL_XY_MAX = Simulink.Parameter(5, DataType="single", Min=0.5, Max=10, Unit="m/s")  % Maximum horizontal velocity allowed in the landed state
LNDFW_VEL_Z_MAX = Simulink.Parameter(3, DataType="single", Min=0.1, Max=20, Unit="m/s")  % Maximum vertical velocity allowed in the landed state
LNDFW_XYACC_MAX = Simulink.Parameter(8, DataType="single", Min=2, Max=15, Unit="m/s^2")  % Maximum horizontal (x,y body axes) acceleration allowed in the landed state
LNDMC_ALT_GND = Simulink.Parameter(-1, DataType="single", Min=-1, Unit="m")  % The height above ground below which ground effect creates barometric altitude errors. A negative value indicates no ground effect.
LNDMC_ALT_MAX = Simulink.Parameter(-1, DataType="single", Min=-1, Max=10000, Unit="m")  % The system will obey this limit as a hard altitude limit. This setting will be consolidated with the GF_MAX_VER_DIST parameter. A negative value indicates no altitude limitation.
LNDMC_ROT_MAX = Simulink.Parameter(20, DataType="single", Unit="deg/s")  % Maximum allowed angular velocity around each axis allowed in the landed state.
LNDMC_TRIG_TIME = Simulink.Parameter(1, DataType="single", Min=0.1, Max=10, Unit="s")  % Total time it takes to go through all three land detection stages: ground contact, maybe landed, landed when all necessary conditions are constantly met.
LNDMC_XY_VEL_MAX = Simulink.Parameter(1.5, DataType="single", Unit="m/s")  % Maximum horizontal velocity allowed in the landed state
LNDMC_Z_VEL_MAX = Simulink.Parameter(0.5, DataType="single", Unit="m/s")  % Maximum vertical velocity allowed in the landed state
LND_FLIGHT_T_HI = Simulink.Parameter(0, DataType="int32", Min=0)  % Total flight time of this autopilot. Higher 32 bits of the value. Flight time in microseconds = (LND_FLIGHT_T_HI << 32) | LND_FLIGHT_T_LO.
LND_FLIGHT_T_LO = Simulink.Parameter(0, DataType="int32", Min=0)  % Total flight time of this autopilot. Lower 32 bits of the value. Flight time in microseconds = (LND_FLIGHT_T_HI << 32) | LND_FLIGHT_T_LO.
LTEST_ACC_UNC = Simulink.Parameter(10, DataType="single", Min=0.01, Unit="(m/s^2)^2")  % Variance of acceleration measurement used for landing target position prediction. Higher values results in tighter following of the measurements and more lenient outlier rejection
LTEST_MEAS_UNC = Simulink.Parameter(0.005, DataType="single")  % Variance of the landing target measurement from the driver. Higher values result in less aggressive following of the measurement and a smoother output as well as fewer rejected measurements.
LTEST_MODE = Simulink.Parameter(0, DataType="int32", Min=0, Max=1)  % Configure the mode of the landing target. Depending on the mode, the landing target observations are used differently to aid position estimation. Mode Moving:     The landing target may be moving around while in the field of view of the vehicle. Landing target measurements are not used to aid positioning. Mode Stationary: The landing target is stationary. Measured velocity w.r.t. the landing target is used to aid velocity estimation.
LTEST_POS_UNC_IN = Simulink.Parameter(0.1, DataType="single", Min=0.001, Unit="m^2")  % Initial variance of the relative landing target position in x and y direction
LTEST_SCALE_X = Simulink.Parameter(1, DataType="single", Min=0.01)  % Landing target x measurements are scaled by this factor before being used
LTEST_SCALE_Y = Simulink.Parameter(1, DataType="single", Min=0.01)  % Landing target y measurements are scaled by this factor before being used
LTEST_VEL_UNC_IN = Simulink.Parameter(0.1, DataType="single", Min=0.001, Unit="(m/s)^2")  % Initial variance of the relative landing target velocity in x and y directions
LPE_ACC_XY = Simulink.Parameter(0.012, DataType="single", Min=1.0e-5, Max=2)  % Data sheet noise density = 150ug/sqrt(Hz) = 0.0015 m/s^2/sqrt(Hz) Larger than data sheet to account for tilt error.
LPE_ACC_Z = Simulink.Parameter(0.02, DataType="single", Min=1.0e-5, Max=2)  % Data sheet noise density = 150ug/sqrt(Hz) = 0.0015 m/s^2/sqrt(Hz)
LPE_BAR_Z = Simulink.Parameter(3, DataType="single", Min=0.01, Max=100, Unit="m")
LPE_EPH_MAX = Simulink.Parameter(3, DataType="single", Min=1, Max=5, Unit="m")
LPE_EPV_MAX = Simulink.Parameter(5, DataType="single", Min=1, Max=5, Unit="m")
LPE_FAKE_ORIGIN = Simulink.Parameter(0, DataType="int32", Min=0, Max=1)  % By initializing the estimator to the LPE_LAT/LON parameters when global information is unavailable
LPE_FGYRO_HP = Simulink.Parameter(0.001, DataType="single", Min=0, Max=2, Unit="Hz")
LPE_FLW_OFF_Z = Simulink.Parameter(0, DataType="single", Min=-1, Max=1, Unit="m")
LPE_FLW_QMIN = Simulink.Parameter(150, DataType="int32", Min=0, Max=255)
LPE_FLW_R = Simulink.Parameter(7, DataType="single", Min=0.1, Max=10, Unit="m/s/rad")
LPE_FLW_RR = Simulink.Parameter(7, DataType="single", Min=0, Max=10, Unit="m/rad")
LPE_FLW_SCALE = Simulink.Parameter(1.3, DataType="single", Min=0.1, Max=10, Unit="m")
LPE_FUSION = Simulink.Parameter(145, DataType="int32", Min=0, Max=255)  % Set bits in the following positions to enable: 0 : Set to true to fuse GPS data if available, also requires GPS for altitude init 1 : Set to true to fuse optical flow data if available 2 : Set to true to fuse vision position 3 : Set to true to enable landing target 4 : Set to true to fuse land detector 5 : Set to true to publish AGL as local position down component 6 : Set to true to enable flow gyro compensation 7 : Set to true to enable baro fusion default (145 - GPS, baro, land detector)
LPE_GPS_DELAY = Simulink.Parameter(0.29, DataType="single", Min=0, Max=0.4, Unit="s")
LPE_GPS_VXY = Simulink.Parameter(0.25, DataType="single", Min=0.01, Max=2, Unit="m/s")  % EPV used if greater than this value.
LPE_GPS_VZ = Simulink.Parameter(0.25, DataType="single", Min=0.01, Max=2, Unit="m/s")
LPE_GPS_XY = Simulink.Parameter(1, DataType="single", Min=0.01, Max=5, Unit="m")
LPE_GPS_Z = Simulink.Parameter(3, DataType="single", Min=0.01, Max=200, Unit="m")
LPE_LAND_VXY = Simulink.Parameter(0.05, DataType="single", Min=0.01, Max=10, Unit="m/s")
LPE_LAND_Z = Simulink.Parameter(0.03, DataType="single", Min=0.001, Max=10, Unit="m")
LPE_LAT = Simulink.Parameter(47.397742, DataType="single", Min=-90, Max=90, Unit="deg")
LPE_LDR_OFF_Z = Simulink.Parameter(0, DataType="single", Min=-1, Max=1, Unit="m")
LPE_LDR_Z = Simulink.Parameter(0.03, DataType="single", Min=0.01, Max=1, Unit="m")
LPE_LON = Simulink.Parameter(8.545594, DataType="single", Min=-180, Max=180, Unit="deg")
LPE_LT_COV = Simulink.Parameter(0.0001, DataType="single", Min=0, Max=10, Unit="m^2")
LPE_PN_B = Simulink.Parameter(0.001, DataType="single", Min=0, Max=1)
LPE_PN_P = Simulink.Parameter(0.1, DataType="single", Min=0, Max=1)  % Increase to trust measurements more. Decrease to trust model more.
LPE_PN_T = Simulink.Parameter(0.001, DataType="single", Min=0, Max=1)
LPE_PN_V = Simulink.Parameter(0.1, DataType="single", Min=0, Max=1)  % Increase to trust measurements more. Decrease to trust model more.
LPE_SNR_OFF_Z = Simulink.Parameter(0, DataType="single", Min=-1, Max=1, Unit="m")
LPE_SNR_Z = Simulink.Parameter(0.05, DataType="single", Min=0.01, Max=1, Unit="m")
LPE_T_MAX_GRADE = Simulink.Parameter(1, DataType="single", Min=0, Max=100, Unit="%")  % Used to calculate increased terrain random walk nosie due to movement.
LPE_VIC_P = Simulink.Parameter(0.001, DataType="single", Min=0.0001, Max=1, Unit="m")
LPE_VIS_DELAY = Simulink.Parameter(0.1, DataType="single", Min=0, Max=0.1, Unit="s")  % Set to zero to enable automatic compensation from measurement timestamps
LPE_VIS_XY = Simulink.Parameter(0.1, DataType="single", Min=0.01, Max=1, Unit="m")
LPE_VIS_Z = Simulink.Parameter(0.5, DataType="single", Min=0.01, Max=100, Unit="m")
LPE_VXY_PUB = Simulink.Parameter(0.3, DataType="single", Min=0.01, Max=1, Unit="m/s")
LPE_X_LP = Simulink.Parameter(5, DataType="single", Min=5, Max=1000, Unit="Hz")
LPE_Z_PUB = Simulink.Parameter(1, DataType="single", Min=0.3, Max=5, Unit="m")
MAV_0_CONFIG = Simulink.Parameter(101, DataType="int32")  % Configure on which serial port to run MAVLink.
MAV_0_FORWARD = Simulink.Parameter(1, DataType="int32")  % If enabled, forward incoming MAVLink messages to other MAVLink ports if the message is either broadcast or the target is not the autopilot. This allows for example a GCS to talk to a camera that is connected to the autopilot via MAVLink (on a different link than the GCS).
MAV_0_MODE = Simulink.Parameter(0, DataType="int32")  % The MAVLink Mode defines the set of streamed messages (for example the vehicle's attitude) and their sending rates.
MAV_0_RADIO_CTL = Simulink.Parameter(1, DataType="int32")  % If enabled, MAVLink messages will be throttled according to `txbuf` field reported by radio_status. Requires a radio to send the mavlink message RADIO_STATUS.
MAV_0_RATE = Simulink.Parameter(1200, DataType="int32", Min=0, Unit="B/s")  % Configure the maximum sending rate for the MAVLink streams in Bytes/sec. If the configured streams exceed the maximum rate, the sending rate of each stream is automatically decreased. If this is set to 0 a value of half of the theoretical maximum bandwidth is used. This corresponds to baudrate/20 Bytes/s (baudrate/10 = maximum data rate on 8N1-configured links).
MAV_1_CONFIG = Simulink.Parameter(0, DataType="int32")  % Configure on which serial port to run MAVLink.
MAV_1_FORWARD = Simulink.Parameter(0, DataType="int32")  % If enabled, forward incoming MAVLink messages to other MAVLink ports if the message is either broadcast or the target is not the autopilot. This allows for example a GCS to talk to a camera that is connected to the autopilot via MAVLink (on a different link than the GCS).
MAV_1_MODE = Simulink.Parameter(2, DataType="int32")  % The MAVLink Mode defines the set of streamed messages (for example the vehicle's attitude) and their sending rates.
MAV_1_RADIO_CTL = Simulink.Parameter(1, DataType="int32")  % If enabled, MAVLink messages will be throttled according to `txbuf` field reported by radio_status. Requires a radio to send the mavlink message RADIO_STATUS.
MAV_1_RATE = Simulink.Parameter(0, DataType="int32", Min=0, Unit="B/s")  % Configure the maximum sending rate for the MAVLink streams in Bytes/sec. If the configured streams exceed the maximum rate, the sending rate of each stream is automatically decreased. If this is set to 0 a value of half of the theoretical maximum bandwidth is used. This corresponds to baudrate/20 Bytes/s (baudrate/10 = maximum data rate on 8N1-configured links).
MAV_2_CONFIG = Simulink.Parameter(0, DataType="int32")  % Configure on which serial port to run MAVLink.
MAV_2_FORWARD = Simulink.Parameter(0, DataType="int32")  % If enabled, forward incoming MAVLink messages to other MAVLink ports if the message is either broadcast or the target is not the autopilot. This allows for example a GCS to talk to a camera that is connected to the autopilot via MAVLink (on a different link than the GCS).
MAV_2_MODE = Simulink.Parameter(0, DataType="int32")  % The MAVLink Mode defines the set of streamed messages (for example the vehicle's attitude) and their sending rates.
MAV_2_RADIO_CTL = Simulink.Parameter(1, DataType="int32")  % If enabled, MAVLink messages will be throttled according to `txbuf` field reported by radio_status. Requires a radio to send the mavlink message RADIO_STATUS.
MAV_2_RATE = Simulink.Parameter(0, DataType="int32", Min=0, Unit="B/s")  % Configure the maximum sending rate for the MAVLink streams in Bytes/sec. If the configured streams exceed the maximum rate, the sending rate of each stream is automatically decreased. If this is set to 0 a value of half of the theoretical maximum bandwidth is used. This corresponds to baudrate/20 Bytes/s (baudrate/10 = maximum data rate on 8N1-configured links).
MAV_COMP_ID = Simulink.Parameter(1, DataType="int32", Min=1, Max=250)
MAV_FWDEXTSP = Simulink.Parameter(1, DataType="int32")  % If set to 1 incoming external setpoint messages will be directly forwarded to the controllers if in offboard control mode
MAV_HASH_CHK_EN = Simulink.Parameter(1, DataType="int32")  % Disabling the parameter hash check functionality will make the mavlink instance stream parameters continuously.
MAV_HB_FORW_EN = Simulink.Parameter(1, DataType="int32")  % The mavlink hearbeat message will not be forwarded if this parameter is set to 'disabled'. The main reason for disabling heartbeats to be forwarded is because they confuse dronekit.
MAV_ODOM_LP = Simulink.Parameter(0, DataType="int32")  % If set, it gets the data from 'vehicle_visual_odometry' instead of 'vehicle_odometry' serving as a loopback of the received ODOMETRY messages on the Mavlink receiver.
MAV_PROTO_VER = Simulink.Parameter(0, DataType="int32")
MAV_RADIO_TOUT = Simulink.Parameter(5, DataType="int32", Min=1, Max=250, Unit="s")  % If the connected radio stops reporting RADIO_STATUS for a certain time, a warning is triggered and, if MAV_X_RADIO_CTL is enabled, the software-flow control is reset.
MAV_SIK_RADIO_ID = Simulink.Parameter(0, DataType="int32", Min=-1, Max=240)  % When non-zero the MAVLink app will attempt to configure the SiK radio to this ID and re-set the parameter to 0. If the value is negative it will reset the complete radio config to factory defaults. Only applies if this mavlink instance is going through a SiK radio
MAV_SYS_ID = Simulink.Parameter(1, DataType="int32", Min=1, Max=250)
MAV_TYPE = Simulink.Parameter(2, DataType="int32", Min=1, Max=27)
MAV_USEHILGPS = Simulink.Parameter(0, DataType="int32")  % If set to 1 incoming HIL GPS messages are parsed.
MIS_DIST_1WP = Simulink.Parameter(900, DataType="single", Min=0, Max=10000, Unit="m")  % Failsafe check to prevent running mission stored from previous flight at a new takeoff location. Set a value of zero or less to disable. The mission will not be started if the current waypoint is more distant than MIS_DIST_1WP from the home position.
MIS_DIST_WPS = Simulink.Parameter(900, DataType="single", Min=0, Max=10000, Unit="m")  % Failsafe check to prevent running missions which are way too big. Set a value of zero or less to disable. The mission will not be started if any distance between two subsequent waypoints is greater than MIS_DIST_WPS.
MIS_LTRMIN_ALT = Simulink.Parameter(-1, DataType="single", Min=-1, Max=80, Unit="m")  % This is the minimum altitude the system will always obey. The intent is to stay out of ground effect. set to -1, if there shouldn't be a minimum loiter altitude
MIS_MNT_YAW_CTL = Simulink.Parameter(0, DataType="int32", Min=0, Max=1)  % If enabled, yaw commands will be sent to the mount and the vehicle will follow its heading towards the flight direction. If disabled, the vehicle will yaw towards the ROI.
MIS_TAKEOFF_ALT = Simulink.Parameter(2.5, DataType="single", Min=0, Max=80, Unit="m")  % This is the minimum altitude the system will take off to.
MIS_TAKEOFF_REQ = Simulink.Parameter(0, DataType="int32")  % If set, the mission feasibility checker will check for a takeoff waypoint on the mission.
MIS_YAW_ERR = Simulink.Parameter(12, DataType="single", Min=0, Max=90, Unit="deg")
MIS_YAW_TMT = Simulink.Parameter(-1, DataType="single", Min=-1, Max=20, Unit="s")  % If set > 0 it will ignore the target heading for normal waypoint acceptance. If the waypoint forces the heading the timeout will matter. For example on VTOL forwards transition. Mainly useful for VTOLs that have less yaw authority and might not reach target yaw in wind. Disabled by default.
MPC_YAW_MODE = Simulink.Parameter(0, DataType="int32", Min=0, Max=4)  % Specifies the heading in Auto.
NAV_ACC_RAD = Simulink.Parameter(10, DataType="single", Min=0.05, Max=200, Unit="m")  % Default acceptance radius, overridden by acceptance radius of waypoint if set. For fixed wing the L1 turning distance is used for horizontal acceptance.
NAV_FORCE_VT = Simulink.Parameter(1, DataType="int32")
NAV_FW_ALTL_RAD = Simulink.Parameter(5, DataType="single", Min=0.05, Max=200, Unit="m")  % Altitude acceptance used for the last waypoint before a fixed-wing landing. This is usually smaller than the standard vertical acceptance because close to the ground higher accuracy is required.
NAV_FW_ALT_RAD = Simulink.Parameter(10, DataType="single", Min=0.05, Max=200, Unit="m")  % Acceptance radius for fixedwing altitude.
NAV_LOITER_RAD = Simulink.Parameter(50, DataType="single", Min=25, Max=1000, Unit="m")  % Default value of loiter radius for missions, Hold mode, Return mode, etc. (fixedwing only).
NAV_MC_ALT_RAD = Simulink.Parameter(0.8, DataType="single", Min=0.05, Max=200, Unit="m")  % Acceptance radius for multicopter altitude.
NAV_TRAFF_AVOID = Simulink.Parameter(1, DataType="int32")  % Enabling this will allow the system to respond to transponder data from e.g. ADSB transponders
NAV_TRAFF_A_RADM = Simulink.Parameter(500, DataType="single", Min=500, Unit="m")  % Defines the Radius where NAV TRAFFIC AVOID is Called For Manned Aviation
NAV_TRAFF_A_RADU = Simulink.Parameter(10, DataType="single", Min=10, Max=500, Unit="m")  % Defines the Radius where NAV TRAFFIC AVOID is Called For Unmanned Aviation
MC_AIRMODE = Simulink.Parameter(0, DataType="int32")  % The air-mode enables the mixer to increase the total thrust of the multirotor in order to keep attitude and rate control even at low and high throttle. This function should be disabled during tuning as it will help the controller to diverge if the closed-loop is unstable (i.e. the vehicle is not tuned yet). Enabling air-mode for yaw requires the use of an arming switch.
MOT_ORDERING = Simulink.Parameter(0, DataType="int32")  % Determines the motor ordering. This can be used for example in combination with a 4-in-1 ESC that assumes a motor ordering which is different from PX4. ONLY supported for Quads. When changing this, make sure to test the motor response without props first.
MNT_DO_STAB = Simulink.Parameter(0, DataType="int32", Min=0, Max=2)  % Set to true for servo gimbal, false for passthrough. This is required for a gimbal which is not capable of stabilizing itself and relies on the IMU's attitude estimation.
MNT_MAN_PITCH = Simulink.Parameter(0, DataType="int32", Min=0, Max=6)
MNT_MAN_ROLL = Simulink.Parameter(0, DataType="int32", Min=0, Max=6)
MNT_MAN_YAW = Simulink.Parameter(0, DataType="int32", Min=0, Max=6)
MNT_MAV_COMPID = Simulink.Parameter(154, DataType="int32")  % If MNT_MODE_OUT is MAVLink protocol v2, mount configure/control commands will be sent with this component ID.
MNT_MAV_SYSID = Simulink.Parameter(1, DataType="int32")  % If MNT_MODE_OUT is MAVLink gimbal protocol v1, mount configure/control commands will be sent with this target ID.
MNT_MODE_IN = Simulink.Parameter(-1, DataType="int32", Min=-1, Max=4)  % RC uses the AUX input channels (see MNT_MAN_* parameters), MAVLINK_ROI uses the MAV_CMD_DO_SET_ROI Mavlink message, and MAVLINK_DO_MOUNT the MAV_CMD_DO_MOUNT_CONFIGURE and MAV_CMD_DO_MOUNT_CONTROL messages to control a mount.
MNT_MODE_OUT = Simulink.Parameter(0, DataType="int32", Min=0, Max=2)  % AUX uses the mixer output Control Group #2. MAVLINK uses the MAV_CMD_DO_MOUNT_CONFIGURE and MAV_CMD_DO_MOUNT_CONTROL MavLink messages to control a mount (set MNT_MAV_SYSID & MNT_MAV_COMPID)
MNT_OB_LOCK_MODE = Simulink.Parameter(0, DataType="single", Min=-1, Max=1)  % if required for the gimbal (only in AUX output mode)
MNT_OB_NORM_MODE = Simulink.Parameter(-1, DataType="single", Min=-1, Max=1)  % if required by the gimbal (only in AUX output mode)
MNT_OFF_PITCH = Simulink.Parameter(0, DataType="single", Min=-360, Max=360)
MNT_OFF_ROLL = Simulink.Parameter(0, DataType="single", Min=-360, Max=360)
MNT_OFF_YAW = Simulink.Parameter(0, DataType="single", Min=-360, Max=360)
MNT_RANGE_PITCH = Simulink.Parameter(360, DataType="single", Min=1, Max=720)
MNT_RANGE_ROLL = Simulink.Parameter(360, DataType="single", Min=1, Max=720)
MNT_RANGE_YAW = Simulink.Parameter(360, DataType="single", Min=1, Max=720)
MNT_RATE_PITCH = Simulink.Parameter(30, DataType="single", Min=1, Max=90)  % Full stick input [-1..1] translats to [-pitch rate..pitch rate].
MNT_RATE_YAW = Simulink.Parameter(30, DataType="single", Min=1, Max=90)  % Full stick input [-1..1] translats to [-yaw rate..yaw rate].
MC_PITCHRATE_MAX = Simulink.Parameter(220, DataType="single", Min=0, Max=1800, Unit="deg/s")  % Limit for pitch rate in manual and auto modes (except acro). Has effect for large rotations in autonomous mode, to avoid large control output and mixer saturation. This is not only limited by the vehicle's properties, but also by the maximum measurement rate of the gyro.
MC_PITCH_P = Simulink.Parameter(6.5, DataType="single", Min=0, Max=12)  % Pitch proportional gain, i.e. desired angular speed in rad/s for error 1 rad.
MC_ROLLRATE_MAX = Simulink.Parameter(220, DataType="single", Min=0, Max=1800, Unit="deg/s")  % Limit for roll rate in manual and auto modes (except acro). Has effect for large rotations in autonomous mode, to avoid large control output and mixer saturation. This is not only limited by the vehicle's properties, but also by the maximum measurement rate of the gyro.
MC_ROLL_P = Simulink.Parameter(6.5, DataType="single", Min=0, Max=12)  % Roll proportional gain, i.e. desired angular speed in rad/s for error 1 rad.
MC_YAWRATE_MAX = Simulink.Parameter(200, DataType="single", Min=0, Max=1800, Unit="deg/s")
MC_YAW_P = Simulink.Parameter(2.8, DataType="single", Min=0, Max=5)  % Yaw proportional gain, i.e. desired angular speed in rad/s for error 1 rad.
MC_YAW_WEIGHT = Simulink.Parameter(0.4, DataType="single", Min=0, Max=1)  % A fraction [0,1] deprioritizing yaw compared to roll and pitch in non-linear attitude control. Deprioritizing yaw is necessary because multicopters have much less control authority in yaw compared to the other axes and it makes sense because yaw is not critical for stable hovering or 3D navigation. For yaw control tuning use MC_YAW_P. This ratio has no inpact on the yaw gain.
MPC_YAWRAUTO_MAX = Simulink.Parameter(45, DataType="single", Min=0, Max=360, Unit="deg/s")  % Limit the rate of change of the yaw setpoint in autonomous mode to avoid large control output and mixer saturation.
CP_DELAY = Simulink.Parameter(0.4, DataType="single", Min=0, Max=1, Unit="s")  % Only used in Position mode.
CP_DIST = Simulink.Parameter(-1, DataType="single", Min=-1, Max=15, Unit="m")  % Only used in Position mode. Collision avoidance is disabled by setting this parameter to a negative value
CP_GO_NO_DATA = Simulink.Parameter(0, DataType="int32")  % Only used in Position mode.
CP_GUIDE_ANG = Simulink.Parameter(30, DataType="single", Min=0, Max=90, Unit="deg")  % Only used in Position mode.
MC_MAN_TILT_TAU = Simulink.Parameter(0, DataType="single", Min=0, Max=2, Unit="s")  % Setting this parameter to 0 disables the filter
MPC_ACC_DOWN_MAX = Simulink.Parameter(3, DataType="single", Min=2, Max=15, Unit="m/s^2")
MPC_ACC_HOR = Simulink.Parameter(3, DataType="single", Min=2, Max=15, Unit="m/s^2")  % Note: In manual, this parameter is only used in MPC_POS_MODE 4.
MPC_ACC_HOR_MAX = Simulink.Parameter(5, DataType="single", Min=2, Max=15, Unit="m/s^2")  % MPC_POS_MODE 1 just deceleration 3 acceleration and deceleration 4 just acceleration
MPC_ACC_UP_MAX = Simulink.Parameter(4, DataType="single", Min=2, Max=15, Unit="m/s^2")
MPC_ALT_MODE = Simulink.Parameter(0, DataType="int32", Min=0, Max=2)  % Set to 0 to control height relative to the earth frame origin. This origin may move up and down in flight due to sensor drift. Set to 1 to control height relative to estimated distance to ground. The vehicle will move up and down with terrain height variation. Requires a distance to ground sensor. The height controller will revert to using height above origin if the distance to ground estimate becomes invalid as indicated by the local_position.distance_bottom_valid message being false. Set to 2 to control height relative to ground (requires a distance sensor) when stationary and relative to earth frame origin when moving horizontally. The speed threshold is controlled by the MPC_HOLD_MAX_XY parameter.
MPC_HOLD_DZ = Simulink.Parameter(0.1, DataType="single", Min=0, Max=1)
MPC_HOLD_MAX_XY = Simulink.Parameter(0.8, DataType="single", Min=0, Max=3, Unit="m/s")
MPC_HOLD_MAX_Z = Simulink.Parameter(0.6, DataType="single", Min=0, Max=3, Unit="m/s")
MPC_JERK_AUTO = Simulink.Parameter(4, DataType="single", Min=1, Max=80, Unit="m/s^3")  % Limit the maximum jerk of the vehicle (how fast the acceleration can change). A lower value leads to smoother vehicle motions, but it also limits its agility.
MPC_JERK_MAX = Simulink.Parameter(8, DataType="single", Min=0.5, Max=500, Unit="m/s^3")  % Limit the maximum jerk of the vehicle (how fast the acceleration can change). A lower value leads to smoother vehicle motions, but it also limits its agility (how fast it can change directions or break). Setting this to the maximum value essentially disables the limit. Note: This is only used when MPC_POS_MODE is set to a smoothing mode 3 or 4.
MPC_LAND_ALT1 = Simulink.Parameter(10, DataType="single", Min=0, Max=122, Unit="m")  % Below this altitude descending velocity gets limited to a value between "MPC_Z_VEL_MAX_DN" and "MPC_LAND_SPEED" Value needs to be higher than "MPC_LAND_ALT2"
MPC_LAND_ALT2 = Simulink.Parameter(5, DataType="single", Min=0, Max=122, Unit="m")  % Below this altitude descending velocity gets limited to "MPC_LAND_SPEED". Value needs to be lower than "MPC_LAND_ALT1"
MPC_LAND_SPEED = Simulink.Parameter(0.7, DataType="single", Min=0.6, Unit="m/s")
MPC_MANTHR_MIN = Simulink.Parameter(0.08, DataType="single", Min=0, Max=1, Unit="norm")  % Minimum vertical thrust. It's recommended to set it > 0 to avoid free fall with zero thrust. With MC_AIRMODE set to 1, this can safely be set to 0.
MPC_MAN_TILT_MAX = Simulink.Parameter(35, DataType="single", Min=0, Max=90, Unit="deg")
MPC_MAN_Y_MAX = Simulink.Parameter(150, DataType="single", Min=0, Max=400, Unit="deg/s")
MPC_MAN_Y_TAU = Simulink.Parameter(0.08, DataType="single", Min=0, Max=5, Unit="s")  % Setting this parameter to 0 disables the filter
MPC_POS_MODE = Simulink.Parameter(4, DataType="int32")  % The supported sub-modes are: 0 Simple position control where sticks map directly to velocity setpoints without smoothing. Useful for velocity control tuning. 3 Smooth position control with maximum acceleration and jerk limits based on jerk optimized trajectory generator (different algorithm than 1). 4 Smooth position control where sticks map to acceleration and there's a virtual brake drag
MPC_SPOOLUP_TIME = Simulink.Parameter(1, DataType="single", Min=0, Max=10, Unit="s")  % For altitude controlled modes the time from arming the motors until a takeoff is possible gets forced to be at least MPC_SPOOLUP_TIME seconds to ensure the motors and propellers can sppol up and reach idle speed before getting commanded to spin faster. This delay is particularly useful for vehicles with slow motor spin-up e.g. because of large propellers.
MPC_THR_CURVE = Simulink.Parameter(0, DataType="int32")  % This parameter defines how the throttle stick input is mapped to commanded thrust in Manual/Stabilized flight mode. In case the default is used ('Rescale to hover thrust'), the stick input is linearly rescaled, such that a centered stick corresponds to the hover throttle (see MPC_THR_HOVER). Select 'No Rescale' to directly map the stick 1:1 to the output. This can be useful in case the hover thrust is very low and the default would lead to too much distortion (e.g. if hover thrust is set to 20%, 80% of the upper thrust range is squeezed into the upper half of the stick range). Note: In case MPC_THR_HOVER is set to 50%, the modes 0 and 1 are the same.
MPC_THR_HOVER = Simulink.Parameter(0.5, DataType="single", Min=0.1, Max=0.8, Unit="norm")  % Vertical thrust required to hover. This value is mapped to center stick for manual throttle control. With this value set to the thrust required to hover, transition from manual to Altitude or Position mode while hovering will occur with the throttle stick near center, which is then interpreted as (near) zero demand for vertical speed. This parameter is also important for the landing detection to work correctly.
MPC_THR_MAX = Simulink.Parameter(1, DataType="single", Min=0, Max=1, Unit="norm")  % Limit max allowed thrust
MPC_THR_MIN = Simulink.Parameter(0.12, DataType="single", Min=0.05, Max=1, Unit="norm")  % It's recommended to set it > 0 to avoid free fall with zero thrust. Note: Without airmode zero thrust leads to zero roll/pitch control authority. (see MC_AIRMODE)
MPC_THR_XY_MARG = Simulink.Parameter(0.3, DataType="single", Min=0, Max=0.5, Unit="norm")  % Margin that is kept for horizontal control when prioritizing vertical thrust. To avoid completely starving horizontal control with high vertical error.
MPC_TILTMAX_AIR = Simulink.Parameter(45, DataType="single", Min=20, Max=89, Unit="deg")  % Limits maximum tilt in AUTO and POSCTRL modes during flight.
MPC_TILTMAX_LND = Simulink.Parameter(12, DataType="single", Min=10, Max=89, Unit="deg")  % Limits maximum tilt angle on landing.
MPC_TKO_RAMP_T = Simulink.Parameter(3, DataType="single", Min=0, Max=5)  % Increasing this value will make automatic and manual takeoff slower. If it's too slow the drone might scratch the ground and tip over. A time constant of 0 disables the ramp
MPC_TKO_SPEED = Simulink.Parameter(1.5, DataType="single", Min=1, Max=5, Unit="m/s")
MPC_USE_HTE = Simulink.Parameter(1, DataType="int32")  % Set false to use the fixed parameter MPC_THR_HOVER Set true to use the value computed by the hover thrust estimator
MPC_VELD_LP = Simulink.Parameter(5, DataType="single", Min=0, Max=10, Unit="Hz")
MPC_VEL_MANUAL = Simulink.Parameter(10, DataType="single", Min=3, Max=20, Unit="m/s")  % If velocity setpoint larger than MPC_XY_VEL_MAX is set, then the setpoint will be capped to MPC_XY_VEL_MAX
MPC_XY_CRUISE = Simulink.Parameter(5, DataType="single", Min=3, Max=20, Unit="m/s")  % Horizontal velocity used when flying autonomously in e.g. Missions, RTL, Goto.
MPC_XY_ERR_MAX = Simulink.Parameter(2, DataType="single", Min=0.1, Max=10)  % The integration speed of the trajectory setpoint is linearly reduced with the horizontal position tracking error. When the error is above this parameter, the integration of the trajectory is stopped to wait for the drone. This value can be adjusted depending on the tracking capabilities of the vehicle.
MPC_XY_MAN_EXPO = Simulink.Parameter(0.6, DataType="single", Min=0, Max=1)  % The higher the value the less sensitivity the stick has around zero while still reaching the maximum value with full stick deflection. 0 Purely linear input curve (default) 1 Purely cubic input curve
MPC_XY_P = Simulink.Parameter(0.95, DataType="single", Min=0, Max=2)
MPC_XY_TRAJ_P = Simulink.Parameter(0.5, DataType="single", Min=0.1, Max=1)
MPC_XY_VEL_ALL = Simulink.Parameter(-10, DataType="single", Min=-20, Max=20)  % If set to a value greater than zero, other parameters are automatically set (such as MPC_XY_VEL_MAX or MPC_VEL_MANUAL). If set to a negative value, the existing individual parameters are used.
MPC_XY_VEL_D_ACC = Simulink.Parameter(0.2, DataType="single", Min=0.1, Max=2)  % defined as correction acceleration in m/s^2 per m/s^2 velocity derivative
MPC_XY_VEL_I_ACC = Simulink.Parameter(0.4, DataType="single", Min=0, Max=60)  % defined as correction acceleration in m/s^2 per m velocity integral Non-zero value allows to eliminate steady state errors in the presence of disturbances like wind.
MPC_XY_VEL_MAX = Simulink.Parameter(12, DataType="single", Min=0, Max=20, Unit="m/s")  % Maximum horizontal velocity in AUTO mode. If higher speeds are commanded in a mission they will be capped to this velocity.
MPC_XY_VEL_P_ACC = Simulink.Parameter(1.8, DataType="single", Min=1.2, Max=5)  % defined as correction acceleration in m/s^2 per m/s velocity error
MPC_YAW_EXPO = Simulink.Parameter(0.6, DataType="single", Min=0, Max=1)  % The higher the value the less sensitivity the stick has around zero while still reaching the maximum value with full stick deflection. 0 Purely linear input curve (default) 1 Purely cubic input curve
MPC_Z_MAN_EXPO = Simulink.Parameter(0.6, DataType="single", Min=0, Max=1)  % The higher the value the less sensitivity the stick has around zero while still reaching the maximum value with full stick deflection. 0 Purely linear input curve (default) 1 Purely cubic input curve
MPC_Z_P = Simulink.Parameter(1, DataType="single", Min=0, Max=1.5)
MPC_Z_VEL_ALL = Simulink.Parameter(-3, DataType="single", Min=-3, Max=8)  % If set to a value greater than zero, other parameters are automatically set (such as MPC_Z_VEL_MAX_UP or MPC_LAND_SPEED). If set to a negative value, the existing individual parameters are used.
MPC_Z_VEL_D_ACC = Simulink.Parameter(0, DataType="single", Min=0, Max=2)  % defined as correction acceleration in m/s^2 per m/s^2 velocity derivative
MPC_Z_VEL_I_ACC = Simulink.Parameter(2, DataType="single", Min=0.2, Max=3)  % defined as correction acceleration in m/s^2 per m velocity integral Non zero value allows hovering thrust estimation on stabilized or autonomous takeoff.

MPC_Z_VEL_MAX_DN = Simulink.Parameter(1, DataType="single", Min=0.5, Max=4, Unit="m/s")  % Maximum vertical velocity in AUTO mode and endpoint for stabilized modes (ALTCTRL, POSCTRL).
MPC_Z_VEL_MAX_UP = Simulink.Parameter(3, DataType="single", Min=0.5, Max=8, Unit="m/s")  % Maximum vertical velocity in AUTO mode and endpoint for stabilized modes (ALTCTRL, POSCTRL).
MPC_Z_VEL_P_ACC = Simulink.Parameter(4, DataType="single", Min=2, Max=15)  % defined as correction acceleration in m/s^2 per m/s velocity error
SYS_VEHICLE_RESP = Simulink.Parameter(-0.4, DataType="single", Min=-1, Max=1)  % Changes the overall responsiveness of the vehicle. The higher the value, the faster the vehicle will react. If set to a value greater than zero, other parameters are automatically set (such as the acceleration or jerk limits). If set to a negative value, the existing individual parameters are used.
WV_EN = Simulink.Parameter(0, DataType="int32")
WV_ROLL_MIN = Simulink.Parameter(1, DataType="single", Min=0, Max=5, Unit="deg")
WV_YRATE_MAX = Simulink.Parameter(90, DataType="single", Min=0, Max=120, Unit="deg/s")
MC_ACRO_EXPO = Simulink.Parameter(0.69, DataType="single", Min=0, Max=1)  % Exponential factor for tuning the input curve shape. 0 Purely linear input curve 1 Purely cubic input curve
MC_ACRO_EXPO_Y = Simulink.Parameter(0.69, DataType="single", Min=0, Max=1)  % Exponential factor for tuning the input curve shape. 0 Purely linear input curve 1 Purely cubic input curve
MC_ACRO_P_MAX = Simulink.Parameter(720, DataType="single", Min=0, Max=1800, Unit="deg/s")  % default: 2 turns per second
MC_ACRO_R_MAX = Simulink.Parameter(720, DataType="single", Min=0, Max=1800, Unit="deg/s")  % default: 2 turns per second
MC_ACRO_SUPEXPO = Simulink.Parameter(0.7, DataType="single", Min=0, Max=0.95)  % SuperExpo factor for refining the input curve shape tuned using MC_ACRO_EXPO. 0 Pure Expo function 0.7 resonable shape enhancement for intuitive stick feel 0.95 very strong bent input curve only near maxima have effect
MC_ACRO_SUPEXPOY = Simulink.Parameter(0.7, DataType="single", Min=0, Max=0.95)  % SuperExpo factor for refining the input curve shape tuned using MC_ACRO_EXPO_Y. 0 Pure Expo function 0.7 resonable shape enhancement for intuitive stick feel 0.95 very strong bent input curve only near maxima have effect
MC_ACRO_Y_MAX = Simulink.Parameter(540, DataType="single", Min=0, Max=1800, Unit="deg/s")  % default 1.5 turns per second
MC_BAT_SCALE_EN = Simulink.Parameter(0, DataType="int32")  % This compensates for voltage drop of the battery over time by attempting to normalize performance across the operating range of the battery. The copter should constantly behave as if it was fully charged with reduced max acceleration at lower battery percentages. i.e. if hover is at 0.5 throttle at 100% battery, it will still be 0.5 at 60% battery.
MC_PITCHRATE_D = Simulink.Parameter(0.003, DataType="single", Min=0)  % Pitch rate differential gain. Small values help reduce fast oscillations. If value is too big oscillations will appear again.
MC_PITCHRATE_FF = Simulink.Parameter(0, DataType="single", Min=0)  % Improves tracking performance.
MC_PITCHRATE_I = Simulink.Parameter(0.2, DataType="single", Min=0)  % Pitch rate integral gain. Can be set to compensate static thrust difference or gravity center offset.
MC_PITCHRATE_K = Simulink.Parameter(1, DataType="single", Min=0.01, Max=5)  % Global gain of the controller. This gain scales the P, I and D terms of the controller: output = MC_PITCHRATE_K * (MC_PITCHRATE_P * error + MC_PITCHRATE_I * error_integral + MC_PITCHRATE_D * error_derivative) Set MC_PITCHRATE_P=1 to implement a PID in the ideal form. Set MC_PITCHRATE_K=1 to implement a PID in the parallel form.
MC_PITCHRATE_P = Simulink.Parameter(0.15, DataType="single", Min=0.01, Max=0.6)  % Pitch rate proportional gain, i.e. control output for angular speed error 1 rad/s.
MC_PR_INT_LIM = Simulink.Parameter(0.3, DataType="single", Min=0)  % Pitch rate integrator limit. Can be set to increase the amount of integrator available to counteract disturbances or reduced to improve settling time after large pitch moment trim changes.
MC_ROLLRATE_D = Simulink.Parameter(0.003, DataType="single", Min=0, Max=0.01)  % Roll rate differential gain. Small values help reduce fast oscillations. If value is too big oscillations will appear again.
MC_ROLLRATE_FF = Simulink.Parameter(0, DataType="single", Min=0)  % Improves tracking performance.
MC_ROLLRATE_I = Simulink.Parameter(0.2, DataType="single", Min=0)  % Roll rate integral gain. Can be set to compensate static thrust difference or gravity center offset.
MC_ROLLRATE_K = Simulink.Parameter(1, DataType="single", Min=0.01, Max=5)  % Global gain of the controller. This gain scales the P, I and D terms of the controller: output = MC_ROLLRATE_K * (MC_ROLLRATE_P * error + MC_ROLLRATE_I * error_integral + MC_ROLLRATE_D * error_derivative) Set MC_ROLLRATE_P=1 to implement a PID in the ideal form. Set MC_ROLLRATE_K=1 to implement a PID in the parallel form.
MC_ROLLRATE_P = Simulink.Parameter(0.15, DataType="single", Min=0.01, Max=0.5)  % Roll rate proportional gain, i.e. control output for angular speed error 1 rad/s.
MC_RR_INT_LIM = Simulink.Parameter(0.3, DataType="single", Min=0)  % Roll rate integrator limit. Can be set to increase the amount of integrator available to counteract disturbances or reduced to improve settling time after large roll moment trim changes.
MC_YAWRATE_D = Simulink.Parameter(0, DataType="single", Min=0)  % Yaw rate differential gain. Small values help reduce fast oscillations. If value is too big oscillations will appear again.
MC_YAWRATE_FF = Simulink.Parameter(0, DataType="single", Min=0)  % Improves tracking performance.
MC_YAWRATE_I = Simulink.Parameter(0.1, DataType="single", Min=0)  % Yaw rate integral gain. Can be set to compensate static thrust difference or gravity center offset.
MC_YAWRATE_K = Simulink.Parameter(1, DataType="single", Min=0, Max=5)  % Global gain of the controller. This gain scales the P, I and D terms of the controller: output = MC_YAWRATE_K * (MC_YAWRATE_P * error + MC_YAWRATE_I * error_integral + MC_YAWRATE_D * error_derivative) Set MC_YAWRATE_P=1 to implement a PID in the ideal form. Set MC_YAWRATE_K=1 to implement a PID in the parallel form.
MC_YAWRATE_P = Simulink.Parameter(0.2, DataType="single", Min=0, Max=0.6)  % Yaw rate proportional gain, i.e. control output for angular speed error 1 rad/s.
MC_YR_INT_LIM = Simulink.Parameter(0.3, DataType="single", Min=0)  % Yaw rate integrator limit. Can be set to increase the amount of integrator available to counteract disturbances or reduced to improve settling time after large yaw moment trim changes.
OSD_ATXXXX_CFG = Simulink.Parameter(0, DataType="int32")  % Configure the ATXXXX OSD Chip (mounted on the OmnibusF4SD board) and select the transmission standard.
MOT_SLEW_MAX = Simulink.Parameter(0, DataType="single", Min=0, Unit="s/(1000*PWM)")  % Minimum time allowed for the motor input signal to pass through a range of 1000 PWM units. A value x means that the motor signal can only go from 1000 to 2000 PWM in maximum x seconds. Zero means that slew rate limiting is disabled.
PWM_AUX_DIS1 = Simulink.Parameter(-1, DataType="int32", Min=-1, Max=2150, Unit="us")  % This is the PWM pulse the autopilot is outputting if not armed. When set to -1 the value for PWM_AUX_DISARM will be used
PWM_AUX_DIS2 = Simulink.Parameter(-1, DataType="int32", Min=-1, Max=2150, Unit="us")  % This is the PWM pulse the autopilot is outputting if not armed. When set to -1 the value for PWM_AUX_DISARM will be used
PWM_AUX_DIS3 = Simulink.Parameter(-1, DataType="int32", Min=-1, Max=2150, Unit="us")  % This is the PWM pulse the autopilot is outputting if not armed. When set to -1 the value for PWM_AUX_DISARM will be used
PWM_AUX_DIS4 = Simulink.Parameter(-1, DataType="int32", Min=-1, Max=2150, Unit="us")  % This is the PWM pulse the autopilot is outputting if not armed. When set to -1 the value for PWM_AUX_DISARM will be used
PWM_AUX_DIS5 = Simulink.Parameter(-1, DataType="int32", Min=-1, Max=2150, Unit="us")  % This is the PWM pulse the autopilot is outputting if not armed. When set to -1 the value for PWM_AUX_DISARM will be used
PWM_AUX_DIS6 = Simulink.Parameter(-1, DataType="int32", Min=-1, Max=2150, Unit="us")  % This is the PWM pulse the autopilot is outputting if not armed. When set to -1 the value for PWM_AUX_DISARM will be used
PWM_AUX_DIS7 = Simulink.Parameter(-1, DataType="int32", Min=-1, Max=2150, Unit="us")  % This is the PWM pulse the autopilot is outputting if not armed. When set to -1 the value for PWM_AUX_DISARM will be used
PWM_AUX_DIS8 = Simulink.Parameter(-1, DataType="int32", Min=-1, Max=2150, Unit="us")  % This is the PWM pulse the autopilot is outputting if not armed. When set to -1 the value for PWM_AUX_DISARM will be used
PWM_AUX_DISARM = Simulink.Parameter(1500, DataType="int32", Min=0, Max=2200, Unit="us")  % This is the PWM pulse the autopilot is outputting if not armed. The main use of this parameter is to silence ESCs when they are disarmed.
PWM_AUX_FAIL1 = Simulink.Parameter(-1, DataType="int32", Min=-1, Max=2150, Unit="us")  % This is the PWM pulse the autopilot is outputting if in failsafe mode. When set to -1 the value is set automatically depending if the actuator is a motor (900us) or a servo (1500us)
PWM_AUX_FAIL2 = Simulink.Parameter(-1, DataType="int32", Min=-1, Max=2150, Unit="us")  % This is the PWM pulse the autopilot is outputting if in failsafe mode. When set to -1 the value is set automatically depending if the actuator is a motor (900us) or a servo (1500us)
PWM_AUX_FAIL3 = Simulink.Parameter(-1, DataType="int32", Min=-1, Max=2150, Unit="us")  % This is the PWM pulse the autopilot is outputting if in failsafe mode. When set to -1 the value is set automatically depending if the actuator is a motor (900us) or a servo (1500us)
PWM_AUX_FAIL4 = Simulink.Parameter(-1, DataType="int32", Min=-1, Max=2150, Unit="us")  % This is the PWM pulse the autopilot is outputting if in failsafe mode. When set to -1 the value is set automatically depending if the actuator is a motor (900us) or a servo (1500us)
PWM_AUX_FAIL5 = Simulink.Parameter(-1, DataType="int32", Min=-1, Max=2150, Unit="us")  % This is the PWM pulse the autopilot is outputting if in failsafe mode. When set to -1 the value is set automatically depending if the actuator is a motor (900us) or a servo (1500us)
PWM_AUX_FAIL6 = Simulink.Parameter(-1, DataType="int32", Min=-1, Max=2150, Unit="us")  % This is the PWM pulse the autopilot is outputting if in failsafe mode. When set to -1 the value is set automatically depending if the actuator is a motor (900us) or a servo (1500us)
PWM_AUX_FAIL7 = Simulink.Parameter(-1, DataType="int32", Min=-1, Max=2150, Unit="us")  % This is the PWM pulse the autopilot is outputting if in failsafe mode. When set to -1 the value is set automatically depending if the actuator is a motor (900us) or a servo (1500us)
PWM_AUX_FAIL8 = Simulink.Parameter(-1, DataType="int32", Min=-1, Max=2150, Unit="us")  % This is the PWM pulse the autopilot is outputting if in failsafe mode. When set to -1 the value is set automatically depending if the actuator is a motor (900us) or a servo (1500us)
PWM_AUX_MAX = Simulink.Parameter(2000, DataType="int32", Min=1600, Max=2200, Unit="us")  % Set to 2000 for industry default or 2100 to increase servo travel.
PWM_AUX_MAX1 = Simulink.Parameter(-1, DataType="int32", Min=-1, Max=2150, Unit="us")  % This is the maximum PWM pulse the autopilot is allowed to output. When set to -1 the value for PWM_AUX_MAX will be used
PWM_AUX_MAX2 = Simulink.Parameter(-1, DataType="int32", Min=-1, Max=2150, Unit="us")  % This is the maximum PWM pulse the autopilot is allowed to output. When set to -1 the value for PWM_AUX_MAX will be used
PWM_AUX_MAX3 = Simulink.Parameter(-1, DataType="int32", Min=-1, Max=2150, Unit="us")  % This is the maximum PWM pulse the autopilot is allowed to output. When set to -1 the value for PWM_AUX_MAX will be used
PWM_AUX_MAX4 = Simulink.Parameter(-1, DataType="int32", Min=-1, Max=2150, Unit="us")  % This is the maximum PWM pulse the autopilot is allowed to output. When set to -1 the value for PWM_AUX_MAX will be used
PWM_AUX_MAX5 = Simulink.Parameter(-1, DataType="int32", Min=-1, Max=2150, Unit="us")  % This is the maximum PWM pulse the autopilot is allowed to output. When set to -1 the value for PWM_AUX_MAX will be used
PWM_AUX_MAX6 = Simulink.Parameter(-1, DataType="int32", Min=-1, Max=2150, Unit="us")  % This is the maximum PWM pulse the autopilot is allowed to output. When set to -1 the value for PWM_AUX_MAX will be used
PWM_AUX_MAX7 = Simulink.Parameter(-1, DataType="int32", Min=-1, Max=2150, Unit="us")  % This is the maximum PWM pulse the autopilot is allowed to output. When set to -1 the value for PWM_AUX_MAX will be used
PWM_AUX_MAX8 = Simulink.Parameter(-1, DataType="int32", Min=-1, Max=2150, Unit="us")  % This is the maximum PWM pulse the autopilot is allowed to output. When set to -1 the value for PWM_AUX_MAX will be used
PWM_AUX_MIN = Simulink.Parameter(1000, DataType="int32", Min=800, Max=1400, Unit="us")  % Set to 1000 for industry default or 900 to increase servo travel.
PWM_AUX_MIN1 = Simulink.Parameter(-1, DataType="int32", Min=-1, Max=1600, Unit="us")  % This is the minimum PWM pulse the autopilot is allowed to output. When set to -1 the value for PWM_AUX_MIN will be used
PWM_AUX_MIN2 = Simulink.Parameter(-1, DataType="int32", Min=-1, Max=1600, Unit="us")  % This is the minimum PWM pulse the autopilot is allowed to output. When set to -1 the value for PWM_AUX_MIN will be used
PWM_AUX_MIN3 = Simulink.Parameter(-1, DataType="int32", Min=-1, Max=1600, Unit="us")  % This is the minimum PWM pulse the autopilot is allowed to output. When set to -1 the value for PWM_AUX_MIN will be used
PWM_AUX_MIN4 = Simulink.Parameter(-1, DataType="int32", Min=-1, Max=1600, Unit="us")  % This is the minimum PWM pulse the autopilot is allowed to output. When set to -1 the value for PWM_AUX_MIN will be used
PWM_AUX_MIN5 = Simulink.Parameter(-1, DataType="int32", Min=-1, Max=1600, Unit="us")  % This is the minimum PWM pulse the autopilot is allowed to output. When set to -1 the value for PWM_AUX_MIN will be used
PWM_AUX_MIN6 = Simulink.Parameter(-1, DataType="int32", Min=-1, Max=1600, Unit="us")  % This is the minimum PWM pulse the autopilot is allowed to output. When set to -1 the value for PWM_AUX_MIN will be used
PWM_AUX_MIN7 = Simulink.Parameter(-1, DataType="int32", Min=-1, Max=1600, Unit="us")  % This is the minimum PWM pulse the autopilot is allowed to output. When set to -1 the value for PWM_AUX_MIN will be used
PWM_AUX_MIN8 = Simulink.Parameter(-1, DataType="int32", Min=-1, Max=1600, Unit="us")  % This is the minimum PWM pulse the autopilot is allowed to output. When set to -1 the value for PWM_AUX_MIN will be used
PWM_AUX_OUT = Simulink.Parameter(0, DataType="int32", Min=0, Max=123456789)  % Number representing the channels e.g. 134 - Channel 1, 3 and 4. Global e.g. PWM_AUX_MIN/MAX/DISARM limits only apply to these channels.
PWM_AUX_RATE = Simulink.Parameter(50, DataType="int32", Min=-1, Max=2000, Unit="Hz")  % Set to 400 for industry default or 1000 for high frequency ESCs. Set to 0 for Oneshot125.
PWM_AUX_RATE1 = Simulink.Parameter(50, DataType="int32", Min=0, Max=400, Unit="Hz")  % Set the default PWM output frequency for the aux outputs
PWM_AUX_REV1 = Simulink.Parameter(0, DataType="int32")  % Enable to invert the channel. Warning: Use this parameter when connected to a servo only. For a brushless motor, invert manually two phases to reverse the direction.
PWM_AUX_REV2 = Simulink.Parameter(0, DataType="int32")  % Enable to invert the channel. Warning: Use this parameter when connected to a servo only. For a brushless motor, invert manually two phases to reverse the direction.
PWM_AUX_REV3 = Simulink.Parameter(0, DataType="int32")  % Enable to invert the channel. Warning: Use this parameter when connected to a servo only. For a brushless motor, invert manually two phases to reverse the direction.
PWM_AUX_REV4 = Simulink.Parameter(0, DataType="int32")  % Enable to invert the channel. Warning: Use this parameter when connected to a servo only. For a brushless motor, invert manually two phases to reverse the direction.
PWM_AUX_REV5 = Simulink.Parameter(0, DataType="int32")  % Enable to invert the channel. Warning: Use this parameter when connected to a servo only. For a brushless motor, invert manually two phases to reverse the direction.
PWM_AUX_REV6 = Simulink.Parameter(0, DataType="int32")  % Enable to invert the channel. Warning: Use this parameter when connected to a servo only. For a brushless motor, invert manually two phases to reverse the direction.
PWM_AUX_REV7 = Simulink.Parameter(0, DataType="int32")  % Enable to invert the channel. Warning: Use this parameter when connected to a servo only. For a brushless motor, invert manually two phases to reverse the direction.
PWM_AUX_REV8 = Simulink.Parameter(0, DataType="int32")  % Enable to invert the channel. Warning: Use this parameter when connected to a servo only. For a brushless motor, invert manually two phases to reverse the direction.
PWM_AUX_TRIM1 = Simulink.Parameter(0, DataType="single", Min=-0.2, Max=0.2)  % Set to normalized offset
PWM_AUX_TRIM2 = Simulink.Parameter(0, DataType="single", Min=-0.2, Max=0.2)  % Set to normalized offset
PWM_AUX_TRIM3 = Simulink.Parameter(0, DataType="single", Min=-0.2, Max=0.2)  % Set to normalized offset
PWM_AUX_TRIM4 = Simulink.Parameter(0, DataType="single", Min=-0.2, Max=0.2)  % Set to normalized offset
PWM_AUX_TRIM5 = Simulink.Parameter(0, DataType="single", Min=-0.2, Max=0.2)  % Set to normalized offset
PWM_AUX_TRIM6 = Simulink.Parameter(0, DataType="single", Min=-0.2, Max=0.2)  % Set to normalized offset
PWM_AUX_TRIM7 = Simulink.Parameter(0, DataType="single", Min=-0.2, Max=0.2)  % Set to normalized offset
PWM_AUX_TRIM8 = Simulink.Parameter(0, DataType="single", Min=-0.2, Max=0.2)  % Set to normalized offset
PWM_EXTRA_DIS1 = Simulink.Parameter(-1, DataType="int32", Min=-1, Max=2150, Unit="us")  % This is the PWM pulse the autopilot is outputting if not armed. When set to -1 the value for PWM_EXTRA_DISARM will be used
PWM_EXTRA_DIS2 = Simulink.Parameter(-1, DataType="int32", Min=-1, Max=2150, Unit="us")  % This is the PWM pulse the autopilot is outputting if not armed. When set to -1 the value for PWM_EXTRA_DISARM will be used
PWM_EXTRA_DIS3 = Simulink.Parameter(-1, DataType="int32", Min=-1, Max=2150, Unit="us")  % This is the PWM pulse the autopilot is outputting if not armed. When set to -1 the value for PWM_EXTRA_DISARM will be used
PWM_EXTRA_DIS4 = Simulink.Parameter(-1, DataType="int32", Min=-1, Max=2150, Unit="us")  % This is the PWM pulse the autopilot is outputting if not armed. When set to -1 the value for PWM_EXTRA_DISARM will be used
PWM_EXTRA_DIS5 = Simulink.Parameter(-1, DataType="int32", Min=-1, Max=2150, Unit="us")  % This is the PWM pulse the autopilot is outputting if not armed. When set to -1 the value for PWM_EXTRA_DISARM will be used
PWM_EXTRA_DIS6 = Simulink.Parameter(-1, DataType="int32", Min=-1, Max=2150, Unit="us")  % This is the PWM pulse the autopilot is outputting if not armed. When set to -1 the value for PWM_EXTRA_DISARM will be used
PWM_EXTRA_DIS7 = Simulink.Parameter(-1, DataType="int32", Min=-1, Max=2150, Unit="us")  % This is the PWM pulse the autopilot is outputting if not armed. When set to -1 the value for PWM_EXTRA_DISARM will be used
PWM_EXTRA_DIS8 = Simulink.Parameter(-1, DataType="int32", Min=-1, Max=2150, Unit="us")  % This is the PWM pulse the autopilot is outputting if not armed. When set to -1 the value for PWM_EXTRA_DISARM will be used
PWM_EXTRA_DISARM = Simulink.Parameter(1500, DataType="int32", Min=0, Max=2200, Unit="us")  % This is the PWM pulse the autopilot is outputting if not armed. The main use of this parameter is to silence ESCs when they are disarmed.
PWM_EXTRA_FAIL1 = Simulink.Parameter(0, DataType="int32", Min=0, Max=2150, Unit="us")  % This is the PWM pulse the autopilot is outputting if in failsafe mode. When set to -1 the value is set automatically depending if the actuator is a motor (900us) or a servo (1500us)
PWM_EXTRA_FAIL2 = Simulink.Parameter(0, DataType="int32", Min=0, Max=2150, Unit="us")  % This is the PWM pulse the autopilot is outputting if in failsafe mode. When set to -1 the value is set automatically depending if the actuator is a motor (900us) or a servo (1500us)
PWM_EXTRA_FAIL3 = Simulink.Parameter(0, DataType="int32", Min=0, Max=2150, Unit="us")  % This is the PWM pulse the autopilot is outputting if in failsafe mode. When set to -1 the value is set automatically depending if the actuator is a motor (900us) or a servo (1500us)
PWM_EXTRA_FAIL4 = Simulink.Parameter(0, DataType="int32", Min=0, Max=2150, Unit="us")  % This is the PWM pulse the autopilot is outputting if in failsafe mode. When set to -1 the value is set automatically depending if the actuator is a motor (900us) or a servo (1500us)
PWM_EXTRA_FAIL5 = Simulink.Parameter(0, DataType="int32", Min=0, Max=2150, Unit="us")  % This is the PWM pulse the autopilot is outputting if in failsafe mode. When set to -1 the value is set automatically depending if the actuator is a motor (900us) or a servo (1500us)
PWM_EXTRA_FAIL6 = Simulink.Parameter(0, DataType="int32", Min=0, Max=2150, Unit="us")  % This is the PWM pulse the autopilot is outputting if in failsafe mode. When set to -1 the value is set automatically depending if the actuator is a motor (900us) or a servo (1500us)
PWM_EXTRA_FAIL7 = Simulink.Parameter(0, DataType="int32", Min=0, Max=2150, Unit="us")  % This is the PWM pulse the autopilot is outputting if in failsafe mode. When set to -1 the value is set automatically depending if the actuator is a motor (900us) or a servo (1500us)
PWM_EXTRA_FAIL8 = Simulink.Parameter(0, DataType="int32", Min=0, Max=2150, Unit="us")  % This is the PWM pulse the autopilot is outputting if in failsafe mode. When set to -1 the value is set automatically depending if the actuator is a motor (900us) or a servo (1500us)
PWM_EXTRA_MAX = Simulink.Parameter(2000, DataType="int32", Min=1600, Max=2200, Unit="us")  % Set to 2000 for industry default or 2100 to increase servo travel.
PWM_EXTRA_MAX1 = Simulink.Parameter(-1, DataType="int32", Min=-1, Max=2150, Unit="us")  % This is the maximum PWM pulse the autopilot is allowed to output. When set to -1 the value for PWM_EXTRA_MAX will be used
PWM_EXTRA_MAX2 = Simulink.Parameter(-1, DataType="int32", Min=-1, Max=2150, Unit="us")  % This is the maximum PWM pulse the autopilot is allowed to output. When set to -1 the value for PWM_EXTRA_MAX will be used
PWM_EXTRA_MAX3 = Simulink.Parameter(-1, DataType="int32", Min=-1, Max=2150, Unit="us")  % This is the maximum PWM pulse the autopilot is allowed to output. When set to -1 the value for PWM_EXTRA_MAX will be used
PWM_EXTRA_MAX4 = Simulink.Parameter(-1, DataType="int32", Min=-1, Max=2150, Unit="us")  % This is the maximum PWM pulse the autopilot is allowed to output. When set to -1 the value for PWM_EXTRA_MAX will be used
PWM_EXTRA_MAX5 = Simulink.Parameter(-1, DataType="int32", Min=-1, Max=2150, Unit="us")  % This is the maximum PWM pulse the autopilot is allowed to output. When set to -1 the value for PWM_EXTRA_MAX will be used
PWM_EXTRA_MAX6 = Simulink.Parameter(-1, DataType="int32", Min=-1, Max=2150, Unit="us")  % This is the maximum PWM pulse the autopilot is allowed to output. When set to -1 the value for PWM_EXTRA_MAX will be used
PWM_EXTRA_MAX7 = Simulink.Parameter(-1, DataType="int32", Min=-1, Max=2150, Unit="us")  % This is the maximum PWM pulse the autopilot is allowed to output. When set to -1 the value for PWM_EXTRA_MAX will be used
PWM_EXTRA_MAX8 = Simulink.Parameter(-1, DataType="int32", Min=-1, Max=2150, Unit="us")  % This is the maximum PWM pulse the autopilot is allowed to output. When set to -1 the value for PWM_EXTRA_MAX will be used
PWM_EXTRA_MIN = Simulink.Parameter(1000, DataType="int32", Min=800, Max=1400, Unit="us")  % Set to 1000 for industry default or 900 to increase servo travel.
PWM_EXTRA_MIN1 = Simulink.Parameter(-1, DataType="int32", Min=-1, Max=1600, Unit="us")  % This is the minimum PWM pulse the autopilot is allowed to output. When set to -1 the value for PWM_EXTRA_MIN will be used
PWM_EXTRA_MIN2 = Simulink.Parameter(-1, DataType="int32", Min=-1, Max=1600, Unit="us")  % This is the minimum PWM pulse the autopilot is allowed to output. When set to -1 the value for PWM_EXTRA_MIN will be used
PWM_EXTRA_MIN3 = Simulink.Parameter(-1, DataType="int32", Min=-1, Max=1600, Unit="us")  % This is the minimum PWM pulse the autopilot is allowed to output. When set to -1 the value for PWM_EXTRA_MIN will be used
PWM_EXTRA_MIN4 = Simulink.Parameter(-1, DataType="int32", Min=-1, Max=1600, Unit="us")  % This is the minimum PWM pulse the autopilot is allowed to output. When set to -1 the value for PWM_EXTRA_MIN will be used
PWM_EXTRA_MIN5 = Simulink.Parameter(-1, DataType="int32", Min=-1, Max=1600, Unit="us")  % This is the minimum PWM pulse the autopilot is allowed to output. When set to -1 the value for PWM_EXTRA_MIN will be used
PWM_EXTRA_MIN6 = Simulink.Parameter(-1, DataType="int32", Min=-1, Max=1600, Unit="us")  % This is the minimum PWM pulse the autopilot is allowed to output. When set to -1 the value for PWM_EXTRA_MIN will be used
PWM_EXTRA_MIN7 = Simulink.Parameter(-1, DataType="int32", Min=-1, Max=1600, Unit="us")  % This is the minimum PWM pulse the autopilot is allowed to output. When set to -1 the value for PWM_EXTRA_MIN will be used
PWM_EXTRA_MIN8 = Simulink.Parameter(-1, DataType="int32", Min=-1, Max=1600, Unit="us")  % This is the minimum PWM pulse the autopilot is allowed to output. When set to -1 the value for PWM_EXTRA_MIN will be used
PWM_EXTRA_RATE = Simulink.Parameter(50, DataType="int32", Min=-1, Max=2000, Unit="Hz")  % Set to 400 for industry default or 1000 for high frequency ESCs. Set to 0 for Oneshot125.
PWM_EXTRA_RATE1 = Simulink.Parameter(50, DataType="int32", Min=0, Max=400, Unit="Hz")  % Set the default PWM output frequency for the main outputs
PWM_EXTRA_REV1 = Simulink.Parameter(0, DataType="int32")  % Enable to invert the channel. Warning: Use this parameter when connected to a servo only. For a brushless motor, invert manually two phases to reverse the direction.
PWM_EXTRA_REV2 = Simulink.Parameter(0, DataType="int32")  % Enable to invert the channel. Warning: Use this parameter when connected to a servo only. For a brushless motor, invert manually two phases to reverse the direction.
PWM_EXTRA_REV3 = Simulink.Parameter(0, DataType="int32")  % Enable to invert the channel. Warning: Use this parameter when connected to a servo only. For a brushless motor, invert manually two phases to reverse the direction.
PWM_EXTRA_REV4 = Simulink.Parameter(0, DataType="int32")  % Enable to invert the channel. Warning: Use this parameter when connected to a servo only. For a brushless motor, invert manually two phases to reverse the direction.
PWM_EXTRA_REV5 = Simulink.Parameter(0, DataType="int32")  % Enable to invert the channel. Warning: Use this parameter when connected to a servo only. For a brushless motor, invert manually two phases to reverse the direction.
PWM_EXTRA_REV6 = Simulink.Parameter(0, DataType="int32")  % Enable to invert the channel. Warning: Use this parameter when connected to a servo only. For a brushless motor, invert manually two phases to reverse the direction.
PWM_EXTRA_REV7 = Simulink.Parameter(0, DataType="int32")  % Enable to invert the channel. Warning: Use this parameter when connected to a servo only. For a brushless motor, invert manually two phases to reverse the direction.
PWM_EXTRA_REV8 = Simulink.Parameter(0, DataType="int32")  % Enable to invert the channel. Warning: Use this parameter when connected to a servo only. For a brushless motor, invert manually two phases to reverse the direction.
PWM_EXTRA_TRIM1 = Simulink.Parameter(0, DataType="single", Min=-0.2, Max=0.2)  % Set to normalized offset
PWM_EXTRA_TRIM2 = Simulink.Parameter(0, DataType="single", Min=-0.2, Max=0.2)  % Set to normalized offset
PWM_EXTRA_TRIM3 = Simulink.Parameter(0, DataType="single", Min=-0.2, Max=0.2)  % Set to normalized offset
PWM_EXTRA_TRIM4 = Simulink.Parameter(0, DataType="single", Min=-0.2, Max=0.2)  % Set to normalized offset
PWM_EXTRA_TRIM5 = Simulink.Parameter(0, DataType="single", Min=-0.2, Max=0.2)  % Set to normalized offset
PWM_EXTRA_TRIM6 = Simulink.Parameter(0, DataType="single", Min=-0.2, Max=0.2)  % Set to normalized offset
PWM_EXTRA_TRIM7 = Simulink.Parameter(0, DataType="single", Min=-0.2, Max=0.2)  % Set to normalized offset
PWM_EXTRA_TRIM8 = Simulink.Parameter(0, DataType="single", Min=-0.2, Max=0.2)  % Set to normalized offset
PWM_MAIN_DIS1 = Simulink.Parameter(-1, DataType="int32", Min=-1, Max=2150, Unit="us")  % This is the PWM pulse the autopilot is outputting if not armed. When set to -1 the value for PWM_MAIN_DISARM will be used
PWM_MAIN_DIS10 = Simulink.Parameter(-1, DataType="int32", Min=-1, Max=2150, Unit="us")  % This is the PWM pulse the autopilot is outputting if not armed. When set to -1 the value for PWM_MAIN_DISARM will be used
PWM_MAIN_DIS11 = Simulink.Parameter(-1, DataType="int32", Min=-1, Max=2150, Unit="us")  % This is the PWM pulse the autopilot is outputting if not armed. When set to -1 the value for PWM_MAIN_DISARM will be used
PWM_MAIN_DIS12 = Simulink.Parameter(-1, DataType="int32", Min=-1, Max=2150, Unit="us")  % This is the PWM pulse the autopilot is outputting if not armed. When set to -1 the value for PWM_MAIN_DISARM will be used
PWM_MAIN_DIS13 = Simulink.Parameter(-1, DataType="int32", Min=-1, Max=2150, Unit="us")  % This is the PWM pulse the autopilot is outputting if not armed. When set to -1 the value for PWM_MAIN_DISARM will be used
PWM_MAIN_DIS14 = Simulink.Parameter(-1, DataType="int32", Min=-1, Max=2150, Unit="us")  % This is the PWM pulse the autopilot is outputting if not armed. When set to -1 the value for PWM_MAIN_DISARM will be used
PWM_MAIN_DIS2 = Simulink.Parameter(-1, DataType="int32", Min=-1, Max=2150, Unit="us")  % This is the PWM pulse the autopilot is outputting if not armed. When set to -1 the value for PWM_MAIN_DISARM will be used
PWM_MAIN_DIS3 = Simulink.Parameter(-1, DataType="int32", Min=-1, Max=2150, Unit="us")  % This is the PWM pulse the autopilot is outputting if not armed. When set to -1 the value for PWM_MAIN_DISARM will be used
PWM_MAIN_DIS4 = Simulink.Parameter(-1, DataType="int32", Min=-1, Max=2150, Unit="us")  % This is the PWM pulse the autopilot is outputting if not armed. When set to -1 the value for PWM_MAIN_DISARM will be used
PWM_MAIN_DIS5 = Simulink.Parameter(-1, DataType="int32", Min=-1, Max=2150, Unit="us")  % This is the PWM pulse the autopilot is outputting if not armed. When set to -1 the value for PWM_MAIN_DISARM will be used
PWM_MAIN_DIS6 = Simulink.Parameter(-1, DataType="int32", Min=-1, Max=2150, Unit="us")  % This is the PWM pulse the autopilot is outputting if not armed. When set to -1 the value for PWM_MAIN_DISARM will be used
PWM_MAIN_DIS7 = Simulink.Parameter(-1, DataType="int32", Min=-1, Max=2150, Unit="us")  % This is the PWM pulse the autopilot is outputting if not armed. When set to -1 the value for PWM_MAIN_DISARM will be used
PWM_MAIN_DIS8 = Simulink.Parameter(-1, DataType="int32", Min=-1, Max=2150, Unit="us")  % This is the PWM pulse the autopilot is outputting if not armed. When set to -1 the value for PWM_MAIN_DISARM will be used
PWM_MAIN_DIS9 = Simulink.Parameter(-1, DataType="int32", Min=-1, Max=2150, Unit="us")  % This is the PWM pulse the autopilot is outputting if not armed. When set to -1 the value for PWM_MAIN_DISARM will be used
PWM_MAIN_DISARM = Simulink.Parameter(900, DataType="int32", Min=0, Max=2200, Unit="us")  % This is the PWM pulse the autopilot is outputting if not armed. The main use of this parameter is to silence ESCs when they are disarmed.
PWM_MAIN_FAIL1 = Simulink.Parameter(-1, DataType="int32", Min=-1, Max=2150, Unit="us")  % This is the PWM pulse the autopilot is outputting if in failsafe mode. When set to -1 the value is set automatically depending if the actuator is a motor (900us) or a servo (1500us)
PWM_MAIN_FAIL10 = Simulink.Parameter(-1, DataType="int32", Min=-1, Max=2150, Unit="us")  % This is the PWM pulse the autopilot is outputting if in failsafe mode. When set to -1 the value is set automatically depending if the actuator is a motor (900us) or a servo (1500us)
PWM_MAIN_FAIL11 = Simulink.Parameter(-1, DataType="int32", Min=-1, Max=2150, Unit="us")  % This is the PWM pulse the autopilot is outputting if in failsafe mode. When set to -1 the value is set automatically depending if the actuator is a motor (900us) or a servo (1500us)
PWM_MAIN_FAIL12 = Simulink.Parameter(-1, DataType="int32", Min=-1, Max=2150, Unit="us")  % This is the PWM pulse the autopilot is outputting if in failsafe mode. When set to -1 the value is set automatically depending if the actuator is a motor (900us) or a servo (1500us)
PWM_MAIN_FAIL13 = Simulink.Parameter(-1, DataType="int32", Min=-1, Max=2150, Unit="us")  % This is the PWM pulse the autopilot is outputting if in failsafe mode. When set to -1 the value is set automatically depending if the actuator is a motor (900us) or a servo (1500us)
PWM_MAIN_FAIL14 = Simulink.Parameter(-1, DataType="int32", Min=-1, Max=2150, Unit="us")  % This is the PWM pulse the autopilot is outputting if in failsafe mode. When set to -1 the value is set automatically depending if the actuator is a motor (900us) or a servo (1500us)
PWM_MAIN_FAIL2 = Simulink.Parameter(-1, DataType="int32", Min=-1, Max=2150, Unit="us")  % This is the PWM pulse the autopilot is outputting if in failsafe mode. When set to -1 the value is set automatically depending if the actuator is a motor (900us) or a servo (1500us)
PWM_MAIN_FAIL3 = Simulink.Parameter(-1, DataType="int32", Min=-1, Max=2150, Unit="us")  % This is the PWM pulse the autopilot is outputting if in failsafe mode. When set to -1 the value is set automatically depending if the actuator is a motor (900us) or a servo (1500us)
PWM_MAIN_FAIL4 = Simulink.Parameter(-1, DataType="int32", Min=-1, Max=2150, Unit="us")  % This is the PWM pulse the autopilot is outputting if in failsafe mode. When set to -1 the value is set automatically depending if the actuator is a motor (900us) or a servo (1500us)
PWM_MAIN_FAIL5 = Simulink.Parameter(-1, DataType="int32", Min=-1, Max=2150, Unit="us")  % This is the PWM pulse the autopilot is outputting if in failsafe mode. When set to -1 the value is set automatically depending if the actuator is a motor (900us) or a servo (1500us)
PWM_MAIN_FAIL6 = Simulink.Parameter(-1, DataType="int32", Min=-1, Max=2150, Unit="us")  % This is the PWM pulse the autopilot is outputting if in failsafe mode. When set to -1 the value is set automatically depending if the actuator is a motor (900us) or a servo (1500us)
PWM_MAIN_FAIL7 = Simulink.Parameter(-1, DataType="int32", Min=-1, Max=2150, Unit="us")  % This is the PWM pulse the autopilot is outputting if in failsafe mode. When set to -1 the value is set automatically depending if the actuator is a motor (900us) or a servo (1500us)
PWM_MAIN_FAIL8 = Simulink.Parameter(-1, DataType="int32", Min=-1, Max=2150, Unit="us")  % This is the PWM pulse the autopilot is outputting if in failsafe mode. When set to -1 the value is set automatically depending if the actuator is a motor (900us) or a servo (1500us)
PWM_MAIN_FAIL9 = Simulink.Parameter(-1, DataType="int32", Min=-1, Max=2150, Unit="us")  % This is the PWM pulse the autopilot is outputting if in failsafe mode. When set to -1 the value is set automatically depending if the actuator is a motor (900us) or a servo (1500us)
PWM_MAIN_MAX = Simulink.Parameter(2000, DataType="int32", Min=1600, Max=2200, Unit="us")  % Set to 2000 for industry default or 2100 to increase servo travel.
PWM_MAIN_MAX1 = Simulink.Parameter(-1, DataType="int32", Min=-1, Max=2150, Unit="us")  % This is the maximum PWM pulse the autopilot is allowed to output. When set to -1 the value for PWM_MAIN_MAX will be used
PWM_MAIN_MAX10 = Simulink.Parameter(-1, DataType="int32", Min=-1, Max=2150, Unit="us")  % This is the maximum PWM pulse the autopilot is allowed to output. When set to -1 the value for PWM_MAIN_MAX will be used
PWM_MAIN_MAX11 = Simulink.Parameter(-1, DataType="int32", Min=-1, Max=2150, Unit="us")  % This is the maximum PWM pulse the autopilot is allowed to output. When set to -1 the value for PWM_MAIN_MAX will be used
PWM_MAIN_MAX12 = Simulink.Parameter(-1, DataType="int32", Min=-1, Max=2150, Unit="us")  % This is the maximum PWM pulse the autopilot is allowed to output. When set to -1 the value for PWM_MAIN_MAX will be used
PWM_MAIN_MAX13 = Simulink.Parameter(-1, DataType="int32", Min=-1, Max=2150, Unit="us")  % This is the maximum PWM pulse the autopilot is allowed to output. When set to -1 the value for PWM_MAIN_MAX will be used
PWM_MAIN_MAX14 = Simulink.Parameter(-1, DataType="int32", Min=-1, Max=2150, Unit="us")  % This is the maximum PWM pulse the autopilot is allowed to output. When set to -1 the value for PWM_MAIN_MAX will be used
PWM_MAIN_MAX2 = Simulink.Parameter(-1, DataType="int32", Min=-1, Max=2150, Unit="us")  % This is the maximum PWM pulse the autopilot is allowed to output. When set to -1 the value for PWM_MAIN_MAX will be used
PWM_MAIN_MAX3 = Simulink.Parameter(-1, DataType="int32", Min=-1, Max=2150, Unit="us")  % This is the maximum PWM pulse the autopilot is allowed to output. When set to -1 the value for PWM_MAIN_MAX will be used
PWM_MAIN_MAX4 = Simulink.Parameter(-1, DataType="int32", Min=-1, Max=2150, Unit="us")  % This is the maximum PWM pulse the autopilot is allowed to output. When set to -1 the value for PWM_MAIN_MAX will be used
PWM_MAIN_MAX5 = Simulink.Parameter(-1, DataType="int32", Min=-1, Max=2150, Unit="us")  % This is the maximum PWM pulse the autopilot is allowed to output. When set to -1 the value for PWM_MAIN_MAX will be used
PWM_MAIN_MAX6 = Simulink.Parameter(-1, DataType="int32", Min=-1, Max=2150, Unit="us")  % This is the maximum PWM pulse the autopilot is allowed to output. When set to -1 the value for PWM_MAIN_MAX will be used
PWM_MAIN_MAX7 = Simulink.Parameter(-1, DataType="int32", Min=-1, Max=2150, Unit="us")  % This is the maximum PWM pulse the autopilot is allowed to output. When set to -1 the value for PWM_MAIN_MAX will be used
PWM_MAIN_MAX8 = Simulink.Parameter(-1, DataType="int32", Min=-1, Max=2150, Unit="us")  % This is the maximum PWM pulse the autopilot is allowed to output. When set to -1 the value for PWM_MAIN_MAX will be used
PWM_MAIN_MAX9 = Simulink.Parameter(-1, DataType="int32", Min=-1, Max=2150, Unit="us")  % This is the maximum PWM pulse the autopilot is allowed to output. When set to -1 the value for PWM_MAIN_MAX will be used
PWM_MAIN_MIN = Simulink.Parameter(1000, DataType="int32", Min=800, Max=1400, Unit="us")  % Set to 1000 for industry default or 900 to increase servo travel.
PWM_MAIN_MIN1 = Simulink.Parameter(-1, DataType="int32", Min=-1, Max=1600, Unit="us")  % This is the minimum PWM pulse the autopilot is allowed to output. When set to -1 the value for PWM_MAIN_MIN will be used
PWM_MAIN_MIN10 = Simulink.Parameter(-1, DataType="int32", Min=-1, Max=1600, Unit="us")  % This is the minimum PWM pulse the autopilot is allowed to output. When set to -1 the value for PWM_MAIN_MIN will be used
PWM_MAIN_MIN11 = Simulink.Parameter(-1, DataType="int32", Min=-1, Max=1600, Unit="us")  % This is the minimum PWM pulse the autopilot is allowed to output. When set to -1 the value for PWM_MAIN_MIN will be used
PWM_MAIN_MIN12 = Simulink.Parameter(-1, DataType="int32", Min=-1, Max=1600, Unit="us")  % This is the minimum PWM pulse the autopilot is allowed to output. When set to -1 the value for PWM_MAIN_MIN will be used
PWM_MAIN_MIN13 = Simulink.Parameter(-1, DataType="int32", Min=-1, Max=1600, Unit="us")  % This is the minimum PWM pulse the autopilot is allowed to output. When set to -1 the value for PWM_MAIN_MIN will be used
PWM_MAIN_MIN14 = Simulink.Parameter(-1, DataType="int32", Min=-1, Max=1600, Unit="us")  % This is the minimum PWM pulse the autopilot is allowed to output. When set to -1 the value for PWM_MAIN_MIN will be used
PWM_MAIN_MIN2 = Simulink.Parameter(-1, DataType="int32", Min=-1, Max=1600, Unit="us")  % This is the minimum PWM pulse the autopilot is allowed to output. When set to -1 the value for PWM_MAIN_MIN will be used
PWM_MAIN_MIN3 = Simulink.Parameter(-1, DataType="int32", Min=-1, Max=1600, Unit="us")  % This is the minimum PWM pulse the autopilot is allowed to output. When set to -1 the value for PWM_MAIN_MIN will be used
PWM_MAIN_MIN4 = Simulink.Parameter(-1, DataType="int32", Min=-1, Max=1600, Unit="us")  % This is the minimum PWM pulse the autopilot is allowed to output. When set to -1 the value for PWM_MAIN_MIN will be used
PWM_MAIN_MIN5 = Simulink.Parameter(-1, DataType="int32", Min=-1, Max=1600, Unit="us")  % This is the minimum PWM pulse the autopilot is allowed to output. When set to -1 the value for PWM_MAIN_MIN will be used
PWM_MAIN_MIN6 = Simulink.Parameter(-1, DataType="int32", Min=-1, Max=1600, Unit="us")  % This is the minimum PWM pulse the autopilot is allowed to output. When set to -1 the value for PWM_MAIN_MIN will be used
PWM_MAIN_MIN7 = Simulink.Parameter(-1, DataType="int32", Min=-1, Max=1600, Unit="us")  % This is the minimum PWM pulse the autopilot is allowed to output. When set to -1 the value for PWM_MAIN_MIN will be used
PWM_MAIN_MIN8 = Simulink.Parameter(-1, DataType="int32", Min=-1, Max=1600, Unit="us")  % This is the minimum PWM pulse the autopilot is allowed to output. When set to -1 the value for PWM_MAIN_MIN will be used

PWM_MAIN_MIN9 = Simulink.Parameter(-1, DataType="int32", Min=-1, Max=1600, Unit="us")  % This is the minimum PWM pulse the autopilot is allowed to output. When set to -1 the value for PWM_MAIN_MIN will be used
PWM_MAIN_OUT = Simulink.Parameter(0, DataType="int32", Min=0, Max=123456789)  % Number representing the channels e.g. 134 - Channel 1, 3 and 4. Global e.g. PWM_MAIN_MIN/MAX/DISARM limits only apply to these channels.
PWM_MAIN_RATE = Simulink.Parameter(400, DataType="int32", Min=-1, Max=2000, Unit="Hz")  % Set to 400 for industry default or 1000 for high frequency ESCs. Set to 0 for Oneshot125.
PWM_MAIN_RATE1 = Simulink.Parameter(50, DataType="int32", Min=0, Max=400, Unit="Hz")  % Set the default PWM output frequency for the main outputs
PWM_MAIN_REV1 = Simulink.Parameter(0, DataType="int32")  % Enable to invert the channel. Warning: Use this parameter when connected to a servo only. For a brushless motor, invert manually two phases to reverse the direction.
PWM_MAIN_REV10 = Simulink.Parameter(0, DataType="int32")  % Enable to invert the channel. Warning: Use this parameter when connected to a servo only. For a brushless motor, invert manually two phases to reverse the direction.
PWM_MAIN_REV11 = Simulink.Parameter(0, DataType="int32")  % Enable to invert the channel. Warning: Use this parameter when connected to a servo only. For a brushless motor, invert manually two phases to reverse the direction.
PWM_MAIN_REV12 = Simulink.Parameter(0, DataType="int32")  % Enable to invert the channel. Warning: Use this parameter when connected to a servo only. For a brushless motor, invert manually two phases to reverse the direction.
PWM_MAIN_REV13 = Simulink.Parameter(0, DataType="int32")  % Enable to invert the channel. Warning: Use this parameter when connected to a servo only. For a brushless motor, invert manually two phases to reverse the direction.
PWM_MAIN_REV14 = Simulink.Parameter(0, DataType="int32")  % Enable to invert the channel. Warning: Use this parameter when connected to a servo only. For a brushless motor, invert manually two phases to reverse the direction.
PWM_MAIN_REV2 = Simulink.Parameter(0, DataType="int32")  % Enable to invert the channel. Warning: Use this parameter when connected to a servo only. For a brushless motor, invert manually two phases to reverse the direction.
PWM_MAIN_REV3 = Simulink.Parameter(0, DataType="int32")  % Enable to invert the channel. Warning: Use this parameter when connected to a servo only. For a brushless motor, invert manually two phases to reverse the direction.
PWM_MAIN_REV4 = Simulink.Parameter(0, DataType="int32")  % Enable to invert the channel. Warning: Use this parameter when connected to a servo only. For a brushless motor, invert manually two phases to reverse the direction.
PWM_MAIN_REV5 = Simulink.Parameter(0, DataType="int32")  % Enable to invert the channel. Warning: Use this parameter when connected to a servo only. For a brushless motor, invert manually two phases to reverse the direction.
PWM_MAIN_REV6 = Simulink.Parameter(0, DataType="int32")  % Enable to invert the channel. Warning: Use this parameter when connected to a servo only. For a brushless motor, invert manually two phases to reverse the direction.
PWM_MAIN_REV7 = Simulink.Parameter(0, DataType="int32")  % Enable to invert the channel. Warning: Use this parameter when connected to a servo only. For a brushless motor, invert manually two phases to reverse the direction.
PWM_MAIN_REV8 = Simulink.Parameter(0, DataType="int32")  % Enable to invert the channel. Warning: Use this parameter when connected to a servo only. For a brushless motor, invert manually two phases to reverse the direction.
PWM_MAIN_REV9 = Simulink.Parameter(0, DataType="int32")  % Enable to invert the channel. Warning: Use this parameter when connected to a servo only. For a brushless motor, invert manually two phases to reverse the direction.
PWM_MAIN_TRIM1 = Simulink.Parameter(0, DataType="single", Min=-0.2, Max=0.2)  % Set to normalized offset
PWM_MAIN_TRIM10 = Simulink.Parameter(0, DataType="single", Min=-0.2, Max=0.2)  % Set to normalized offset
PWM_MAIN_TRIM11 = Simulink.Parameter(0, DataType="single", Min=-0.2, Max=0.2)  % Set to normalized offset
PWM_MAIN_TRIM12 = Simulink.Parameter(0, DataType="single", Min=-0.2, Max=0.2)  % Set to normalized offset
PWM_MAIN_TRIM13 = Simulink.Parameter(0, DataType="single", Min=-0.2, Max=0.2)  % Set to normalized offset
PWM_MAIN_TRIM14 = Simulink.Parameter(0, DataType="single", Min=-0.2, Max=0.2)  % Set to normalized offset
PWM_MAIN_TRIM2 = Simulink.Parameter(0, DataType="single", Min=-0.2, Max=0.2)  % Set to normalized offset
PWM_MAIN_TRIM3 = Simulink.Parameter(0, DataType="single", Min=-0.2, Max=0.2)  % Set to normalized offset
PWM_MAIN_TRIM4 = Simulink.Parameter(0, DataType="single", Min=-0.2, Max=0.2)  % Set to normalized offset
PWM_MAIN_TRIM5 = Simulink.Parameter(0, DataType="single", Min=-0.2, Max=0.2)  % Set to normalized offset
PWM_MAIN_TRIM6 = Simulink.Parameter(0, DataType="single", Min=-0.2, Max=0.2)  % Set to normalized offset
PWM_MAIN_TRIM7 = Simulink.Parameter(0, DataType="single", Min=-0.2, Max=0.2)  % Set to normalized offset
PWM_MAIN_TRIM8 = Simulink.Parameter(0, DataType="single", Min=-0.2, Max=0.2)  % Set to normalized offset
PWM_MAIN_TRIM9 = Simulink.Parameter(0, DataType="single", Min=-0.2, Max=0.2)  % Set to normalized offset
PWM_SBUS_MODE = Simulink.Parameter(0, DataType="int32")  % Set to 1 to enable S.BUS version 1 output instead of RSSI.
THR_MDL_FAC = Simulink.Parameter(0, DataType="single", Min=0, Max=1)  % Parameter used to model the nonlinear relationship between motor control signal (e.g. PWM) and static thrust. The model is: rel_thrust = factor * rel_signal^2 + (1-factor) * rel_signal, where rel_thrust is the normalized thrust between 0 and 1, and rel_signal is the relative motor control signal between 0 and 1.
PLD_BTOUT = Simulink.Parameter(5, DataType="single", Min=0, Max=50, Unit="s")  % Time after which the landing target is considered lost without any new measurements.
PLD_FAPPR_ALT = Simulink.Parameter(0.1, DataType="single", Min=0, Max=10, Unit="m")  % Allow final approach (without horizontal positioning) if losing landing target closer than this to the ground.
PLD_HACC_RAD = Simulink.Parameter(0.2, DataType="single", Min=0, Max=10, Unit="m")  % Start descending if closer above landing target than this.
PLD_MAX_SRCH = Simulink.Parameter(3, DataType="int32", Min=0, Max=100)  % Maximum number of times to search for the landing target if it is lost during the precision landing.
PLD_SRCH_ALT = Simulink.Parameter(10, DataType="single", Min=0, Max=100, Unit="m")  % Altitude above home to which to climb when searching for the landing target.
PLD_SRCH_TOUT = Simulink.Parameter(10, DataType="single", Min=0, Max=100, Unit="s")  % Time allowed to search for the landing target before falling back to normal landing.
RC10_DZ = Simulink.Parameter(0, DataType="single", Min=0, Max=100)  % The +- range of this value around the trim value will be considered as zero.
RC10_MAX = Simulink.Parameter(2000, DataType="single", Min=1500, Max=2200, Unit="us")  % Maximum value for this channel.
RC10_MIN = Simulink.Parameter(1000, DataType="single", Min=800, Max=1500, Unit="us")  % Minimum value for this channel.
RC10_REV = Simulink.Parameter(1, DataType="single", Min=-1, Max=1)  % Set to -1 to reverse channel.
RC10_TRIM = Simulink.Parameter(1500, DataType="single", Min=800, Max=2200, Unit="us")  % Mid point value (has to be set to the same as min for throttle channel).
RC11_DZ = Simulink.Parameter(0, DataType="single", Min=0, Max=100)  % The +- range of this value around the trim value will be considered as zero.
RC11_MAX = Simulink.Parameter(2000, DataType="single", Min=1500, Max=2200, Unit="us")  % Maximum value for this channel.
RC11_MIN = Simulink.Parameter(1000, DataType="single", Min=800, Max=1500, Unit="us")  % Minimum value for this channel.
RC11_REV = Simulink.Parameter(1, DataType="single", Min=-1, Max=1)  % Set to -1 to reverse channel.
RC11_TRIM = Simulink.Parameter(1500, DataType="single", Min=800, Max=2200, Unit="us")  % Mid point value (has to be set to the same as min for throttle channel).
RC12_DZ = Simulink.Parameter(0, DataType="single", Min=0, Max=100)  % The +- range of this value around the trim value will be considered as zero.
RC12_MAX = Simulink.Parameter(2000, DataType="single", Min=1500, Max=2200, Unit="us")  % Maximum value for this channel.
RC12_MIN = Simulink.Parameter(1000, DataType="single", Min=800, Max=1500, Unit="us")  % Minimum value for this channel.
RC12_REV = Simulink.Parameter(1, DataType="single", Min=-1, Max=1)  % Set to -1 to reverse channel.
RC12_TRIM = Simulink.Parameter(1500, DataType="single", Min=800, Max=2200, Unit="us")  % Mid point value (has to be set to the same as min for throttle channel).
RC13_DZ = Simulink.Parameter(0, DataType="single", Min=0, Max=100)  % The +- range of this value around the trim value will be considered as zero.
RC13_MAX = Simulink.Parameter(2000, DataType="single", Min=1500, Max=2200, Unit="us")  % Maximum value for this channel.
RC13_MIN = Simulink.Parameter(1000, DataType="single", Min=800, Max=1500, Unit="us")  % Minimum value for this channel.
RC13_REV = Simulink.Parameter(1, DataType="single", Min=-1, Max=1)  % Set to -1 to reverse channel.
RC13_TRIM = Simulink.Parameter(1500, DataType="single", Min=800, Max=2200, Unit="us")  % Mid point value (has to be set to the same as min for throttle channel).
RC14_DZ = Simulink.Parameter(0, DataType="single", Min=0, Max=100)  % The +- range of this value around the trim value will be considered as zero.
RC14_MAX = Simulink.Parameter(2000, DataType="single", Min=1500, Max=2200, Unit="us")  % Maximum value for this channel.
RC14_MIN = Simulink.Parameter(1000, DataType="single", Min=800, Max=1500, Unit="us")  % Minimum value for this channel.
RC14_REV = Simulink.Parameter(1, DataType="single", Min=-1, Max=1)  % Set to -1 to reverse channel.
RC14_TRIM = Simulink.Parameter(1500, DataType="single", Min=800, Max=2200, Unit="us")  % Mid point value (has to be set to the same as min for throttle channel).
RC15_DZ = Simulink.Parameter(0, DataType="single", Min=0, Max=100)  % The +- range of this value around the trim value will be considered as zero.
RC15_MAX = Simulink.Parameter(2000, DataType="single", Min=1500, Max=2200, Unit="us")  % Maximum value for this channel.
RC15_MIN = Simulink.Parameter(1000, DataType="single", Min=800, Max=1500, Unit="us")  % Minimum value for this channel.
RC15_REV = Simulink.Parameter(1, DataType="single", Min=-1, Max=1)  % Set to -1 to reverse channel.
RC15_TRIM = Simulink.Parameter(1500, DataType="single", Min=800, Max=2200, Unit="us")  % Mid point value (has to be set to the same as min for throttle channel).
RC16_DZ = Simulink.Parameter(0, DataType="single", Min=0, Max=100)  % The +- range of this value around the trim value will be considered as zero.
RC16_MAX = Simulink.Parameter(2000, DataType="single", Min=1500, Max=2200, Unit="us")  % Maximum value for this channel.
RC16_MIN = Simulink.Parameter(1000, DataType="single", Min=800, Max=1500, Unit="us")  % Minimum value for this channel.
RC16_REV = Simulink.Parameter(1, DataType="single", Min=-1, Max=1)  % Set to -1 to reverse channel.
RC16_TRIM = Simulink.Parameter(1500, DataType="single", Min=800, Max=2200, Unit="us")  % Mid point value (has to be set to the same as min for throttle channel).
RC17_DZ = Simulink.Parameter(0, DataType="single", Min=0, Max=100)  % The +- range of this value around the trim value will be considered as zero.
RC17_MAX = Simulink.Parameter(2000, DataType="single", Min=1500, Max=2200, Unit="us")  % Maximum value for this channel.
RC17_MIN = Simulink.Parameter(1000, DataType="single", Min=800, Max=1500, Unit="us")  % Minimum value for this channel.
RC17_REV = Simulink.Parameter(1, DataType="single", Min=-1, Max=1)  % Set to -1 to reverse channel.
RC17_TRIM = Simulink.Parameter(1500, DataType="single", Min=800, Max=2200, Unit="us")  % Mid point value (has to be set to the same as min for throttle channel).
RC18_DZ = Simulink.Parameter(0, DataType="single", Min=0, Max=100)  % The +- range of this value around the trim value will be considered as zero.
RC18_MAX = Simulink.Parameter(2000, DataType="single", Min=1500, Max=2200, Unit="us")  % Maximum value for this channel.
RC18_MIN = Simulink.Parameter(1000, DataType="single", Min=800, Max=1500, Unit="us")  % Minimum value for this channel.
RC18_REV = Simulink.Parameter(1, DataType="single", Min=-1, Max=1)  % Set to -1 to reverse channel.
RC18_TRIM = Simulink.Parameter(1500, DataType="single", Min=800, Max=2200, Unit="us")  % Mid point value (has to be set to the same as min for throttle channel).
RC1_DZ = Simulink.Parameter(10, DataType="single", Min=0, Max=100, Unit="us")  % The +- range of this value around the trim value will be considered as zero.
RC1_MAX = Simulink.Parameter(2000, DataType="single", Min=1500, Max=2200, Unit="us")  % Maximum value for RC channel 1
RC1_MIN = Simulink.Parameter(1000, DataType="single", Min=800, Max=1500, Unit="us")  % Minimum value for RC channel 1
RC1_REV = Simulink.Parameter(1, DataType="single", Min=-1, Max=1)  % Set to -1 to reverse channel.
RC1_TRIM = Simulink.Parameter(1500, DataType="single", Min=800, Max=2200, Unit="us")  % Mid point value (same as min for throttle)
RC2_DZ = Simulink.Parameter(10, DataType="single", Min=0, Max=100, Unit="us")  % The +- range of this value around the trim value will be considered as zero.
RC2_MAX = Simulink.Parameter(2000, DataType="single", Min=1500, Max=2200, Unit="us")  % Maximum value for this channel.
RC2_MIN = Simulink.Parameter(1000, DataType="single", Min=800, Max=1500, Unit="us")  % Minimum value for this channel.
RC2_REV = Simulink.Parameter(1, DataType="single", Min=-1, Max=1)  % Set to -1 to reverse channel.
RC2_TRIM = Simulink.Parameter(1500, DataType="single", Min=800, Max=2200, Unit="us")  % Mid point value (has to be set to the same as min for throttle channel).
RC3_DZ = Simulink.Parameter(10, DataType="single", Min=0, Max=100, Unit="us")  % The +- range of this value around the trim value will be considered as zero.
RC3_MAX = Simulink.Parameter(2000, DataType="single", Min=1500, Max=2200, Unit="us")  % Maximum value for this channel.
RC3_MIN = Simulink.Parameter(1000, DataType="single", Min=800, Max=1500, Unit="us")  % Minimum value for this channel.
RC3_REV = Simulink.Parameter(1, DataType="single", Min=-1, Max=1)  % Set to -1 to reverse channel.
RC3_TRIM = Simulink.Parameter(1500, DataType="single", Min=800, Max=2200, Unit="us")  % Mid point value (has to be set to the same as min for throttle channel).
RC4_DZ = Simulink.Parameter(10, DataType="single", Min=0, Max=100, Unit="us")  % The +- range of this value around the trim value will be considered as zero.
RC4_MAX = Simulink.Parameter(2000, DataType="single", Min=1500, Max=2200, Unit="us")  % Maximum value for this channel.
RC4_MIN = Simulink.Parameter(1000, DataType="single", Min=800, Max=1500, Unit="us")  % Minimum value for this channel.
RC4_REV = Simulink.Parameter(1, DataType="single", Min=-1, Max=1)  % Set to -1 to reverse channel.
RC4_TRIM = Simulink.Parameter(1500, DataType="single", Min=800, Max=2200, Unit="us")  % Mid point value (has to be set to the same as min for throttle channel).
RC5_DZ = Simulink.Parameter(10, DataType="single", Min=0, Max=100)  % The +- range of this value around the trim value will be considered as zero.
RC5_MAX = Simulink.Parameter(2000, DataType="single", Min=1500, Max=2200, Unit="us")  % Maximum value for this channel.
RC5_MIN = Simulink.Parameter(1000, DataType="single", Min=800, Max=1500, Unit="us")  % Minimum value for this channel.
RC5_REV = Simulink.Parameter(1, DataType="single", Min=-1, Max=1)  % Set to -1 to reverse channel.
RC5_TRIM = Simulink.Parameter(1500, DataType="single", Min=800, Max=2200, Unit="us")  % Mid point value (has to be set to the same as min for throttle channel).
RC6_DZ = Simulink.Parameter(10, DataType="single", Min=0, Max=100)  % The +- range of this value around the trim value will be considered as zero.
RC6_MAX = Simulink.Parameter(2000, DataType="single", Min=1500, Max=2200, Unit="us")  % Maximum value for this channel.
RC6_MIN = Simulink.Parameter(1000, DataType="single", Min=800, Max=1500, Unit="us")  % Minimum value for this channel.
RC6_REV = Simulink.Parameter(1, DataType="single", Min=-1, Max=1)  % Set to -1 to reverse channel.
RC6_TRIM = Simulink.Parameter(1500, DataType="single", Min=800, Max=2200, Unit="us")  % Mid point value (has to be set to the same as min for throttle channel).
RC7_DZ = Simulink.Parameter(10, DataType="single", Min=0, Max=100)  % The +- range of this value around the trim value will be considered as zero.
RC7_MAX = Simulink.Parameter(2000, DataType="single", Min=1500, Max=2200, Unit="us")  % Maximum value for this channel.
RC7_MIN = Simulink.Parameter(1000, DataType="single", Min=800, Max=1500, Unit="us")  % Minimum value for this channel.
RC7_REV = Simulink.Parameter(1, DataType="single", Min=-1, Max=1)  % Set to -1 to reverse channel.
RC7_TRIM = Simulink.Parameter(1500, DataType="single", Min=800, Max=2200, Unit="us")  % Mid point value (has to be set to the same as min for throttle channel).
RC8_DZ = Simulink.Parameter(10, DataType="single", Min=0, Max=100)  % The +- range of this value around the trim value will be considered as zero.
RC8_MAX = Simulink.Parameter(2000, DataType="single", Min=1500, Max=2200, Unit="us")  % Maximum value for this channel.
RC8_MIN = Simulink.Parameter(1000, DataType="single", Min=800, Max=1500, Unit="us")  % Minimum value for this channel.
RC8_REV = Simulink.Parameter(1, DataType="single", Min=-1, Max=1)  % Set to -1 to reverse channel.
RC8_TRIM = Simulink.Parameter(1500, DataType="single", Min=800, Max=2200, Unit="us")  % Mid point value (has to be set to the same as min for throttle channel).
RC9_DZ = Simulink.Parameter(0, DataType="single", Min=0, Max=100)  % The +- range of this value around the trim value will be considered as zero.
RC9_MAX = Simulink.Parameter(2000, DataType="single", Min=1500, Max=2200, Unit="us")  % Maximum value for this channel.
RC9_MIN = Simulink.Parameter(1000, DataType="single", Min=800, Max=1500, Unit="us")  % Minimum value for this channel.
RC9_REV = Simulink.Parameter(1, DataType="single", Min=-1, Max=1)  % Set to -1 to reverse channel.
RC9_TRIM = Simulink.Parameter(1500, DataType="single", Min=800, Max=2200, Unit="us")  % Mid point value (has to be set to the same as min for throttle channel).
RC_CHAN_CNT = Simulink.Parameter(0, DataType="int32", Min=0, Max=18)  % This parameter is used by Ground Station software to save the number of channels which were used during RC calibration. It is only meant for ground station use.
RC_FAILS_THR = Simulink.Parameter(0, DataType="int32", Min=0, Max=2200, Unit="us")  % Use RC_MAP_FAILSAFE to specify which channel is used to indicate RC loss via this theshold. By default this is the throttle channel. Set to a PWM value slightly above the PWM value for the channel (e.g. throttle) in a failsafe event, but below the minimum PWM value for the channel during normal operation. Note: The default value of 0 disables the feature (it is below the expected range).
RC_MAP_AUX1 = Simulink.Parameter(0, DataType="int32", Min=0, Max=18)  % Default function: Camera pitch
RC_MAP_AUX2 = Simulink.Parameter(0, DataType="int32", Min=0, Max=18)  % Default function: Camera roll
RC_MAP_AUX3 = Simulink.Parameter(0, DataType="int32", Min=0, Max=18)  % Default function: Camera azimuth / yaw
RC_MAP_AUX4 = Simulink.Parameter(0, DataType="int32", Min=0, Max=18)
RC_MAP_AUX5 = Simulink.Parameter(0, DataType="int32", Min=0, Max=18)
RC_MAP_AUX6 = Simulink.Parameter(0, DataType="int32", Min=0, Max=18)
RC_MAP_FAILSAFE = Simulink.Parameter(0, DataType="int32", Min=0, Max=18)  % Configures which RC channel is used by the receiver to indicate the signal was lost (on receivers that use output a fixed signal value to report lost signal). If set to 0, the channel mapped to throttle is used. Use RC_FAILS_THR to set the threshold indicating lost signal. By default it's below the expected range and hence disabled.
RC_MAP_PARAM1 = Simulink.Parameter(0, DataType="int32", Min=0, Max=18)  % Can be used for parameter tuning with the RC. This one is further referenced as the 1st parameter channel. Set to 0 to deactivate *
RC_MAP_PARAM2 = Simulink.Parameter(0, DataType="int32", Min=0, Max=18)  % Can be used for parameter tuning with the RC. This one is further referenced as the 2nd parameter channel. Set to 0 to deactivate *
RC_MAP_PARAM3 = Simulink.Parameter(0, DataType="int32", Min=0, Max=18)  % Can be used for parameter tuning with the RC. This one is further referenced as the 3th parameter channel. Set to 0 to deactivate *
RC_MAP_PITCH = Simulink.Parameter(0, DataType="int32", Min=0, Max=18)  % The channel index (starting from 1 for channel 1) indicates which channel should be used for reading pitch inputs from. A value of zero indicates the switch is not assigned.
RC_MAP_ROLL = Simulink.Parameter(0, DataType="int32", Min=0, Max=18)  % The channel index (starting from 1 for channel 1) indicates which channel should be used for reading roll inputs from. A value of zero indicates the switch is not assigned.
RC_MAP_THROTTLE = Simulink.Parameter(0, DataType="int32", Min=0, Max=18)  % The channel index (starting from 1 for channel 1) indicates which channel should be used for reading throttle inputs from. A value of zero indicates the switch is not assigned.
RC_MAP_YAW = Simulink.Parameter(0, DataType="int32", Min=0, Max=18)  % The channel index (starting from 1 for channel 1) indicates which channel should be used for reading yaw inputs from. A value of zero indicates the switch is not assigned.
RC_RSSI_PWM_CHAN = Simulink.Parameter(0, DataType="int32", Min=0, Max=18)  % 0: do not read RSSI from input channel 1-18: read RSSI from specified input channel Specify the range for RSSI input with RC_RSSI_PWM_MIN and RC_RSSI_PWM_MAX parameters.
RC_RSSI_PWM_MAX = Simulink.Parameter(2000, DataType="int32", Min=0, Max=2000)  % Only used if RC_RSSI_PWM_CHAN > 0
RC_RSSI_PWM_MIN = Simulink.Parameter(1000, DataType="int32", Min=0, Max=2000)  % Only used if RC_RSSI_PWM_CHAN > 0
TRIM_PITCH = Simulink.Parameter(0, DataType="single", Min=-0.25, Max=0.25)  % The trim value is the actuator control value the system needs for straight and level flight. It can be calibrated by flying manually straight and level using the RC trims and copying them using the GCS.
TRIM_ROLL = Simulink.Parameter(0, DataType="single", Min=-0.25, Max=0.25)  % The trim value is the actuator control value the system needs for straight and level flight. It can be calibrated by flying manually straight and level using the RC trims and copying them using the GCS.
TRIM_YAW = Simulink.Parameter(0, DataType="single", Min=-0.25, Max=0.25)  % The trim value is the actuator control value the system needs for straight and level flight. It can be calibrated by flying manually straight and level using the RC trims and copying them using the GCS.
RC_ACRO_TH = Simulink.Parameter(0.75, DataType="single", Min=-1, Max=1)  % 0-1 indicate where in the full channel range the threshold sits 0 : min 1 : max sign indicates polarity of comparison positive : true when channel>th negative : true when channel<th
RC_ARMSWITCH_TH = Simulink.Parameter(0.75, DataType="single", Min=-1, Max=1)  % 0-1 indicate where in the full channel range the threshold sits 0 : min 1 : max sign indicates polarity of comparison positive : true when channel>th negative : true when channel<th
RC_ASSIST_TH = Simulink.Parameter(0.25, DataType="single", Min=-1, Max=1)  % 0-1 indicate where in the full channel range the threshold sits 0 : min 1 : max sign indicates polarity of comparison positive : true when channel>th negative : true when channel<th
RC_AUTO_TH = Simulink.Parameter(0.75, DataType="single", Min=-1, Max=1)  % 0-1 indicate where in the full channel range the threshold sits 0 : min 1 : max sign indicates polarity of comparison positive : true when channel>th negative : true when channel<th
RC_GEAR_TH = Simulink.Parameter(0.75, DataType="single", Min=-1, Max=1)  % 0-1 indicate where in the full channel range the threshold sits 0 : min 1 : max sign indicates polarity of comparison positive : true when channel>th negative : true when channel<th
RC_KILLSWITCH_TH = Simulink.Parameter(0.75, DataType="single", Min=-1, Max=1)  % 0-1 indicate where in the full channel range the threshold sits 0 : min 1 : max sign indicates polarity of comparison positive : true when channel>th negative : true when channel<th
RC_LOITER_TH = Simulink.Parameter(0.75, DataType="single", Min=-1, Max=1)  % 0-1 indicate where in the full channel range the threshold sits 0 : min 1 : max sign indicates polarity of comparison positive : true when channel>th negative : true when channel<th
RC_MAN_TH = Simulink.Parameter(0.75, DataType="single", Min=-1, Max=1)  % 0-1 indicate where in the full channel range the threshold sits 0 : min 1 : max sign indicates polarity of comparison positive : true when channel>th negative : true when channel<th
RC_MAP_ACRO_SW = Simulink.Parameter(0, DataType="int32", Min=0, Max=18)
RC_MAP_ARM_SW = Simulink.Parameter(0, DataType="int32", Min=0, Max=18)  % Use it to arm/disarm via switch instead of default throttle stick. If this is assigned, arming and disarming via stick is disabled.
RC_MAP_FLAPS = Simulink.Parameter(0, DataType="int32", Min=0, Max=18)
RC_MAP_FLTMODE = Simulink.Parameter(0, DataType="int32", Min=0, Max=18)  % If this parameter is non-zero, flight modes are only selected by this channel and are assigned to six slots.
RC_MAP_FLTM_BTN = Simulink.Parameter(0, DataType="int32", Min=0, Max=258048)  % This bitmask allows to specify multiple channels for changing flight modes using momentary buttons. Each channel is assigned to a mode slot ((lowest channel = slot 1). The resulting modes for each slot X is defined by the COM_FLTMODEX parameters. The functionality can be used only if RC_MAP_FLTMODE is disabled. The maximum number of available slots and hence bits set in the mask is 6.
RC_MAP_GEAR_SW = Simulink.Parameter(0, DataType="int32", Min=0, Max=18)
RC_MAP_KILL_SW = Simulink.Parameter(0, DataType="int32", Min=0, Max=18)
RC_MAP_LOITER_SW = Simulink.Parameter(0, DataType="int32", Min=0, Max=18)
RC_MAP_MAN_SW = Simulink.Parameter(0, DataType="int32", Min=0, Max=18)
RC_MAP_MODE_SW = Simulink.Parameter(0, DataType="int32", Min=0, Max=18)  % This is the main flight mode selector. The channel index (starting from 1 for channel 1) indicates which channel should be used for deciding about the main mode. A value of zero indicates the switch is not assigned.
RC_MAP_OFFB_SW = Simulink.Parameter(0, DataType="int32", Min=0, Max=18)
RC_MAP_POSCTL_SW = Simulink.Parameter(0, DataType="int32", Min=0, Max=18)
RC_MAP_RATT_SW = Simulink.Parameter(0, DataType="int32", Min=0, Max=18)
RC_MAP_RETURN_SW = Simulink.Parameter(0, DataType="int32", Min=0, Max=18)
RC_MAP_STAB_SW = Simulink.Parameter(0, DataType="int32", Min=0, Max=18)
RC_MAP_TRANS_SW = Simulink.Parameter(0, DataType="int32", Min=0, Max=18)
RC_OFFB_TH = Simulink.Parameter(0.75, DataType="single", Min=-1, Max=1)  % 0-1 indicate where in the full channel range the threshold sits 0 : min 1 : max sign indicates polarity of comparison positive : true when channel>th negative : true when channel<th
RC_POSCTL_TH = Simulink.Parameter(0.75, DataType="single", Min=-1, Max=1)  % 0-1 indicate where in the full channel range the threshold sits 0 : min 1 : max sign indicates polarity of comparison positive : true when channel>th negative : true when channel<th
RC_RETURN_TH = Simulink.Parameter(0.75, DataType="single", Min=-1, Max=1)  % 0-1 indicate where in the full channel range the threshold sits 0 : min 1 : max sign indicates polarity of comparison positive : true when channel>th negative : true when channel<th
RC_STAB_TH = Simulink.Parameter(0.5, DataType="single", Min=-1, Max=1)  % 0-1 indicate where in the full channel range the threshold sits 0 : min 1 : max sign indicates polarity of comparison positive : true when channel>th negative : true when channel<th
RC_TRANS_TH = Simulink.Parameter(0.75, DataType="single", Min=-1, Max=1)  % 0-1 indicate where in the full channel range the threshold sits 0 : min 1 : max sign indicates polarity of comparison positive : true when channel>th negative : true when channel<th
RTL_CONE_ANG = Simulink.Parameter(45, DataType="int32", Min=0, Max=90, Unit="deg")  % Defines the half-angle of a cone centered around the destination position that affects the altitude at which the vehicle returns.
RTL_DESCEND_ALT = Simulink.Parameter(30, DataType="single", Min=2, Max=100, Unit="m")  % Descend to this altitude (above destination position) after return, and wait for time defined in RTL_LAND_DELAY. Land (i.e. slowly descend) from this altitude if autolanding allowed.
RTL_LAND_DELAY = Simulink.Parameter(0, DataType="single", Min=-1, Max=300, Unit="s")  % Delay before landing (after initial descent) in Return mode. If set to -1 the system will not land but loiter at RTL_DESCEND_ALT.
RTL_LOITER_RAD = Simulink.Parameter(50, DataType="single", Min=25, Max=1000, Unit="m")  % Set the radius for loitering to a safe altitude for VTOL transition.
RTL_MIN_DIST = Simulink.Parameter(10, DataType="single", Min=0.5, Max=100, Unit="m")  % The return altitude will be calculated based on RTL_CONE_ANG parameter. The yaw setpoint will switch to the one defined by corresponding waypoint.
RTL_RETURN_ALT = Simulink.Parameter(60, DataType="single", Min=0, Max=150, Unit="m")  % Default minimum altitude above destination (e.g. home, safe point, landing pattern) for return flight. This is affected by RTL_MIN_DIST and RTL_CONE_ANG.
RTL_TYPE = Simulink.Parameter(0, DataType="int32")  % Return mode destination and flight path (home location, rally point, mission landing pattern, reverse mission)
RTL_PLD_MD = Simulink.Parameter(0, DataType="int32")  % Use precision landing when doing an RTL landing phase.
RBCLW_SER_CFG = Simulink.Parameter(0, DataType="int32")  % Configure on which serial port to run Roboclaw Driver.
RBCLW_ADDRESS = Simulink.Parameter(128, DataType="int32", Min=128, Max=135)  % The Roboclaw can be configured to have an address from 0x80 to 0x87, inclusive. It must be configured to match this parameter.
RBCLW_BAUD = Simulink.Parameter(2400, DataType="int32", Min=2400, Max=460800)  % Baud rate of the serial communication with the Roboclaw. The Roboclaw must be configured to match this rate.
RBCLW_COUNTS_REV = Simulink.Parameter(1200, DataType="int32", Min=1)  % Number of encoder counts for one revolution. The roboclaw treats analog encoders (potentiometers) as having 2047 counts per rev. The default value of 1200 corresponds to the default configuration of the Aion R1 rover.
RBCLW_READ_PER = Simulink.Parameter(10, DataType="int32", Min=1, Max=1000, Unit="ms")  % How long to wait, in Milliseconds, between reading wheel encoder values over Uart from the Roboclaw
RBCLW_WRITE_PER = Simulink.Parameter(10, DataType="int32", Min=1, Max=1000, Unit="ms")  % How long to wait, in Milliseconds, between writing actuator controls over Uart to the Roboclaw
GND_L1_DAMPING = Simulink.Parameter(0.75, DataType="single", Min=0.6, Max=0.9)  % Damping factor for L1 control.
GND_L1_DIST = Simulink.Parameter(1, DataType="single", Min=1, Max=50, Unit="m")  % This is the distance at which the next waypoint is activated. This should be set to about 2-4x of GND_WHEEL_BASE and not smaller than one meter (due to GPS accuracy).
GND_L1_PERIOD = Simulink.Parameter(5, DataType="single", Min=0.5, Max=50, Unit="m")  % This is the L1 distance and defines the tracking point ahead of the rover it's following. Use values around 2-5m for a 0.3m wheel base. Tuning instructions: Shorten slowly during tuning until response is sharp without oscillation.
GND_MAN_Y_MAX = Simulink.Parameter(150, DataType="single", Min=0, Max=400, Unit="deg/s")
GND_MAX_ANG = Simulink.Parameter(0.7854, DataType="single", Min=0, Max=3.14159, Unit="rad")  % At a control output of 0, the steering wheels are at 0 radians. At a control output of 1, the steering wheels are at GND_MAX_ANG radians.

GND_SPEED_D = Simulink.Parameter(0.001, DataType="single", Min=0, Max=50, Unit="%m/s")  % This is the derivative gain for the speed closed loop controller
GND_SPEED_I = Simulink.Parameter(3, DataType="single", Min=0, Max=50, Unit="%m/s")  % This is the integral gain for the speed closed loop controller
GND_SPEED_IMAX = Simulink.Parameter(1, DataType="single", Min=0.005, Max=50, Unit="%m/s")  % This is the maxim value the integral can reach to prevent wind-up.
GND_SPEED_MAX = Simulink.Parameter(10, DataType="single", Min=0, Max=40, Unit="m/s")
GND_SPEED_P = Simulink.Parameter(2, DataType="single", Min=0.005, Max=50, Unit="%m/s")  % This is the proportional gain for the speed closed loop controller
GND_SPEED_THR_SC = Simulink.Parameter(1, DataType="single", Min=0.005, Max=50, Unit="%m/s")  % This is a gain to map the speed control output to the throttle linearly.
GND_SPEED_TRIM = Simulink.Parameter(3, DataType="single", Min=0, Max=40, Unit="m/s")
GND_SP_CTRL_MODE = Simulink.Parameter(1, DataType="int32", Min=0, Max=1)  % This allows the user to choose between closed loop gps speed or open loop cruise throttle speed
GND_THR_CRUISE = Simulink.Parameter(0.1, DataType="single", Min=0, Max=1, Unit="norm")  % This is the throttle setting required to achieve the desired cruise speed. 10% is ok for a traxxas stampede vxl with ESC set to training mode
GND_THR_MAX = Simulink.Parameter(0.3, DataType="single", Min=0, Max=1, Unit="norm")  % This is the maximum throttle % that can be used by the controller. For a Traxxas stampede vxl with the ESC set to training, 30 % is enough
GND_THR_MIN = Simulink.Parameter(0, DataType="single", Min=0, Max=1, Unit="norm")  % This is the minimum throttle % that can be used by the controller. Set to 0 for rover
GND_WHEEL_BASE = Simulink.Parameter(0.31, DataType="single", Min=0, Unit="m")  % A value of 0.31 is typical for 1/10 RC cars.
RWTO_AIRSPD_SCL = Simulink.Parameter(1.3, DataType="single", Min=0, Max=2, Unit="norm")  % Pitch up will be commanded when the following airspeed is reached: FW_AIRSPD_MIN * RWTO_AIRSPD_SCL
RWTO_HDG = Simulink.Parameter(0, DataType="int32", Min=0, Max=1)  % 0: airframe heading, 1: heading towards takeoff waypoint
RWTO_MAX_PITCH = Simulink.Parameter(20, DataType="single", Min=0, Max=60, Unit="deg")  % Fixed-wing settings are used if set to 0. Note that there is also a minimum pitch of 10 degrees during takeoff, so this must be larger if set.
RWTO_MAX_ROLL = Simulink.Parameter(25, DataType="single", Min=0, Max=60, Unit="deg")  % Roll is limited during climbout to ensure enough lift and prevents aggressive navigation before we're on a safe height.
RWTO_MAX_THR = Simulink.Parameter(1, DataType="single", Min=0, Max=1, Unit="norm")  % Can be used to test taxi on runway
RWTO_NAV_ALT = Simulink.Parameter(5, DataType="single", Min=0, Max=100, Unit="m")  % Until RWTO_NAV_ALT is reached the plane is held level and only rudder is used to keep the heading (see RWTO_HDG). This should be below FW_CLMBOUT_DIFF if FW_CLMBOUT_DIFF > 0.
RWTO_PSP = Simulink.Parameter(0, DataType="single", Min=-10, Max=20, Unit="deg")  % A taildragger with steerable wheel might need to pitch up a little to keep its wheel on the ground before airspeed to takeoff is reached.
RWTO_RAMP_TIME = Simulink.Parameter(2, DataType="single", Min=1, Max=15, Unit="s")
RWTO_TKOFF = Simulink.Parameter(0, DataType="int32")
SDLOG_BOOT_BAT = Simulink.Parameter(0, DataType="int32")  % When enabled, logging will not start from boot if battery power is not detected (e.g. powered via USB on a test bench). This prevents extraneous flight logs from being created during bench testing. Note that this only applies to log-from-boot modes. This has no effect on arm-based modes.
SDLOG_DIRS_MAX = Simulink.Parameter(0, DataType="int32", Min=0, Max=1000)  % If there are more log directories than this value, the system will delete the oldest directories during startup. In addition, the system will delete old logs if there is not enough free space left. The minimum amount is 300 MB. If this is set to 0, old directories will only be removed if the free space falls below the minimum. Note: this does not apply to mission log files.
SDLOG_MISSION = Simulink.Parameter(0, DataType="int32")  % If enabled, a small additional "mission" log file will be written to the SD card. The log contains just those messages that are useful for tasks like generating flight statistics and geotagging. The different modes can be used to further reduce the logged data (and thus the log file size). For example, choose geotagging mode to only log data required for geotagging. Note that the normal/full log is still created, and contains all the data in the mission log (and more).
SDLOG_MODE = Simulink.Parameter(0, DataType="int32")  % Determines when to start and stop logging. By default, logging is started when arming the system, and stopped when disarming.
SDLOG_PROFILE = Simulink.Parameter(1, DataType="int32", Min=0, Max=1023)  % This integer bitmask controls the set and rates of logged topics. The default allows for general log analysis while keeping the log file size reasonably small. Enabling multiple sets leads to higher bandwidth requirements and larger log files. Set bits true to enable: 0 : Default set (used for general log analysis) 1 : Full rate estimator (EKF2) replay topics 2 : Topics for thermal calibration (high rate raw IMU and Baro sensor data) 3 : Topics for system identification (high rate actuator control and IMU data) 4 : Full rates for analysis of fast maneuvers (RC, attitude, rates and actuators) 5 : Debugging topics (debug_*.msg topics, for custom code) 6 : Topics for sensor comparison (low rate raw IMU, Baro and Magnetomer data) 7 : Topics for computer vision and collision avoidance 8 : Raw FIFO high-rate IMU (Gyro) 9 : Raw FIFO high-rate IMU (Accel)
SDLOG_UTC_OFFSET = Simulink.Parameter(0, DataType="int32", Min=-1000, Max=1000, Unit="min")  % the difference in hours and minutes from Coordinated Universal Time (UTC) for a your place and date. for example, In case of South Korea(UTC+09:00), UTC offset is 540 min (9*60) refer to https://en.wikipedia.org/wiki/List_of_UTC_time_offsets
SDLOG_UUID = Simulink.Parameter(1, DataType="int32")  % If set to 1, add an ID to the log, which uniquely identifies the vehicle
CAL_ACC0_ID = Simulink.Parameter(0, DataType="int32")
CAL_ACC0_PRIO = Simulink.Parameter(-1, DataType="int32")
CAL_ACC0_ROT = Simulink.Parameter(-1, DataType="int32", Min=-1, Max=40)  % An internal sensor will force a value of -1, so a GCS should only attempt to configure the rotation if the value is greater than or equal to zero.
CAL_ACC0_TEMP = Simulink.Parameter(-1000, DataType="single", Unit="celcius")  % Temperature during last calibration.
CAL_ACC0_XOFF = Simulink.Parameter(0, DataType="single")
CAL_ACC0_XSCALE = Simulink.Parameter(1, DataType="single")
CAL_ACC0_YOFF = Simulink.Parameter(0, DataType="single")
CAL_ACC0_YSCALE = Simulink.Parameter(1, DataType="single")
CAL_ACC0_ZOFF = Simulink.Parameter(0, DataType="single")
CAL_ACC0_ZSCALE = Simulink.Parameter(1, DataType="single")
CAL_ACC1_ID = Simulink.Parameter(0, DataType="int32")
CAL_ACC1_PRIO = Simulink.Parameter(-1, DataType="int32")
CAL_ACC1_ROT = Simulink.Parameter(-1, DataType="int32", Min=-1, Max=40)  % An internal sensor will force a value of -1, so a GCS should only attempt to configure the rotation if the value is greater than or equal to zero.
CAL_ACC1_TEMP = Simulink.Parameter(-1000, DataType="single", Unit="celcius")  % Temperature during last calibration.
CAL_ACC1_XOFF = Simulink.Parameter(0, DataType="single")
CAL_ACC1_XSCALE = Simulink.Parameter(1, DataType="single")
CAL_ACC1_YOFF = Simulink.Parameter(0, DataType="single")
CAL_ACC1_YSCALE = Simulink.Parameter(1, DataType="single")
CAL_ACC1_ZOFF = Simulink.Parameter(0, DataType="single")
CAL_ACC1_ZSCALE = Simulink.Parameter(1, DataType="single")
CAL_ACC2_ID = Simulink.Parameter(0, DataType="int32")
CAL_ACC2_PRIO = Simulink.Parameter(-1, DataType="int32")
CAL_ACC2_ROT = Simulink.Parameter(-1, DataType="int32", Min=-1, Max=40)  % An internal sensor will force a value of -1, so a GCS should only attempt to configure the rotation if the value is greater than or equal to zero.
CAL_ACC2_TEMP = Simulink.Parameter(-1000, DataType="single", Unit="celcius")  % Temperature during last calibration.
CAL_ACC2_XOFF = Simulink.Parameter(0, DataType="single")
CAL_ACC2_XSCALE = Simulink.Parameter(1, DataType="single")
CAL_ACC2_YOFF = Simulink.Parameter(0, DataType="single")
CAL_ACC2_YSCALE = Simulink.Parameter(1, DataType="single")
CAL_ACC2_ZOFF = Simulink.Parameter(0, DataType="single")
CAL_ACC2_ZSCALE = Simulink.Parameter(1, DataType="single")
CAL_ACC3_ID = Simulink.Parameter(0, DataType="int32")
CAL_ACC3_PRIO = Simulink.Parameter(-1, DataType="int32")
CAL_ACC3_ROT = Simulink.Parameter(-1, DataType="int32", Min=-1, Max=40)  % An internal sensor will force a value of -1, so a GCS should only attempt to configure the rotation if the value is greater than or equal to zero.
CAL_ACC3_TEMP = Simulink.Parameter(-1000, DataType="single", Unit="celcius")  % Temperature during last calibration.
CAL_ACC3_XOFF = Simulink.Parameter(0, DataType="single")
CAL_ACC3_XSCALE = Simulink.Parameter(1, DataType="single")
CAL_ACC3_YOFF = Simulink.Parameter(0, DataType="single")
CAL_ACC3_YSCALE = Simulink.Parameter(1, DataType="single")
CAL_ACC3_ZOFF = Simulink.Parameter(0, DataType="single")
CAL_ACC3_ZSCALE = Simulink.Parameter(1, DataType="single")
CAL_GYRO0_ID = Simulink.Parameter(0, DataType="int32")
CAL_GYRO0_PRIO = Simulink.Parameter(-1, DataType="int32")
CAL_GYRO0_ROT = Simulink.Parameter(-1, DataType="int32", Min=-1, Max=40)  % An internal sensor will force a value of -1, so a GCS should only attempt to configure the rotation if the value is greater than or equal to zero.
CAL_GYRO0_TEMP = Simulink.Parameter(-1000, DataType="single", Unit="celcius")  % Temperature during last calibration.
CAL_GYRO0_XOFF = Simulink.Parameter(0, DataType="single")
CAL_GYRO0_YOFF = Simulink.Parameter(0, DataType="single")
CAL_GYRO0_ZOFF = Simulink.Parameter(0, DataType="single")
CAL_GYRO1_ID = Simulink.Parameter(0, DataType="int32")
CAL_GYRO1_PRIO = Simulink.Parameter(-1, DataType="int32")
CAL_GYRO1_ROT = Simulink.Parameter(-1, DataType="int32", Min=-1, Max=40)  % An internal sensor will force a value of -1, so a GCS should only attempt to configure the rotation if the value is greater than or equal to zero.
CAL_GYRO1_TEMP = Simulink.Parameter(-1000, DataType="single", Unit="celcius")  % Temperature during last calibration.
CAL_GYRO1_XOFF = Simulink.Parameter(0, DataType="single")
CAL_GYRO1_YOFF = Simulink.Parameter(0, DataType="single")
CAL_GYRO1_ZOFF = Simulink.Parameter(0, DataType="single")
CAL_GYRO2_ID = Simulink.Parameter(0, DataType="int32")
CAL_GYRO2_PRIO = Simulink.Parameter(-1, DataType="int32")
CAL_GYRO2_ROT = Simulink.Parameter(-1, DataType="int32", Min=-1, Max=40)  % An internal sensor will force a value of -1, so a GCS should only attempt to configure the rotation if the value is greater than or equal to zero.
CAL_GYRO2_TEMP = Simulink.Parameter(-1000, DataType="single", Unit="celcius")  % Temperature during last calibration.
CAL_GYRO2_XOFF = Simulink.Parameter(0, DataType="single")
CAL_GYRO2_YOFF = Simulink.Parameter(0, DataType="single")
CAL_GYRO2_ZOFF = Simulink.Parameter(0, DataType="single")
CAL_GYRO3_ID = Simulink.Parameter(0, DataType="int32")
CAL_GYRO3_PRIO = Simulink.Parameter(-1, DataType="int32")
CAL_GYRO3_ROT = Simulink.Parameter(-1, DataType="int32", Min=-1, Max=40)  % An internal sensor will force a value of -1, so a GCS should only attempt to configure the rotation if the value is greater than or equal to zero.
CAL_GYRO3_TEMP = Simulink.Parameter(-1000, DataType="single", Unit="celcius")  % Temperature during last calibration.
CAL_GYRO3_XOFF = Simulink.Parameter(0, DataType="single")
CAL_GYRO3_YOFF = Simulink.Parameter(0, DataType="single")
CAL_GYRO3_ZOFF = Simulink.Parameter(0, DataType="single")
CAL_MAG0_ID = Simulink.Parameter(0, DataType="int32")
CAL_MAG0_PRIO = Simulink.Parameter(-1, DataType="int32")
CAL_MAG0_ROT = Simulink.Parameter(-1, DataType="int32", Min=-1, Max=40)  % An internal sensor will force a value of -1, so a GCS should only attempt to configure the rotation if the value is greater than or equal to zero.
CAL_MAG0_TEMP = Simulink.Parameter(-1000, DataType="single", Unit="celcius")  % Temperature during last calibration.
CAL_MAG0_XCOMP = Simulink.Parameter(0, DataType="single")  % Coefficient describing linear relationship between X component of magnetometer in body frame axis and either current or throttle depending on value of CAL_MAG_COMP_TYP. Unit for throttle-based compensation is [G] and for current-based compensation [G/kA]
CAL_MAG0_XODIAG = Simulink.Parameter(0, DataType="single")
CAL_MAG0_XOFF = Simulink.Parameter(0, DataType="single")
CAL_MAG0_XSCALE = Simulink.Parameter(1, DataType="single")
CAL_MAG0_YCOMP = Simulink.Parameter(0, DataType="single")  % Coefficient describing linear relationship between Y component of magnetometer in body frame axis and either current or throttle depending on value of CAL_MAG_COMP_TYP. Unit for throttle-based compensation is [G] and for current-based compensation [G/kA]
CAL_MAG0_YODIAG = Simulink.Parameter(0, DataType="single")
CAL_MAG0_YOFF = Simulink.Parameter(0, DataType="single")
CAL_MAG0_YSCALE = Simulink.Parameter(1, DataType="single")
CAL_MAG0_ZCOMP = Simulink.Parameter(0, DataType="single")  % Coefficient describing linear relationship between Z component of magnetometer in body frame axis and either current or throttle depending on value of CAL_MAG_COMP_TYP. Unit for throttle-based compensation is [G] and for current-based compensation [G/kA]
CAL_MAG0_ZODIAG = Simulink.Parameter(0, DataType="single")
CAL_MAG0_ZOFF = Simulink.Parameter(0, DataType="single")
CAL_MAG0_ZSCALE = Simulink.Parameter(1, DataType="single")
CAL_MAG1_ID = Simulink.Parameter(0, DataType="int32")
CAL_MAG1_PRIO = Simulink.Parameter(-1, DataType="int32")
CAL_MAG1_ROT = Simulink.Parameter(-1, DataType="int32", Min=-1, Max=40)  % An internal sensor will force a value of -1, so a GCS should only attempt to configure the rotation if the value is greater than or equal to zero.
CAL_MAG1_TEMP = Simulink.Parameter(-1000, DataType="single", Unit="celcius")  % Temperature during last calibration.
CAL_MAG1_XCOMP = Simulink.Parameter(0, DataType="single")  % Coefficient describing linear relationship between X component of magnetometer in body frame axis and either current or throttle depending on value of CAL_MAG_COMP_TYP. Unit for throttle-based compensation is [G] and for current-based compensation [G/kA]
CAL_MAG1_XODIAG = Simulink.Parameter(0, DataType="single")
CAL_MAG1_XOFF = Simulink.Parameter(0, DataType="single")
CAL_MAG1_XSCALE = Simulink.Parameter(1, DataType="single")
CAL_MAG1_YCOMP = Simulink.Parameter(0, DataType="single")  % Coefficient describing linear relationship between Y component of magnetometer in body frame axis and either current or throttle depending on value of CAL_MAG_COMP_TYP. Unit for throttle-based compensation is [G] and for current-based compensation [G/kA]
CAL_MAG1_YODIAG = Simulink.Parameter(0, DataType="single")
CAL_MAG1_YOFF = Simulink.Parameter(0, DataType="single")
CAL_MAG1_YSCALE = Simulink.Parameter(1, DataType="single")
CAL_MAG1_ZCOMP = Simulink.Parameter(0, DataType="single")  % Coefficient describing linear relationship between Z component of magnetometer in body frame axis and either current or throttle depending on value of CAL_MAG_COMP_TYP. Unit for throttle-based compensation is [G] and for current-based compensation [G/kA]
CAL_MAG1_ZODIAG = Simulink.Parameter(0, DataType="single")
CAL_MAG1_ZOFF = Simulink.Parameter(0, DataType="single")
CAL_MAG1_ZSCALE = Simulink.Parameter(1, DataType="single")
CAL_MAG2_ID = Simulink.Parameter(0, DataType="int32")
CAL_MAG2_PRIO = Simulink.Parameter(-1, DataType="int32")
CAL_MAG2_ROT = Simulink.Parameter(-1, DataType="int32", Min=-1, Max=40)  % An internal sensor will force a value of -1, so a GCS should only attempt to configure the rotation if the value is greater than or equal to zero.
CAL_MAG2_TEMP = Simulink.Parameter(-1000, DataType="single", Unit="celcius")  % Temperature during last calibration.
CAL_MAG2_XCOMP = Simulink.Parameter(0, DataType="single")  % Coefficient describing linear relationship between X component of magnetometer in body frame axis and either current or throttle depending on value of CAL_MAG_COMP_TYP. Unit for throttle-based compensation is [G] and for current-based compensation [G/kA]
CAL_MAG2_XODIAG = Simulink.Parameter(0, DataType="single")
CAL_MAG2_XOFF = Simulink.Parameter(0, DataType="single")
CAL_MAG2_XSCALE = Simulink.Parameter(1, DataType="single")
CAL_MAG2_YCOMP = Simulink.Parameter(0, DataType="single")  % Coefficient describing linear relationship between Y component of magnetometer in body frame axis and either current or throttle depending on value of CAL_MAG_COMP_TYP. Unit for throttle-based compensation is [G] and for current-based compensation [G/kA]
CAL_MAG2_YODIAG = Simulink.Parameter(0, DataType="single")
CAL_MAG2_YOFF = Simulink.Parameter(0, DataType="single")
CAL_MAG2_YSCALE = Simulink.Parameter(1, DataType="single")
CAL_MAG2_ZCOMP = Simulink.Parameter(0, DataType="single")  % Coefficient describing linear relationship between Z component of magnetometer in body frame axis and either current or throttle depending on value of CAL_MAG_COMP_TYP. Unit for throttle-based compensation is [G] and for current-based compensation [G/kA]
CAL_MAG2_ZODIAG = Simulink.Parameter(0, DataType="single")
CAL_MAG2_ZOFF = Simulink.Parameter(0, DataType="single")
CAL_MAG2_ZSCALE = Simulink.Parameter(1, DataType="single")
CAL_MAG3_ID = Simulink.Parameter(0, DataType="int32")
CAL_MAG3_PRIO = Simulink.Parameter(-1, DataType="int32")
CAL_MAG3_ROT = Simulink.Parameter(-1, DataType="int32", Min=-1, Max=40)  % An internal sensor will force a value of -1, so a GCS should only attempt to configure the rotation if the value is greater than or equal to zero.
CAL_MAG3_TEMP = Simulink.Parameter(-1000, DataType="single", Unit="celcius")  % Temperature during last calibration.
CAL_MAG3_XCOMP = Simulink.Parameter(0, DataType="single")  % Coefficient describing linear relationship between X component of magnetometer in body frame axis and either current or throttle depending on value of CAL_MAG_COMP_TYP. Unit for throttle-based compensation is [G] and for current-based compensation [G/kA]
CAL_MAG3_XODIAG = Simulink.Parameter(0, DataType="single")
CAL_MAG3_XOFF = Simulink.Parameter(0, DataType="single")
CAL_MAG3_XSCALE = Simulink.Parameter(1, DataType="single")
CAL_MAG3_YCOMP = Simulink.Parameter(0, DataType="single")  % Coefficient describing linear relationship between Y component of magnetometer in body frame axis and either current or throttle depending on value of CAL_MAG_COMP_TYP. Unit for throttle-based compensation is [G] and for current-based compensation [G/kA]
CAL_MAG3_YODIAG = Simulink.Parameter(0, DataType="single")
CAL_MAG3_YOFF = Simulink.Parameter(0, DataType="single")
CAL_MAG3_YSCALE = Simulink.Parameter(1, DataType="single")
CAL_MAG3_ZCOMP = Simulink.Parameter(0, DataType="single")  % Coefficient describing linear relationship between Z component of magnetometer in body frame axis and either current or throttle depending on value of CAL_MAG_COMP_TYP. Unit for throttle-based compensation is [G] and for current-based compensation [G/kA]
CAL_MAG3_ZODIAG = Simulink.Parameter(0, DataType="single")
CAL_MAG3_ZOFF = Simulink.Parameter(0, DataType="single")
CAL_MAG3_ZSCALE = Simulink.Parameter(1, DataType="single")
CAL_MAG_COMP_TYP = Simulink.Parameter(0, DataType="int32")
SENS_DPRES_ANSC = Simulink.Parameter(0, DataType="single")  % Pick the appropriate scaling from the datasheet. this number defines the (linear) conversion from voltage to Pascal (pa). For the MPXV7002DP this is 1000. NOTE: If the sensor always registers zero, try switching the static and dynamic tubes.
SENS_DPRES_OFF = Simulink.Parameter(0, DataType="single")  % The offset (zero-reading) in Pascal
SENS_FLOW_MAXHGT = Simulink.Parameter(3, DataType="single", Min=1, Max=25, Unit="m")  % This parameter defines the maximum distance from ground at which the optical flow sensor operates reliably. The height setpoint will be limited to be no greater than this value when the navigation system is completely reliant on optical flow data and the height above ground estimate is valid. The sensor may be usable above this height, but accuracy will progressively degrade.
SENS_FLOW_MAXR = Simulink.Parameter(2.5, DataType="single", Min=1, Unit="rad/s")  % Optical flow data will not fused by the estimators if the magnitude of the flow rate exceeds this value and control loops will be instructed to limit ground speed such that the flow rate produced by movement over ground is less than 50% of this value.
SENS_FLOW_MINHGT = Simulink.Parameter(0.7, DataType="single", Min=0, Max=1, Unit="m")  % This parameter defines the minimum distance from ground at which the optical flow sensor operates reliably. The sensor may be usable below this height, but accuracy will progressively reduce to loss of focus.
BAT1_C_MULT = Simulink.Parameter(1, DataType="single")
BAT1_SMBUS_MODEL = Simulink.Parameter(0, DataType="int32", Min=0, Max=2)
BATMON_ADDR_DFLT = Simulink.Parameter(11, DataType="int32")
BATMON_DRIVER_EN = Simulink.Parameter(0, DataType="int32", Min=0, Max=2)
CAL_AIR_CMODEL = Simulink.Parameter(0, DataType="int32")  % Model with Pitot CAL_AIR_TUBED_MM: Not used, 1.5 mm tubes assumed. CAL_AIR_TUBELEN: Length of the tubes connecting the pitot to the sensor. Model without Pitot (1.5 mm tubes) CAL_AIR_TUBED_MM: Not used, 1.5 mm tubes assumed. CAL_AIR_TUBELEN: Length of the tubes connecting the pitot to the sensor. Tube Pressure Drop CAL_AIR_TUBED_MM: Diameter in mm of the pitot and tubes, must have the same diameter. CAL_AIR_TUBELEN: Length of the tubes connecting the pitot to the sensor and the static + dynamic port length of the pitot.
CAL_AIR_TUBED_MM = Simulink.Parameter(1.5, DataType="single", Min=1.5, Max=100, Unit="mm")
CAL_AIR_TUBELEN = Simulink.Parameter(0.2, DataType="single", Min=0.01, Max=2, Unit="m")  % See the CAL_AIR_CMODEL explanation on how this parameter should be set.
CAL_MAG_ROT_AUTO = Simulink.Parameter(1, DataType="int32")  % During calibration attempt to automatically determine the rotation of external magnetometers.
CAL_MAG_SIDES = Simulink.Parameter(63, DataType="int32", Min=34, Max=63)  % If set to two side calibration, only the offsets are estimated, the scale calibration is left unchanged. Thus an initial six side calibration is recommended. Bits: ORIENTATION_TAIL_DOWN = 1 ORIENTATION_NOSE_DOWN = 2 ORIENTATION_LEFT = 4 ORIENTATION_RIGHT = 8 ORIENTATION_UPSIDE_DOWN = 16 ORIENTATION_RIGHTSIDE_UP = 32
IMU_ACCEL_CUTOFF = Simulink.Parameter(30, DataType="single", Min=0, Max=1000, Unit="Hz")  % The cutoff frequency for the 2nd order butterworth filter on the primary accelerometer. This only affects the signal sent to the controllers, not the estimators. 0 disables the filter.
IMU_DGYRO_CUTOFF = Simulink.Parameter(30, DataType="single", Min=0, Max=1000, Unit="Hz")  % The cutoff frequency for the 2nd order butterworth filter used on the time derivative of the measured angular velocity, also known as the D-term filter in the rate controller. The D-term uses the derivative of the rate and thus is the most susceptible to noise. Therefore, using a D-term filter allows to increase IMU_GYRO_CUTOFF, which leads to reduced control latency and permits to increase the P gains. A value of 0 disables the filter.
IMU_GYRO_CAL_EN = Simulink.Parameter(1, DataType="int32")
IMU_GYRO_CUTOFF = Simulink.Parameter(40, DataType="single", Min=0, Max=1000, Unit="Hz")  % The cutoff frequency for the 2nd order butterworth filter on the primary gyro. This only affects the angular velocity sent to the controllers, not the estimators. It applies also to the angular acceleration (D-Term filter), see IMU_DGYRO_CUTOFF. A value of 0 disables the filter.
IMU_GYRO_DYN_NF = Simulink.Parameter(0, DataType="int32", Min=0, Max=3)  % Enable bank of dynamically updating notch filters. Requires ESC RPM feedback or onboard FFT (IMU_GYRO_FFT_EN).
IMU_GYRO_FFT_EN = Simulink.Parameter(0, DataType="int32")
IMU_GYRO_FFT_LEN = Simulink.Parameter(512, DataType="int32", Unit="Hz")
IMU_GYRO_FFT_MAX = Simulink.Parameter(192, DataType="single", Min=1, Max=1000, Unit="Hz")
IMU_GYRO_FFT_MIN = Simulink.Parameter(32, DataType="single", Min=1, Max=1000, Unit="Hz")
IMU_GYRO_NF_BW = Simulink.Parameter(20, DataType="single", Min=0, Max=100, Unit="Hz")  % The frequency width of the stop band for the 2nd order notch filter on the primary gyro. See "IMU_GYRO_NF_FREQ" to activate the filter and to set the notch frequency. Applies to both angular velocity and angular acceleration sent to the controllers.
IMU_GYRO_NF_FREQ = Simulink.Parameter(0, DataType="single", Min=0, Max=1000, Unit="Hz")  % The center frequency for the 2nd order notch filter on the primary gyro. This filter can be enabled to avoid feedback amplification of structural resonances at a specific frequency. This only affects the signal sent to the controllers, not the estimators. Applies to both angular velocity and angular acceleration sent to the controllers. See "IMU_GYRO_NF_BW" to set the bandwidth of the filter. A value of 0 disables the filter.
IMU_GYRO_RATEMAX = Simulink.Parameter(400, DataType="int32", Min=100, Max=2000, Unit="Hz")  % The maximum rate the gyro control data (vehicle_angular_velocity) will be allowed to publish at. This is the loop rate for the rate controller and outputs. Note: sensor data is always read and filtered at the full raw rate (eg commonly 8 kHz) regardless of this setting.
IMU_INTEG_RATE = Simulink.Parameter(200, DataType="int32", Min=100, Max=1000, Unit="Hz")  % The rate at which raw IMU data is integrated to produce delta angles and delta velocities. Recommended to set this to a multiple of the estimator update period (currently 10 ms for ekf2).
INA226_CONFIG = Simulink.Parameter(18139, DataType="int32", Min=0, Max=65535)
INA226_CURRENT = Simulink.Parameter(164, DataType="single", Min=0.1, Max=200)
INA226_SHUNT = Simulink.Parameter(0.0005, DataType="single", Min=1.0e-9, Max=0.1)
PCF8583_ADDR = Simulink.Parameter(80, DataType="int32")
PCF8583_MAGNET = Simulink.Parameter(2, DataType="int32", Min=1)  % Nmumber of signals per rotation of actuator
PCF8583_POOL = Simulink.Parameter(1000000, DataType="int32", Unit="us")  % Determines how often the sensor is read out.
PCF8583_RESET = Simulink.Parameter(500000, DataType="int32")  % Internal device counter is reset to 0 when overun this value, counter is able to store upto 6 digits reset of counter takes some time - measurement with reset has worse accurancy. 0 means reset counter after every measurement.
SENS_BARO_QNH = Simulink.Parameter(1013.25, DataType="single", Min=500, Max=1500, Unit="hPa")
SENS_BARO_RATE = Simulink.Parameter(20, DataType="single", Min=1, Max=200, Unit="Hz")  % Barometric air data maximum publication rate. This is an upper bound, actual barometric data rate is still dependant on the sensor.
SENS_BOARD_ROT = Simulink.Parameter(0, DataType="int32", Min=-1, Max=40)  % This parameter defines the rotation of the FMU board relative to the platform.
SENS_BOARD_X_OFF = Simulink.Parameter(0, DataType="single", Unit="deg")  % This parameter defines a rotational offset in degrees around the X (Roll) axis It allows the user to fine tune the board offset in the event of misalignment.
SENS_BOARD_Y_OFF = Simulink.Parameter(0, DataType="single", Unit="deg")  % This parameter defines a rotational offset in degrees around the Y (Pitch) axis. It allows the user to fine tune the board offset in the event of misalignment.

SENS_BOARD_Z_OFF = Simulink.Parameter(0, DataType="single", Unit="deg")  % This parameter defines a rotational offset in degrees around the Z (Yaw) axis. It allows the user to fine tune the board offset in the event of misalignment.
SENS_CM8JL65_CFG = Simulink.Parameter(0, DataType="int32")  % Configure on which serial port to run Lanbao PSK-CM8JL65-CC5.
SENS_CM8JL65_R_0 = Simulink.Parameter(25, DataType="int32")  % Distance Sensor Rotation as MAV_SENSOR_ORIENTATION enum
SENS_EN_ADIS164X = Simulink.Parameter(0, DataType="int32", Min=0, Max=1)
SENS_EN_BATT = Simulink.Parameter(0, DataType="int32")
SENS_EN_ETSASPD = Simulink.Parameter(0, DataType="int32")
SENS_EN_INA226 = Simulink.Parameter(0, DataType="int32")  % For systems a INA226 Power Monitor, this should be set to true
SENS_EN_LL40LS = Simulink.Parameter(0, DataType="int32", Min=0, Max=2)
SENS_EN_MB12XX = Simulink.Parameter(0, DataType="int32")
SENS_EN_MPDT = Simulink.Parameter(0, DataType="int32", Min=0, Max=1)
SENS_EN_MS4525 = Simulink.Parameter(0, DataType="int32")
SENS_EN_MS5525 = Simulink.Parameter(0, DataType="int32")
SENS_EN_PAW3902 = Simulink.Parameter(0, DataType="int32")
SENS_EN_PGA460 = Simulink.Parameter(0, DataType="int32")
SENS_EN_PMW3901 = Simulink.Parameter(0, DataType="int32")
SENS_EN_PX4FLOW = Simulink.Parameter(0, DataType="int32")
SENS_EN_SDP3X = Simulink.Parameter(0, DataType="int32")
SENS_EN_SF0X = Simulink.Parameter(1, DataType="int32")
SENS_EN_SF1XX = Simulink.Parameter(0, DataType="int32", Min=0, Max=6)
SENS_EN_THERMAL = Simulink.Parameter(-1, DataType="int32")
SENS_EN_TRANGER = Simulink.Parameter(0, DataType="int32", Min=0, Max=3)
SENS_EN_VL53L1X = Simulink.Parameter(0, DataType="int32")
SENS_EXT_I2C_PRB = Simulink.Parameter(1, DataType="int32")  % Probe for optional external I2C devices.
SENS_FLOW_ROT = Simulink.Parameter(6, DataType="int32")  % This parameter defines the yaw rotation of the PX4FLOW board relative to the vehicle body frame. Zero rotation is defined as X on flow board pointing towards front of vehicle. The recommneded installation default for the PX4FLOW board is with the Y axis forward (270 deg yaw).
SENS_GPS_MASK = Simulink.Parameter(0, DataType="int32", Min=0, Max=7)  % Set bits in the following positions to set which GPS accuracy metrics will be used to calculate the blending weight. Set to zero to disable and always used first GPS instance. 0 : Set to true to use speed accuracy 1 : Set to true to use horizontal position accuracy 2 : Set to true to use vertical position accuracy
SENS_GPS_PRIME = Simulink.Parameter(0, DataType="int32", Min=-1, Max=1)  % When no blending is active, this defines the preferred GPS receiver instance. The GPS selection logic waits until the primary receiver is available to send data to the EKF even if a secondary instance is already available. The secondary instance is then only used if the primary one times out. To have an equal priority of all the instances, set this parameter to -1 and the best receiver will be used. This parameter has no effect if blending is active.
SENS_GPS_TAU = Simulink.Parameter(10, DataType="single", Min=1, Max=100, Unit="s")  % Sets the longest time constant that will be applied to the calculation of GPS position and height offsets used to correct data from multiple GPS data for steady state position differences.
SENS_IMU_MODE = Simulink.Parameter(1, DataType="int32")
SENS_IMU_TEMP = Simulink.Parameter(55, DataType="single", Min=0, Max=85, Unit="celcius")
SENS_IMU_TEMP_FF = Simulink.Parameter(0.05, DataType="single", Min=0, Max=1, Unit="%")
SENS_IMU_TEMP_I = Simulink.Parameter(0.025, DataType="single", Min=0, Max=1, Unit="us/C")
SENS_IMU_TEMP_P = Simulink.Parameter(1, DataType="single", Min=0, Max=2, Unit="us/C")
SENS_INT_BARO_EN = Simulink.Parameter(1, DataType="int32")  % For systems with an external barometer, this should be set to false to make sure that the external is used.
SENS_LEDDAR1_CFG = Simulink.Parameter(0, DataType="int32")  % Configure on which serial port to run LeddarOne Rangefinder.
SENS_MAG_MODE = Simulink.Parameter(1, DataType="int32")
SENS_MAG_RATE = Simulink.Parameter(50, DataType="single", Min=1, Max=200, Unit="Hz")  % Magnetometer data maximum publication rate. This is an upper bound, actual magnetometer data rate is still dependant on the sensor.
SENS_MB12_0_ROT = Simulink.Parameter(0, DataType="int32", Min=0, Max=7)  % This parameter defines the rotation of the sensor relative to the platform.
SENS_MB12_10_ROT = Simulink.Parameter(0, DataType="int32", Min=0, Max=7)  % This parameter defines the rotation of the sensor relative to the platform.
SENS_MB12_11_ROT = Simulink.Parameter(0, DataType="int32", Min=0, Max=7)  % This parameter defines the rotation of the sensor relative to the platform.
SENS_MB12_1_ROT = Simulink.Parameter(0, DataType="int32", Min=0, Max=7)  % This parameter defines the rotation of the sensor relative to the platform.
SENS_MB12_2_ROT = Simulink.Parameter(0, DataType="int32", Min=0, Max=7)  % This parameter defines the rotation of the sensor relative to the platform.
SENS_MB12_3_ROT = Simulink.Parameter(0, DataType="int32", Min=0, Max=7)  % This parameter defines the rotation of the sensor relative to the platform.
SENS_MB12_4_ROT = Simulink.Parameter(0, DataType="int32", Min=0, Max=7)  % This parameter defines the rotation of the sensor relative to the platform.
SENS_MB12_5_ROT = Simulink.Parameter(0, DataType="int32", Min=0, Max=7)  % This parameter defines the rotation of the sensor relative to the platform.
SENS_MB12_6_ROT = Simulink.Parameter(0, DataType="int32", Min=0, Max=7)  % This parameter defines the rotation of the sensor relative to the platform.
SENS_MB12_7_ROT = Simulink.Parameter(0, DataType="int32", Min=0, Max=7)  % This parameter defines the rotation of the sensor relative to the platform.
SENS_MB12_8_ROT = Simulink.Parameter(0, DataType="int32", Min=0, Max=7)  % This parameter defines the rotation of the sensor relative to the platform.
SENS_MB12_9_ROT = Simulink.Parameter(0, DataType="int32", Min=0, Max=7)  % This parameter defines the rotation of the sensor relative to the platform.
SENS_MPDT0_ROT = Simulink.Parameter(0, DataType="int32", Min=0, Max=7)  % This parameter defines the rotation of the Mappydot sensor relative to the platform.
SENS_MPDT10_ROT = Simulink.Parameter(0, DataType="int32", Min=0, Max=7)  % This parameter defines the rotation of the Mappydot sensor relative to the platform.
SENS_MPDT11_ROT = Simulink.Parameter(0, DataType="int32", Min=0, Max=7)  % This parameter defines the rotation of the Mappydot sensor relative to the platform.
SENS_MPDT1_ROT = Simulink.Parameter(0, DataType="int32", Min=0, Max=7)  % This parameter defines the rotation of the Mappydot sensor relative to the platform.
SENS_MPDT2_ROT = Simulink.Parameter(0, DataType="int32", Min=0, Max=7)  % This parameter defines the rotation of the Mappydot sensor relative to the platform.
SENS_MPDT3_ROT = Simulink.Parameter(0, DataType="int32", Min=0, Max=7)  % This parameter defines the rotation of the Mappydot sensor relative to the platform.
SENS_MPDT4_ROT = Simulink.Parameter(0, DataType="int32", Min=0, Max=7)  % This parameter defines the rotation of the Mappydot sensor relative to the platform.
SENS_MPDT5_ROT = Simulink.Parameter(0, DataType="int32", Min=0, Max=7)  % This parameter defines the rotation of the Mappydot sensor relative to the platform.
SENS_MPDT6_ROT = Simulink.Parameter(0, DataType="int32", Min=0, Max=7)  % This parameter defines the rotation of the Mappydot sensor relative to the platform.
SENS_MPDT7_ROT = Simulink.Parameter(0, DataType="int32", Min=0, Max=7)  % This parameter defines the rotation of the Mappydot sensor relative to the platform.
SENS_MPDT8_ROT = Simulink.Parameter(0, DataType="int32", Min=0, Max=7)  % This parameter defines the rotation of the Mappydot sensor relative to the platform.
SENS_MPDT9_ROT = Simulink.Parameter(0, DataType="int32", Min=0, Max=7)  % This parameter defines the rotation of the Mappydot sensor relative to the platform.
SENS_OR_ADIS164X = Simulink.Parameter(0, DataType="int32", Min=0, Max=101)
SENS_SF0X_CFG = Simulink.Parameter(0, DataType="int32")  % Configure on which serial port to run Lightware Laser Rangefinder (serial).
SENS_TEMP_ID = Simulink.Parameter(0, DataType="int32")
SENS_TFLOW_CFG = Simulink.Parameter(0, DataType="int32")  % Configure on which serial port to run ThoneFlow-3901U optical flow sensor.
SENS_TFMINI_CFG = Simulink.Parameter(0, DataType="int32")  % Configure on which serial port to run Benewake TFmini Rangefinder.
SENS_ULAND_CFG = Simulink.Parameter(0, DataType="int32")  % Configure on which serial port to run uLanding Radar.
SER_GPS1_BAUD = Simulink.Parameter(0, DataType="int32")  % Configure the Baudrate for the GPS 1 Serial Port. Note: certain drivers such as the GPS can determine the Baudrate automatically.
SER_TEL1_BAUD = Simulink.Parameter(57600, DataType="int32")  % Configure the Baudrate for the TELEM 1 Serial Port. Note: certain drivers such as the GPS can determine the Baudrate automatically.
SER_TEL2_BAUD = Simulink.Parameter(921600, DataType="int32")  % Configure the Baudrate for the TELEM 2 Serial Port. Note: certain drivers such as the GPS can determine the Baudrate automatically.
SER_TEL4_BAUD = Simulink.Parameter(57600, DataType="int32")  % Configure the Baudrate for the TELEM/SERIAL 4 Serial Port. Note: certain drivers such as the GPS can determine the Baudrate automatically.
SIH_BARO_OFFSET = Simulink.Parameter(0, DataType="single", Unit="m")  % Absolute value superior to 10000 will disable barometer
SIH_DISTSNSR_MAX = Simulink.Parameter(100, DataType="single", Min=0, Max=1000, Unit="m")
SIH_DISTSNSR_MIN = Simulink.Parameter(0, DataType="single", Min=0, Max=10, Unit="m")
SIH_DISTSNSR_OVR = Simulink.Parameter(-1, DataType="single", Unit="m")  % Absolute value superior to 10000 will disable distance sensor
SIH_GPS_USED = Simulink.Parameter(10, DataType="int32", Min=0, Max=50)
SIH_IXX = Simulink.Parameter(0.025, DataType="single", Min=0)  % The intertia is a 3 by 3 symmetric matrix. It represents the difficulty of the vehicle to modify its angular rate.
SIH_IXY = Simulink.Parameter(0, DataType="single")  % The intertia is a 3 by 3 symmetric matrix. This value can be set to 0 for a quad symmetric about its center of mass.
SIH_IXZ = Simulink.Parameter(0, DataType="single")  % The intertia is a 3 by 3 symmetric matrix. This value can be set to 0 for a quad symmetric about its center of mass.
SIH_IYY = Simulink.Parameter(0.025, DataType="single", Min=0)  % The intertia is a 3 by 3 symmetric matrix. It represents the difficulty of the vehicle to modify its angular rate.
SIH_IYZ = Simulink.Parameter(0, DataType="single")  % The intertia is a 3 by 3 symmetric matrix. This value can be set to 0 for a quad symmetric about its center of mass.
SIH_IZZ = Simulink.Parameter(0.03, DataType="single", Min=0)  % The intertia is a 3 by 3 symmetric matrix. It represents the difficulty of the vehicle to modify its angular rate.
SIH_KDV = Simulink.Parameter(1, DataType="single", Min=0, Unit="N/(m/s)")  % Physical coefficient representing the friction with air particules. The greater this value, the slower the quad will move. Drag force function of velocity: D=-KDV*V. The maximum freefall velocity can be computed as V=10*MASS/KDV [m/s]
SIH_KDW = Simulink.Parameter(0.025, DataType="single", Min=0, Unit="Nm/(rad/s)")  % Physical coefficient representing the friction with air particules during rotations. The greater this value, the slower the quad will rotate. Aerodynamic moment function of body rate: Ma=-KDW*W_B. This value can be set to 0 if unknown.
SIH_LOC_H0 = Simulink.Parameter(32.34, DataType="single", Min=-420, Max=8848, Unit="m")  % This value represents the Above Mean Sea Level (AMSL) altitude where the simulation begins. If using FlightGear as a visual animation, this value can be tweaked such that the vehicle lies on the ground at takeoff. LAT0, LON0, H0, MU_X, MU_Y, and MU_Z should ideally be consistent among each others to represent a physical ground location on Earth.
SIH_LOC_LAT0 = Simulink.Parameter(454671160, DataType="int32", Min=-850000000, Max=850000000, Unit="deg*1e7")  % This value represents the North-South location on Earth where the simulation begins. A value of 45 deg should be written 450000000. LAT0, LON0, H0, MU_X, MU_Y, and MU_Z should ideally be consistent among each others to represent a physical ground location on Earth.
SIH_LOC_LON0 = Simulink.Parameter(-737578370, DataType="int32", Min=-1800000000, Max=1800000000, Unit="deg*1e7")  % This value represents the East-West location on Earth where the simulation begins. A value of 45 deg should be written 450000000. LAT0, LON0, H0, MU_X, MU_Y, and MU_Z should ideally be consistent among each others to represent a physical ground location on Earth.
SIH_LOC_MU_X = Simulink.Parameter(0.179, DataType="single", Min=-1, Max=1, Unit="gauss")  % This value represents the North magnetic field at the initial location. A magnetic field calculator can be found on the NOAA website Note, the values need to be converted from nano Tesla to Gauss LAT0, LON0, H0, MU_X, MU_Y, and MU_Z should ideally be consistent among each others to represent a physical ground location on Earth.
SIH_LOC_MU_Y = Simulink.Parameter(-0.045, DataType="single", Min=-1, Max=1, Unit="gauss")  % This value represents the East magnetic field at the initial location. A magnetic field calculator can be found on the NOAA website Note, the values need to be converted from nano Tesla to Gauss LAT0, LON0, H0, MU_X, MU_Y, and MU_Z should ideally be consistent among each others to represent a physical ground location on Earth.
SIH_LOC_MU_Z = Simulink.Parameter(0.504, DataType="single", Min=-1, Max=1, Unit="gauss")  % This value represents the Down magnetic field at the initial location. A magnetic field calculator can be found on the NOAA website Note, the values need to be converted from nano Tesla to Gauss LAT0, LON0, H0, MU_X, MU_Y, and MU_Z should ideally be consistent among each others to represent a physical ground location on Earth.
SIH_L_PITCH = Simulink.Parameter(0.2, DataType="single", Min=0, Unit="m")  % This is the arm length generating the pitching moment This value can be measured with a ruler. This corresponds to half the distance between the front and rear motors.
SIH_L_ROLL = Simulink.Parameter(0.2, DataType="single", Min=0, Unit="m")  % This is the arm length generating the rolling moment This value can be measured with a ruler. This corresponds to half the distance between the left and right motors.
SIH_MAG_OFFSET_X = Simulink.Parameter(0, DataType="single", Unit="gauss")  % Absolute value superior to 10000 will disable magnetometer
SIH_MAG_OFFSET_Y = Simulink.Parameter(0, DataType="single", Unit="gauss")  % Absolute value superior to 10000 will disable magnetometer
SIH_MAG_OFFSET_Z = Simulink.Parameter(0, DataType="single", Unit="gauss")  % Absolute value superior to 10000 will disable magnetometer
SIH_MASS = Simulink.Parameter(1, DataType="single", Min=0, Unit="kg")  % This value can be measured by weighting the quad on a scale.
SIH_Q_MAX = Simulink.Parameter(0.1, DataType="single", Min=0, Unit="Nm")  % This is the maximum torque delivered by one propeller when the motor is running at full speed. This value is usually about few percent of the maximum thrust force.
SIH_T_MAX = Simulink.Parameter(5, DataType="single", Min=0, Unit="N")  % This is the maximum force delivered by one propeller when the motor is running at full speed. This value is usually about 5 times the mass of the quadrotor.
SIH_T_TAU = Simulink.Parameter(0.05, DataType="single", Unit="s")  % the time taken for the thruster to step from 0 to 100% should be about 4 times tau
SIH_VEHICLE_TYPE = Simulink.Parameter(0, DataType="int32")
LED_RGB1_MAXBRT = Simulink.Parameter(31, DataType="int32", Min=0, Max=31)  % Set to 0 to disable, 1 for minimum brightness up to 31 (max)
LED_RGB_MAXBRT = Simulink.Parameter(15, DataType="int32", Min=0, Max=15)  % Set to 0 to disable, 1 for minimum brightness up to 15 (max)
SYS_AUTOCONFIG = Simulink.Parameter(0, DataType="int32")  % Set to 1 to reset parameters on next system startup (setting defaults). Platform-specific values are used if available. RC* parameters are preserved.
SYS_AUTOSTART = Simulink.Parameter(0, DataType="int32", Min=0, Max=9999999)  % CHANGING THIS VALUE REQUIRES A RESTART. Defines the auto-start script used to bootstrap the system.
SYS_BL_UPDATE = Simulink.Parameter(0, DataType="int32")  % If enabled, update the bootloader on the next boot. WARNING: do not cut the power during an update process, otherwise you will have to recover using some alternative method (e.g. JTAG). Instructions: - Insert an SD card - Enable this parameter - Reboot the board (plug the power or send a reboot command) - Wait until the board comes back up (or at least 2 minutes) - If it does not come back, check the file bootlog.txt on the SD card
SYS_CAL_ACCEL = Simulink.Parameter(0, DataType="int32", Min=0, Max=1)  % 0 : Set to 0 to do nothing 1 : Set to 1 to start a calibration at next boot This parameter is reset to zero when the temperature calibration starts. default (0, no calibration)
SYS_CAL_BARO = Simulink.Parameter(0, DataType="int32", Min=0, Max=1)  % 0 : Set to 0 to do nothing 1 : Set to 1 to start a calibration at next boot This parameter is reset to zero when the temperature calibration starts. default (0, no calibration)
SYS_CAL_GYRO = Simulink.Parameter(0, DataType="int32", Min=0, Max=1)  % 0 : Set to 0 to do nothing 1 : Set to 1 to start a calibration at next boot This parameter is reset to zero when the temperature calibration starts. default (0, no calibration)
SYS_CAL_TDEL = Simulink.Parameter(24, DataType="int32", Min=10, Unit="celcius")  % A temperature increase greater than this value is required during calibration. Calibration will complete for each sensor when the temperature increase above the starting temeprature exceeds the value set by SYS_CAL_TDEL. If the temperature rise is insufficient, the calibration will continue indefinitely and the board will need to be repowered to exit.
SYS_CAL_TMAX = Simulink.Parameter(10, DataType="int32", Unit="celcius")  % Temperature calibration will not start if the temperature of any sensor is higher than the value set by SYS_CAL_TMAX.
SYS_CAL_TMIN = Simulink.Parameter(5, DataType="int32", Unit="celcius")  % Temperature calibration for each sensor will ignore data if the temperature is lower than the value set by SYS_CAL_TMIN.
SYS_FAC_CAL_MODE = Simulink.Parameter(0, DataType="int32")  % If enabled, future sensor calibrations will be stored to /fs/mtd_caldata. Note: this is only supported on boards with a separate calibration storage /fs/mtd_caldata.
SYS_FAILURE_EN = Simulink.Parameter(0, DataType="int32")  % If enabled allows MAVLink INJECT_FAILURE commands. WARNING: the failures can easily cause crashes and are to be used with caution!
SYS_HAS_BARO = Simulink.Parameter(1, DataType="int32")  % Disable this if the board has no barometer, such as some of the Omnibus F4 SD variants. If disabled, the preflight checks will not check for the presence of a barometer.
SYS_HAS_GPS = Simulink.Parameter(1, DataType="int32")  % Disable this if the system has no GPS. If disabled, the sensors hub will not process sensor_gps, and GPS will not be available for the rest of the system.
SYS_HAS_MAG = Simulink.Parameter(1, DataType="int32")  % Disable this if the board has no magnetometer, such as the Omnibus F4 SD. If disabled, the preflight checks will not check for the presence of a magnetometer.
SYS_HITL = Simulink.Parameter(0, DataType="int32")  % While enabled the system will boot in Hardware-In-The-Loop (HITL) or Simulation-In-Hardware (SIH) mode and not enable all sensors and checks. When disabled the same vehicle can be flown normally. Set to 'external HITL', if the system should perform as if it were a real vehicle (the only difference to a real system is then only the parameter value, which can be used for log analysis).
SYS_MC_EST_GROUP = Simulink.Parameter(2, DataType="int32")  % Set the group of estimators used for multicopters and VTOLs
SYS_RESTART_TYPE = Simulink.Parameter(2, DataType="int32", Min=0, Max=2)  % Set by px4io to indicate type of restart
SYS_STCK_EN = Simulink.Parameter(1, DataType="int32")
SYS_USE_IO = Simulink.Parameter(1, DataType="int32", Min=0, Max=1)  % Can be used to use a standard startup script but with a FMU only set-up. Set to 0 to force the FMU only set-up.
TEL_BST_EN = Simulink.Parameter(0, DataType="int32")  % If true, the FMU will try to connect to Blacksheep telemetry on start up
TEL_FRSKY_CONFIG = Simulink.Parameter(0, DataType="int32")  % Configure on which serial port to run FrSky Telemetry.
TEL_HOTT_CONFIG = Simulink.Parameter(0, DataType="int32")  % Configure on which serial port to run HoTT Telemetry.
TC_A0_ID = Simulink.Parameter(0, DataType="int32")
TC_A0_TMAX = Simulink.Parameter(100, DataType="single")
TC_A0_TMIN = Simulink.Parameter(0, DataType="single")
TC_A0_TREF = Simulink.Parameter(25, DataType="single")
TC_A0_X0_0 = Simulink.Parameter(0, DataType="single")
TC_A0_X0_1 = Simulink.Parameter(0, DataType="single")
TC_A0_X0_2 = Simulink.Parameter(0, DataType="single")
TC_A0_X1_0 = Simulink.Parameter(0, DataType="single")
TC_A0_X1_1 = Simulink.Parameter(0, DataType="single")
TC_A0_X1_2 = Simulink.Parameter(0, DataType="single")
TC_A0_X2_0 = Simulink.Parameter(0, DataType="single")
TC_A0_X2_1 = Simulink.Parameter(0, DataType="single")
TC_A0_X2_2 = Simulink.Parameter(0, DataType="single")
TC_A0_X3_0 = Simulink.Parameter(0, DataType="single")
TC_A0_X3_1 = Simulink.Parameter(0, DataType="single")
TC_A0_X3_2 = Simulink.Parameter(0, DataType="single")
TC_A1_ID = Simulink.Parameter(0, DataType="int32")
TC_A1_TMAX = Simulink.Parameter(100, DataType="single")
TC_A1_TMIN = Simulink.Parameter(0, DataType="single")
TC_A1_TREF = Simulink.Parameter(25, DataType="single")
TC_A1_X0_0 = Simulink.Parameter(0, DataType="single")
TC_A1_X0_1 = Simulink.Parameter(0, DataType="single")
TC_A1_X0_2 = Simulink.Parameter(0, DataType="single")
TC_A1_X1_0 = Simulink.Parameter(0, DataType="single")
TC_A1_X1_1 = Simulink.Parameter(0, DataType="single")
TC_A1_X1_2 = Simulink.Parameter(0, DataType="single")
TC_A1_X2_0 = Simulink.Parameter(0, DataType="single")
TC_A1_X2_1 = Simulink.Parameter(0, DataType="single")
TC_A1_X2_2 = Simulink.Parameter(0, DataType="single")
TC_A1_X3_0 = Simulink.Parameter(0, DataType="single")
TC_A1_X3_1 = Simulink.Parameter(0, DataType="single")
TC_A1_X3_2 = Simulink.Parameter(0, DataType="single")
TC_A2_ID = Simulink.Parameter(0, DataType="int32")
TC_A2_TMAX = Simulink.Parameter(100, DataType="single")
TC_A2_TMIN = Simulink.Parameter(0, DataType="single")
TC_A2_TREF = Simulink.Parameter(25, DataType="single")
TC_A2_X0_0 = Simulink.Parameter(0, DataType="single")
TC_A2_X0_1 = Simulink.Parameter(0, DataType="single")
TC_A2_X0_2 = Simulink.Parameter(0, DataType="single")
TC_A2_X1_0 = Simulink.Parameter(0, DataType="single")
TC_A2_X1_1 = Simulink.Parameter(0, DataType="single")
TC_A2_X1_2 = Simulink.Parameter(0, DataType="single")
TC_A2_X2_0 = Simulink.Parameter(0, DataType="single")
TC_A2_X2_1 = Simulink.Parameter(0, DataType="single")
TC_A2_X2_2 = Simulink.Parameter(0, DataType="single")
TC_A2_X3_0 = Simulink.Parameter(0, DataType="single")
TC_A2_X3_1 = Simulink.Parameter(0, DataType="single")
TC_A2_X3_2 = Simulink.Parameter(0, DataType="single")
TC_A3_ID = Simulink.Parameter(0, DataType="int32")
TC_A3_TMAX = Simulink.Parameter(100, DataType="single")
TC_A3_TMIN = Simulink.Parameter(0, DataType="single")
TC_A3_TREF = Simulink.Parameter(25, DataType="single")
TC_A3_X0_0 = Simulink.Parameter(0, DataType="single")
TC_A3_X0_1 = Simulink.Parameter(0, DataType="single")
TC_A3_X0_2 = Simulink.Parameter(0, DataType="single")
TC_A3_X1_0 = Simulink.Parameter(0, DataType="single")
TC_A3_X1_1 = Simulink.Parameter(0, DataType="single")
TC_A3_X1_2 = Simulink.Parameter(0, DataType="single")
TC_A3_X2_0 = Simulink.Parameter(0, DataType="single")
TC_A3_X2_1 = Simulink.Parameter(0, DataType="single")
TC_A3_X2_2 = Simulink.Parameter(0, DataType="single")
TC_A3_X3_0 = Simulink.Parameter(0, DataType="single")
TC_A3_X3_1 = Simulink.Parameter(0, DataType="single")
TC_A3_X3_2 = Simulink.Parameter(0, DataType="single")
TC_A_ENABLE = Simulink.Parameter(0, DataType="int32")
TC_B0_ID = Simulink.Parameter(0, DataType="int32")
TC_B0_TMAX = Simulink.Parameter(75, DataType="single")
TC_B0_TMIN = Simulink.Parameter(5, DataType="single")
TC_B0_TREF = Simulink.Parameter(40, DataType="single")
TC_B0_X0 = Simulink.Parameter(0, DataType="single")
TC_B0_X1 = Simulink.Parameter(0, DataType="single")
TC_B0_X2 = Simulink.Parameter(0, DataType="single")
TC_B0_X3 = Simulink.Parameter(0, DataType="single")
TC_B0_X4 = Simulink.Parameter(0, DataType="single")
TC_B0_X5 = Simulink.Parameter(0, DataType="single")
TC_B1_ID = Simulink.Parameter(0, DataType="int32")
TC_B1_TMAX = Simulink.Parameter(75, DataType="single")

TC_B1_TMIN = Simulink.Parameter(5, DataType="single")
TC_B1_TREF = Simulink.Parameter(40, DataType="single")
TC_B1_X0 = Simulink.Parameter(0, DataType="single")
TC_B1_X1 = Simulink.Parameter(0, DataType="single")
TC_B1_X2 = Simulink.Parameter(0, DataType="single")
TC_B1_X3 = Simulink.Parameter(0, DataType="single")
TC_B1_X4 = Simulink.Parameter(0, DataType="single")
TC_B1_X5 = Simulink.Parameter(0, DataType="single")
TC_B2_ID = Simulink.Parameter(0, DataType="int32")
TC_B2_TMAX = Simulink.Parameter(75, DataType="single")
TC_B2_TMIN = Simulink.Parameter(5, DataType="single")
TC_B2_TREF = Simulink.Parameter(40, DataType="single")
TC_B2_X0 = Simulink.Parameter(0, DataType="single")
TC_B2_X1 = Simulink.Parameter(0, DataType="single")
TC_B2_X2 = Simulink.Parameter(0, DataType="single")
TC_B2_X3 = Simulink.Parameter(0, DataType="single")
TC_B2_X4 = Simulink.Parameter(0, DataType="single")
TC_B2_X5 = Simulink.Parameter(0, DataType="single")
TC_B3_ID = Simulink.Parameter(0, DataType="int32")
TC_B3_TMAX = Simulink.Parameter(75, DataType="single")
TC_B3_TMIN = Simulink.Parameter(5, DataType="single")
TC_B3_TREF = Simulink.Parameter(40, DataType="single")
TC_B3_X0 = Simulink.Parameter(0, DataType="single")
TC_B3_X1 = Simulink.Parameter(0, DataType="single")
TC_B3_X2 = Simulink.Parameter(0, DataType="single")
TC_B3_X3 = Simulink.Parameter(0, DataType="single")
TC_B3_X4 = Simulink.Parameter(0, DataType="single")
TC_B3_X5 = Simulink.Parameter(0, DataType="single")
TC_B_ENABLE = Simulink.Parameter(0, DataType="int32")
TC_G0_ID = Simulink.Parameter(0, DataType="int32")
TC_G0_TMAX = Simulink.Parameter(100, DataType="single")
TC_G0_TMIN = Simulink.Parameter(0, DataType="single")
TC_G0_TREF = Simulink.Parameter(25, DataType="single")
TC_G0_X0_0 = Simulink.Parameter(0, DataType="single")
TC_G0_X0_1 = Simulink.Parameter(0, DataType="single")
TC_G0_X0_2 = Simulink.Parameter(0, DataType="single")
TC_G0_X1_0 = Simulink.Parameter(0, DataType="single")
TC_G0_X1_1 = Simulink.Parameter(0, DataType="single")
TC_G0_X1_2 = Simulink.Parameter(0, DataType="single")
TC_G0_X2_0 = Simulink.Parameter(0, DataType="single")
TC_G0_X2_1 = Simulink.Parameter(0, DataType="single")
TC_G0_X2_2 = Simulink.Parameter(0, DataType="single")
TC_G0_X3_0 = Simulink.Parameter(0, DataType="single")
TC_G0_X3_1 = Simulink.Parameter(0, DataType="single")
TC_G0_X3_2 = Simulink.Parameter(0, DataType="single")
TC_G1_ID = Simulink.Parameter(0, DataType="int32")
TC_G1_TMAX = Simulink.Parameter(100, DataType="single")
TC_G1_TMIN = Simulink.Parameter(0, DataType="single")
TC_G1_TREF = Simulink.Parameter(25, DataType="single")
TC_G1_X0_0 = Simulink.Parameter(0, DataType="single")
TC_G1_X0_1 = Simulink.Parameter(0, DataType="single")
TC_G1_X0_2 = Simulink.Parameter(0, DataType="single")
TC_G1_X1_0 = Simulink.Parameter(0, DataType="single")
TC_G1_X1_1 = Simulink.Parameter(0, DataType="single")
TC_G1_X1_2 = Simulink.Parameter(0, DataType="single")
TC_G1_X2_0 = Simulink.Parameter(0, DataType="single")
TC_G1_X2_1 = Simulink.Parameter(0, DataType="single")
TC_G1_X2_2 = Simulink.Parameter(0, DataType="single")
TC_G1_X3_0 = Simulink.Parameter(0, DataType="single")
TC_G1_X3_1 = Simulink.Parameter(0, DataType="single")
TC_G1_X3_2 = Simulink.Parameter(0, DataType="single")
TC_G2_ID = Simulink.Parameter(0, DataType="int32")
TC_G2_TMAX = Simulink.Parameter(100, DataType="single")
TC_G2_TMIN = Simulink.Parameter(0, DataType="single")
TC_G2_TREF = Simulink.Parameter(25, DataType="single")
TC_G2_X0_0 = Simulink.Parameter(0, DataType="single")
TC_G2_X0_1 = Simulink.Parameter(0, DataType="single")
TC_G2_X0_2 = Simulink.Parameter(0, DataType="single")
TC_G2_X1_0 = Simulink.Parameter(0, DataType="single")
TC_G2_X1_1 = Simulink.Parameter(0, DataType="single")
TC_G2_X1_2 = Simulink.Parameter(0, DataType="single")
TC_G2_X2_0 = Simulink.Parameter(0, DataType="single")
TC_G2_X2_1 = Simulink.Parameter(0, DataType="single")
TC_G2_X2_2 = Simulink.Parameter(0, DataType="single")
TC_G2_X3_0 = Simulink.Parameter(0, DataType="single")
TC_G2_X3_1 = Simulink.Parameter(0, DataType="single")
TC_G2_X3_2 = Simulink.Parameter(0, DataType="single")
TC_G3_ID = Simulink.Parameter(0, DataType="int32")
TC_G3_TMAX = Simulink.Parameter(100, DataType="single")
TC_G3_TMIN = Simulink.Parameter(0, DataType="single")
TC_G3_TREF = Simulink.Parameter(25, DataType="single")
TC_G3_X0_0 = Simulink.Parameter(0, DataType="single")
TC_G3_X0_1 = Simulink.Parameter(0, DataType="single")
TC_G3_X0_2 = Simulink.Parameter(0, DataType="single")
TC_G3_X1_0 = Simulink.Parameter(0, DataType="single")
TC_G3_X1_1 = Simulink.Parameter(0, DataType="single")
TC_G3_X1_2 = Simulink.Parameter(0, DataType="single")
TC_G3_X2_0 = Simulink.Parameter(0, DataType="single")
TC_G3_X2_1 = Simulink.Parameter(0, DataType="single")
TC_G3_X2_2 = Simulink.Parameter(0, DataType="single")
TC_G3_X3_0 = Simulink.Parameter(0, DataType="single")
TC_G3_X3_1 = Simulink.Parameter(0, DataType="single")
TC_G3_X3_2 = Simulink.Parameter(0, DataType="single")
TC_G_ENABLE = Simulink.Parameter(0, DataType="int32")
UAVCAN_BAT_MON = Simulink.Parameter(0, DataType="int32", Min=0, Max=1)  % This parameter defines that the system will select the battery monitor under the following conditions 0 - default battery monitor 1 - CUAV battery monitor
UAVCAN_BITRATE = Simulink.Parameter(1000000, DataType="int32", Min=20000, Max=1000000, Unit="bit/s")
UAVCAN_ENABLE = Simulink.Parameter(0, DataType="int32", Min=0, Max=3)  % 0 - UAVCAN disabled. 1 - Enables support for UAVCAN sensors without dynamic node ID allocation and firmware update. 2 - Enables support for UAVCAN sensors with dynamic node ID allocation and firmware update. 3 - Enables support for UAVCAN sensors and actuators with dynamic node ID allocation and firmware update. Also sets the motor control outputs to UAVCAN.
UAVCAN_ESC_IDLT = Simulink.Parameter(1, DataType="int32")
UAVCAN_LGT_ANTCL = Simulink.Parameter(2, DataType="int32", Min=0, Max=3)  % This parameter defines the minimum condition under which the system will command the ANTI_COLLISION lights on 0 - Always off 1 - When autopilot is armed 2 - When autopilot is prearmed 3 - Always on
UAVCAN_LGT_LAND = Simulink.Parameter(0, DataType="int32", Min=0, Max=3)  % This parameter defines the minimum condition under which the system will command the LIGHT_ID_LANDING lights on 0 - Always off 1 - When autopilot is armed 2 - When autopilot is prearmed 3 - Always on
UAVCAN_LGT_NAV = Simulink.Parameter(3, DataType="int32", Min=0, Max=3)  % This parameter defines the minimum condition under which the system will command the RIGHT_OF_WAY lights on 0 - Always off 1 - When autopilot is armed 2 - When autopilot is prearmed 3 - Always on
UAVCAN_LGT_STROB = Simulink.Parameter(1, DataType="int32", Min=0, Max=3)  % This parameter defines the minimum condition under which the system will command the STROBE lights on 0 - Always off 1 - When autopilot is armed 2 - When autopilot is prearmed 3 - Always on
UAVCAN_NODE_ID = Simulink.Parameter(1, DataType="int32", Min=1, Max=125)  % Read the specs at http://uavcan.org to learn more about Node ID.
UAVCAN_RNG_MAX = Simulink.Parameter(200, DataType="single", Unit="m")  % This parameter defines the maximum valid range for a rangefinder connected via UAVCAN.
UAVCAN_RNG_MIN = Simulink.Parameter(0.3, DataType="single", Unit="m")  % This parameter defines the minimum valid range for a rangefinder connected via UAVCAN.
UUV_DIRCT_PITCH = Simulink.Parameter(0, DataType="single")
UUV_DIRCT_ROLL = Simulink.Parameter(0, DataType="single")
UUV_DIRCT_THRUST = Simulink.Parameter(0, DataType="single")
UUV_DIRCT_YAW = Simulink.Parameter(0, DataType="single")
UUV_INPUT_MODE = Simulink.Parameter(0, DataType="int32")
UUV_PITCH_D = Simulink.Parameter(2, DataType="single")
UUV_PITCH_P = Simulink.Parameter(4, DataType="single")
UUV_ROLL_D = Simulink.Parameter(1.5, DataType="single")
UUV_ROLL_P = Simulink.Parameter(4, DataType="single")
UUV_YAW_D = Simulink.Parameter(2, DataType="single")
UUV_YAW_P = Simulink.Parameter(4, DataType="single")
UUV_GAIN_X_D = Simulink.Parameter(0.2, DataType="single")
UUV_GAIN_X_P = Simulink.Parameter(1, DataType="single")
UUV_GAIN_Y_D = Simulink.Parameter(0.2, DataType="single")
UUV_GAIN_Y_P = Simulink.Parameter(1, DataType="single")
UUV_GAIN_Z_D = Simulink.Parameter(0.2, DataType="single")
UUV_GAIN_Z_P = Simulink.Parameter(1, DataType="single")
UUV_STAB_MODE = Simulink.Parameter(1, DataType="int32")
VT_ARSP_BLEND = Simulink.Parameter(8, DataType="single", Min=0, Max=30, Unit="m/s")  % Airspeed at which we can start blending both fw and mc controls. Set to 0 to disable.
VT_ARSP_TRANS = Simulink.Parameter(10, DataType="single", Min=0, Max=30, Unit="m/s")  % Airspeed at which we can switch to fw mode
VT_B_DEC_FF = Simulink.Parameter(0.12, DataType="single", Min=0, Max=0.2)
VT_B_DEC_I = Simulink.Parameter(0.1, DataType="single", Min=0, Max=0.3)
VT_B_DEC_MSS = Simulink.Parameter(2, DataType="single", Min=0.5, Max=10, Unit="m/s^2")  % The approximate deceleration during a back transition in m/s/s Used to calculate back transition distance in mission mode. A lower value will make the VTOL transition further from the destination waypoint. For standard vtol and tiltrotors a controller is used to track this value during the transition.
VT_B_REV_DEL = Simulink.Parameter(0, DataType="single", Min=0, Max=10)  % Set this to a value greater than 0 to give the motor time to spin down. unit s
VT_B_REV_OUT = Simulink.Parameter(0, DataType="single", Min=0, Max=1)  % Used for airbrakes or with ESCs that have reverse thrust enabled on a seperate channel Airbrakes need to be enables for your selected model/mixer
VT_B_TRANS_DUR = Simulink.Parameter(4, DataType="single", Min=0, Max=20, Unit="s")  % Time in seconds used for a back transition
VT_B_TRANS_RAMP = Simulink.Parameter(3, DataType="single", Min=0, Max=20, Unit="s")  % This sets the duration during which the MC motors ramp up to the commanded thrust during the back transition stage.
VT_B_TRANS_THR = Simulink.Parameter(0, DataType="single", Min=-1, Max=1)  % standard vtol: pusher tailsitter, tiltrotor: main throttle Note for standard vtol: For ESCs and mixers that support reverse thrust on low PWM values set this to a negative value to apply active breaking For ESCs that support thrust reversal with a control channel please set VT_B_REV_OUT and set this to a positive value to apply active breaking
VT_DWN_PITCH_MAX = Simulink.Parameter(5, DataType="single", Min=0, Max=45)  % When fixed-wing forward actuation is active (see VT_FW_TRHUST_EN). If demanded down pitch exceeds this limmit, the fixed-wing forward actuators are used instead.
VT_ELEV_MC_LOCK = Simulink.Parameter(1, DataType="int32")  % If set to 1 the elevons are locked in multicopter mode
VT_FWD_THRUST_EN = Simulink.Parameter(0, DataType="int32")  % This technique can be used to avoid the plane having to pitch down in order to move forward. This prevents large, negative lift values being created when facing strong winds. Fixed-wing forward actuators refers to puller/pusher (standard VTOL), or forward-tilt (tiltrotor VTOL). Only active if demaded down pitch is above VT_DWN_PITCH_MAX, and uses VT_FWD_THRUST_SC to get from demanded down pitch to fixed-wing actuation.
VT_FWD_THRUST_SC = Simulink.Parameter(0.7, DataType="single", Min=0, Max=2)  % Scale applied to the demanded down-pitch to get the fixed-wing forward actuation in hover mode. Only active if demaded down pitch is above VT_DWN_PITCH_MAX. Enabled via VT_FWD_THRUST_EN.
VT_FW_ALT_ERR = Simulink.Parameter(0, DataType="single", Min=0, Max=200)  % Maximum negative altitude error for fixed wing flight. If the altitude drops below this value below the altitude setpoint the vehicle will transition back to MC mode and enter failsafe RTL.
VT_FW_DIFTHR_EN = Simulink.Parameter(0, DataType="int32", Min=0, Max=1)  % Set to 1 to enable differential thrust in fixed-wing flight.
VT_FW_DIFTHR_SC = Simulink.Parameter(0.1, DataType="single", Min=0, Max=1)  % This factor specifies how the yaw input gets mapped to differential thrust in forwards flight.
VT_FW_MIN_ALT = Simulink.Parameter(0, DataType="single", Min=0, Max=200)  % Minimum altitude for fixed wing flight, when in fixed wing the altitude drops below this altitude the vehicle will transition back to MC mode and enter failsafe RTL
VT_FW_MOT_OFFID = Simulink.Parameter(0, DataType="int32", Min=0, Max=12345678)
VT_FW_PERM_STAB = Simulink.Parameter(0, DataType="int32")  % If set to one this parameter will cause permanent attitude stabilization in fw mode. This parameter has been introduced for pure convenience sake.
VT_FW_QC_P = Simulink.Parameter(0, DataType="int32", Min=0, Max=180)  % Maximum pitch angle before QuadChute engages Above this the vehicle will transition back to MC mode and enter failsafe RTL
VT_FW_QC_R = Simulink.Parameter(0, DataType="int32", Min=0, Max=180)  % Maximum roll angle before QuadChute engages Above this the vehicle will transition back to MC mode and enter failsafe RTL
VT_F_TRANS_DUR = Simulink.Parameter(5, DataType="single", Min=0, Max=20, Unit="s")  % Time in seconds used for a transition
VT_F_TRANS_THR = Simulink.Parameter(1, DataType="single", Min=0, Max=1)  % standard vtol: pusher tailsitter, tiltrotor: main throttle
VT_F_TR_OL_TM = Simulink.Parameter(6, DataType="single", Min=1, Max=30, Unit="s")  % The duration of the front transition when there is no airspeed feedback available.
VT_IDLE_PWM_MC = Simulink.Parameter(900, DataType="int32", Min=900, Max=2000, Unit="us")
VT_MC_ON_FMU = Simulink.Parameter(0, DataType="int32")  % Set this parameter to true if the vehicle's hover motors are connected to the FMU (AUX) port. Not required for boards that only have a FMU, and no IO. Only applies for standard VTOL and tiltrotor.
VT_MOT_ID = Simulink.Parameter(0, DataType="int32", Min=0, Max=12345678)
VT_PSHER_RMP_DT = Simulink.Parameter(3, DataType="single", Max=20)  % Defines the time window during which the pusher throttle will be ramped up linearly to VT_F_TRANS_THR during a transition to fixed wing mode. Zero or negative values will produce an instant throttle rise to VT_F_TRANS_THR.
VT_TILT_FW = Simulink.Parameter(1, DataType="single", Min=0, Max=1)
VT_TILT_MC = Simulink.Parameter(0, DataType="single", Min=0, Max=1)
VT_TILT_SPINUP = Simulink.Parameter(0, DataType="single", Min=0, Max=1)  % This specific tilt during spin-up is necessary for some systems whose motors otherwise don't spin-up freely.
VT_TILT_TRANS = Simulink.Parameter(0.3, DataType="single", Min=0, Max=1)
VT_TRANS_MIN_TM = Simulink.Parameter(2, DataType="single", Min=0, Max=20, Unit="s")  % Minimum time in seconds for front transition.
VT_TRANS_P2_DUR = Simulink.Parameter(0.5, DataType="single", Min=0.1, Max=5, Unit="s")  % Time in seconds it should take for the rotors to rotate forward completely from the point when the plane has picked up enough airspeed and is ready to go into fixed wind mode.
VT_TRANS_TIMEOUT = Simulink.Parameter(15, DataType="single", Min=0, Max=30, Unit="s")  % Time in seconds after which transition will be cancelled. Disabled if set to 0.
VT_TYPE = Simulink.Parameter(0, DataType="int32", Min=0, Max=2)
WV_GAIN = Simulink.Parameter(1, DataType="single", Min=0, Max=3, Unit="Hz")  % The desired gain to convert roll sp into yaw rate sp.
MPC_LAND_RC_HELP = Simulink.Parameter(0, DataType="int32", Min=0, Max=1)  % When enabled, descent speed will be: stick full up - 0 stick centered - MPC_LAND_SPEED stick full down - 2 * MPC_LAND_SPEED
UUV_SKIP_CTRL = Simulink.Parameter(0, DataType="int32")
MIN_TAKEOFF_THRUST = 0.2
ALTHOLD_EPV_RESET_THRESH = Simulink.Parameter(5)
BAT_LOW_THR = Simulink.Parameter(0.15, DataType="single", Min=0.12, Max=0.5, Unit="unit")  % Sets the threshold when the battery will be reported as low. This has to be higher than the critical threshold.